# Grasshopper definition ghxToArchicad.gh (Grasshopper 1.0.7)
# plug-ins: Tapir, Grasshopper-Archicad Live Connection built for Rhinoceros 7, ShapeDiverForGrasshopper, Pufferfish, Kangaroo Components

sddp = ShapeDiverDocumentPayload({AbsoluteTolerance=0, AngleTolerance=0, DistanceDisplayPrecision=0, GltfVersion="Gltf2", GrasshopperVersion="1.0.0007", InputGroups="{}", OutputGroups="{}", RelativeTolerance=0, RhinoVersion="7.37.24107.15001", UnitSystem=0, VersionCreated="1.22.0.0", VersionSaved="1.22.0.0"})
list = ValueList({"select single item (Wall panel)": 0, "select multiple items (Wall panel)": 1}, selected="select multiple items (Wall panel)")

# ---- group: Json file
path = FilePath("C:\Users\panz\Documents\GitHub\2025-AEC-Hackathon\json\GenericDesign_12005\12005.json")
panel = Panel(path)

# ----
select_item = Slider(41, range=0..46)

python = GhPythonScript(file=path)  # -> out, apartmentNames, roomTypes, roomPolylines, roomSurfaces, roomColors
# ---------- python: Python ----------
__author__ = "panz"
__version__ = "2024.11.11"

import rhinoscriptsyntax as rs
import json
import json
import Rhino.Geometry as rg

# Read and parse JSON data from the file
with open(file, 'r') as inputfile:
    data = json.load(inputfile)

# Extract panels (walls) data
panels_data = data.get("panels", {}).get("items", {})
if not panels_data:
    print("Warning: 'panels.items' key is missing or empty in JSON.")
    
# Extract apartment outlines from 'spaces'
spaces_data = data.get("spaces", {})
roomOutlines = []
roomPolylines =[]
apartmentNames = []
roomTypes = []
roomColors = []
roomSurfaces = []

for space_id, space in spaces_data.items():
    coordinates = space.get("coordinates")
    roomTypes.append(space.get("room_type"))
    apartmentNames.append(space.get("apartment"))
    outline_points = [[point["x"], point["y"], point["z"]] for point in coordinates]
    roomOutlines.append(outline_points)
print (len(roomOutlines))


roomCounter = 0 
for index in range (0, len(spaces_data)):
    roomOutline = roomOutlines[index] 
    
    # Convert the point lists into Rhino Point3d objects
    polyline_points = [rg.Point3d(point[0], point[1], point[2]) for point in roomOutline]
    # Create the polyline using the list of Point3d objects
    polyline = rg.Polyline(polyline_points)
    
    
    #assign colors based on roomput
    if (roomTypes[index] == "living_room"):
        roomColors.append('255,100,0')
    elif (roomTypes[index] == "bedroom"):
        roomColors.append('153,137,255')
    elif (roomTypes[index] == "kitchen"):
        roomColors.append('0,0,220')
    elif (roomTypes[index] == "bathroom"):
        roomColors.append('151,255,255')
    elif (roomTypes[index] == "core"):
        roomColors.append('150,150,150')
        
    # create a surface
    roomSrfs = rg.Brep.CreatePlanarBreps(polyline.ToNurbsCurve())
    roomSurfaces.append(roomSrfs[0])
    # Ensure the polyline is closed if necessary (optional)
    if not polyline.IsClosed:
        polyline.Add(polyline[0])  # Add the first point to close the polyline
    # Output the polyline (e.g., to Grasshopper)
    roomPolylines.append(polyline)
    roomCounter +=1 
    print ("created", roomCounter, "space polylines")
    print(roomSurfaces)
# ---------- end python ----------
crv = Curve(python.roomPolylines)
brep = Brep(python.roomSurfaces)
bounding_rectangle = BoundingRectangle(Geometry=crv, Plane=PlaneXY(0, 0, 0), Axis=0, Slide=0, Union=True)  # -> Bounding, DimensionX, DimensionY
area = Area(Geometry=bounding_rectangle.Bounding)  # -> Area, Centroid
scale = Scale(Geometry=brep, Center=area.Centroid, Factor="1000")  # -> Geometry, Transform
scale_2 = Scale(Geometry=crv, Center=area.Centroid, Factor="1000")  # -> Geometry, Transform

# ----
# GET WALL PROPERTIES
series = Series(Start=0, Step=1, Count=select_item)
filter = StreamFilter(Gate=list, Stream0=select_item, Stream1=series)
python_2 = GhPythonScript(file=path, panelIndex=filter)  # -> out, PanelType, StartPoint, EndPoint, Height, Thickness, RoomType, ApartmentName; inputs panelIndex: Int32
# ---------- python_2: Python ----------
__author__ = "panz"
__version__ = "2024.11.11"

import rhinoscriptsyntax as rs
import json
import json
import Rhino.Geometry as rg

# Read and parse JSON data from the file
with open(file, 'r') as inputfile:
    data = json.load(inputfile)

# Extract panel information
panels = data["panels"]["items"]
if not panels:
    print("Warning: 'panels.items' key is missing or empty in JSON.")
    
# Extract apartment outlines from 'spaces'
spaces_data = data.get("spaces", {})


# Initialize lists to store panel data
panel_types = []
start_points = []
end_points = []
heights = []
thicknesses = []
roomTypes = []
apartmentNames = []



# Loop through each panel and extract relevant information
for key, panel in panels.items():
    panel_types.append(panel.get("panel_type"))
    start_points.append(panel.get("start_point"))
    end_points.append(panel.get("end_point"))
    heights.append(panel.get("height"))
    thicknesses.append(panel.get("thickness"))
    roomTypes.append(panel.get("room"))
    apartmentNames.append(panel.get("apartment", "N/A"))          # Default: "N/A"


# Assume 'index' is passed as an argument (in a Grasshopper environment, for example)

PanelType = panel_types[panelIndex]
StartPoint = start_points[panelIndex]
EndPoint = end_points[panelIndex]
Height = heights[panelIndex]
Thickness = thicknesses[panelIndex]
RoomType = roomTypes[panelIndex]
ApartmentName = apartmentNames[panelIndex]



print("Panel Type:", PanelType)
print("Start Point:", StartPoint)
print("End Point:", EndPoint)
print("Height:", Height)
print("Thickness:", Thickness)
print("Room Type:", RoomType)
print("Apartment:", ApartmentName)
# ---------- end python_2 ----------

element_label_height = Slider(3, range=0..30)
show_info = BooleanToggle(True)
element_label_size = Slider(0.183, range=0..50)
element_label_color = ColourSwatch(SwatchColor=RGB(3, 3, 3))
addition = Addition(A=element_label_height, B=3)
dom = ConstructDomain(DomainStart=element_label_height, DomainEnd=addition)

item = ListItem(List=python_2.StartPoint, Index=0, Wrap=True)  # -> Item, Item1, Item2
item_2 = ListItem(List=python_2.EndPoint, Index=0, Wrap=True)  # -> Item, Item1, Item2
pt = ConstructPoint(XCoordinate=item_2.Item, YCoordinate=item_2.Item1, ZCoordinate=item_2.Item2)
pt_2 = ConstructPoint(XCoordinate=item.Item, YCoordinate=item.Item1, ZCoordinate=item.Item2)
ln = Line(StartPoint=pt_2, EndPoint=pt)

eval = EvaluateCurve(Curve=reparameterize(ln), Parameter="0.5")  # -> Point, Tangent, Angle
lng = ListLength(List=eval.Point)
random = Random(Range=dom, Number=lng, Seed=2)
Z = UnitZ(Factor=random)
concat = Concatenate(FragmentB=python_2.RoomType, FragmentE=python_2.PanelType)
move = Move(Geometry=eval.Point, Motion=Z)  # -> Geometry, Transform
ln_2 = Line(StartPoint=eval.Point, EndPoint=move.Geometry)
panel_2 = Panel(concat)
gate = StreamGate(Stream=move.Geometry, Gate=show_info)  # -> Target0, Target1
gate_2 = StreamGate(Stream=ln_2, Gate=show_info)  # -> Target0, Target1
preview = CustomPreview(Geometry=gate_2.Target1, Material=element_label_color)
tag = TextTag3D(Location=gate.Target1, Text=graft(panel_2), Size=element_label_size, Colour=element_label_color, Justification=8)

scale_3 = Scale(Geometry=ln, Center=area.Centroid, Factor="1000")  # -> Geometry, Transform
connect_archicad = ConnectArchicad(Port=19723, AllowAutomaticRefresh=True)
zone = Zone(Synchronize=True)

# ----
# Look into how we can create custom composite walls
composite = Composite()
panel_3 = Panel(python_2.PanelType)

# ---- group: slab
curve = Curve(scale_2.Geometry)
slabsetc = SlabSettingsComposite(AC_ActiveState_Name="Composite")
region_union = RegionUnion(Curves=curve)
slab = Slab(Synchronize=True, Polygon=region_union, SlabSettings=slabsetc)

# ----
i_want_to_convert_to = ValueList({"1 - Microns (1.0e-6 meters)": 1, "2 - Millimeters (1.0e-3 meters)": 2, "3 - Centimeters (1.0e-2 meters)": 3, "4 - Meters": 4, "5 - Kilometers (1.0e+3 meters)": 5, "6 - Microinches (2.54e-8 meters, 1.0e-6 inches)": 6, "7 - Mils (2.54e-5 meters, 0.001 inches)": 7, "8 - Inches (0.0254 meters)": 8, "9 - Feet (0.3408 meters, 12 inches)": 9, "10 - Miles (1609.344 meters, 5280 feet)": 10}, selected="2 - Millimeters (1.0e-3 meters)")
my_model_is_in = ValueList({"1 - Microns (1.0e-6 meters)": 1, "2 - Millimeters (1.0e-3 meters)": 2, "3 - Centimeters (1.0e-2 meters)": 3, "4 - Meters": 4, "5 - Kilometers (1.0e+3 meters)": 5, "6 - Microinches (2.54e-8 meters, 1.0e-6 inches)": 6, "7 - Mils (2.54e-5 meters, 0.001 inches)": 7, "8 - Inches (0.0254 meters)": 8, "9 - Feet (0.3408 meters, 12 inches)": 9, "10 - Miles (1609.344 meters, 5280 feet)": 10}, selected="4 - Meters")
what_are_the_untis = ValueList({"Distance": 1, "Area": 2, "Volume": 3}, selected="Distance")
units_of_the_model_i_want_to_convert = Panel("1")
integer = Integer(units_of_the_model_i_want_to_convert)
sysunits = GhPythonScript(N=integer, unitsFrom=my_model_is_in, unitsTo=i_want_to_convert_to, mag=what_are_the_untis)  # -> message, R
# ---------- sysunits: Python ----------
__author__ = "michael.lee"
__version__ = "2019.05.29"

import rhinoscriptsyntax as rs
intModelUnits = rs.UnitSystem()

if (intModelUnits == 0):
    message = "No unit system is assigned"
elif (intModelUnits == 1 ):
    message = "Your model is in Microns (1.0e-6 meters)"
elif (intModelUnits == 2 ):
    message = "Your model is in Millimeters (1.0e-3 meters)"
elif (intModelUnits == 3 ):
    message ="Your model is in Centimeters (1.0e-2 meters)"
elif (intModelUnits == 4 ):
    message = "Your model is in Meters"
elif (intModelUnits == 5 ):
    message = "Your model is in Kilometers (1.0e+3 meters)"
elif (intModelUnits == 6 ):
    message = "Your model is in Microinches (2.54e-8 meters, 1.0e-6 inches)"
elif (intModelUnits == 7 ):
    message = "Yourmodel is in Mils (2.54e-5 meters, 0.001 inches)"
elif (intModelUnits == 8 ):
    message = "Your model is in Inches (0.0254 meters)"
elif (intModelUnits == 9 ):
    message = "Your model is in Feet (0.3408 meters, 12 inches)"
elif (intModelUnits == 10 ):
    message = "Your model is in Miles (1609.344 meters, 5280 feet)"
else:
    message = "please check your inputs"



if (intModelUnits != unitsFrom ):
    message = "Caution! your model units are different from what you indicate, if this is in purpose you are good"
else:
    message = message + ". Converting units!"
    print(message)
    
if (N):
    R = N*pow(rs.UnitScale(unitsTo,unitsFrom),mag)

else:
    R = None
# ---------- end sysunits ----------
units_of_the_model_i_want_to_convert_2 = Panel(sysunits.message)

integer_2 = Integer(python_2.Height)
sysunits_2 = GhPythonScript(N=integer_2, unitsFrom=my_model_is_in, unitsTo=i_want_to_convert_to, mag=what_are_the_untis)  # -> message, R; same code as sysunits
integer_3 = Integer(sysunits_2.R)
units_of_the_model_i_want_to_convert_3 = Panel(integer_3)

integer_4 = Integer(python_2.Thickness)
sysunits_3 = GhPythonScript(N=integer_4, unitsFrom=my_model_is_in, unitsTo=i_want_to_convert_to, mag=what_are_the_untis)  # -> message, R; same code as sysunits
integer_5 = Integer(sysunits_3.R)

integer_6 = Integer(sysunits.R)

units_of_the_model_i_want_to_convert_4 = Panel(integer_6)

# ---- group: slab
removeduplicatelines = RemoveDuplicateLines(Lines=flatten(scale_3.Geometry), Tolerance=0.01)
wallsetc = WallSettingsComposite(
    Composite=composite,
    Height=units_of_the_model_i_want_to_convert_3,
    Composite_2=composite,
    Height_2=units_of_the_model_i_want_to_convert_3,
    AC_ActiveState_Name="SC_CompositeSlantedCRL")
wall = Wall(Synchronize=True, Curve=flatten(removeduplicatelines), WallSettings=wallsetc)

# ---- group: columns
number_slider = Slider(293, range=0..580)
explode = Explode(Curve=region_union, Recursive=True)  # -> Segments, Vertices
panel_4 = Panel(integer_3)
unit_z = UnitZ(Factor=1)
columnsetr = ColumnSettingsRectangular(
    Depth=number_slider,
    Width=number_slider,
    Depth_2=number_slider,
    Width_2=number_slider,
    AC_ActiveState_Name="Rectangular")
move_2 = Move(Geometry=explode.Vertices, Motion=unit_z)  # -> Geometry, Transform
column = Column(Synchronize=True, AnchorPoint=explode.Vertices, EndPoint=move_2.Geometry, ColumnSettings=columnsetr)

# ----
i_want_to_convert_to_2 = ValueList({"1 - Microns (1.0e-6 meters)": 1, "2 - Millimeters (1.0e-3 meters)": 2, "3 - Centimeters (1.0e-2 meters)": 3, "4 - Meters": 4, "5 - Kilometers (1.0e+3 meters)": 5, "6 - Microinches (2.54e-8 meters, 1.0e-6 inches)": 6, "7 - Mils (2.54e-5 meters, 0.001 inches)": 7, "8 - Inches (0.0254 meters)": 8, "9 - Feet (0.3408 meters, 12 inches)": 9, "10 - Miles (1609.344 meters, 5280 feet)": 10}, selected="4 - Meters")
my_model_is_in_2 = ValueList({"1 - Microns (1.0e-6 meters)": 1, "2 - Millimeters (1.0e-3 meters)": 2, "3 - Centimeters (1.0e-2 meters)": 3, "4 - Meters": 4, "5 - Kilometers (1.0e+3 meters)": 5, "6 - Microinches (2.54e-8 meters, 1.0e-6 inches)": 6, "7 - Mils (2.54e-5 meters, 0.001 inches)": 7, "8 - Inches (0.0254 meters)": 8, "9 - Feet (0.3408 meters, 12 inches)": 9, "10 - Miles (1609.344 meters, 5280 feet)": 10}, selected="2 - Millimeters (1.0e-3 meters)")
what_are_the_untis_2 = ValueList({"Distance": 1, "Area": 2, "Volume": 3}, selected="Area")

# ---- group: tags
area_2 = Area(Geometry=scale_2.Geometry)  # -> Area, Centroid
show_room_labels = BooleanToggle(True)
room_label_height = Slider(9, range=0..30)
room_labler_color = ColourSwatch(SwatchColor=RGB(0, 255, 0))
room_label_size = Slider(230, range=0..230)
Z_2 = UnitZ(Factor=room_label_height)
move_3 = Move(Geometry=area_2.Centroid, Motion=Z_2)  # -> Geometry, Transform
ln_3 = Line(StartPoint=area_2.Centroid, EndPoint=move_3.Geometry)
gate_3 = StreamGate(Stream=move_3.Geometry, Gate=show_room_labels)  # -> Target0, Target1
gate_4 = StreamGate(Stream=ln_3, Gate=show_room_labels)  # -> Target0, Target1
preview_2 = CustomPreview(Geometry=brep, Material=python.roomColors)
preview_3 = CustomPreview(Geometry=gate_4.Target1, Material=room_labler_color)

# ----
units_of_the_model_i_want_to_convert_5 = Panel(area_2.Area)
integer_7 = Integer(area_2.Area)
sysunits_4 = GhPythonScript(N=area_2.Area, unitsFrom=my_model_is_in_2, unitsTo=i_want_to_convert_to_2, mag=what_are_the_untis_2)  # -> message, R; same code as sysunits
units_of_the_model_i_want_to_convert_6 = Panel(sysunits_4.message)
units_of_the_model_i_want_to_convert_7 = Panel(sysunits_4.R)

integer_8 = Integer(sysunits_4.R)

# ---- group: tags (continued)
concat_2 = Concatenate(FragmentE=python.apartmentNames, FragmentA=python.roomTypes, FragmentC=":", FragmentB=sysunits_4.R, FragmentD=" m2")
tag_2 = TextTag3D(Location=gate_3.Target1, Text=flatten(concat_2), Size=room_label_size, Colour=room_labler_color, Justification=5)
