# Grasshopper definition ReadJsonAndCreateGeometry_4python.gh (Grasshopper 1.0.8)
# plug-ins: RhinoCodePluginGH, Speckle 2, Pufferfish, Human

candidate_design = ValueList({"candidate 11001": 0, "candidate 12001": 1, "candidate 12005": 2, "candidate 12009": 3, "candidate 14007": 4, "candidate 14012": 5, "candidate 18003": 6, "candidate 21004": 7}, selected="candidate 14012")
path = FilePath("C:\Users\panz\Documents\GitHub\2025-AEC-Hackathon\json\GenericDesign_12001\12001.json")
path_2 = FilePath("C:\Users\panz\Documents\GitHub\2025-AEC-Hackathon\json\GenericDesign_11001\11001.json")
path_3 = FilePath("C:\Users\panz\Documents\GitHub\2025-AEC-Hackathon\json\GenericDesign_12005\12005.json")
path_4 = FilePath("C:\Users\panz\Documents\GitHub\2025-AEC-Hackathon\json\GenericDesign_14012\14012.json")
path_5 = FilePath("C:\Users\panz\Documents\GitHub\2025-AEC-Hackathon\json\GenericDesign_12009\12009.json")
path_6 = FilePath("C:\Users\panz\Documents\GitHub\2025-AEC-Hackathon\json\GenericDesign_14007\14007.json")
path_7 = FilePath("C:\Users\panz\Documents\GitHub\2025-AEC-Hackathon\json\GenericDesign_18003\18003.json")
path_8 = FilePath("C:\Users\panz\Documents\GitHub\2025-AEC-Hackathon\json\GenericDesign_21004\21004.json")
filter = StreamFilter(
    Gate=candidate_design,
    Stream0=path_2,
    Stream1=path,
    Stream2=path_3,
    Stream3=path_5,
    Stream4=path_6,
    Stream5=path_4,
    Stream6=path_7,
    Stream7=path_8)
python = GhPythonScript(file=filter)  # -> out, apartmentNames, roomTypes, roomPolylines, roomSurfaces, roomColors, adjacencies
# ---------- python: Python ----------
__author__ = "panz"
__version__ = "2024.11.11"

import rhinoscriptsyntax as rs
import json
import json
import Rhino.Geometry as rg

# Read and parse JSON data from the file
with open(file, 'r') as inputfile:
    data = json.load(inputfile)

# Extract panels (walls) data
panels_data = data.get("panels", {}).get("items", {})
if not panels_data:
    print("Warning: 'panels.items' key is missing or empty in JSON.")
    
    


# Extract apartment outlines from 'spaces'
spaces_data = data.get("spaces", {})
roomOutlines = []
roomPolylines =[]
apartmentNames = []
roomTypes = []
roomColors = []
roomSurfaces = []

for space_id, space in spaces_data.items():
    coordinates = space.get("coordinates")
    roomTypes.append(space.get("room_type"))
    apartmentNames.append(space.get("apartment"))
    outline_points = [[point["x"], point["y"], point["z"]] for point in coordinates]
    roomOutlines.append(outline_points)
print (len(roomOutlines))


roomType = "bathroom"

#get adjacencies
adjacencies =[]
#adjacency_data =data.get("room_adjacency").get(roomType)
adjacency_data =data.get("room_adjacency")
adjacencies = adjacency_data
print (adjacency_data) 



roomCounter = 0 
for index in range (0, len(spaces_data)):
    roomOutline = roomOutlines[index] 
    
    # Convert the point lists into Rhino Point3d objects
    polyline_points = [rg.Point3d(point[0], point[1], point[2]) for point in roomOutline]
    # Create the polyline using the list of Point3d objects
    polyline = rg.Polyline(polyline_points)
    
    
    #assign colors based on roomput
    if (roomTypes[index] == "living_room"):
        roomColors.append('255,100,0')
    elif (roomTypes[index] == "bedroom"):
        roomColors.append('153,137,255')
    elif (roomTypes[index] == "kitchen"):
        roomColors.append('0,0,220')
    elif (roomTypes[index] == "bathroom"):
        roomColors.append('151,255,255')
    elif (roomTypes[index] == "core"):
        roomColors.append('150,150,150')
        
    # create a surface
    roomSrfs = rg.Brep.CreatePlanarBreps(polyline.ToNurbsCurve())
    roomSurfaces.append(roomSrfs[0])
    # Ensure the polyline is closed if necessary (optional)
    if not polyline.IsClosed:
        polyline.Add(polyline[0])  # Add the first point to close the polyline
    # Output the polyline (e.g., to Grasshopper)
    roomPolylines.append(polyline)
    roomCounter +=1 
    #print ("created", roomCounter, "space polylines")
    #print(roomSurfaces)
# ---------- end python ----------
panel = Panel(python.roomTypes)
area = Area(Geometry=python.roomSurfaces)  # -> Area, Centroid
crv = Curve(python.roomPolylines)
tag = TextTag(Location=area.Centroid, Text=panel)

reference_design = ValueList({"reference design 01": 0, "reference design 02": 1, "reference design 03": 2}, selected="reference design 01")
path_9 = FilePath("C:\Users\panz\Documents\GitHub\2025-AEC-Hackathon\json\ReferenceDesign_01\Reference01.json")
path_10 = FilePath("C:\Users\panz\Documents\GitHub\IBC\05_Flooplan_processing\jsonExports\ReferenceDesign_02\ReferenceDesign_02_EP_bom.json")
filter_2 = StreamFilter(Gate=reference_design, Stream0=path_9, Stream1=path_10)
python_2 = GhPythonScript(file=filter_2)  # -> out, apartmentNames, roomTypes, roomPolylines, roomSurfaces, roomColors, adjacencies; same code as python
panel_2 = Panel(python_2.roomTypes)
area_2 = Area(Geometry=python_2.roomSurfaces)  # -> Area, Centroid
crv_2 = Curve(python_2.roomPolylines)
tag_2 = TextTag(Location=area_2.Centroid, Text=panel_2)

select_input = ValueList({"candidate designs": 0, "reference designs": 1}, selected="candidate designs")
panel_3 = Panel("""candidate design 11001
candidate design 12001
candidate design 12005
candidate design 12009
candidate design 14007
candidate design 14012
candidate design 18003
candidate design 21004""")
panel_4 = Panel("""reference design 01
reference design 02
reference design 03""")
list_item = ListItem(List=panel_3, Index=candidate_design, Wrap=True)
list_item_2 = ListItem(List=panel_4, Index=reference_design, Wrap=True)
filter_3 = StreamFilter(Gate=select_input, Stream0=filter, Stream1=filter_2)
filter_4 = StreamFilter(Gate=select_input, Stream0=list_item, Stream1=filter_2)
panel_5 = Panel(filter_4)

# ---- group: hackathon_test FILE
list = ValueList({"select single item (Wall panel)": 0, "select multiple items (Wall panel)": 1}, selected="select multiple items (Wall panel)")
path_11 = FilePath(filter_3)
# TO DO fix the panel index
select_item = Slider(35, range=0..76)
panel_6 = Panel(path_11)
series = Series(Start=0, Step=1, Count=select_item)
filter_5 = StreamFilter(Gate=list, Stream0=select_item, Stream1=series)

# ---- group: hackathon_test FILE -reference
path_12 = FilePath("C:\Users\panz\Documents\GitHub\IBC\05_Flooplan_processing\jsonExports\ReferenceDesign_01\Reference01.json")

# ---- group: 3d module
path_13 = FilePath("C:\Users\panz\Documents\GitHub\IBC\05_Flooplan_processing\jsonExports\3dmodules_json\3d_module_BigAptA.json")

# ----
# GET  spaces, and bounding rectangles
python_3_script = Python3Script(file=path_11)  # -> out, apartmentNames, roomTypes, roomPolylines, roomSurfaces, roomColors, possibleBoundingRect
# ---------- python_3_script: Python ----------
"""Grasshopper Script"""
a = "Hello Python 3 in Grasshopper!"
__author__ = "panz"
__version__ = "2024.11.11"

import rhinoscriptsyntax as rs
import json
import Rhino.Geometry as rg

# Read and parse JSON data from the file
with open(file, 'r') as inputfile:
    data = json.load(inputfile)

# Extract panels (walls) data
panels_data = data.get("panels", {}).get("items", {})
if not panels_data:
    print("Warning: 'panels.items' key is missing or empty in JSON.")
    
# Extract apartment outlines from 'spaces'
spaces_data = data.get("spaces", {})
roomOutlines = []
roomPolylines = []
apartmentNames = []
roomTypes = []
roomColors = []
roomSurfaces = []
possibleBoundingRect = []

for space_id, space in spaces_data.items():
    coordinates = space.get("coordinates")
    roomTypes.append(space.get("room_type"))
    apartmentNames.append(space.get("apartment"))
    outline_points = [[point["x"], point["y"], point["z"]] for point in coordinates]
    roomOutlines.append(outline_points)

print("There are", len(roomOutlines), "rooms in the JSON file")

roomCounter = 0 
#TO DO CALCULATE AREA OF APARMENT AND EXCLUDE CRVS THAT ARE LARGER THAN THAT
for index in range(len(spaces_data)):
    roomOutline = roomOutlines[index] 
    polyline_points = [rg.Point3d(point[0], point[1], point[2]) for point in roomOutline]
    polyline = rg.Polyline(polyline_points)

    # Assign colors and store rooms for bounding box calculation
    #TO DO FIX COLORING
    roomType = roomTypes[index]
    if roomType == "living_room":
        roomColors.append('255,100,0')
    elif roomType == "bedroom":
        roomColors.append('153,137,255')
    elif roomType in ["kitchen", "corridor", "bathroom"]:  # Selected room types
        print("Processing", roomType)
        roomColors.append({'kitchen': '0,0,220', 'corridor': '0,150,200', 'bathroom': '151,255,255'}[roomType])
        possibleBoundingRect.append(polyline)
    elif roomType == "core":
        roomColors.append('150,150,150')

    # Create a surface from the polyline
    roomSrfs = rg.Brep.CreatePlanarBreps(polyline.ToNurbsCurve())
    roomSurfaces.append(roomSrfs[0])

    # Ensure the polyline is closed
    if not polyline.IsClosed:
        polyline.Add(polyline[0])
        
    roomPolylines.append(polyline)
    roomCounter += 1 

print("Created", roomCounter, "space polylines")

# ==========================
# BOUNDING RECTANGLE LOGIC
# ==========================

def get_bounding_rectangle(polylines):
    """Finds the bounding box for a list of polylines."""
    all_points = []
    
    for polyline in polylines:
        all_points.extend(list(polyline)) 

    if not all_points:
        return None  # Avoid errors if list is empty

    # Find min/max X and Y
    min_x, max_x = min(pt.X for pt in all_points), max(pt.X for pt in all_points)
    min_y, max_y = min(pt.Y for pt in all_points), max(pt.Y for pt in all_points)

    # Define the rectangle corners
    corners = [
        rg.Point3d(min_x, min_y, 0),
        rg.Point3d(max_x, min_y, 0),
        rg.Point3d(max_x, max_y, 0),
        rg.Point3d(min_x, max_y, 0),
        rg.Point3d(min_x, min_y, 0)  # Closing the rectangle
    ]

    return rg.Polyline(corners)

possible_bounding_rects = []

# Compute bounding box for all selected rooms
bounding_rect = get_bounding_rectangle(possibleBoundingRect)
print("Bounding rectangle for all rooms:", bounding_rect)
possible_bounding_rects.append(bounding_rect)


# Compute bounding boxes for pairs of rooms
for i in range(len(possibleBoundingRect)):
    for j in range(i + 1, len(possibleBoundingRect)):
        pair_rect = get_bounding_rectangle([possibleBoundingRect[i], possibleBoundingRect[j]])
        if pair_rect:
            possible_bounding_rects.append(pair_rect)
possibleBoundingRect = possible_bounding_rects
print("Generated", len(possible_bounding_rects), "bounding rectangles for room pairs.")
# ---------- end python_3_script ----------
panel_7 = Panel(python_3_script.apartmentNames)
panel_8 = Panel(python_3_script.roomTypes)

# ----
# GET WALL PROPERTIES
python_3 = GhPythonScript(file=path_11, panelIndex=filter_5)  # -> out, PanelType, StartPoint, EndPoint, Height, Thickness, RoomType, ApartmentName; inputs panelIndex: Int32
# ---------- python_3: Python ----------
__author__ = "panz"
__version__ = "2024.11.11"

import rhinoscriptsyntax as rs
import json
import json
import Rhino.Geometry as rg

# Read and parse JSON data from the file
with open(file, 'r') as inputfile:
    data = json.load(inputfile)

# Extract panel information
panels = data["panels"]["items"]
if not panels:
    print("Warning: 'panels.items' key is missing or empty in JSON.")
    
# Extract apartment outlines from 'spaces'
spaces_data = data.get("spaces", {})


# Initialize lists to store panel data
panel_types = []
start_points = []
end_points = []
heights = []
thicknesses = []
roomTypes = []
apartmentNames = []



# Loop through each panel and extract relevant information
for key, panel in panels.items():
    panel_types.append(panel.get("panel_type"))
    start_points.append(panel.get("start_point"))
    end_points.append(panel.get("end_point"))
    heights.append(panel.get("height"))
    thicknesses.append(panel.get("thickness"))
    roomTypes.append(panel.get("room"))
    apartmentNames.append(panel.get("apartment", "N/A"))          # Default: "N/A"


# Assume 'index' is passed as an argument (in a Grasshopper environment, for example)

PanelType = panel_types[panelIndex]
StartPoint = start_points[panelIndex]
EndPoint = end_points[panelIndex]
Height = heights[panelIndex]
Thickness = thicknesses[panelIndex]
RoomType = roomTypes[panelIndex]
ApartmentName = apartmentNames[panelIndex]



print("Panel Type:", PanelType)
print("Start Point:", StartPoint)
print("End Point:", EndPoint)
print("Height:", Height)
print("Thickness:", Thickness)
print("Room Type:", RoomType)
print("Apartment:", ApartmentName)
# ---------- end python_3 ----------

# ---- group: older version
# TO DO add openings classification
# entrance door
# interior doors
# window
# passage-corridor
python_4 = GhPythonScript(file=path_11)  # -> out, apartmentNames, roomTypes, roomPolylines, roomSurfaces, roomColors, roomCombos
# ---------- python_4: Python ----------
__author__ = "panz"
__version__ = "2024.11.11"

import rhinoscriptsyntax as rs
import json
import json
import Rhino.Geometry as rg

# Read and parse JSON data from the file
with open(file, 'r') as inputfile:
    data = json.load(inputfile)

# Extract panels (walls) data
panels_data = data.get("panels", {}).get("items", {})
if not panels_data:
    print("Warning: 'panels.items' key is missing or empty in JSON.")
    
# Extract apartment outlines from 'spaces'
spaces_data = data.get("spaces", {})
roomOutlines = []
roomPolylines =[]
apartmentNames = []
roomTypes = []
roomColors = []
roomSurfaces = []
roomCombos = []

for space_id, space in spaces_data.items():
    coordinates = space.get("coordinates")
    roomTypes.append(space.get("room_type"))
    apartmentNames.append(space.get("apartment"))
    outline_points = [[point["x"], point["y"], point["z"]] for point in coordinates]
    roomOutlines.append(outline_points)
print ("there are ", len(roomOutlines), "rooms in the json file")

roomCounter = 0 

for index in range (0, len(spaces_data)):
    roomOutline = roomOutlines[index] 
    # Convert the point lists into Rhino Point3d objects
    polyline_points = [rg.Point3d(point[0], point[1], point[2]) for point in roomOutline]
    
    # Create the polyline using the list of Point3d objects
    polyline = rg.Polyline(polyline_points)
    #assign colors based on room type
    print(roomTypes[index])
    if (roomTypes[index] == "living_room"):
        roomColors.append('255,100,0')
    elif (roomTypes[index] == "bedroom"):
        roomColors.append('153,137,255')
    elif (roomTypes[index] == "kitchen"):
        print ("got here")
        roomColors.append('0,0,220')
        roomCombos.append(polyline)
    elif (roomTypes[index] == "corridor"):
        print ("got here")
        roomColors.append('0,150,200')
        roomCombos.append(polyline)
    elif (roomTypes[index] == "bathroom"):
        print ("got here")
        roomColors.append('151,255,255')
        roomCombos.append(polyline)
    elif (roomTypes[index] == "core"):
        roomColors.append('150,150,150')

    # create a surface
    roomSrfs = rg.Brep.CreatePlanarBreps(polyline.ToNurbsCurve())
    roomSurfaces.append(roomSrfs[0])
    # Ensure the polyline is closed if necessary (optional)
    if not polyline.IsClosed:
        polyline.Add(polyline[0])  # Add the first point to close the polyline
        
    # Output the polyline (e.g., to Grasshopper)
    roomPolylines.append(polyline)
    roomCounter +=1 
    

    print ("created", roomCounter, "space polylines")
    print(roomSurfaces)
# ---------- end python_4 ----------

# ----
python_5 = GhPythonScript(file=path_13)  # -> out, apartmentNames, roomTypes, roomPolylines, roomSurfaces, roomColors
# ---------- python_5: Python ----------
__author__ = "panz"
__version__ = "2024.11.11"

import rhinoscriptsyntax as rs
import json
import json
import Rhino.Geometry as rg

# Read and parse JSON data from the file
with open(file, 'r') as inputfile:
    data = json.load(inputfile)

# Extract panels (walls) data
panels_data = data.get("panels", {}).get("items", {})
if not panels_data:
    print("Warning: 'panels.items' key is missing or empty in JSON.")
    
# Extract apartment outlines from 'spaces'
spaces_data = data.get("rooms", {})
roomOutlines = []
roomPolylines =[]
apartmentNames = []
roomTypes = []
roomColors = []
roomSurfaces = []

for space_id, space in spaces_data.items():
    coordinates = space.get("coordinates")
    roomTypes.append(space.get("room_type"))
    apartmentNames.append(space.get("apartment"))
    outline_points = [[point["x"], point["y"], point["z"]] for point in coordinates]
    roomOutlines.append(outline_points)
print (len(roomOutlines))


roomCounter = 0 
for index in range (0, len(spaces_data)):
    roomOutline = roomOutlines[index] 
    
    # Convert the point lists into Rhino Point3d objects
    polyline_points = [rg.Point3d(point[0], point[1], point[2]) for point in roomOutline]
    # Create the polyline using the list of Point3d objects
    polyline = rg.Polyline(polyline_points)
    
    
    #assign colors based on roomput
    if (roomTypes[index] == "living_room"):
        roomColors.append('255,100,0')
    elif (roomTypes[index] == "bedroom"):
        roomColors.append('153,137,255')
    elif (roomTypes[index] == "kitchen"):
        roomColors.append('0,0,220')
    elif (roomTypes[index] == "bathroom"):
        roomColors.append('151,255,255')
    elif (roomTypes[index] == "core"):
        roomColors.append('150,150,150')
        
    # create a surface
    roomSrfs = rg.Brep.CreatePlanarBreps(polyline.ToNurbsCurve())
    roomSurfaces.append(roomSrfs[0])
    # Ensure the polyline is closed if necessary (optional)
    if not polyline.IsClosed:
        polyline.Add(polyline[0])  # Add the first point to close the polyline
    # Output the polyline (e.g., to Grasshopper)
    roomPolylines.append(polyline)
    roomCounter +=1 
    print ("created", roomCounter, "space polylines")
    print(roomSurfaces)
# ---------- end python_5 ----------
crv_3 = Curve(python_5.roomPolylines)
brep = Brep(python_5.roomSurfaces)

# ----
# 3d_module
list_2 = ValueList({"select single item (Wall panel)": 0, "select multiple items (Wall panel)": 1}, selected="select multiple items (Wall panel)")
select_item_2 = Slider(19, range=0..46)
panel_9 = Panel(path_13)
series_2 = Series(Start=0, Step=1, Count=select_item_2)
filter_6 = StreamFilter(Gate=list_2, Stream0=select_item_2, Stream1=series_2)
panel_10 = Panel(python_5.apartmentNames)

# ----
# GET WALL PROPERTIES
python_6 = GhPythonScript(file=path_13, panelIndex=filter_6)  # -> out, PanelType, StartPoint, EndPoint, Height, Thickness, RoomType, ApartmentName; inputs panelIndex: Int32; same code as python_3

item = ListItem(List=python_3.StartPoint, Index=0, Wrap=True)  # -> Item, Item1, Item2
item_2 = ListItem(List=python_3.EndPoint, Index=0, Wrap=True)  # -> Item, Item1, Item2
Z = UnitZ(Factor=python_3.Height)
pt = ConstructPoint(XCoordinate=item_2.Item, YCoordinate=item_2.Item1, ZCoordinate=item_2.Item2)
pt_2 = ConstructPoint(XCoordinate=item.Item, YCoordinate=item.Item1, ZCoordinate=item.Item2)
division = Division(A=python_3.Thickness, B=2)
ln = Line(StartPoint=pt_2, EndPoint=pt)
offcrv = OffsetCurve(Curve=ln, Plane=PlaneXY(0, 0, 0), Distance=graft(division), BothSides=True, Kinks=0, CapType=1)

# ---- group: Remove bounding rectangles
crv_4 = Curve(python_3_script.possibleBoundingRect)
area_threshold = Slider(32, range=0..100)
area_3 = Area(Geometry=crv_4)  # -> Area, Centroid
smaller_than = SmallerThan(FirstNumber=area_3.Area, SecondNumber=area_threshold)  # -> SmallerThan, OrEqualTo
cull_pattern = CullPattern(List=crv_4, CullPattern=smaller_than.SmallerThan)

# ----
panel_11 = Panel(panel_5)
panel_12 = Panel(python_3_script.out)

# ----
# organize curves and surfaces  by apartment
brep_2 = Brep(python_3_script.roomSurfaces)
crv_5 = Curve(python_3_script.roomPolylines)

list_item_3 = ListItem(List=crv_4, Index=Slider(3, range=0..10), Wrap=True)

number_slider = Slider(4, range=0..5)  # disabled
series_3 = Series(Start=0, Step=1, Count=number_slider)  # disabled
item_3 = ListItem(List=crv_3, Index=series_3, Wrap=True)  # disabled
brec = BoundingRectangle(Geometry=item_3, Plane=PlaneXY(0, 0, 0), Axis=0, Slide=0, Union=True)  # -> Bounding, DimensionX, DimensionY; disabled
boundary = BoundarySurfaces(Edges=brec.Bounding)  # disabled
pull = PullCurve(Curve=item_3, Surface=boundary)  # disabled

item_4 = ListItem(List=python_6.StartPoint, Index=0, Wrap=True)  # -> Item, Item1, Item2; disabled
item_5 = ListItem(List=python_6.EndPoint, Index=0, Wrap=True)  # -> Item, Item1, Item2; disabled
Z_2 = UnitZ(Factor=python_6.Height)  # disabled
pt_3 = ConstructPoint(XCoordinate=item_5.Item, YCoordinate=item_5.Item1, ZCoordinate=item_5.Item2)  # disabled
pt_4 = ConstructPoint(XCoordinate=item_4.Item, YCoordinate=item_4.Item1, ZCoordinate=item_4.Item2)  # disabled
ln_2 = Line(StartPoint=pt_4, EndPoint=pt_3)  # disabled
division_2 = Division(A=python_6.Thickness, B=2)  # disabled
offcrv_2 = OffsetCurve(Curve=ln_2, Plane=PlaneXY(0, 0, 0), Distance=graft(division_2), BothSides=True, Kinks=0, CapType=1)  # disabled

no_of_apts = Slider(1, range=0..4)

crv_6 = Curve(crv_4)
length = Length(Curve=crv_6)
bounds = Bounds(Numbers=length)
deconstruct_domain = DeconstructDomain(Domain=bounds)  # -> Start, End
gradient = Gradient(
    LowerLimit=deconstruct_domain.Start,
    UpperLimit=deconstruct_domain.End,
    Parameter=length,
    stops=[0: RGB(0, 255, 0), 1: RGB(220, 0, 40)])
previewlw = CustomPreviewLineweights(Geometry=crv_6, Shader=gradient, Thickness=Slider(2.318, range=0..8), Absolute=False)

number_slider_2 = Slider(1, range=0..10)  # disabled
series_4 = Series(Start=0, Step=1, Count=number_slider_2)  # disabled
item_6 = ListItem(List=crv_3, Index=series_4, Wrap=True)  # disabled
explode = Explode(Curve=item_6, Recursive=True)  # -> Segments, Vertices; disabled
strainghten_poly_lin = StrainghtenPolyLin(vec=explode.Segments, pt=explode.Vertices)  # disabled

series_5 = Series(Start=0, Step=1, Count=no_of_apts)

number_slider_3 = Slider(1, range=0..10)  # disabled
series_6 = Series(Start=0, Step=1, Count=number_slider_3)  # disabled
item_7 = ListItem(List=crv_3, Index=series_6, Wrap=True)  # disabled

# ---- group: tags
show_room_labels = BooleanToggle(True)  # disabled
room_label_height = Slider(9, range=0..30)  # disabled
room_labler_color = ColourSwatch(SwatchColor=RGB(0, 255, 0))  # disabled
room_label_size = Slider(0.265, range=0..50)  # disabled
area_4 = Area(Geometry=crv_3)  # -> Area, Centroid; disabled
Z_3 = UnitZ(Factor=room_label_height)  # disabled
move = Move(Geometry=area_4.Centroid, Motion=Z_3)  # -> Geometry, Transform; disabled
panel_13 = Panel("")  # disabled
panel_14 = Panel(":")  # disabled
panel_15 = Panel(" m2")  # disabled
concat = Concatenate(
    FragmentE=python_5.apartmentNames,
    FragmentF=panel_13,
    FragmentA=python_5.roomTypes,
    FragmentC=panel_14,
    FragmentB=area_4.Area,
    FragmentD=panel_15)  # disabled
ln_3 = Line(StartPoint=area_4.Centroid, EndPoint=move.Geometry)  # disabled
gate = StreamGate(Stream=move.Geometry, Gate=show_room_labels)  # -> Target0, Target1; disabled
gate_2 = StreamGate(Stream=ln_3, Gate=show_room_labels)  # -> Target0, Target1; disabled
tag_3 = TextTag3D(Location=gate.Target1, Text=flatten(concat), Size=room_label_size, Colour=room_labler_color, Justification=5)  # disabled
preview = CustomPreview(Geometry=brep, Material=python_5.roomColors)  # disabled
preview_2 = CustomPreview(Geometry=gate_2.Target1, Material=room_labler_color)  # disabled

# ----
number_slider_4 = Slider(8, range=0..8)  # disabled
swatch = ColourSwatch(SwatchColor=RGB(247, 0, 0))  # disabled
previewlw_2 = CustomPreviewLineweights(Geometry=item_6, Shader=swatch, Thickness=number_slider_4, Absolute=False)  # disabled

swatch_2 = ColourSwatch(SwatchColor=RGB(0, 247, 41))  # disabled
number_slider_5 = Slider(8, range=0..8)  # disabled
previewlw_3 = CustomPreviewLineweights(Geometry=strainghten_poly_lin, Shader=swatch_2, Thickness=number_slider_5, Absolute=False)  # disabled

show_info = BooleanToggle(True)  # disabled
element_label_height = Slider(3, range=0..30)  # disabled
element_label_size = Slider(0.183, range=0..50)  # disabled
element_label_color = ColourSwatch(SwatchColor=RGB(3, 3, 3))  # disabled
addition = Addition(A=element_label_height, B=3)  # disabled
dom = ConstructDomain(DomainStart=element_label_height, DomainEnd=addition)  # disabled

panel_16 = Panel("0.5")  # disabled
eval = EvaluateCurve(Curve=reparameterize(ln_2), Parameter=panel_16)  # -> Point, Tangent, Angle; disabled
panel_17 = Panel("")  # disabled
lng = ListLength(List=eval.Point)  # disabled
random = Random(Range=dom, Number=lng, Seed=2)  # disabled
concat_2 = Concatenate(FragmentC=panel_17, FragmentB=python_6.RoomType, FragmentD=panel_17, FragmentE=python_6.PanelType)  # disabled
Z_4 = UnitZ(Factor=random)  # disabled
move_2 = Move(Geometry=eval.Point, Motion=Z_4)  # -> Geometry, Transform; disabled
panel_18 = Panel(concat_2)  # disabled
ln_4 = Line(StartPoint=eval.Point, EndPoint=move_2.Geometry)  # disabled
gate_3 = StreamGate(Stream=move_2.Geometry, Gate=show_info)  # -> Target0, Target1; disabled
gate_4 = StreamGate(Stream=ln_4, Gate=show_info)  # -> Target0, Target1; disabled
tag_4 = TextTag3D(Location=gate_3.Target1, Text=graft(panel_18), Size=element_label_size, Colour=element_label_color, Justification=8)  # disabled
preview_3 = CustomPreview(Geometry=gate_4.Target1, Material=element_label_color)  # disabled

extr = Extrude(Base=offcrv_2, Direction=graft(Z_2))  # disabled
cap = CapHoles(Brep=extr)  # disabled
brep_3 = Brep(flatten(cap))  # disabled
debrep = DeconstructBrep(Brep=brep_3)  # -> Faces, Edges, Vertices; disabled
area_5 = Area(Geometry=debrep.Faces)  # -> Area, Centroid; disabled
sort = SortList(Keys=area_5.Area, ValuesA=debrep.Faces)  # -> Keys, reverse(ValuesA), ValuesB; disabled
item_8 = ListItem(List=sort.Keys, Index=0, Wrap=True)  # disabled

series_7 = Series(Start=0, Step=1, Count=Slider(4, range=0..5))
item_9 = ListItem(List=crv_5, Index=series_7, Wrap=True)
brec_2 = BoundingRectangle(Geometry=item_9, Plane=PlaneXY(0, 0, 0), Axis=0, Slide=0, Union=True)  # -> Bounding, DimensionX, DimensionY
boundary_2 = BoundarySurfaces(Edges=brec_2.Bounding)
pull_2 = PullCurve(Curve=item_9, Surface=boundary_2)

show_info_2 = BooleanToggle(True)
element_label_height_2 = Slider(3, range=0..30)
element_label_size_2 = Slider(0.183, range=0..50)
element_label_color_2 = ColourSwatch(SwatchColor=RGB(3, 3, 3))
addition_2 = Addition(A=element_label_height_2, B=3)
dom_2 = ConstructDomain(DomainStart=element_label_height_2, DomainEnd=addition_2)

number_slider_6 = Slider(1, range=0..10)  # disabled
series_8 = Series(Start=0, Step=1, Count=number_slider_6)  # disabled
item_10 = ListItem(List=crv_5, Index=series_8, Wrap=True)  # disabled
explode_2 = Explode(Curve=item_10, Recursive=True)  # -> Segments, Vertices; disabled
strainghten_poly_lin_2 = StrainghtenPolyLin(vec=explode_2.Segments, pt=explode_2.Vertices)  # disabled

random_2 = Random(Range=Domain(0, 1), Number=1, Seed=2)

eval_2 = EvaluateCurve(Curve=reparameterize(ln), Parameter="0.5")  # -> Point, Tangent, Angle; disabled
panel_19 = Panel("")  # disabled
lng_2 = ListLength(List=eval_2.Point)  # disabled
random_3 = Random(Range=dom_2, Number=lng_2, Seed=2)  # disabled
concat_3 = Concatenate(FragmentC=panel_19, FragmentB=python_3.RoomType, FragmentD=panel_19, FragmentE=python_3.PanelType)  # disabled
Z_5 = UnitZ(Factor=random_3)  # disabled
panel_20 = Panel(concat_3)  # disabled
move_3 = Move(Geometry=eval_2.Point, Motion=Z_5)  # -> Geometry, Transform; disabled
ln_5 = Line(StartPoint=eval_2.Point, EndPoint=move_3.Geometry)  # disabled
gate_5 = StreamGate(Stream=move_3.Geometry, Gate=show_info_2)  # -> Target0, Target1; disabled
gate_6 = StreamGate(Stream=ln_5, Gate=show_info_2)  # -> Target0, Target1; disabled
tag_5 = TextTag3D(Location=gate_5.Target1, Text=graft(panel_20), Size=element_label_size_2, Colour=element_label_color_2, Justification=8)  # disabled
preview_4 = CustomPreview(Geometry=gate_6.Target1, Material=element_label_color_2)  # disabled

extr_2 = Extrude(Base=offcrv, Direction=graft(Z))  # disabled
cap_2 = CapHoles(Brep=extr_2)  # disabled
brep_4 = Brep(flatten(cap_2))  # disabled
debrep_2 = DeconstructBrep(Brep=brep_4)  # -> Faces, Edges, Vertices; disabled
area_6 = Area(Geometry=debrep_2.Faces)  # -> Area, Centroid; disabled
sort_2 = SortList(Keys=area_6.Area, ValuesA=debrep_2.Faces)  # -> Keys, reverse(ValuesA), ValuesB; disabled
item_11 = ListItem(List=sort_2.Keys, Index=0, Wrap=True)  # disabled

swatch_3 = ColourSwatch(SwatchColor=RGB(0, 247, 41))  # disabled
number_slider_7 = Slider(8, range=0..8)  # disabled
previewlw_4 = CustomPreviewLineweights(Geometry=strainghten_poly_lin_2, Shader=swatch_3, Thickness=number_slider_7, Absolute=False)  # disabled

previewlw_5 = CustomPreviewLineweights(Geometry=item_10, Shader=ColourSwatch(SwatchColor=RGB(247, 0, 0)), Thickness=Slider(8, range=0..8), Absolute=False)

# ---- group: Porject_information
cso = CreateSpeckleObject(Name="IBC-Building", selectedKitName="Objects")
cso_2 = CreateSpeckleObject(Name="Implenia_Default", selectedKitName="Objects")
cso_3 = CreateSpeckleObject(Name="Implenia_Default", selectedKitName="Objects")
eso = ExtendSpeckleObject(
    SpeckleObject=cso,
    Building_ID=cso_3,
    Level_ID=cso_2,
    Building_Use="Implenia_Default",
    Building_phase="tbd",
    selectedKitName="Objects")
panel_21 = Panel("In Progress")

# ----
level = Level(
    Name="Level 0",
    Elevation="0",
    SelectedConstructorName="Objects.BuiltElements.Level.ctor(System.String,System.Double)",
    SelectedTypeName="Objects.BuiltElements.Level",
    UseSchemaTag=False,
    UserSetSchemaTag=False,
    seed="d38af342d870281b8f9e")

crv_7 = Curve(crv_3)
Z_6 = UnitZ(Factor="-0.15")
boundary_3 = BoundarySurfaces(Edges=crv_7)
floor = Floor(
    Outline=crv_7,
    Family="Floor",
    A=boundary_3,
    SelectedConstructorName="Objects.BuiltElements.Floor.ctor(Objects.ICurve,System.Collections.Generic.List`1[Objects.ICurve],System.Collections.Generic.List`1[Speckle.Core.Models.Base])",
    SelectedTypeName="Objects.BuiltElements.Floor",
    UseSchemaTag=False,
    UserSetSchemaTag=False,
    seed="5cc5e3f46eed33223d9a")
extr_3 = Extrude(Base=boundary_3, Direction=Z_6)

# ---- group: wall_parameters
cso_4 = CreateSpeckleObject(Name_EN="Implenia Slab", selectedKitName="Objects")
eso_2 = ExtendSpeckleObject(SpeckleObject=cso_4, Is_External="FALSE", UValue="1.0", selectedKitName="Objects")

# ----
crv_8 = Curve(cull_pattern)
merge = Merge(Data1=crv_8)  # -> flatten(Result)

# ---- group: tags
show_score_labels = BooleanToggle(True)
room_label_size_2 = Slider(0.554, range=0..50)
score__label_color = ColourSwatch(SwatchColor=RGB(46, 46, 46))
room_label_height_2 = Slider(16, range=0..30)
panel_22 = Panel("3")
Z_7 = UnitZ(Factor=room_label_height_2)

# ----
unit_z = UnitZ(Factor=panel_22)

# ---- group: compare different bounding boxes with the bounding rectangle
# compare and give a similarity score
number_slider_8 = Slider(8, range=0..8)

# ----
bounding_rectangle = BoundingRectangle(Geometry=crv_3, Plane=PlaneXY(0, 0, 0), Axis=0, Slide=0, Union=True)  # -> Bounding, DimensionX, DimensionY
unit_z_2 = UnitZ(Factor="3")
area_7 = Area(Geometry=bounding_rectangle.Bounding)  # -> Area, Centroid
extrude = Extrude(Base=bounding_rectangle.Bounding, Direction=unit_z_2)
cap_holes = CapHoles(Brep=extrude)

curve = Curve(bounding_rectangle.Bounding)

# ---- group: compare different bounding boxes with the bounding rectangle (continued)
python_3_script_2 = Python3Script(inputBounding=merge, refBounding=curve)  # -> out, output_rectangles, output_colors, output_scores; inputs inputBounding: list of Polyline, refBounding: Polyline
# ---------- python_3_script_2: Python ----------
import Rhino.Geometry as rg
import rhinoscriptsyntax as rs
import System.Drawing as sd

def get_dimensions(rect):
    """Extracts width, height, area, perimeter, and aspect ratio from a rectangle."""
    if not rect or len(rect) != 5:  # A valid closed rectangle has 5 points (4 for the rectangle + 1 for closure)
        print(f"Invalid rectangle: Rect has fewer or more than 5 points. Rect points: {rect}")  # Debugging message
        return None

    # Calculate the width and height from the polyline
    width = abs(rect[1].X - rect[0].X)
    height = abs(rect[2].Y - rect[1].Y)
    area = width * height
    perimeter = 2 * (width + height)
    aspect_ratio = width / height if height != 0 else 1  # Avoid division by zero
    
    # Debugging: Print the dimensions
    print(f"Rectangle dimensions - Width: {width}, Height: {height}, Area: {area}, Perimeter: {perimeter}, Aspect Ratio: {aspect_ratio}")
    
    return width, height, area, perimeter, aspect_ratio

def compare_rectangles(rect1, rect2, shape_weight=0.4, length_weight=0.3, area_weight=0.3):
    """
    Compares two rectangles based on shape (aspect ratio), perimeter, and area.
    Returns a similarity score between 0 and 1.
    """
    dims1 = get_dimensions(rect1)
    dims2 = get_dimensions(rect2)

    if not dims1 or not dims2:
        print("Invalid dimensions for comparison.")
        return 0  # Invalid rectangles, return lowest score

    width1, height1, area1, perimeter1, aspect_ratio1 = dims1
    width2, height2, area2, perimeter2, aspect_ratio2 = dims2

    # Shape Similarity (Aspect Ratio Comparison)
    shape_score = 1 - abs(aspect_ratio1 - aspect_ratio2) / max(aspect_ratio1, aspect_ratio2)
    print(f"Shape Score: {shape_score}")  # Debugging: Print shape score

    # Length Similarity (Perimeter Comparison)
    length_score = 1 - abs(perimeter1 - perimeter2) / max(perimeter1, perimeter2)
    print(f"Length Score: {length_score}")  # Debugging: Print length score

    # Area Similarity (Area Comparison)
    area_score = 1 - abs(area1 - area2) / max(area1, area2)
    print(f"Area Score: {area_score}")  # Debugging: Print area score

    # Weighted sum of scores
    final_score = (shape_score * shape_weight) + (length_score * length_weight) + (area_score * area_weight)

    # Debugging: Print final score
    print(f"Final Score: {final_score}")
    
    return round(final_score, 3)  # Round for better readability

def assign_color_based_on_score(score):
    """
    Assigns a color based on the similarity score.
    Returns a System.Drawing.Color object.
    """
    if score >= 0.9:
        return sd.Color.Green  # Very similar
    elif score >= 0.7:
        return sd.Color.Yellow  # Moderately similar
    else:
        return sd.Color.Red  # Not similar

def ensure_polyline_input(input_curve):
    """
    Ensures that the input is a valid Polyline object.
    If it's a Curve, it tries to coerce it into a Polyline object.
    """
    print(f"Ensuring input curve: {input_curve}")  # Debugging message
    # Check if it's already a Polyline
    if isinstance(input_curve, rg.Polyline):
        print(f"Input is already a valid Polyline: {input_curve}")  # Debugging message
        if input_curve.IsClosed:
            print("Polyline is closed.")  # Debugging message
        else:
            print("Polyline is not closed.")  # Debugging message
        return input_curve

    # Coerce the curve to a Polyline (if it's a valid curve)
    coerced_curve = rs.coercecurve(input_curve)
    if coerced_curve:
        if isinstance(coerced_curve, rg.Polyline):
            print(f"Coerced curve to Polyline: {coerced_curve}")  # Debugging message
            if coerced_curve.IsClosed:
                print("Coerced polyline is closed.")  # Debugging message
            else:
                print("Coerced polyline is not closed.")  # Debugging message
            return coerced_curve
        else:
            print("The coerced curve is not a Polyline.")  # Debugging message
    else:
        print("Curve coercion failed.")  # Debugging message
    return None

def main(possible_rects, ref_rect):
    # Ensure inputs are valid polylines by coercing curves
    valid_rects = []
    for rect in possible_rects:
        rect_polyline = ensure_polyline_input(rect)
        if rect_polyline:
            valid_rects.append(rect_polyline)
        else:
            print(f"Skipping invalid rectangle: {rect}")  # Debugging message

    # Ensure reference rectangle is a valid polyline
    ref_polyline = ensure_polyline_input(ref_rect)
    if not ref_polyline:
        print("Invalid reference rectangle.")
        return [], []  # Return empty lists if reference rectangle is invalid

    # Compare all valid rectangles with the reference rectangle
    scores = [compare_rectangles(rect, ref_polyline) for rect in valid_rects]

    # Output similarity scores and color code each rectangle based on its similarity score
    colored_rects = []
    for rect, score in zip(valid_rects, scores):
        # Assign color based on score
        color = assign_color_based_on_score(score)
        colored_rects.append((rect, color))  # Store the rectangle and its color

    # Output the rectangles and their corresponding colors

    output_rects = [rect for rect, color in colored_rects]
    output_colors = [color for rect, color in colored_rects]
    
    # Return both output_rects and output_colors for use in Grasshopper
    return scores, output_rects, output_colors

# The outputs in Grasshopper:
# Make sure you assign the outputs to variables like this:
output_scores, output_rectangles, output_colors = main(inputBounding, refBounding)


# Example call to the main function (replace with actual inputs in Grasshopper)
main(inputBounding, refBounding)
# ---------- end python_3_script_2 ----------
similarity_score = Panel(python_3_script_2.output_scores)
previewlw_6 = CustomPreviewLineweights(
    Geometry=python_3_script_2.output_rectangles,
    Shader=python_3_script_2.output_colors,
    Thickness=number_slider_8,
    Absolute=False)

# ---- group: tags (continued)
sort_list = SortList(
    Keys=python_3_script_2.output_scores,
    ValuesValuesA=python_3_script_2.output_rectangles,
    ValuesA=python_3_script_2.output_colors)  # -> reverse(Keys), reverse(ValuesValuesA), reverse(ValuesA)
list_item_4 = ListItem(List=sort_list.ValuesValuesA, Index=series_5, Wrap=True)
list_item_5 = ListItem(List=sort_list.ValuesA, Index=series_5, Wrap=True)
list_item_6 = ListItem(List=sort_list.Keys, Index=series_5, Wrap=True)
curve_2 = Curve(list_item_4)
boundary_surfaces = BoundarySurfaces(Edges=curve_2)
area_8 = Area(Geometry=boundary_surfaces)  # -> Area, Centroid
extrude_2 = Extrude(Base=boundary_surfaces, Direction=unit_z)
move_4 = Move(Geometry=area_8.Centroid, Motion=Z_7)  # -> Geometry, Transform
ln_6 = Line(StartPoint=area_8.Centroid, EndPoint=move_4.Geometry)
concat_4 = Concatenate(FragmentE="3d module fitting score", FragmentC=":", FragmentB=list_item_6)
gate_7 = StreamGate(Stream=move_4.Geometry, Gate=show_score_labels)  # -> Target0, Target1
gate_8 = StreamGate(Stream=ln_6, Gate=show_score_labels)  # -> Target0, Target1
preview_5 = CustomPreview(Geometry=gate_8.Target1, Material=score__label_color)
tag_6 = TextTag3D(Location=gate_7.Target1, Text=flatten(concat_4), Size=room_label_size_2, Colour=score__label_color, Justification=5)

# ----
preview_6 = CustomPreview(Geometry=boundary_surfaces, Material=python_3_script.roomColors)
division_3 = Division(A=bounding_rectangle.DimensionX, B=bounding_rectangle.DimensionY)
panel_23 = Panel(division_3)

bounding_rectangle_2 = BoundingRectangle(Geometry=curve_2, Plane=PlaneXY(0, 0, 0), Axis=0, Slide=0, Union=True)  # -> Bounding, DimensionX, DimensionY

division_4 = Division(A=bounding_rectangle_2.DimensionX, B=bounding_rectangle_2.DimensionY)
panel_24 = Panel(division_4)
python_3_script_3 = Python3Script(ratio=division_4)  # -> out, rotationFlag
# ---------- python_3_script_3: Python ----------
"""Grasshopper Script"""
a = "Hello Python 3 in Grasshopper!"
print(a)
if (ratio < 1 and ratio >0.8):
    rotationFlag = 1
elif (ratio > 1 ):
    rotationFlag = 0
elif (ratio > 0.4 and ratio < 0.8 ):
    rotationFlag = 1
else:
    rotationFlag = 0
# ---------- end python_3_script_3 ----------
subtraction = Subtraction(A=panel_23, B=panel_24)
larger_than = LargerThan(FirstNumber=panel_23, SecondNumber=panel_24)  # -> LargerThan, OrEqualTo
equality_within_tolerance = EqualityWithinTolerance(FirstNumber=subtraction, SecondNumber="0", Tolerance=Slider(0.147, range=0..1))  # -> Equality, Inequality
gate_or = GateOr(A=larger_than.OrEqualTo, B=equality_within_tolerance.Equality)

stream_filter = StreamFilter(Gate=python_3_script_3.rotationFlag, Stream0="90", Stream1="0")
radians = Radians(Degrees=stream_filter)
rotate = Rotate(Geometry=cap_holes, Angle=radians, Plane=area_7.Centroid)  # -> Geometry, Transform
move_to_point = MoveToPoint(Geometry=rotate.Geometry, PointA=area_7.Centroid, PointB=area_8.Centroid)  # -> Moved, Vector, Transform
preview_7 = CustomPreview(Geometry=move_to_point.Moved, Material=ColourSwatch(SwatchColor=RGBA(0, 186, 40, 62)))

# ---- group: tags
show_room_labels_2 = BooleanToggle(True)
room_label_height_3 = Slider(2, range=0..30)
room_labler_color_2 = ColourSwatch(SwatchColor=RGB(87, 87, 87))
room_label_size_3 = Slider(0.265, range=0..50)
area_9 = Area(Geometry=crv_5)  # -> Area, Centroid
Z_8 = UnitZ(Factor=room_label_height_3)
move_5 = Move(Geometry=area_9.Centroid, Motion=Z_8)  # -> Geometry, Transform
ln_7 = Line(StartPoint=area_9.Centroid, EndPoint=move_5.Geometry)
gate_9 = StreamGate(Stream=move_5.Geometry, Gate=show_room_labels_2)  # -> Target0, Target1
gate_10 = StreamGate(Stream=ln_7, Gate=show_room_labels_2)  # -> Target0, Target1
preview_8 = CustomPreview(Geometry=brep_2, Material=python_3_script.roomColors)
preview_9 = CustomPreview(Geometry=gate_10.Target1, Material=room_labler_color_2)

# ----
expression = Expression(x=area_9.Area, Expression="Format(\"{0:0.00}\",x)")

# ---- group: tags (continued)
concat_5 = Concatenate(FragmentA=python_3_script.roomTypes, FragmentC=":", FragmentB=expression, FragmentD=" m2")
tag_7 = TextTag3D(Location=gate_9.Target1, Text=flatten(concat_5), Size=room_label_size_3, Colour=room_labler_color_2, Justification=5)

# ----
# CLICK TO SELECT AND
# SEND ASSEMBLIES TO SPECKLE
panel_27 = Panel(python_6.PanelType)
# You could replicate this type of structure in Speckle like so 👇
# 
# Conceptual building using nested speckle objects to organise, categorise and label the data.
# 
# If you receive this structure from someone else, you just need to expand it until you reach the data you need 👇🏼
# 
# Doing the inverse operation: starting from the "building" and expanding down to the unit values.
panel_28 = Panel(python_6.Height)
list_3 = Accounts(
    {"No account selected": , "Account (panz@zhaw.ch | https://app.speckle.systems)": "https://app.speckle.systems/?id=7b59e40123", "Account (vague@topotheque.com | https://app.speckle.systems)": "https://app.speckle.systems/?id=d442476304"}, selected="Account (panz@zhaw.ch | https://app.speckle.systems)",
    FirstSelectedItem="https://app.speckle.systems/?id=7b59e40123")
panel_29 = Panel("https://app.speckle.systems/projects/b9d01cae98/models/2a663449ba")
message = Panel("testing export walls")
sget = StreamGet(StreamIDURL=panel_29, SpeckleAccount=list_3)

# ---- group: WALL object
rendermaterial = RenderMaterial(
    Opacity=1,
    Metalness=0,
    Roughness=1,
    SelectedConstructorName="Objects.Other.RenderMaterial.ctor(System.Double,System.Double,System.Double,System.Nullable`1[System.Drawing.Color],System.Nullable`1[System.Drawing.Color])",
    SelectedTypeName="Objects.Other.RenderMaterial",
    UseSchemaTag=False,
    UserSetSchemaTag=False,
    seed="6f203a072cfea5a7e1e1")
cso_5 = CreateSpeckleObject(Wall_geometry=brep_3, selectedKitName="Objects")
wall = Wall(
    Height=python_6.Height,
    BaseLine=flatten(ln_2),
    Thickness=python_6.Thickness,
    Level=level,
    NumberCode=panel_27,
    ProjectInformation=eso,
    Surface=flatten(item_8),
    Material=rendermaterial,
    A=cso_5,
    SelectedConstructorName="Objects.BuiltElements.Wall.ctor(System.Double,Objects.ICurve,System.Collections.Generic.List`1[Speckle.Core.Models.Base])",
    SelectedTypeName="Objects.BuiltElements.Wall",
    UseSchemaTag=False,
    UserSetSchemaTag=True,
    seed="a3bcf4127012e3fe4be9")  # -> flatten(SpeckleObject)

# ---- group: REVIT_Wall
sso = RevitWallByCurveAndHeight(
    Family=panel_27,
    Type="Implenia_wall",
    BaseLine=ln_2,
    Level=level,
    Height=python_6.Height,
    BaseOffset=0,
    TopOffset=0,
    Flipped=False,
    Structural=False,
    Thickness=python_6.Thickness,
    SelectedConstructorName="Objects.BuiltElements.Revit.RevitWall.ctor(System.String,System.String,Objects.ICurve,Objects.BuiltElements.Level,System.Double,System.Double,System.Double,System.Boolean,System.Boolean,System.Collections.Generic.List`1[Speckle.Core.Models.Base],System.Collections.Generic.List`1[Objects.BuiltElements.Revit.Parameter])",
    SelectedTypeName="Objects.BuiltElements.Revit.RevitWall",
    UseSchemaTag=False,
    UserSetSchemaTag=False,
    seed="73301769be48de9a2ede")

# ----
eso_3 = ExtendSpeckleObject(
    SpeckleObject=extr_3,
    Type="SLA_21",
    Category="SLAB",
    Outline=crv_7,
    Thickness="-0.15",
    Level=level,
    ProjectInformation=eso,
    ElementInformation=eso_2,
    selectedKitName="Objects")  # -> flatten(ExtendedSpeckleObject)
eso_4 = ExtendSpeckleObject(
    SpeckleObject=brep_3,
    Type=panel_27,
    Category="Walls",
    Baseline=ln_2,
    Thickness=python_6.Thickness,
    Level=level,
    ApartmentName=python_6.RoomType,
    RoomName=python_6.RoomType,
    RoomHeight=panel_28,
    ProjectInformation=eso,
    ElementInformation=eso_2,
    selectedKitName="Objects")  # -> flatten(ExtendedSpeckleObject)
cso_6 = CreateSpeckleObject(Floors=eso_3, Walls=eso_4, selectedKitName="Objects")

send = Send(
    Stream=sget,
    Message=message,
    Data=cso_6,
    AutoSend=False,
    BaseId="251fe3be066f2a7fd52ae77e43311b4d",
    CurrentComponentState="expired",
    KitName="Objects",
    OutputWrappers="https://app.speckle.systems\tb9d01cae98\t0227d45a21",
    UseDefaultCache=True,
    selectedKitName="Objects")

# ==== cluster StrainghtenPolyLin
vec = ClusterInput()
pt = ClusterInput()
vec_2 = Vector(vec)
pt_2 = Point(pt)
pt_3 = Point(pt)
devec = DeconstructVector(Vector=vec_2)  # -> XComponent, YComponent, ZComponent
lng = ListLength(List=pt_2)
round = Round(Number=devec.XComponent)  # -> Nearest, Floor, Ceiling
round_2 = Round(Number=devec.YComponent)  # -> Nearest, Floor, Ceiling
round_3 = Round(Number=devec.ZComponent)  # -> Nearest, Floor, Ceiling
culln = CullNth(List=pt_3, CullFrequency=lng)
vec_3 = VectorXYZ(XComponent=round.Nearest, YComponent=round_2.Nearest, ZComponent=round_3.Nearest)  # -> Vector, Length
number_slider = Slider(66, range=1..100)
line = LineSDL(Start=culln, Direction=vec_3.Vector, Length="1")
ext = ExtendCurve(Curve=line, Type=0, Start=number_slider, End=number_slider)
ccx = CurveCurve(CurveA=ext, CurveB=graft(ext))  # -> Points, ParamsA, ParamsB
cp = ClosestPoint(Point=pt_3, Cloud=flatten(ccx.Points))  # -> ClosestPoint, CPIndex, Distance
pline = PolyLine(Vertices=cp.ClosestPoint, Closed=False)
pl = ClusterOutput(pline)
