# Grasshopper definition ReadJsonAndCreateGeometry_1python.gh (Grasshopper 1.0.7)
# plug-ins: Pufferfish, CORE.Toolbox.Grasshopper, Speckle 2

list = ValueList({"select single item (Wall panel)": 0, "select multiple items (Wall panel)": 1}, selected="select multiple items (Wall panel)")
select_item = Slider(40, range=0..46)
path = FilePath("C:\Users\panz\Documents\GitHub\IBC\05_Flooplan_processing_ve0_1\jsonExports\apartment.json")

# ---- group: KEMPS_JSON_test FILE
path_2 = FilePath("C:\Users\panz\Documents\GitHub\IBC\05_Flooplan_processing\jsonExports\panels_oneApt_EP_update1_withRoomOutlineEDITED.json")

# ----
path_3 = FilePath("C:\Users\panz\Documents\GitHub\IBC\05_Flooplan_processing_ve0_1\jsonExports\apartment.json")
series = Series(Start=0, Step=1, Count=select_item)
panel = Panel(path_2)
filter = StreamFilter(Gate=list, Stream0=select_item, Stream1=series)

label_height = Slider(3, range=0..30)
swatch = ColourSwatch(SwatchColor=RGB(3, 3, 3))
number_slider = Slider(0.165, range=0..50)
show_info = BooleanToggle(True)
addition = Addition(A=label_height, B=3)
dom = ConstructDomain(DomainStart=label_height, DomainEnd=addition)

python = GhPythonScript(file=path_2, index=filter)  # -> out, PanelType, StartPoint, EndPoint, Height, Thickness, Room, Apartment, ApartmentOutline; inputs index: Int32
# ---------- python: Python ----------
__author__ = "panz"
__version__ = "2024.11.11"

import rhinoscriptsyntax as rs
import json
import json



# Read and parse JSON data from the file
with open(file, 'r') as inputfile:
    data = json.load(inputfile)

# Now 'data' contains the JSON data as a Python dictionary
# Prints the entire JSON data
#print(data)  

# Example: Accessing a specific panel
first_panel = data['panels']['items']['0']
#print(first_panel)


# Example: Accessing a specific room
first_room = data['spaces']['1']
#print("data stored in spaces", first_room)
roomCoordinates = first_room['coordinates']
print("vertices of room:", roomCoordinates)

# Example: Accessing start point of a specific panel
start_point = first_panel['start_point']
#print("Start point of first panel:", start_point)

# Example: Accessing panels in living
#roomType = first_panel['room']
#print("panel belongs to:", roomType)


# Extract panel information
panels = data["panels"]["items"]

# Initialize lists to store data for Grasshopper output
panel_types = []
start_points = []
end_points = []
heights = []
thicknesses = []
rooms = []
apartments = []
apartmentOutlines = []
# Loop through each panel and extract relevant information
for key, panel in panels.items():
    panel_types.append(panel.get("panel_type"))
    start_points.append(panel.get("start_point"))
    end_points.append(panel.get("end_point"))
    heights.append(panel.get("height"))
    thicknesses.append(panel.get("thickness"))
    rooms.append(panel.get("room"))
    apartments.append(panel.get("apartment", "N/A"))  # Default to "N/A" if no apartment info


# this needs fixing

for key, panel in panels.items():
    if (panel.get("room") == "living_room"):
        #print(start_point)
        apartmentOutlines.append(panel.get("start_point"))
        apartmentOutlines.append(panel.get("end_point"))
        
        
#print (apartmentOutlines)




# Output to Grasshopper (assign these lists to the component outputs)
PanelType = panel_types[index]
StartPoint = start_points[index]
EndPoint = end_points[index]
Height = heights[index]
Thickness = thicknesses[index]
Room = rooms[index]
Apartment = apartments[index]
ApartmentOutline = apartmentOutlines


print("apartment :", Apartment)
# ---------- end python ----------

item = ListItem(List=python.EndPoint, Index=0, Wrap=True)  # -> Item, Item1, Item2
item_2 = ListItem(List=python.StartPoint, Index=0, Wrap=True)  # -> Item, Item1, Item2
Z = UnitZ(Factor=python.Height)
pt = ConstructPoint(XCoordinate=item.Item, YCoordinate=item.Item1, ZCoordinate=item.Item2)
pt_2 = ConstructPoint(XCoordinate=item_2.Item, YCoordinate=item_2.Item1, ZCoordinate=item_2.Item2)
ln = Line(StartPoint=pt_2, EndPoint=pt)
division = Division(A=python.Thickness, B=2)
offcrv = OffsetCurve(Curve=ln, Plane=PlaneXY(0, 0, 0), Distance=graft(division), BothSides=True, Kinks=0, CapType=1)

# ---- group: spaces
panel_2 = Panel(python.Room)
item_3 = ListItem(List=panel_2, Index=Slider(3, range=0..20), Wrap=True)
tmatch = MatchText(Text=python.Room, Pattern=item_3, Case=True)
cull = CullPattern(List=flatten(pt_2), CullPattern=tmatch)
dup_pts = CleanDuplicatePoints(Points=cull, Tolerance=0.01)  # -> Points, Indices, Status
pt_3 = Point(dup_pts.Points)
pdecon = Deconstruct(Point=pt_3)  # -> XComponent, YComponent, ZComponent
lng = ListLength(List=pt_3)
ma = MassAddition(Input=pdecon.XComponent)  # -> Result, PartialResults
ma_2 = MassAddition(Input=pdecon.YComponent)  # -> Result, PartialResults
ma_3 = MassAddition(Input=pdecon.ZComponent)  # -> Result, PartialResults
division_2 = Division(A=ma.Result, B=lng)
division_3 = Division(A=ma_2.Result, B=lng)
division_4 = Division(A=ma_3.Result, B=lng)
pt_4 = ConstructPoint(XCoordinate=division_2, YCoordinate=division_3, ZCoordinate=division_4)
python_2 = PythonScript(Points=pt_3, Center=pt_4)  # -> SortedPoints, Plane; inputs Points: list
# ---------- python_2: Python ----------
import Rhino as rc

def sortPointsAroundCenter(pts,center):
    
    """ Sort a list of points radially around a center """
    
    # Make plane through points and set its origin
    test,plane = rc.Geometry.Plane.FitPlaneToPoints(pts)
    plane.Origin = center
    
    # Calculate vectors from center to points
    vecs = [pt - center for pt in pts]
    
    # Calculate angles between vectors and plane X-axis
    angles = [rc.Geometry.Vector3d.VectorAngle(plane.XAxis,v,plane) for v in vecs]
    
    # Sort points by angles
    sortedBoth = sorted(zip(angles,pts))
    sortedPts = [l[1] for l in sortedBoth]
    
    return sortedPts,plane
    

if Points and Center:
    
    SortedPoints,Plane = sortPointsAroundCenter(Points,Center)
    
    print
# ---------- end python_2 ----------
pline = PolyLine(Vertices=python_2.SortedPoints, Closed=True)
boundary = BoundarySurfaces(Edges=pline)

# ---- group: apartment
panel_3 = Panel(python.Apartment)
item_4 = ListItem(List=panel_3, Index=0, Wrap=True)
tmatch_2 = MatchText(Text=python.Apartment, Pattern=item_4, Case=True)
cull_2 = CullPattern(List=pt, CullPattern=tmatch_2)
cull_3 = CullPattern(List=pt_2, CullPattern=tmatch_2)
dup_pts_2 = CleanDuplicatePoints(Points=flatten([cull_2, cull_3]), Tolerance=0.01)  # -> Points, Indices, Status
sort_pt = SortPoints(Points=dup_pts_2.Points)  # -> Points, Indices
pline_2 = PolyLine(Vertices=flatten(sort_pt.Points), Closed=True)
boundary_2 = BoundarySurfaces(Edges=pline_2)

# ----
extr = Extrude(Base=offcrv, Direction=graft(Z))
cap = CapHoles(Brep=extr)

pdecon_2 = Deconstruct(Point=dup_pts_2.Points)  # -> XComponent, YComponent, ZComponent
sort = SortList(Keys=pdecon_2.XComponent, ValuesA=dup_pts_2.Points)  # -> Keys, ValuesA
sort_2 = SortList(Keys=pdecon_2.YComponent, ValuesA=sort.ValuesA)  # -> Keys, ValuesA
panel_4 = Panel(sort_2.ValuesA)

# ---- group: Porject_information
cso = CreateSpeckleObject(Name="IBC-Building", selectedKitName="Objects")
cso_2 = CreateSpeckleObject(Name="Implenia_Default", selectedKitName="Objects")
cso_3 = CreateSpeckleObject(Name="Implenia_Default", selectedKitName="Objects")
eso = ExtendSpeckleObject(
    SpeckleObject=cso,
    Building_ID=cso_3,
    Level_ID=cso_2,
    Building_Use="Implenia_Default",
    Building_phase="tbd",
    selectedKitName="Objects")
panel_5 = Panel("In Progress")

# ----
item_5 = ListItem(List=sort_2.ValuesA, Index=Slider(36, range=0..100), Wrap=True)
brep = Brep(flatten(cap))
partition = PartitionList(List=sort_2.ValuesA, Size=3)
panel_6 = Panel(python.PanelType)

level = Level(
    Name="Level 0",
    Elevation="0",
    SelectedConstructorName="Objects.BuiltElements.Level.ctor(System.String,System.Double)",
    SelectedTypeName="Objects.BuiltElements.Level",
    UseSchemaTag=False,
    UserSetSchemaTag=False,
    seed="4807875e681e755d86d8")

srfgrid = SurfaceFromPoints(Points=partition, UCount="2", Interpolate=False)
points = PointList(Points=sort_2.ValuesA, Size=Slider(1, range=1..100))

debrep = DeconstructBrep(Brep=brep)  # -> Faces, Edges, Vertices
area = Area(Geometry=debrep.Faces)  # -> Area, Centroid
sort_3 = SortList(Keys=area.Area, ValuesA=debrep.Faces)  # -> Keys, reverse(ValuesA), ValuesB
item_6 = ListItem(List=sort_3.Keys, Index=0, Wrap=True)

eval = EvaluateCurve(Curve=reparameterize(ln), Parameter="0.5")  # -> Point, Tangent, Angle
lng_2 = ListLength(List=eval.Point)
random = Random(Range=dom, Number=lng_2, Seed=2)
Z_2 = UnitZ(Factor=random)
concat = Concatenate(FragmentA=python.Apartment, FragmentB=python.Room, FragmentE=python.PanelType)
move = Move(Geometry=eval.Point, Motion=Z_2)  # -> Geometry, Transform
ln_2 = Line(StartPoint=eval.Point, EndPoint=move.Geometry)
panel_7 = Panel(concat)
gate = StreamGate(Stream=ln_2, Gate=show_info)  # -> Target0, Target1
gate_2 = StreamGate(Stream=move.Geometry, Gate=show_info)  # -> Target0, Target1
preview = CustomPreview(Geometry=gate.Target1, Material=swatch)
tag = TextTag3D(Location=gate_2.Target1, Text=graft(panel_7), Size=number_slider, Colour=swatch, Justification=8)

panel_8 = Panel(python.Height)

# ---- group: tags
area_2 = Area(Geometry=boundary)  # -> Area, Centroid
concat_2 = Concatenate(FragmentA=python.Apartment, FragmentB=python.Room, FragmentE=python.PanelType)
move_2 = Move(Geometry=area_2.Centroid, Motion=Z_2)  # -> Geometry, Transform
panel_9 = Panel(concat_2)
swatch_2 = ColourSwatch(SwatchColor=RGB(255, 0, 0))
ln_3 = Line(StartPoint=area_2.Centroid, EndPoint=move_2.Geometry)
gate_3 = StreamGate(Stream=move_2.Geometry, Gate=show_info)  # -> Target0, Target1
gate_4 = StreamGate(Stream=ln_3, Gate=show_info)  # -> Target0, Target1
concat_3 = Concatenate(FragmentA=item_3, FragmentC=":", FragmentB=area_2.Area, FragmentD="sqmt")
preview_2 = CustomPreview(Geometry=gate_4.Target1, Material=swatch_2)
tag_2 = TextTag3D(Location=gate_3.Target1, Text=flatten(concat_3), Size=number_slider, Colour=swatch_2, Justification=8)

# ----
# list of elements: 3d module
# 3d module
# Façade wall
# Load Bearing Facade  Wall
# Apartment Dividing Wall Horizontal
# Apartment Dividing Wall Vertical
# Room Divding Wall
# CLT Slab
# Beam
element_index = StreamFilter(Gate=0)  # disabled
merge = Merge()  # -> flatten(Result); disabled
speckle_id = Panel("2a663449ba")  # disabled
assembly_geometry_selector = StreamFilter(Gate=0, Stream0=merge, Stream1=merge)  # disabled
item_7 = ListItem(List=speckle_id, Index=element_index, Wrap=True)  # disabled
concat_4 = Concatenate(FragmentB=item_7)  # disabled
panel_10 = Panel(concat_4)  # disabled

# ---- group: WALL object
rendermaterial = RenderMaterial(
    Opacity=1,
    Metalness=0,
    Roughness=1,
    SelectedConstructorName="Objects.Other.RenderMaterial.ctor(System.Double,System.Double,System.Double,System.Nullable`1[System.Drawing.Color],System.Nullable`1[System.Drawing.Color])",
    SelectedTypeName="Objects.Other.RenderMaterial",
    UseSchemaTag=False,
    UserSetSchemaTag=False,
    seed="373eed1013d68e8b251c")
cso_4 = CreateSpeckleObject(Wall_geometry=brep, selectedKitName="Objects")
wall = Wall(
    Height=python.Height,
    BaseLine=flatten(ln),
    Thickness=python.Thickness,
    Level=level,
    NumberCode=panel_6,
    ProjectInformation=eso,
    Surface=flatten(item_6),
    Material=rendermaterial,
    A=cso_4,
    SelectedConstructorName="Objects.BuiltElements.Wall.ctor(System.Double,Objects.ICurve,System.Collections.Generic.List`1[Speckle.Core.Models.Base])",
    SelectedTypeName="Objects.BuiltElements.Wall",
    UseSchemaTag=False,
    UserSetSchemaTag=True,
    seed="60c021c72f66312a0417")  # -> flatten(SpeckleObject)

# ---- group: wall_parameters
cso_5 = CreateSpeckleObject(Name_EN="Implenia Slab", selectedKitName="Objects")
eso_2 = ExtendSpeckleObject(SpeckleObject=cso_5, Is_External="FALSE", UValue="1.0", selectedKitName="Objects")

# ---- group: REVIT_Wall
sso = RevitWallByCurveAndHeight(
    Family=panel_6,
    Type="Implenia_wall",
    BaseLine=ln,
    Level=level,
    Height=python.Height,
    BaseOffset=0,
    TopOffset=0,
    Flipped=False,
    Structural=False,
    Thickness=python.Thickness,
    SelectedConstructorName="Objects.BuiltElements.Revit.RevitWall.ctor(System.String,System.String,Objects.ICurve,Objects.BuiltElements.Level,System.Double,System.Double,System.Double,System.Boolean,System.Boolean,System.Collections.Generic.List`1[Speckle.Core.Models.Base],System.Collections.Generic.List`1[Objects.BuiltElements.Revit.Parameter])",
    SelectedTypeName="Objects.BuiltElements.Revit.RevitWall",
    UseSchemaTag=False,
    UserSetSchemaTag=False,
    seed="aa1af884c6233d0c52a0")

# ----
eso_3 = ExtendSpeckleObject(
    SpeckleObject=brep,
    Type=panel_6,
    Category="Walls",
    Baseline=ln,
    Thickness=python.Thickness,
    Level=level,
    ApartmentName=python.Apartment,
    RoomName=python.Room,
    RoomHeight=panel_8,
    ProjectInformation=eso,
    ElementInformation=eso_2,
    selectedKitName="Objects")  # -> flatten(ExtendedSpeckleObject)

crv = Curve(<curve referenced from the Rhino model>)
Z_3 = UnitZ(Factor="-0.15")
boundary_3 = BoundarySurfaces(Edges=crv)
floor = Floor(
    Outline=crv,
    Family="Floor",
    A=boundary_3,
    SelectedConstructorName="Objects.BuiltElements.Floor.ctor(Objects.ICurve,System.Collections.Generic.List`1[Objects.ICurve],System.Collections.Generic.List`1[Speckle.Core.Models.Base])",
    SelectedTypeName="Objects.BuiltElements.Floor",
    UseSchemaTag=False,
    UserSetSchemaTag=False,
    seed="e4098f801990a6f4439b")
extr_2 = Extrude(Base=boundary_3, Direction=Z_3)

eso_4 = ExtendSpeckleObject(
    SpeckleObject=extr_2,
    Type="SLA_21",
    Category="SLAB",
    Outline=crv,
    Thickness="-0.15",
    Level=level,
    ProjectInformation=eso,
    ElementInformation=eso_2,
    selectedKitName="Objects")  # -> flatten(ExtendedSpeckleObject)
cso_6 = CreateSpeckleObject(Floors=eso_4, Walls=eso_3, selectedKitName="Objects")

# ----
# You could replicate this type of structure in Speckle like so 👇
# 
# Conceptual building using nested speckle objects to organise, categorise and label the data.
# 
# If you receive this structure from someone else, you just need to expand it until you reach the data you need 👇🏼
# 
# Doing the inverse operation: starting from the "building" and expanding down to the unit values.
# CLICK TO SELECT AND
# SEND ASSEMBLIES TO SPECKLE
list_2 = Accounts(
    {"No account selected": , "Account (panz@zhaw.ch | https://app.speckle.systems)": "https://app.speckle.systems/?id=7b59e40123", "Account (vague@topotheque.com | https://app.speckle.systems)": "https://app.speckle.systems/?id=d442476304"}, selected="Account (panz@zhaw.ch | https://app.speckle.systems)",
    FirstSelectedItem="https://app.speckle.systems/?id=7b59e40123")
panel_11 = Panel("https://app.speckle.systems/projects/b9d01cae98/models/2a663449ba")
message = Panel("testing export walls")
sget = StreamGet(StreamIDURL=panel_11, SpeckleAccount=list_2)
send = Send(
    Stream=sget,
    Message=message,
    Data=cso_6,
    AutoSend=False,
    BaseId="251fe3be066f2a7fd52ae77e43311b4d",
    CurrentComponentState="expired",
    KitName="Objects",
    OutputWrappers="https://app.speckle.systems\tb9d01cae98\t0227d45a21",
    UseDefaultCache=True,
    selectedKitName="Objects")
