# Grasshopper definition ReadJsonAndCreateGeometry_2python.gh (Grasshopper 1.0.7)
# plug-ins: Pufferfish, Speckle 2

list = ValueList({"select single item (Wall panel)": 0, "select multiple items (Wall panel)": 1}, selected="select multiple items (Wall panel)")
path = FilePath("C:\Users\panz\Documents\GitHub\IBC\05_Flooplan_processing\jsonExports\panels_oneApt_EP_update1_withRoomOutlineEDITED.json")
path_2 = FilePath("C:\Users\panz\Documents\GitHub\IBC\05_Flooplan_processing_ve0_1\jsonExports\apartment.json")
select_item = Slider(41, range=0..46)

# ---- group: KEMPS_JSON_test FILE
path_3 = FilePath("C:\Users\panz\Documents\GitHub\IBC\05_Flooplan_processing\jsonExports\panels_oneApt_EP_update1_withRoomOutlineEDITED.json")

# ----
path_4 = FilePath("C:\Users\panz\Documents\GitHub\IBC\05_Flooplan_processing_ve0_1\jsonExports\apartment.json")
panel = Panel(path_3)
series = Series(Start=0, Step=1, Count=select_item)
filter = StreamFilter(Gate=list, Stream0=select_item, Stream1=series)

# ----
# GET WALL PROPERTIES
python = GhPythonScript(file=path_3, panelIndex=filter)  # -> out, PanelType, StartPoint, EndPoint, Height, Thickness, RoomType, ApartmentName; inputs panelIndex: Int32
# ---------- python: Python ----------
__author__ = "panz"
__version__ = "2024.11.11"

import rhinoscriptsyntax as rs
import json
import json
import Rhino.Geometry as rg

# Read and parse JSON data from the file
with open(file, 'r') as inputfile:
    data = json.load(inputfile)

# Extract panel information
panels = data["panels"]["items"]
if not panels:
    print("Warning: 'panels.items' key is missing or empty in JSON.")
    
# Extract apartment outlines from 'spaces'
spaces_data = data.get("spaces", {})


# Initialize lists to store panel data
panel_types = []
start_points = []
end_points = []
heights = []
thicknesses = []
roomTypes = []
apartmentNames = []



# Loop through each panel and extract relevant information
for key, panel in panels.items():
    panel_types.append(panel.get("panel_type"))
    start_points.append(panel.get("start_point"))
    end_points.append(panel.get("end_point"))
    heights.append(panel.get("height"))
    thicknesses.append(panel.get("thickness"))
    roomTypes.append(panel.get("room"))
    apartmentNames.append(panel.get("apartment", "N/A"))          # Default: "N/A"


# Assume 'index' is passed as an argument (in a Grasshopper environment, for example)

PanelType = panel_types[panelIndex]
StartPoint = start_points[panelIndex]
EndPoint = end_points[panelIndex]
Height = heights[panelIndex]
Thickness = thicknesses[panelIndex]
RoomType = roomTypes[panelIndex]
ApartmentName = apartmentNames[panelIndex]



print("Panel Type:", PanelType)
print("Start Point:", StartPoint)
print("End Point:", EndPoint)
print("Height:", Height)
print("Thickness:", Thickness)
print("Room Type:", RoomType)
print("Apartment:", ApartmentName)
# ---------- end python ----------

python_2 = GhPythonScript(file=path_3)  # -> out, apartmentNames, roomTypes, roomPolylines, roomSurfaces, roomColors
# ---------- python_2: Python ----------
__author__ = "panz"
__version__ = "2024.11.11"

import rhinoscriptsyntax as rs
import json
import json
import Rhino.Geometry as rg

# Read and parse JSON data from the file
with open(file, 'r') as inputfile:
    data = json.load(inputfile)

# Extract panels (walls) data
panels_data = data.get("panels", {}).get("items", {})
if not panels_data:
    print("Warning: 'panels.items' key is missing or empty in JSON.")
    
# Extract apartment outlines from 'spaces'
spaces_data = data.get("spaces", {})
roomOutlines = []
roomPolylines =[]
apartmentNames = []
roomTypes = []
roomColors = []
roomSurfaces = []

for space_id, space in spaces_data.items():
    coordinates = space.get("coordinates")
    roomTypes.append(space.get("room_type"))
    apartmentNames.append(space.get("apartment"))
    outline_points = [[point["x"], point["y"], point["z"]] for point in coordinates]
    roomOutlines.append(outline_points)
print (len(roomOutlines))


roomCounter = 0 
for index in range (0, len(spaces_data)):
    roomOutline = roomOutlines[index] 
    
    # Convert the point lists into Rhino Point3d objects
    polyline_points = [rg.Point3d(point[0], point[1], point[2]) for point in roomOutline]
    # Create the polyline using the list of Point3d objects
    polyline = rg.Polyline(polyline_points)
    
    
    #assign colors based on roomput
    if (roomTypes[index] == "living_room"):
        roomColors.append('255,100,0')
    elif (roomTypes[index] == "bedroom"):
        roomColors.append('153,137,255')
    elif (roomTypes[index] == "kitchen"):
        roomColors.append('0,0,220')
    elif (roomTypes[index] == "bathroom"):
        roomColors.append('151,255,255')
    elif (roomTypes[index] == "core"):
        roomColors.append('150,150,150')
        
    # create a surface
    roomSrfs = rg.Brep.CreatePlanarBreps(polyline.ToNurbsCurve())
    roomSurfaces.append(roomSrfs[0])
    # Ensure the polyline is closed if necessary (optional)
    if not polyline.IsClosed:
        polyline.Add(polyline[0])  # Add the first point to close the polyline
    # Output the polyline (e.g., to Grasshopper)
    roomPolylines.append(polyline)
    roomCounter +=1 
    print ("created", roomCounter, "space polylines")
    print(roomSurfaces)
# ---------- end python_2 ----------
curve = Curve(python_2.roomPolylines)
brep = Brep(python_2.roomSurfaces)

label_height = Slider(9, range=0..30)

item = ListItem(List=python.StartPoint, Index=0, Wrap=True)  # -> Item, Item1, Item2
item_2 = ListItem(List=python.EndPoint, Index=0, Wrap=True)  # -> Item, Item1, Item2
Z = UnitZ(Factor=python.Height)
pt = ConstructPoint(XCoordinate=item_2.Item, YCoordinate=item_2.Item1, ZCoordinate=item_2.Item2)
pt_2 = ConstructPoint(XCoordinate=item.Item, YCoordinate=item.Item1, ZCoordinate=item.Item2)
ln = Line(StartPoint=pt_2, EndPoint=pt)
division = Division(A=python.Thickness, B=2)
offcrv = OffsetCurve(Curve=ln, Plane=PlaneXY(0, 0, 0), Distance=graft(division), BothSides=True, Kinks=0, CapType=1)

Z_2 = UnitZ(Factor=label_height)
preview = CustomPreview(Geometry=brep, Material=python_2.roomColors)

label_height_2 = Slider(3, range=0..30)
swatch = ColourSwatch(SwatchColor=RGB(3, 3, 3))
show_info = BooleanToggle(True)
addition = Addition(A=label_height_2, B=3)
dom = ConstructDomain(DomainStart=label_height_2, DomainEnd=addition)

# ---- group: tags
area = Area(Geometry=curve)  # -> Area, Centroid
move = Move(Geometry=area.Centroid, Motion=Z_2)  # -> Geometry, Transform
swatch_2 = ColourSwatch(SwatchColor=RGB(0, 255, 0))
concat = Concatenate(FragmentE=python_2.apartmentNames, FragmentA=python_2.roomTypes, FragmentC=":", FragmentB=area.Area, FragmentD=" m2")
ln_2 = Line(StartPoint=area.Centroid, EndPoint=move.Geometry)
gate = StreamGate(Stream=move.Geometry, Gate=show_info)  # -> Target0, Target1
gate_2 = StreamGate(Stream=ln_2, Gate=show_info)  # -> Target0, Target1
tag = TextTag3D(Location=gate.Target1, Text=flatten(concat), Size=Slider(0.265, range=0..50), Colour=swatch_2, Justification=5)
preview_2 = CustomPreview(Geometry=gate_2.Target1, Material=swatch_2)

# ----
eval = EvaluateCurve(Curve=reparameterize(ln), Parameter="0.5")  # -> Point, Tangent, Angle
lng = ListLength(List=eval.Point)
random = Random(Range=dom, Number=lng, Seed=2)
concat_2 = Concatenate(FragmentB=python.RoomType, FragmentE=python.PanelType)
Z_3 = UnitZ(Factor=random)
move_2 = Move(Geometry=eval.Point, Motion=Z_3)  # -> Geometry, Transform
panel_2 = Panel(concat_2)
ln_3 = Line(StartPoint=eval.Point, EndPoint=move_2.Geometry)
gate_3 = StreamGate(Stream=move_2.Geometry, Gate=show_info)  # -> Target0, Target1
gate_4 = StreamGate(Stream=ln_3, Gate=show_info)  # -> Target0, Target1
tag_2 = TextTag3D(Location=gate_3.Target1, Text=graft(panel_2), Size=Slider(0.183, range=0..50), Colour=swatch, Justification=8)
preview_3 = CustomPreview(Geometry=gate_4.Target1, Material=swatch)

extr = Extrude(Base=offcrv, Direction=graft(Z))
cap = CapHoles(Brep=extr)
brep_2 = Brep(flatten(cap))
debrep = DeconstructBrep(Brep=brep_2)  # -> Faces, Edges, Vertices
area_2 = Area(Geometry=debrep.Faces)  # -> Area, Centroid
sort = SortList(Keys=area_2.Area, ValuesA=debrep.Faces)  # -> Keys, reverse(ValuesA), ValuesB
item_3 = ListItem(List=sort.Keys, Index=0, Wrap=True)

# ---- group: Porject_information
cso = CreateSpeckleObject(Name="IBC-Building", selectedKitName="Objects")
cso_2 = CreateSpeckleObject(Name="Implenia_Default", selectedKitName="Objects")
cso_3 = CreateSpeckleObject(Name="Implenia_Default", selectedKitName="Objects")
eso = ExtendSpeckleObject(
    SpeckleObject=cso,
    Building_ID=cso_3,
    Level_ID=cso_2,
    Building_Use="Implenia_Default",
    Building_phase="tbd",
    selectedKitName="Objects")
panel_3 = Panel("In Progress")

# ----
level = Level(
    Name="Level 0",
    Elevation="0",
    SelectedConstructorName="Objects.BuiltElements.Level.ctor(System.String,System.Double)",
    SelectedTypeName="Objects.BuiltElements.Level",
    UseSchemaTag=False,
    UserSetSchemaTag=False,
    seed="d38af342d870281b8f9e")

crv = Curve(curve)
Z_4 = UnitZ(Factor="-0.15")
boundary = BoundarySurfaces(Edges=crv)
floor = Floor(
    Outline=crv,
    Family="Floor",
    A=boundary,
    SelectedConstructorName="Objects.BuiltElements.Floor.ctor(Objects.ICurve,System.Collections.Generic.List`1[Objects.ICurve],System.Collections.Generic.List`1[Speckle.Core.Models.Base])",
    SelectedTypeName="Objects.BuiltElements.Floor",
    UseSchemaTag=False,
    UserSetSchemaTag=False,
    seed="5cc5e3f46eed33223d9a")
extr_2 = Extrude(Base=boundary, Direction=Z_4)

# ---- group: wall_parameters
cso_4 = CreateSpeckleObject(Name_EN="Implenia Slab", selectedKitName="Objects")
eso_2 = ExtendSpeckleObject(SpeckleObject=cso_4, Is_External="FALSE", UValue="1.0", selectedKitName="Objects")

# ----
# CLICK TO SELECT AND
# SEND ASSEMBLIES TO SPECKLE
panel_4 = Panel(python.PanelType)
panel_5 = Panel(python.Height)
list_2 = Accounts(
    {"No account selected": , "Account (panz@zhaw.ch | https://app.speckle.systems)": "https://app.speckle.systems/?id=7b59e40123", "Account (vague@topotheque.com | https://app.speckle.systems)": "https://app.speckle.systems/?id=d442476304"}, selected="Account (panz@zhaw.ch | https://app.speckle.systems)",
    FirstSelectedItem="https://app.speckle.systems/?id=7b59e40123")
panel_6 = Panel("https://app.speckle.systems/projects/b9d01cae98/models/2a663449ba")
message = Panel("testing export walls")
sget = StreamGet(StreamIDURL=panel_6, SpeckleAccount=list_2)

# ---- group: WALL object
rendermaterial = RenderMaterial(
    Opacity=1,
    Metalness=0,
    Roughness=1,
    SelectedConstructorName="Objects.Other.RenderMaterial.ctor(System.Double,System.Double,System.Double,System.Nullable`1[System.Drawing.Color],System.Nullable`1[System.Drawing.Color])",
    SelectedTypeName="Objects.Other.RenderMaterial",
    UseSchemaTag=False,
    UserSetSchemaTag=False,
    seed="6f203a072cfea5a7e1e1")
cso_5 = CreateSpeckleObject(Wall_geometry=brep_2, selectedKitName="Objects")
# You could replicate this type of structure in Speckle like so 👇
# 
# Conceptual building using nested speckle objects to organise, categorise and label the data.
# 
# If you receive this structure from someone else, you just need to expand it until you reach the data you need 👇🏼
# 
# Doing the inverse operation: starting from the "building" and expanding down to the unit values.
wall = Wall(
    Height=python.Height,
    BaseLine=flatten(ln),
    Thickness=python.Thickness,
    Level=level,
    NumberCode=panel_4,
    ProjectInformation=eso,
    Surface=flatten(item_3),
    Material=rendermaterial,
    A=cso_5,
    SelectedConstructorName="Objects.BuiltElements.Wall.ctor(System.Double,Objects.ICurve,System.Collections.Generic.List`1[Speckle.Core.Models.Base])",
    SelectedTypeName="Objects.BuiltElements.Wall",
    UseSchemaTag=False,
    UserSetSchemaTag=True,
    seed="a3bcf4127012e3fe4be9")  # -> flatten(SpeckleObject)

# ---- group: REVIT_Wall
sso = RevitWallByCurveAndHeight(
    Family=panel_4,
    Type="Implenia_wall",
    BaseLine=ln,
    Level=level,
    Height=python.Height,
    BaseOffset=0,
    TopOffset=0,
    Flipped=False,
    Structural=False,
    Thickness=python.Thickness,
    SelectedConstructorName="Objects.BuiltElements.Revit.RevitWall.ctor(System.String,System.String,Objects.ICurve,Objects.BuiltElements.Level,System.Double,System.Double,System.Double,System.Boolean,System.Boolean,System.Collections.Generic.List`1[Speckle.Core.Models.Base],System.Collections.Generic.List`1[Objects.BuiltElements.Revit.Parameter])",
    SelectedTypeName="Objects.BuiltElements.Revit.RevitWall",
    UseSchemaTag=False,
    UserSetSchemaTag=False,
    seed="73301769be48de9a2ede")

# ----
eso_3 = ExtendSpeckleObject(
    SpeckleObject=extr_2,
    Type="SLA_21",
    Category="SLAB",
    Outline=crv,
    Thickness="-0.15",
    Level=level,
    ProjectInformation=eso,
    ElementInformation=eso_2,
    selectedKitName="Objects")  # -> flatten(ExtendedSpeckleObject)
eso_4 = ExtendSpeckleObject(
    SpeckleObject=brep_2,
    Type=panel_4,
    Category="Walls",
    Baseline=ln,
    Thickness=python.Thickness,
    Level=level,
    ApartmentName=python.RoomType,
    RoomName=python.RoomType,
    RoomHeight=panel_5,
    ProjectInformation=eso,
    ElementInformation=eso_2,
    selectedKitName="Objects")  # -> flatten(ExtendedSpeckleObject)
cso_6 = CreateSpeckleObject(Floors=eso_3, Walls=eso_4, selectedKitName="Objects")

send = Send(
    Stream=sget,
    Message=message,
    Data=cso_6,
    AutoSend=False,
    BaseId="251fe3be066f2a7fd52ae77e43311b4d",
    CurrentComponentState="expired",
    KitName="Objects",
    OutputWrappers="https://app.speckle.systems\tb9d01cae98\t0227d45a21",
    UseDefaultCache=True,
    selectedKitName="Objects")
