# Grasshopper definition ReadJsonAndCreateGeometry.gh (Grasshopper 1.0.7)
# plug-ins: jSwan, Pufferfish, TT Toolbox

path = FilePath("C:\Users\panz\Documents\GitHub\IBC\05_Flooplan_processing_ve0_1\panels.json")
python = GhPythonScript(File=path)  # -> Out, A
dejson = DeserializeJson(JSON=path, OutputsLocked=False)
panel = Panel(path)
dejson_2 = DeserializeJson(JSON=dejson, OutputsLocked=False)  # -> Attributes, Items, Max_key
panel_2 = Panel(dejson_2.Items)
dejsonkv = DeserializeKeysAndValues(JSON=dejson_2.Items, Keys="living_room")  # -> Key, Value
panel_3 = Panel(dejsonkv.Key)
dejson_3 = DeserializeJson(JSON=dejson_2.Items, OutputsLocked=False)  # -> _0, _1, _2, _3, _4, _5, _6, _7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

dejson_4 = DeserializeJson(JSON=dejson_3._0, OutputsLocked=False)  # -> Panel_type, Start_point, End_point, Height, Thickness, Room, Apartment
item = ListItem(List=dejson_4.End_point, Index=0, Wrap=True)  # -> Item, Item1, Item2
item_2 = ListItem(List=dejson_4.Start_point, Index=0, Wrap=True)  # -> Item, Item1, Item2
pt = ConstructPoint(XCoordinate=item_2.Item, YCoordinate=item_2.Item1, ZCoordinate=item_2.Item2)
pt_2 = ConstructPoint(XCoordinate=item.Item, YCoordinate=item.Item1, ZCoordinate=item.Item2)
division = Division(A=dejson_4.Thickness, B=2)
division_2 = Division(A=dejson_4.Thickness, B=2)
ln = Line(StartPoint=pt, EndPoint=pt_2)
Z = UnitZ(Factor=dejson_4.Height)
offcrv = OffsetCurve(Curve=ln, Plane=PlaneXY(0, 0, 0), Distance=division_2, BothSides=True, Kinks=0, CapType=1)
extr = Extrude(Base=offcrv, Direction=Z)

dejson_5 = DeserializeJson(JSON=dejson_3._8, OutputsLocked=False)  # -> Panel_type, Start_point, End_point, Height, Thickness, Room, Apartment
item_3 = ListItem(List=dejson_5.End_point, Index=0, Wrap=True)  # -> Item, Item1, Item2
item_4 = ListItem(List=dejson_5.Start_point, Index=0, Wrap=True)  # -> Item, Item1, Item2
pt_3 = ConstructPoint(XCoordinate=item_4.Item, YCoordinate=item_4.Item1, ZCoordinate=item_4.Item2)
pt_4 = ConstructPoint(XCoordinate=item_3.Item, YCoordinate=item_3.Item1, ZCoordinate=item_3.Item2)
division_3 = Division(A=dejson_5.Thickness, B=2)
division_4 = Division(A=dejson_5.Thickness, B=2)
ln_2 = Line(StartPoint=pt_3, EndPoint=pt_4)
Z_2 = UnitZ(Factor=dejson_5.Height)
offcrv_2 = OffsetCurve(Curve=ln_2, Plane=PlaneXY(0, 0, 0), Distance=division_4, BothSides=True, Kinks=0, CapType=1)
extr_2 = Extrude(Base=offcrv_2, Direction=Z_2)

dejson_6 = DeserializeJson(JSON=dejson_3._2, OutputsLocked=False)  # -> Panel_type, Start_point, End_point, Height, Thickness, Room, Apartment
item_5 = ListItem(List=dejson_6.End_point, Index=0, Wrap=True)  # -> Item, Item1, Item2
item_6 = ListItem(List=dejson_6.Start_point, Index=0, Wrap=True)  # -> Item, Item1, Item2
pt_5 = ConstructPoint(XCoordinate=item_6.Item, YCoordinate=item_6.Item1, ZCoordinate=item_6.Item2)
pt_6 = ConstructPoint(XCoordinate=item_5.Item, YCoordinate=item_5.Item1, ZCoordinate=item_5.Item2)
division_5 = Division(A=dejson_6.Thickness, B=2)
division_6 = Division(A=dejson_6.Thickness, B=2)
ln_3 = Line(StartPoint=pt_5, EndPoint=pt_6)
Z_3 = UnitZ(Factor=dejson_6.Height)
offcrv_3 = OffsetCurve(Curve=ln_3, Plane=PlaneXY(0, 0, 0), Distance=division_6, BothSides=True, Kinks=0, CapType=1)
extr_3 = Extrude(Base=offcrv_3, Direction=Z_3)

dejson_7 = DeserializeJson(JSON=dejson_3._4, OutputsLocked=False)  # -> Panel_type, Start_point, End_point, Height, Thickness, Room, Apartment
item_7 = ListItem(List=dejson_7.End_point, Index=0, Wrap=True)  # -> Item, Item1, Item2
item_8 = ListItem(List=dejson_7.Start_point, Index=0, Wrap=True)  # -> Item, Item1, Item2
pt_7 = ConstructPoint(XCoordinate=item_8.Item, YCoordinate=item_8.Item1, ZCoordinate=item_8.Item2)
pt_8 = ConstructPoint(XCoordinate=item_7.Item, YCoordinate=item_7.Item1, ZCoordinate=item_7.Item2)
division_7 = Division(A=dejson_7.Thickness, B=2)
division_8 = Division(A=dejson_7.Thickness, B=2)
ln_4 = Line(StartPoint=pt_7, EndPoint=pt_8)
Z_4 = UnitZ(Factor=dejson_7.Height)
offcrv_4 = OffsetCurve(Curve=ln_4, Plane=PlaneXY(0, 0, 0), Distance=division_8, BothSides=True, Kinks=0, CapType=1)
extr_4 = Extrude(Base=offcrv_4, Direction=Z_4)

dejson_8 = DeserializeJson(JSON=dejson_3._3, OutputsLocked=False)  # -> Panel_type, Start_point, End_point, Height, Thickness, Room, Apartment
item_9 = ListItem(List=dejson_8.End_point, Index=0, Wrap=True)  # -> Item, Item1, Item2
item_10 = ListItem(List=dejson_8.Start_point, Index=0, Wrap=True)  # -> Item, Item1, Item2
pt_9 = ConstructPoint(XCoordinate=item_10.Item, YCoordinate=item_10.Item1, ZCoordinate=item_10.Item2)
pt_10 = ConstructPoint(XCoordinate=item_9.Item, YCoordinate=item_9.Item1, ZCoordinate=item_9.Item2)
division_9 = Division(A=dejson_8.Thickness, B=2)
division_10 = Division(A=dejson_8.Thickness, B=2)
ln_5 = Line(StartPoint=pt_9, EndPoint=pt_10)
Z_5 = UnitZ(Factor=dejson_8.Height)
offcrv_5 = OffsetCurve(Curve=ln_5, Plane=PlaneXY(0, 0, 0), Distance=division_10, BothSides=True, Kinks=0, CapType=1)
extr_5 = Extrude(Base=offcrv_5, Direction=Z_5)

dejson_9 = DeserializeJson(JSON=dejson_3._6, OutputsLocked=False)  # -> Panel_type, Start_point, End_point, Height, Thickness, Room, Apartment
item_11 = ListItem(List=dejson_9.End_point, Index=0, Wrap=True)  # -> Item, Item1, Item2
item_12 = ListItem(List=dejson_9.Start_point, Index=0, Wrap=True)  # -> Item, Item1, Item2
pt_11 = ConstructPoint(XCoordinate=item_11.Item, YCoordinate=item_11.Item1, ZCoordinate=item_11.Item2)
division_11 = Division(A=dejson_9.Thickness, B=2)
pt_12 = ConstructPoint(XCoordinate=item_12.Item, YCoordinate=item_12.Item1, ZCoordinate=item_12.Item2)
division_12 = Division(A=dejson_9.Thickness, B=2)
ln_6 = Line(StartPoint=pt_12, EndPoint=pt_11)
Z_6 = UnitZ(Factor=dejson_9.Height)
offcrv_6 = OffsetCurve(Curve=ln_6, Plane=PlaneXY(0, 0, 0), Distance=division_12, BothSides=True, Kinks=0, CapType=1)
extr_6 = Extrude(Base=offcrv_6, Direction=Z_6)

dejson_10 = DeserializeJson(JSON=dejson_3._9, OutputsLocked=False)  # -> Panel_type, Start_point, End_point, Height, Thickness, Room, Apartment
item_13 = ListItem(List=dejson_10.End_point, Index=0, Wrap=True)  # -> Item, Item1, Item2
item_14 = ListItem(List=dejson_10.Start_point, Index=0, Wrap=True)  # -> Item, Item1, Item2
pt_13 = ConstructPoint(XCoordinate=item_14.Item, YCoordinate=item_14.Item1, ZCoordinate=item_14.Item2)
pt_14 = ConstructPoint(XCoordinate=item_13.Item, YCoordinate=item_13.Item1, ZCoordinate=item_13.Item2)
division_13 = Division(A=dejson_10.Thickness, B=2)
division_14 = Division(A=dejson_10.Thickness, B=2)
ln_7 = Line(StartPoint=pt_13, EndPoint=pt_14)
Z_7 = UnitZ(Factor=dejson_10.Height)
offcrv_7 = OffsetCurve(Curve=ln_7, Plane=PlaneXY(0, 0, 0), Distance=division_14, BothSides=True, Kinks=0, CapType=1)
extr_7 = Extrude(Base=offcrv_7, Direction=Z_7)

dejson_11 = DeserializeJson(JSON=dejson_3._5, OutputsLocked=False)  # -> Panel_type, Start_point, End_point, Height, Thickness, Room, Apartment
item_15 = ListItem(List=dejson_11.End_point, Index=0, Wrap=True)  # -> Item, Item1, Item2
item_16 = ListItem(List=dejson_11.Start_point, Index=0, Wrap=True)  # -> Item, Item1, Item2
pt_15 = ConstructPoint(XCoordinate=item_16.Item, YCoordinate=item_16.Item1, ZCoordinate=item_16.Item2)
pt_16 = ConstructPoint(XCoordinate=item_15.Item, YCoordinate=item_15.Item1, ZCoordinate=item_15.Item2)
division_15 = Division(A=dejson_11.Thickness, B=2)
division_16 = Division(A=dejson_11.Thickness, B=2)
ln_8 = Line(StartPoint=pt_15, EndPoint=pt_16)
Z_8 = UnitZ(Factor=dejson_11.Height)
offcrv_8 = OffsetCurve(Curve=ln_8, Plane=PlaneXY(0, 0, 0), Distance=division_16, BothSides=True, Kinks=0, CapType=1)
extr_8 = Extrude(Base=offcrv_8, Direction=Z_8)

dejson_12 = DeserializeJson(JSON=dejson_3._10, OutputsLocked=False)  # -> Panel_type, Start_point, End_point, Height, Thickness, Room, Apartment
item_17 = ListItem(List=dejson_12.End_point, Index=0, Wrap=True)  # -> Item, Item1, Item2
item_18 = ListItem(List=dejson_12.Start_point, Index=0, Wrap=True)  # -> Item, Item1, Item2
pt_17 = ConstructPoint(XCoordinate=item_18.Item, YCoordinate=item_18.Item1, ZCoordinate=item_18.Item2)
pt_18 = ConstructPoint(XCoordinate=item_17.Item, YCoordinate=item_17.Item1, ZCoordinate=item_17.Item2)
division_17 = Division(A=dejson_12.Thickness, B=2)
division_18 = Division(A=dejson_12.Thickness, B=2)
ln_9 = Line(StartPoint=pt_17, EndPoint=pt_18)
Z_9 = UnitZ(Factor=dejson_12.Height)
offcrv_9 = OffsetCurve(Curve=ln_9, Plane=PlaneXY(0, 0, 0), Distance=division_18, BothSides=True, Kinks=0, CapType=1)
extr_9 = Extrude(Base=offcrv_9, Direction=Z_9)

dejson_13 = DeserializeJson(JSON=dejson_3._7, OutputsLocked=False)  # -> Panel_type, Start_point, End_point, Height, Thickness, Room, Apartment
item_19 = ListItem(List=dejson_13.End_point, Index=0, Wrap=True)  # -> Item, Item1, Item2
item_20 = ListItem(List=dejson_13.Start_point, Index=0, Wrap=True)  # -> Item, Item1, Item2
pt_19 = ConstructPoint(XCoordinate=item_20.Item, YCoordinate=item_20.Item1, ZCoordinate=item_20.Item2)
pt_20 = ConstructPoint(XCoordinate=item_19.Item, YCoordinate=item_19.Item1, ZCoordinate=item_19.Item2)
division_19 = Division(A=dejson_13.Thickness, B=2)
division_20 = Division(A=dejson_13.Thickness, B=2)
ln_10 = Line(StartPoint=pt_19, EndPoint=pt_20)
Z_10 = UnitZ(Factor=dejson_13.Height)
offcrv_10 = OffsetCurve(Curve=ln_10, Plane=PlaneXY(0, 0, 0), Distance=division_20, BothSides=True, Kinks=0, CapType=1)
extr_10 = Extrude(Base=offcrv_10, Direction=Z_10)

dejson_14 = DeserializeJson(JSON=dejson_3._1, OutputsLocked=False)  # -> Panel_type, Start_point, End_point, Height, Thickness, Room, Apartment
item_21 = ListItem(List=dejson_14.End_point, Index=0, Wrap=True)  # -> Item, Item1, Item2
item_22 = ListItem(List=dejson_14.Start_point, Index=0, Wrap=True)  # -> Item, Item1, Item2
pt_21 = ConstructPoint(XCoordinate=item_22.Item, YCoordinate=item_22.Item1, ZCoordinate=item_22.Item2)
pt_22 = ConstructPoint(XCoordinate=item_21.Item, YCoordinate=item_21.Item1, ZCoordinate=item_21.Item2)
division_21 = Division(A=dejson_14.Thickness, B=2)
division_22 = Division(A=dejson_14.Thickness, B=2)
ln_11 = Line(StartPoint=pt_21, EndPoint=pt_22)
Z_11 = UnitZ(Factor=dejson_14.Height)
offcrv_11 = OffsetCurve(Curve=ln_11, Plane=PlaneXY(0, 0, 0), Distance=division_22, BothSides=True, Kinks=0, CapType=1)
extr_11 = Extrude(Base=offcrv_11, Direction=Z_11)

cap = CapHoles(Brep=extr)
cap_2 = CapHoles(Brep=extr_11)

label_height = Slider(10, range=0..30)
swatch = ColourSwatch(SwatchColor=RGB(3, 3, 3))
number_slider = Slider(0.1, range=0..50)
show_info = BooleanToggle(True)

concat = Concatenate(FragmentA=dejson_7.Apartment, FragmentB=dejson_7.Room, FragmentE=dejson_7.Panel_type)
eval = EvaluateCurve(Curve=reparameterize(ln_4), Parameter="0.5")  # -> Point, Tangent, Angle
panel_4 = Panel(concat)
Z_12 = UnitZ(Factor=label_height)
move = Move(Geometry=eval.Point, Motion=Z_12)  # -> Geometry, Transform
ln_12 = Line(StartPoint=eval.Point, EndPoint=move.Geometry)
gate = StreamGate(Stream=move.Geometry, Gate=show_info)  # -> Target0, Target1
gate_2 = StreamGate(Stream=ln_12, Gate=show_info)  # -> Target0, Target1
tag = TextTag3D(Location=gate.Target1, Text=panel_4, Size=number_slider, Colour=swatch, Justification=5)
preview = CustomPreview(Geometry=gate_2.Target1, Material=swatch)

concat_2 = Concatenate(FragmentA=dejson_5.Apartment, FragmentB=dejson_5.Room, FragmentE=dejson_5.Panel_type)
eval_2 = EvaluateCurve(Curve=reparameterize(ln_2), Parameter="0.5")  # -> Point, Tangent, Angle
panel_5 = Panel(concat_2)
Z_13 = UnitZ(Factor=label_height)
move_2 = Move(Geometry=eval_2.Point, Motion=Z_13)  # -> Geometry, Transform
ln_13 = Line(StartPoint=eval_2.Point, EndPoint=move_2.Geometry)
gate_3 = StreamGate(Stream=move_2.Geometry, Gate=show_info)  # -> Target0, Target1
gate_4 = StreamGate(Stream=ln_13, Gate=show_info)  # -> Target0, Target1
tag_2 = TextTag3D(Location=gate_3.Target1, Text=panel_5, Size=number_slider, Colour=swatch, Justification=5)
preview_2 = CustomPreview(Geometry=gate_4.Target1, Material=swatch)

concat_3 = Concatenate(FragmentA=dejson_6.Apartment, FragmentB=dejson_6.Room, FragmentE=dejson_6.Panel_type)
eval_3 = EvaluateCurve(Curve=reparameterize(ln_3), Parameter="0.5")  # -> Point, Tangent, Angle
panel_6 = Panel(concat_3)
Z_14 = UnitZ(Factor=label_height)
move_3 = Move(Geometry=eval_3.Point, Motion=Z_14)  # -> Geometry, Transform
ln_14 = Line(StartPoint=eval_3.Point, EndPoint=move_3.Geometry)
gate_5 = StreamGate(Stream=move_3.Geometry, Gate=show_info)  # -> Target0, Target1
gate_6 = StreamGate(Stream=ln_14, Gate=show_info)  # -> Target0, Target1
tag_3 = TextTag3D(Location=gate_5.Target1, Text=panel_6, Size=number_slider, Colour=swatch, Justification=5)
preview_3 = CustomPreview(Geometry=gate_6.Target1, Material=swatch)

concat_4 = Concatenate(FragmentA=dejson_8.Apartment, FragmentB=dejson_8.Room, FragmentE=dejson_8.Panel_type)
eval_4 = EvaluateCurve(Curve=reparameterize(ln_5), Parameter="0.5")  # -> Point, Tangent, Angle
panel_7 = Panel(concat_4)
Z_15 = UnitZ(Factor=label_height)
move_4 = Move(Geometry=eval_4.Point, Motion=Z_15)  # -> Geometry, Transform
ln_15 = Line(StartPoint=eval_4.Point, EndPoint=move_4.Geometry)
gate_7 = StreamGate(Stream=move_4.Geometry, Gate=show_info)  # -> Target0, Target1
gate_8 = StreamGate(Stream=ln_15, Gate=show_info)  # -> Target0, Target1
tag_4 = TextTag3D(Location=gate_7.Target1, Text=panel_7, Size=number_slider, Colour=swatch, Justification=5)
preview_4 = CustomPreview(Geometry=gate_8.Target1, Material=swatch)

concat_5 = Concatenate(FragmentA=dejson_9.Apartment, FragmentB=dejson_9.Room, FragmentE=dejson_9.Panel_type)
eval_5 = EvaluateCurve(Curve=reparameterize(ln_6), Parameter="0.5")  # -> Point, Tangent, Angle
panel_8 = Panel(concat_5)
Z_16 = UnitZ(Factor=label_height)
move_5 = Move(Geometry=eval_5.Point, Motion=Z_16)  # -> Geometry, Transform
ln_16 = Line(StartPoint=eval_5.Point, EndPoint=move_5.Geometry)
gate_9 = StreamGate(Stream=move_5.Geometry, Gate=show_info)  # -> Target0, Target1
gate_10 = StreamGate(Stream=ln_16, Gate=show_info)  # -> Target0, Target1
tag_5 = TextTag3D(Location=gate_9.Target1, Text=panel_8, Size=number_slider, Colour=swatch, Justification=5)
preview_5 = CustomPreview(Geometry=gate_10.Target1, Material=swatch)

concat_6 = Concatenate(FragmentA=dejson_11.Apartment, FragmentB=dejson_11.Room, FragmentE=dejson_11.Panel_type)
eval_6 = EvaluateCurve(Curve=reparameterize(ln_8), Parameter="0.5")  # -> Point, Tangent, Angle
panel_9 = Panel(concat_6)
Z_17 = UnitZ(Factor=label_height)
move_6 = Move(Geometry=eval_6.Point, Motion=Z_17)  # -> Geometry, Transform
ln_17 = Line(StartPoint=eval_6.Point, EndPoint=move_6.Geometry)
gate_11 = StreamGate(Stream=move_6.Geometry, Gate=show_info)  # -> Target0, Target1
gate_12 = StreamGate(Stream=ln_17, Gate=show_info)  # -> Target0, Target1
tag_6 = TextTag3D(Location=gate_11.Target1, Text=panel_9, Size=number_slider, Colour=swatch, Justification=5)
preview_6 = CustomPreview(Geometry=gate_12.Target1, Material=swatch)

concat_7 = Concatenate(FragmentA=dejson_13.Apartment, FragmentB=dejson_13.Room, FragmentE=dejson_13.Panel_type)
eval_7 = EvaluateCurve(Curve=reparameterize(ln_10), Parameter="0.5")  # -> Point, Tangent, Angle
panel_10 = Panel(concat_7)
Z_18 = UnitZ(Factor=label_height)
move_7 = Move(Geometry=eval_7.Point, Motion=Z_18)  # -> Geometry, Transform
ln_18 = Line(StartPoint=eval_7.Point, EndPoint=move_7.Geometry)
gate_13 = StreamGate(Stream=move_7.Geometry, Gate=show_info)  # -> Target0, Target1
gate_14 = StreamGate(Stream=ln_18, Gate=show_info)  # -> Target0, Target1
tag_7 = TextTag3D(Location=gate_13.Target1, Text=panel_10, Size=number_slider, Colour=swatch, Justification=5)
preview_7 = CustomPreview(Geometry=gate_14.Target1, Material=swatch)

concat_8 = Concatenate(FragmentA=dejson_14.Apartment, FragmentB=dejson_14.Room, FragmentE=dejson_14.Panel_type)
eval_8 = EvaluateCurve(Curve=reparameterize(ln_11), Parameter="0.5")  # -> Point, Tangent, Angle
panel_11 = Panel(concat_8)
Z_19 = UnitZ(Factor=label_height)
move_8 = Move(Geometry=eval_8.Point, Motion=Z_19)  # -> Geometry, Transform
ln_19 = Line(StartPoint=eval_8.Point, EndPoint=move_8.Geometry)
gate_15 = StreamGate(Stream=move_8.Geometry, Gate=show_info)  # -> Target0, Target1
gate_16 = StreamGate(Stream=ln_19, Gate=show_info)  # -> Target0, Target1
preview_8 = CustomPreview(Geometry=gate_16.Target1, Material=swatch)
tag_8 = TextTag3D(Location=gate_15.Target1, Text=panel_11, Size=number_slider, Colour=swatch, Justification=5)

concat_9 = Concatenate(FragmentA=dejson_10.Apartment, FragmentB=dejson_10.Room, FragmentE=dejson_10.Panel_type)
eval_9 = EvaluateCurve(Curve=reparameterize(ln_7), Parameter="0.5")  # -> Point, Tangent, Angle
panel_12 = Panel(concat_9)
Z_20 = UnitZ(Factor=label_height)
move_9 = Move(Geometry=eval_9.Point, Motion=Z_20)  # -> Geometry, Transform
ln_20 = Line(StartPoint=eval_9.Point, EndPoint=move_9.Geometry)
gate_17 = StreamGate(Stream=move_9.Geometry, Gate=show_info)  # -> Target0, Target1
gate_18 = StreamGate(Stream=ln_20, Gate=show_info)  # -> Target0, Target1
tag_9 = TextTag3D(Location=gate_17.Target1, Text=panel_12, Size=number_slider, Colour=swatch, Justification=5)
preview_9 = CustomPreview(Geometry=gate_18.Target1, Material=swatch)

concat_10 = Concatenate(FragmentA=dejson_12.Apartment, FragmentB=dejson_12.Room, FragmentE=dejson_12.Panel_type)
eval_10 = EvaluateCurve(Curve=reparameterize(ln_9), Parameter="0.5")  # -> Point, Tangent, Angle
panel_13 = Panel(concat_10)
Z_21 = UnitZ(Factor=label_height)
move_10 = Move(Geometry=eval_10.Point, Motion=Z_21)  # -> Geometry, Transform
ln_21 = Line(StartPoint=eval_10.Point, EndPoint=move_10.Geometry)
gate_19 = StreamGate(Stream=move_10.Geometry, Gate=show_info)  # -> Target0, Target1
gate_20 = StreamGate(Stream=ln_21, Gate=show_info)  # -> Target0, Target1
tag_10 = TextTag3D(Location=gate_19.Target1, Text=panel_13, Size=number_slider, Colour=swatch, Justification=5)
preview_10 = CustomPreview(Geometry=gate_20.Target1, Material=swatch)

merge = Merge(
    Data1=pt_21,
    Data2=pt_22,
    Data3=pt_5,
    Data4=pt_6,
    Data5=pt_9,
    Data6=pt_10,
    Data7=pt_7,
    Data8=pt_8,
    Data9=pt_15,
    Data10=pt_16,
    Data11=pt_12,
    Data12=pt_11,
    Data13=pt_19,
    Data14=pt_20)
cullduppoints = RemoveDuplicatePoints(InputPoints=merge, Tolerance=0.001)  # -> OutputPoints, FirstPointIndexes
pline = PolyLine(Vertices=cullduppoints.OutputPoints, Closed=True)
boundary = BoundarySurfaces(Edges=pline)

concat_11 = Concatenate(FragmentA=dejson_4.Apartment, FragmentB=dejson_4.Room, FragmentE=dejson_4.Panel_type)
eval_11 = EvaluateCurve(Curve=reparameterize(ln), Parameter="0.5")  # -> Point, Tangent, Angle
panel_14 = Panel(concat_11)
Z_22 = UnitZ(Factor=Slider(10, range=0..30))
move_11 = Move(Geometry=eval_11.Point, Motion=Z_22)  # -> Geometry, Transform
ln_22 = Line(StartPoint=eval_11.Point, EndPoint=move_11.Geometry)

gate_21 = StreamGate(Stream=move_11.Geometry, Gate=show_info)  # -> Target0, Target1
gate_22 = StreamGate(Stream=ln_22, Gate=show_info)  # -> Target0, Target1

tag_11 = TextTag3D(Location=gate_21.Target1, Text=panel_14, Size=number_slider, Colour=swatch, Justification=5)
preview_11 = CustomPreview(Geometry=gate_22.Target1, Material=swatch)
