# Grasshopper definition ReadJsonAndCreateGeometry_1python.gh (Grasshopper 1.0.7)
# plug-ins: Pufferfish, CORE.Toolbox.Grasshopper, Speckle 2

list = ValueList({"select single item (Wall panel)": 0, "select multiple items (Wall panel)": 1}, selected="select multiple items (Wall panel)")

# ---- group: KEMPS_JSON_test FILE
path = FilePath("C:\Users\panz\Documents\GitHub\IBC\05_Flooplan_processing_ve0_1\jsonExports\apartment.json")

# ----
select_item = Slider(19, range=0..46)
series = Series(Start=0, Step=1, Count=select_item)
filter = StreamFilter(Gate=list, Stream0=select_item, Stream1=series)
python = GhPythonScript(file=path, index=filter)  # -> out, PanelType, StartPoint, EndPoint, Height, Thickness, Room, Apartment, ApartmentOutline; inputs index: Int32
# ---------- python: Python ----------
__author__ = "panz"
__version__ = "2024.11.11"

import rhinoscriptsyntax as rs
import json
import json



# Read and parse JSON data from the file
with open(file, 'r') as inputfile:
    data = json.load(inputfile)

# Now 'data' contains the JSON data as a Python dictionary
#print(data)  # Prints the entire JSON data

# Example: Accessing a specific panel
first_panel = data['panels']['items']['0']
print(first_panel)


# Example: Accessing start point of a specific panel
start_point = first_panel['start_point']
print("Start point of first panel:", start_point)

# Example: Accessing panels in living
roomType = first_panel['room']
print("panel belongs to:", roomType)


# Extract panel information
panels = data["panels"]["items"]

# Initialize lists to store data for Grasshopper output
panel_types = []
start_points = []
end_points = []
heights = []
thicknesses = []
rooms = []
apartments = []
apartmentOutlines = []
# Loop through each panel and extract relevant information
for key, panel in panels.items():
    panel_types.append(panel.get("panel_type"))
    start_points.append(panel.get("start_point"))
    end_points.append(panel.get("end_point"))
    heights.append(panel.get("height"))
    thicknesses.append(panel.get("thickness"))
    rooms.append(panel.get("room"))
    apartments.append(panel.get("apartment", "N/A"))  # Default to "N/A" if no apartment info

for key, panel in panels.items():
    if (panel.get("room") == "living_room"):
        print(start_point)
        apartmentOutlines.append(panel.get("start_point"))
        apartmentOutlines.append(panel.get("end_point"))
        
        
print (apartmentOutlines)







# Output to Grasshopper (assign these lists to the component outputs)
PanelType = panel_types[index]
StartPoint = start_points[index]
EndPoint = end_points[index]
Height = heights[index]
Thickness = thicknesses[index]
Room = rooms[index]
Apartment = apartments[index]
ApartmentOutline = apartmentOutlines


print("apartment :", Apartment)
# ---------- end python ----------

label_height = Slider(3, range=0..30)
swatch = ColourSwatch(SwatchColor=RGB(3, 3, 3))
number_slider = Slider(0.165, range=0..50)
show_info = BooleanToggle(True)

addition = Addition(A=label_height, B=3)
dom = ConstructDomain(DomainStart=label_height, DomainEnd=addition)

item = ListItem(List=python.EndPoint, Index=0, Wrap=True)  # -> Item, Item1, Item2
item_2 = ListItem(List=python.StartPoint, Index=0, Wrap=True)  # -> Item, Item1, Item2
pt = ConstructPoint(XCoordinate=item.Item, YCoordinate=item.Item1, ZCoordinate=item.Item2)
pt_2 = ConstructPoint(XCoordinate=item_2.Item, YCoordinate=item_2.Item1, ZCoordinate=item_2.Item2)
division = Division(A=python.Thickness, B=2)
ln = Line(StartPoint=pt_2, EndPoint=pt)
Z = UnitZ(Factor=python.Height)
offcrv = OffsetCurve(Curve=ln, Plane=PlaneXY(0, 0, 0), Distance=graft(division), BothSides=True, Kinks=0, CapType=1)
extr = Extrude(Base=offcrv, Direction=graft(Z))

panel = Panel(python.Room)
item_3 = ListItem(List=panel, Index=Slider(2, range=0..20), Wrap=True)
tmatch = MatchText(Text=python.Room, Pattern=item_3, Case=True)
cull = CullPattern(List=flatten(pt_2), CullPattern=tmatch)
dup_pts = CleanDuplicatePoints(Points=cull, Tolerance=0.01)  # -> Points, Indices, Status
pt_3 = Point(dup_pts.Points)
pdecon = Deconstruct(Point=pt_3)  # -> XComponent, YComponent, ZComponent
lng = ListLength(List=pt_3)
ma = MassAddition(Input=pdecon.XComponent)  # -> Result, PartialResults
ma_2 = MassAddition(Input=pdecon.YComponent)  # -> Result, PartialResults
ma_3 = MassAddition(Input=pdecon.ZComponent)  # -> Result, PartialResults
division_2 = Division(A=ma.Result, B=lng)
division_3 = Division(A=ma_2.Result, B=lng)
division_4 = Division(A=ma_3.Result, B=lng)
pt_4 = ConstructPoint(XCoordinate=division_2, YCoordinate=division_3, ZCoordinate=division_4)
python_2 = PythonScript(Points=pt_3, Center=pt_4)  # -> SortedPoints, Plane; inputs Points: list
# ---------- python_2: Python ----------
import Rhino as rc

def sortPointsAroundCenter(pts,center):
    
    """ Sort a list of points radially around a center """
    
    # Make plane through points and set its origin
    test,plane = rc.Geometry.Plane.FitPlaneToPoints(pts)
    plane.Origin = center
    
    # Calculate vectors from center to points
    vecs = [pt - center for pt in pts]
    
    # Calculate angles between vectors and plane X-axis
    angles = [rc.Geometry.Vector3d.VectorAngle(plane.XAxis,v,plane) for v in vecs]
    
    # Sort points by angles
    sortedBoth = sorted(zip(angles,pts))
    sortedPts = [l[1] for l in sortedBoth]
    
    return sortedPts,plane
    

if Points and Center:
    
    SortedPoints,Plane = sortPointsAroundCenter(Points,Center)
    
    print
# ---------- end python_2 ----------
pline = PolyLine(Vertices=python_2.SortedPoints, Closed=True)
boundary = BoundarySurfaces(Edges=pline)

panel_2 = Panel(python.Apartment)
item_4 = ListItem(List=panel_2, Index=0, Wrap=True)
tmatch_2 = MatchText(Text=python.Apartment, Pattern=item_4, Case=True)
cull_2 = CullPattern(List=pt, CullPattern=tmatch_2)
cull_3 = CullPattern(List=pt_2, CullPattern=tmatch_2)
dup_pts_2 = CleanDuplicatePoints(Points=flatten([cull_2, cull_3]), Tolerance=0.01)  # -> Points, Indices, Status
sort_pt = SortPoints(Points=dup_pts_2.Points)  # -> Points, Indices
pline_2 = PolyLine(Vertices=flatten(sort_pt.Points), Closed=True)
boundary_2 = BoundarySurfaces(Edges=pline_2)

cap = CapHoles(Brep=extr)
wall = Wall(
    Height=python.Height,
    BaseLine=ln,
    Thickness=python.Thickness,
    SelectedConstructorName="Objects.BuiltElements.Wall.ctor(System.Double,Objects.ICurve,System.Collections.Generic.List`1[Speckle.Core.Models.Base])",
    SelectedTypeName="Objects.BuiltElements.Wall",
    UseSchemaTag=False,
    UserSetSchemaTag=False,
    seed="a3bcf4127012e3fe4be9")

# ----
# list of elements: 3d module
# 3d module
# Façade wall
# Load Bearing Facade  Wall
# Apartment Dividing Wall Horizontal
# Apartment Dividing Wall Vertical
# Room Divding Wall
# CLT Slab
# Beam
element_index = StreamFilter(Gate=0)  # disabled
merge = Merge()  # -> flatten(Result); disabled
speckle_id = Panel("2a663449ba")  # disabled
assembly_geometry_selector = StreamFilter(Gate=0, Stream0=merge, Stream1=merge)  # disabled
item_5 = ListItem(List=speckle_id, Index=element_index, Wrap=True)  # disabled
concat = Concatenate(FragmentB=item_5)  # disabled
panel_3 = Panel(concat)  # disabled

label_height_2 = Slider(10, range=0..30)
list_2 = Accounts(
    {"No account selected": , "Account (panz@zhaw.ch | https://app.speckle.systems)": "https://app.speckle.systems/?id=7b59e40123", "Account (vague@topotheque.com | https://app.speckle.systems)": "https://app.speckle.systems/?id=d442476304"}, selected="Account (panz@zhaw.ch | https://app.speckle.systems)",
    FirstSelectedItem="https://app.speckle.systems/?id=7b59e40123")
panel_4 = Panel("https://app.speckle.systems/projects/b9d01cae98/models/2a663449ba")

# ----
# CLICK TO SELECT AND
# SEND ASSEMBLIES TO SPECKLE
message = Panel("testing export walls")
sget = StreamGet(StreamIDURL=panel_4, SpeckleAccount=list_2)
send = Send(
    Stream=sget,
    Message=message,
    Data=wall,
    AutoSend=False,
    BaseId="77770778528598a5b9dccaa1eb906df5",
    CurrentComponentState="up_to_date",
    KitName="Objects",
    OutputWrappers="https://app.speckle.systems\tb9d01cae98\t0dd601a118",
    UseDefaultCache=True,
    selectedKitName="Objects")

slist = StreamList(SpeckleAccount=list_2, Limit=10)
speckle_id_2 = Panel(slist)

concat_2 = Concatenate(FragmentA=python.Apartment, FragmentB=python.Room, FragmentE=python.PanelType)
eval = EvaluateCurve(Curve=reparameterize(ln), Parameter="0.5")  # -> Point, Tangent, Angle
panel_5 = Panel(concat_2)

lng_2 = ListLength(List=eval.Point)
random = Random(Range=dom, Number=lng_2, Seed=2)

Z_2 = UnitZ(Factor=random)
move = Move(Geometry=eval.Point, Motion=Z_2)  # -> Geometry, Transform
ln_2 = Line(StartPoint=eval.Point, EndPoint=move.Geometry)
gate = StreamGate(Stream=ln_2, Gate=show_info)  # -> Target0, Target1
gate_2 = StreamGate(Stream=move.Geometry, Gate=show_info)  # -> Target0, Target1
preview = CustomPreview(Geometry=gate.Target1, Material=swatch)
tag = TextTag3D(Location=gate_2.Target1, Text=graft(panel_5), Size=number_slider, Colour=swatch, Justification=8)

area = Area(Geometry=boundary)  # -> Area, Centroid
concat_3 = Concatenate(FragmentA=python.Apartment, FragmentB=python.Room, FragmentE=python.PanelType)
panel_6 = Panel(concat_3)
move_2 = Move(Geometry=area.Centroid, Motion=Z_2)  # -> Geometry, Transform
swatch_2 = ColourSwatch(SwatchColor=RGB(255, 0, 0))
ln_3 = Line(StartPoint=area.Centroid, EndPoint=move_2.Geometry)
gate_3 = StreamGate(Stream=ln_3, Gate=show_info)  # -> Target0, Target1
gate_4 = StreamGate(Stream=move_2.Geometry, Gate=show_info)  # -> Target0, Target1
preview_2 = CustomPreview(Geometry=gate_3.Target1, Material=swatch_2)

concat_4 = Concatenate(FragmentA=item_3, FragmentC=":", FragmentB=area.Area, FragmentD="sqmt")

tag_2 = TextTag3D(Location=gate_4.Target1, Text=flatten(concat_4), Size=number_slider, Colour=swatch_2, Justification=8)
