# Grasshopper definition ReadJsonAndCreateGeometry_4python.gh (Grasshopper 1.0.8)
# plug-ins: RhinoCodePluginGH, Speckle 2, Pufferfish, Human

select_reference_design = ValueList({"reference design 01": 0, "reference design 02": 1, "reference design 03": 2}, selected="reference design 02")
select_reference_apt = ValueList({"Apartment 1", "Apartment 2", "Apartment 3", "Apartment 4"}, selected="Apartment 1")

candidate_design = ValueList({"candidate 11001": 0, "candidate 12001": 1, "candidate 12005": 2, "candidate 12009": 3, "candidate 14007": 4, "candidate 14012": 5, "candidate 18003": 6, "candidate 21004": 7}, selected="candidate 14012")

# ----
# READ json
# with floorplan
panel = Panel("""candidate design 11001
candidate design 12001
candidate design 12005
candidate design 12009
candidate design 14007
candidate design 14012
candidate design 18003
candidate design 21004""")
path = FilePath("C:\Users\panz\Documents\GitHub\2025-AEC-Hackathon\json\GenericDesign_12001\12001.json")
path_2 = FilePath("C:\Users\panz\Documents\GitHub\2025-AEC-Hackathon\json\GenericDesign_11001\11001.json")
path_3 = FilePath("C:\Users\panz\Documents\GitHub\2025-AEC-Hackathon\json\GenericDesign_12005\12005.json")
path_4 = FilePath("C:\Users\panz\Documents\GitHub\2025-AEC-Hackathon\json\GenericDesign_14012\14012.json")
path_5 = FilePath("C:\Users\panz\Documents\GitHub\2025-AEC-Hackathon\json\GenericDesign_12009\12009.json")
path_6 = FilePath("C:\Users\panz\Documents\GitHub\2025-AEC-Hackathon\json\GenericDesign_14007\14007.json")
path_7 = FilePath("C:\Users\panz\Documents\GitHub\2025-AEC-Hackathon\json\GenericDesign_18003\18003.json")
path_8 = FilePath("C:\Users\panz\Documents\GitHub\2025-AEC-Hackathon\json\GenericDesign_21004\21004.json")
filter = StreamFilter(
    Gate=candidate_design,
    Stream0=path_2,
    Stream1=path,
    Stream2=path_3,
    Stream3=path_5,
    Stream4=path_6,
    Stream5=path_4,
    Stream6=path_7,
    Stream7=path_8)
python = GhPythonScript(file=filter)  # -> out, apartmentNames, roomTypes, roomPolylines, roomSurfaces, roomColors, adjacencies
# ---------- python: Python ----------
__author__ = "panz"
__version__ = "2024.11.11"

import rhinoscriptsyntax as rs
import json
import json
import Rhino.Geometry as rg

# Read and parse JSON data from the file
with open(file, 'r') as inputfile:
    data = json.load(inputfile)

# Extract panels (walls) data
panels_data = data.get("panels", {}).get("items", {})
if not panels_data:
    print("Warning: 'panels.items' key is missing or empty in JSON.")
    
    


# Extract apartment outlines from 'spaces'
spaces_data = data.get("spaces", {})
roomOutlines = []
roomPolylines =[]
apartmentNames = []
roomTypes = []
roomColors = []
roomSurfaces = []

for space_id, space in spaces_data.items():
    coordinates = space.get("coordinates")
    roomTypes.append(space.get("room_type"))
    apartmentNames.append(space.get("apartment"))
    outline_points = [[point["x"], point["y"], point["z"]] for point in coordinates]
    roomOutlines.append(outline_points)
print (len(roomOutlines))


roomType = "bathroom"

#get adjacencies
adjacencies =[]
#adjacency_data =data.get("room_adjacency").get(roomType)
adjacency_data =data.get("room_adjacency")
adjacencies = adjacency_data
print (adjacency_data) 



roomCounter = 0 
for index in range (0, len(spaces_data)):
    roomOutline = roomOutlines[index] 
    
    # Convert the point lists into Rhino Point3d objects
    polyline_points = [rg.Point3d(point[0], point[1], point[2]) for point in roomOutline]
    # Create the polyline using the list of Point3d objects
    polyline = rg.Polyline(polyline_points)
    
    
    #assign colors based on roomput
    if (roomTypes[index] == "living_room"):
        roomColors.append('255,100,0')
    elif (roomTypes[index] == "bedroom"):
        roomColors.append('153,137,255')
    elif (roomTypes[index] == "kitchen"):
        roomColors.append('0,0,220')
    elif (roomTypes[index] == "bathroom"):
        roomColors.append('151,255,255')
    elif (roomTypes[index] == "core"):
        roomColors.append('150,150,150')
        
    # create a surface
    roomSrfs = rg.Brep.CreatePlanarBreps(polyline.ToNurbsCurve())
    roomSurfaces.append(roomSrfs[0])
    # Ensure the polyline is closed if necessary (optional)
    if not polyline.IsClosed:
        polyline.Add(polyline[0])  # Add the first point to close the polyline
    # Output the polyline (e.g., to Grasshopper)
    roomPolylines.append(polyline)
    roomCounter +=1 
    #print ("created", roomCounter, "space polylines")
    #print(roomSurfaces)
# ---------- end python ----------
panel_2 = Panel(python.roomTypes)
area = Area(Geometry=python.roomSurfaces)  # -> Area, Centroid
tag = TextTag(Location=area.Centroid, Text=panel_2)

path_9 = FilePath("C:\Users\panz\Documents\GitHub\2025-AEC-Hackathon\json\ReferenceDesign_01\Reference01.json")
path_10 = FilePath("C:\Users\panz\Documents\GitHub\IBC\05_Flooplan_processing\jsonExports\ReferenceDesign_02\ReferenceDesign_02_EP_bom.json")
filter_2 = StreamFilter(Gate=select_reference_design, Stream0=path_9, Stream1=path_10)
list_of_implenia_design = Panel("""reference design 01
reference design 02
reference design 03""")
python_2 = GhPythonScript(file=filter_2)  # -> out, apartmentNames, roomTypes, roomPolylines, roomSurfaces, roomColors, adjacencies; same code as python
replace_nulls = ReplaceNulls(Items=python_2.apartmentNames, Replacements="Core")  # -> Items, Count
panel_3 = Panel(replace_nulls.Items)

list_item = ListItem(List=list_of_implenia_design, Index=select_reference_design, Wrap=True)

# ---- group: sanity check
select_input_to_compare = ValueList({"candidate designs": 0, "reference designs": 1}, selected="candidate designs")
list_item_2 = ListItem(List=panel, Index=candidate_design, Wrap=True)
filter_3 = StreamFilter(Gate=select_input_to_compare, Stream0=list_item_2, Stream1=list_item)
filter_4 = StreamFilter(Gate=select_input_to_compare, Stream0=filter, Stream1=filter_2)
panel_4 = Panel(filter_3)

# ----
# Save one image
view_to_capture = Panel("Parallel_01")
panel_5 = Panel("C:\Users\panz\Implenia AG\Innosuisse - Intelligent Configurator - Dokumente\04_images_screenshots\")
view_to_capture_2 = Panel("1080")
view_to_capture_3 = Panel("1920")
concat = Concatenate(FragmentA=list_item_2)
save_image = Button()
captureview = LBCaptureView(
    file_name=concat,
    folder=panel_5,
    viewport=view_to_capture,
    width=view_to_capture_3,
    height=view_to_capture_2,
    capture=save_image)  # -> Output; plug-in component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
panel_6 = Panel(captureview)

path_11 = FilePath(filter_4)

# ----
# TO DO fix the panel index
# GET WALL PROPERTIES
list = ValueList({"select single item (Wall panel)": 0, "select multiple items (Wall panel)": 1}, selected="select multiple items (Wall panel)")
select_item = Slider(35, range=0..76)
panel_7 = Panel(path_11)
series = Series(Start=0, Step=1, Count=select_item)
filter_5 = StreamFilter(Gate=list, Stream0=select_item, Stream1=series)
python_3 = GhPythonScript(file=path_11, panelIndex=filter_5)  # -> out, PanelType, StartPoint, EndPoint, Height, Thickness, RoomType, ApartmentName; inputs panelIndex: Int32
# ---------- python_3: Python ----------
__author__ = "panz"
__version__ = "2024.11.11"

import rhinoscriptsyntax as rs
import json
import json
import Rhino.Geometry as rg

# Read and parse JSON data from the file
with open(file, 'r') as inputfile:
    data = json.load(inputfile)

# Extract panel information
panels = data["panels"]["items"]
if not panels:
    print("Warning: 'panels.items' key is missing or empty in JSON.")
    
# Extract apartment outlines from 'spaces'
spaces_data = data.get("spaces", {})


# Initialize lists to store panel data
panel_types = []
start_points = []
end_points = []
heights = []
thicknesses = []
roomTypes = []
apartmentNames = []



# Loop through each panel and extract relevant information
for key, panel in panels.items():
    panel_types.append(panel.get("panel_type"))
    start_points.append(panel.get("start_point"))
    end_points.append(panel.get("end_point"))
    heights.append(panel.get("height"))
    thicknesses.append(panel.get("thickness"))
    roomTypes.append(panel.get("room"))
    apartmentNames.append(panel.get("apartment", "N/A"))          # Default: "N/A"


# Assume 'index' is passed as an argument (in a Grasshopper environment, for example)

PanelType = panel_types[panelIndex]
StartPoint = start_points[panelIndex]
EndPoint = end_points[panelIndex]
Height = heights[panelIndex]
Thickness = thicknesses[panelIndex]
RoomType = roomTypes[panelIndex]
ApartmentName = apartmentNames[panelIndex]



print("Panel Type:", PanelType)
print("Start Point:", StartPoint)
print("End Point:", EndPoint)
print("Height:", Height)
print("Thickness:", Thickness)
print("Room Type:", RoomType)
print("Apartment:", ApartmentName)
# ---------- end python_3 ----------

# ---- group: older version
python_4 = GhPythonScript(file=path_11)  # -> out, apartmentNames, roomTypes, roomPolylines, roomSurfaces, roomColors, roomCombos; disabled
# ---------- python_4: Python ----------
__author__ = "panz"
__version__ = "2024.11.11"

import rhinoscriptsyntax as rs
import json
import json
import Rhino.Geometry as rg

# Read and parse JSON data from the file
with open(file, 'r') as inputfile:
    data = json.load(inputfile)

# Extract panels (walls) data
panels_data = data.get("panels", {}).get("items", {})
if not panels_data:
    print("Warning: 'panels.items' key is missing or empty in JSON.")
    
# Extract apartment outlines from 'spaces'
spaces_data = data.get("spaces", {})
roomOutlines = []
roomPolylines =[]
apartmentNames = []
roomTypes = []
roomColors = []
roomSurfaces = []
roomCombos = []

for space_id, space in spaces_data.items():
    coordinates = space.get("coordinates")
    roomTypes.append(space.get("room_type"))
    apartmentNames.append(space.get("apartment"))
    outline_points = [[point["x"], point["y"], point["z"]] for point in coordinates]
    roomOutlines.append(outline_points)
print ("there are ", len(roomOutlines), "rooms in the json file")

roomCounter = 0 

for index in range (0, len(spaces_data)):
    roomOutline = roomOutlines[index] 
    # Convert the point lists into Rhino Point3d objects
    polyline_points = [rg.Point3d(point[0], point[1], point[2]) for point in roomOutline]
    
    # Create the polyline using the list of Point3d objects
    polyline = rg.Polyline(polyline_points)
    #assign colors based on room type
    print(roomTypes[index])
    if (roomTypes[index] == "living_room"):
        roomColors.append('255,100,0')
    elif (roomTypes[index] == "bedroom"):
        roomColors.append('153,137,255')
    elif (roomTypes[index] == "kitchen"):
        print ("got here")
        roomColors.append('0,0,220')
        roomCombos.append(polyline)
    elif (roomTypes[index] == "corridor"):
        print ("got here")
        roomColors.append('0,150,200')
        roomCombos.append(polyline)
    elif (roomTypes[index] == "bathroom"):
        print ("got here")
        roomColors.append('151,255,255')
        roomCombos.append(polyline)
    elif (roomTypes[index] == "core"):
        roomColors.append('150,150,150')

    # create a surface
    roomSrfs = rg.Brep.CreatePlanarBreps(polyline.ToNurbsCurve())
    roomSurfaces.append(roomSrfs[0])
    # Ensure the polyline is closed if necessary (optional)
    if not polyline.IsClosed:
        polyline.Add(polyline[0])  # Add the first point to close the polyline
        
    # Output the polyline (e.g., to Grasshopper)
    roomPolylines.append(polyline)
    roomCounter +=1 
    

    print ("created", roomCounter, "space polylines")
    print(roomSurfaces)
# ---------- end python_4 ----------

# ----
# GET  spaces, and Generate
# bounding rectangles
python_3_script = Python3Script(file=path_11)  # -> out, apartmentNames, roomTypes, roomPolylines, roomSurfaces, roomColors, possibleBoundingRect
# ---------- python_3_script: Python ----------
"""Grasshopper Script"""
a = "Hello Python 3 in Grasshopper!"
__author__ = "panz"
__version__ = "2024.11.11"

import rhinoscriptsyntax as rs
import json
import Rhino.Geometry as rg

# Read and parse JSON data from the file
with open(file, 'r') as inputfile:
    data = json.load(inputfile)

# Extract panels (walls) data
panels_data = data.get("panels", {}).get("items", {})
if not panels_data:
    print("Warning: 'panels.items' key is missing or empty in JSON.")
    
# Extract apartment outlines from 'spaces'
spaces_data = data.get("spaces", {})
roomOutlines = []
roomPolylines = []
apartmentNames = []
roomTypes = []
roomColors = []
roomSurfaces = []
possibleBoundingRect = []

for space_id, space in spaces_data.items():
    coordinates = space.get("coordinates")
    roomTypes.append(space.get("room_type"))
    apartmentNames.append(space.get("apartment"))
    outline_points = [[point["x"], point["y"], point["z"]] for point in coordinates]
    roomOutlines.append(outline_points)

print("There are", len(roomOutlines), "rooms in the JSON file")

roomCounter = 0 
#TO DO CALCULATE AREA OF APARMENT AND EXCLUDE CRVS THAT ARE LARGER THAN THAT
for index in range(len(spaces_data)):
    roomOutline = roomOutlines[index] 
    polyline_points = [rg.Point3d(point[0], point[1], point[2]) for point in roomOutline]
    polyline = rg.Polyline(polyline_points)

    # Assign colors and store rooms for bounding box calculation
    #TO DO FIX COLORING
    roomType = roomTypes[index]
    if roomType == "living_room":
        roomColors.append('255,100,0')
    elif roomType == "bedroom":
        roomColors.append('153,137,255')
    elif roomType in ["kitchen", "corridor", "bathroom"]:  # Selected room types
        print("Processing", roomType)
        roomColors.append({'kitchen': '0,0,220', 'corridor': '0,150,200', 'bathroom': '151,255,255'}[roomType])
        possibleBoundingRect.append(polyline)
    elif roomType == "core":
        roomColors.append('150,150,150')

    # Create a surface from the polyline
    roomSrfs = rg.Brep.CreatePlanarBreps(polyline.ToNurbsCurve())
    roomSurfaces.append(roomSrfs[0])

    # Ensure the polyline is closed
    if not polyline.IsClosed:
        polyline.Add(polyline[0])
        
    roomPolylines.append(polyline)
    roomCounter += 1 

print("Created", roomCounter, "space polylines")

# ==========================
# BOUNDING RECTANGLE LOGIC
# ==========================

def get_bounding_rectangle(polylines):
    """Finds the bounding box for a list of polylines."""
    all_points = []
    
    for polyline in polylines:
        all_points.extend(list(polyline)) 

    if not all_points:
        return None  # Avoid errors if list is empty

    # Find min/max X and Y
    min_x, max_x = min(pt.X for pt in all_points), max(pt.X for pt in all_points)
    min_y, max_y = min(pt.Y for pt in all_points), max(pt.Y for pt in all_points)

    # Define the rectangle corners
    corners = [
        rg.Point3d(min_x, min_y, 0),
        rg.Point3d(max_x, min_y, 0),
        rg.Point3d(max_x, max_y, 0),
        rg.Point3d(min_x, max_y, 0),
        rg.Point3d(min_x, min_y, 0)  # Closing the rectangle
    ]

    return rg.Polyline(corners)

possible_bounding_rects = []

# Compute bounding box for all selected rooms
bounding_rect = get_bounding_rectangle(possibleBoundingRect)
print("Bounding rectangle for all rooms:", bounding_rect)
possible_bounding_rects.append(bounding_rect)


# Compute bounding boxes for pairs of rooms
for i in range(len(possibleBoundingRect)):
    for j in range(i + 1, len(possibleBoundingRect)):
        pair_rect = get_bounding_rectangle([possibleBoundingRect[i], possibleBoundingRect[j]])
        if pair_rect:
            possible_bounding_rects.append(pair_rect)
possibleBoundingRect = possible_bounding_rects
print("Generated", len(possible_bounding_rects), "bounding rectangles for room pairs.")
# ---------- end python_3_script ----------
bounding_rectangle = BoundingRectangle(Geometry=python_3_script.roomPolylines, Plane=PlaneXY(0, 0, 0), Axis=0, Slide=0, Union=True)  # -> Bounding, DimensionX, DimensionY
panel_8 = Panel(python_3_script.apartmentNames)
panel_9 = Panel(python_3_script.out)
area_2 = Area(Geometry=bounding_rectangle.Bounding)  # -> Area, Centroid

item = ListItem(List=python_3.StartPoint, Index=0, Wrap=True)  # -> Item, Item1, Item2
item_2 = ListItem(List=python_3.EndPoint, Index=0, Wrap=True)  # -> Item, Item1, Item2
Z = UnitZ(Factor=python_3.Height)
pt = ConstructPoint(XCoordinate=item_2.Item, YCoordinate=item_2.Item1, ZCoordinate=item_2.Item2)
# TO DO add openings classification
# entrance door
# interior doors
# window
# passage-corridor
pt_2 = ConstructPoint(XCoordinate=item.Item, YCoordinate=item.Item1, ZCoordinate=item.Item2)
division = Division(A=python_3.Thickness, B=2)
ln = Line(StartPoint=pt_2, EndPoint=pt)
offcrv = OffsetCurve(Curve=ln, Plane=PlaneXY(0, 0, 0), Distance=graft(division), BothSides=True, Kinks=0, CapType=1)

point = Point(Point(-12791.16896, 11.99833375, 0))

# ---- group: Move and scale
scaling_factor = Panel("1000")
scale = Scale(Geometry=python_3_script.possibleBoundingRect, Center=area_2.Centroid, Factor=scaling_factor)  # -> Geometry, Transform
scale_2 = Scale(Geometry=python_3_script.roomSurfaces, Center=area_2.Centroid, Factor=scaling_factor)  # -> Geometry, Transform
scale_3 = Scale(Geometry=python_3_script.roomPolylines, Center=area_2.Centroid, Factor=scaling_factor)  # -> Geometry, Transform
move_to_point = MoveToPoint(Geometry=scale_3.Geometry, PointA=area_2.Centroid, PointB=point)  # -> Moved, Vector, Transform
move_to_point_2 = MoveToPoint(Geometry=scale_2.Geometry, PointA=area_2.Centroid, PointB=point)  # -> Moved, Vector, Transform
move_to_point_3 = MoveToPoint(Geometry=scale.Geometry, PointA=area_2.Centroid, PointB=point)  # -> Moved, Vector, Transform

# ----
point_2 = Point(Point(27478.25969, 13.60035537, 0))

# ---- group: visualize whole floorplan
crv = Curve(python_2.roomPolylines)
bounding_rectangle_2 = BoundingRectangle(Geometry=crv, Plane=PlaneXY(0, 0, 0), Axis=0, Slide=0, Union=True)  # -> Bounding, DimensionX, DimensionY
area_3 = Area(Geometry=bounding_rectangle_2.Bounding)  # -> Area, Centroid
scale_4 = Scale(Geometry=crv, Center=area_3.Centroid, Factor=scaling_factor)  # -> Geometry, Transform
move_to_point_4 = MoveToPoint(Geometry=scale_4.Geometry, PointA=area_3.Centroid, PointB=point_2)  # -> Moved, Vector, Transform
region_union = RegionUnion(Curves=move_to_point_4.Moved)

# ---- group: AREA
area_threshold_sqm = Slider(29, range=0..100)
max_length_threshold = Panel("14.00")
max_width_threshold = Panel("3.40")

# ---- group: seleect curves for one apt
match_text = MatchText(Text=panel_3, Pattern=select_reference_apt, Case=True)
cull_pattern = CullPattern(List=move_to_point_4.Moved, CullPattern=match_text)
region_union_2 = RegionUnion(Curves=cull_pattern)
curve = Curve(cull_pattern)
boundary_surfaces = BoundarySurfaces(Edges=region_union_2)

# ---- group: Remove bounding rectangles that completely not working
i_want_to_convert_to = ValueList({"1 - Microns (1.0e-6 meters)": 1, "2 - Millimeters (1.0e-3 meters)": 2, "3 - Centimeters (1.0e-2 meters)": 3, "4 - Meters": 4, "5 - Kilometers (1.0e+3 meters)": 5, "6 - Microinches (2.54e-8 meters, 1.0e-6 inches)": 6, "7 - Mils (2.54e-5 meters, 0.001 inches)": 7, "8 - Inches (0.0254 meters)": 8, "9 - Feet (0.3408 meters, 12 inches)": 9, "10 - Miles (1609.344 meters, 5280 feet)": 10}, selected="2 - Millimeters (1.0e-3 meters)")
my_model_is_in = ValueList({"1 - Microns (1.0e-6 meters)": 1, "2 - Millimeters (1.0e-3 meters)": 2, "3 - Centimeters (1.0e-2 meters)": 3, "4 - Meters": 4, "5 - Kilometers (1.0e+3 meters)": 5, "6 - Microinches (2.54e-8 meters, 1.0e-6 inches)": 6, "7 - Mils (2.54e-5 meters, 0.001 inches)": 7, "8 - Inches (0.0254 meters)": 8, "9 - Feet (0.3408 meters, 12 inches)": 9, "10 - Miles (1609.344 meters, 5280 feet)": 10}, selected="4 - Meters")
what_are_the_untis = ValueList({"Distance": 1, "Area": 2, "Volume": 3}, selected="Area")

i_want_to_convert_to_2 = ValueList({"1 - Microns (1.0e-6 meters)": 1, "2 - Millimeters (1.0e-3 meters)": 2, "3 - Centimeters (1.0e-2 meters)": 3, "4 - Meters": 4, "5 - Kilometers (1.0e+3 meters)": 5, "6 - Microinches (2.54e-8 meters, 1.0e-6 inches)": 6, "7 - Mils (2.54e-5 meters, 0.001 inches)": 7, "8 - Inches (0.0254 meters)": 8, "9 - Feet (0.3408 meters, 12 inches)": 9, "10 - Miles (1609.344 meters, 5280 feet)": 10}, selected="4 - Meters")
crv_2 = Curve(move_to_point_3.Moved)
my_model_is_in_2 = ValueList({"1 - Microns (1.0e-6 meters)": 1, "2 - Millimeters (1.0e-3 meters)": 2, "3 - Centimeters (1.0e-2 meters)": 3, "4 - Meters": 4, "5 - Kilometers (1.0e+3 meters)": 5, "6 - Microinches (2.54e-8 meters, 1.0e-6 inches)": 6, "7 - Mils (2.54e-5 meters, 0.001 inches)": 7, "8 - Inches (0.0254 meters)": 8, "9 - Feet (0.3408 meters, 12 inches)": 9, "10 - Miles (1609.344 meters, 5280 feet)": 10}, selected="2 - Millimeters (1.0e-3 meters)")
explode = Explode(Curve=crv_2, Recursive=True)  # -> Segments, Vertices
what_are_the_untis_2 = ValueList({"Distance": 1, "Area": 2, "Volume": 3}, selected="Distance")
bounds = Bounds(Numbers=explode.Segments)
deconstruct_domain = DeconstructDomain(Domain=bounds)  # -> Start, End
integer = Integer(area_threshold_sqm)
area_4 = Area(Geometry=crv_2)  # -> Area, Centroid
sysunits = GhPythonScript(N=deconstruct_domain.Start, unitsFrom=my_model_is_in_2, unitsTo=i_want_to_convert_to_2, mag=what_are_the_untis_2)  # -> message, R
# ---------- sysunits: Python ----------
__author__ = "michael.lee"
__version__ = "2019.05.29"

import rhinoscriptsyntax as rs
intModelUnits = rs.UnitSystem()

if (intModelUnits == 0):
    message = "No unit system is assigned"
elif (intModelUnits == 1 ):
    message = "Your model is in Microns (1.0e-6 meters)"
elif (intModelUnits == 2 ):
    message = "Your model is in Millimeters (1.0e-3 meters)"
elif (intModelUnits == 3 ):
    message ="Your model is in Centimeters (1.0e-2 meters)"
elif (intModelUnits == 4 ):
    message = "Your model is in Meters"
elif (intModelUnits == 5 ):
    message = "Your model is in Kilometers (1.0e+3 meters)"
elif (intModelUnits == 6 ):
    message = "Your model is in Microinches (2.54e-8 meters, 1.0e-6 inches)"
elif (intModelUnits == 7 ):
    message = "Yourmodel is in Mils (2.54e-5 meters, 0.001 inches)"
elif (intModelUnits == 8 ):
    message = "Your model is in Inches (0.0254 meters)"
elif (intModelUnits == 9 ):
    message = "Your model is in Feet (0.3408 meters, 12 inches)"
elif (intModelUnits == 10 ):
    message = "Your model is in Miles (1609.344 meters, 5280 feet)"
else:
    message = "please check your inputs"



if (intModelUnits != unitsFrom ):
    message = "Caution! your model units are different from what you indicate, if this is in purpose you are good"
else:
    message = message + ". Converting units!"
    print(message)
    
if (N):
    R = N*pow(rs.UnitScale(unitsTo,unitsFrom),mag)

else:
    R = None
# ---------- end sysunits ----------
sysunits_2 = GhPythonScript(N=integer, unitsFrom=my_model_is_in, unitsTo=i_want_to_convert_to, mag=what_are_the_untis)  # -> message, R; same code as sysunits
sysunits_3 = GhPythonScript(N=deconstruct_domain.End, unitsFrom=my_model_is_in_2, unitsTo=i_want_to_convert_to_2, mag=what_are_the_untis_2)  # -> message, R; same code as sysunits
smaller_than = SmallerThan(FirstNumber=area_4.Area, SecondNumber=sysunits_2.R)  # -> SmallerThan, OrEqualTo
smaller_than_2 = SmallerThan(FirstNumber=sysunits.R, SecondNumber=max_width_threshold)  # -> SmallerThan, OrEqualTo
smaller_than_3 = SmallerThan(FirstNumber=sysunits_3.R, SecondNumber=max_length_threshold)  # -> SmallerThan, OrEqualTo
gate_or = GateOr(A=smaller_than_2.SmallerThan, B=smaller_than_3.SmallerThan)  # -> flatten(Result)
gate_and = GateAnd(A=smaller_than.SmallerThan, B=gate_or)
cull_pattern_2 = CullPattern(List=crv_2, CullPattern=gate_and)

# ----
i_want_to_convert_to_3 = ValueList({"1 - Microns (1.0e-6 meters)": 1, "2 - Millimeters (1.0e-3 meters)": 2, "3 - Centimeters (1.0e-2 meters)": 3, "4 - Meters": 4, "5 - Kilometers (1.0e+3 meters)": 5, "6 - Microinches (2.54e-8 meters, 1.0e-6 inches)": 6, "7 - Mils (2.54e-5 meters, 0.001 inches)": 7, "8 - Inches (0.0254 meters)": 8, "9 - Feet (0.3408 meters, 12 inches)": 9, "10 - Miles (1609.344 meters, 5280 feet)": 10}, selected="4 - Meters")
my_model_is_in_3 = ValueList({"1 - Microns (1.0e-6 meters)": 1, "2 - Millimeters (1.0e-3 meters)": 2, "3 - Centimeters (1.0e-2 meters)": 3, "4 - Meters": 4, "5 - Kilometers (1.0e+3 meters)": 5, "6 - Microinches (2.54e-8 meters, 1.0e-6 inches)": 6, "7 - Mils (2.54e-5 meters, 0.001 inches)": 7, "8 - Inches (0.0254 meters)": 8, "9 - Feet (0.3408 meters, 12 inches)": 9, "10 - Miles (1609.344 meters, 5280 feet)": 10}, selected="2 - Millimeters (1.0e-3 meters)")
what_are_the_untis_3 = ValueList({"Distance": 1, "Area": 2, "Volume": 3}, selected="Area")

show_room_labels = BooleanToggle(True)
room_label_size = Slider(191, range=0..250)
room_labler_color = ColourSwatch(SwatchColor=RGB(87, 87, 87))
room_label_height = Slider(1530, range=0..1530)

# ---- group: 3d module
path_12 = FilePath("C:\Users\panz\Documents\GitHub\IBC\05_Flooplan_processing\jsonExports\3dmodules_json\3d_module_BigAptA.json")

# ----
panel_10 = Panel(python_2.roomTypes)
curve_2 = Curve(curve)
panel_11 = Panel("""bathroom
corridor
kitchen""")
cull_pattern_3 = CullPattern(List=panel_10, CullPattern=match_text)
match_text_2 = MatchText(Text=cull_pattern_3, Pattern=graft(panel_11), Case=True)
cull_pattern_4 = CullPattern(List=curve_2, CullPattern=match_text_2)
region_union_3 = RegionUnion(Curves=flatten(cull_pattern_4))

python_5 = GhPythonScript(file=path_12)  # -> out, apartmentNames, roomTypes, roomPolylines, roomSurfaces, roomColors
# ---------- python_5: Python ----------
__author__ = "panz"
__version__ = "2024.11.11"

import rhinoscriptsyntax as rs
import json
import json
import Rhino.Geometry as rg

# Read and parse JSON data from the file
with open(file, 'r') as inputfile:
    data = json.load(inputfile)

# Extract panels (walls) data
panels_data = data.get("panels", {}).get("items", {})
if not panels_data:
    print("Warning: 'panels.items' key is missing or empty in JSON.")
    
# Extract apartment outlines from 'spaces'
spaces_data = data.get("rooms", {})
roomOutlines = []
roomPolylines =[]
apartmentNames = []
roomTypes = []
roomColors = []
roomSurfaces = []

for space_id, space in spaces_data.items():
    coordinates = space.get("coordinates")
    roomTypes.append(space.get("room_type"))
    apartmentNames.append(space.get("apartment"))
    outline_points = [[point["x"], point["y"], point["z"]] for point in coordinates]
    roomOutlines.append(outline_points)
print (len(roomOutlines))


roomCounter = 0 
for index in range (0, len(spaces_data)):
    roomOutline = roomOutlines[index] 
    
    # Convert the point lists into Rhino Point3d objects
    polyline_points = [rg.Point3d(point[0], point[1], point[2]) for point in roomOutline]
    # Create the polyline using the list of Point3d objects
    polyline = rg.Polyline(polyline_points)
    
    
    #assign colors based on roomput
    if (roomTypes[index] == "living_room"):
        roomColors.append('255,100,0')
    elif (roomTypes[index] == "bedroom"):
        roomColors.append('153,137,255')
    elif (roomTypes[index] == "kitchen"):
        roomColors.append('0,0,220')
    elif (roomTypes[index] == "bathroom"):
        roomColors.append('151,255,255')
    elif (roomTypes[index] == "core"):
        roomColors.append('150,150,150')
        
    # create a surface
    roomSrfs = rg.Brep.CreatePlanarBreps(polyline.ToNurbsCurve())
    roomSurfaces.append(roomSrfs[0])
    # Ensure the polyline is closed if necessary (optional)
    if not polyline.IsClosed:
        polyline.Add(polyline[0])  # Add the first point to close the polyline
    # Output the polyline (e.g., to Grasshopper)
    roomPolylines.append(polyline)
    roomCounter +=1 
    print ("created", roomCounter, "space polylines")
    print(roomSurfaces)
# ---------- end python_5 ----------
crv_3 = Curve(python_5.roomPolylines)
brep = Brep(python_5.roomSurfaces)

# ----
# 3d_module json
panel_12 = Panel(path_12)
panel_13 = Panel(python_5.apartmentNames)
bounding_rectangle_3 = BoundingRectangle(Geometry=crv_3, Plane=PlaneXY(0, 0, 0), Axis=0, Slide=0, Union=True)  # -> Bounding, DimensionX, DimensionY

area_5 = Area(Geometry=bounding_rectangle_3.Bounding)  # -> Area, Centroid
scale_5 = Scale(Geometry=bounding_rectangle_3.Bounding, Center=area_5.Centroid, Factor=scaling_factor)  # -> Geometry, Transform

crv_4 = Curve(cull_pattern_2)
merge = Merge(Data1=crv_4)  # -> flatten(Result)
curve_3 = Curve(scale_5.Geometry)

crv_5 = Curve(crv_2)
length = Length(Curve=crv_5)
bounds_2 = Bounds(Numbers=length)
deconstruct_domain_2 = DeconstructDomain(Domain=bounds_2)  # -> Start, End
gradient = Gradient(
    LowerLimit=deconstruct_domain_2.Start,
    UpperLimit=deconstruct_domain_2.End,
    Parameter=length,
    stops=[0: RGB(0, 255, 0), 1: RGB(220, 0, 40)])
previewlw = CustomPreviewLineweights(Geometry=crv_5, Shader=gradient, Thickness=Slider(2.387, range=0..8), Absolute=False)

# ---- group: compare different bounding boxes with the bounding rectangle
# compare and give a similarity score
python_3_script_2 = Python3Script(inputBounding=merge, refBounding=curve_3)  # -> out, output_rectangles, output_colors, output_scores; inputs inputBounding: list of Polyline, refBounding: Polyline
# ---------- python_3_script_2: Python ----------
import Rhino.Geometry as rg
import rhinoscriptsyntax as rs
import System.Drawing as sd

def get_dimensions(rect):
    """Extracts width, height, area, perimeter, and aspect ratio from a rectangle."""
    if not rect or len(rect) != 5:  # A valid closed rectangle has 5 points (4 for the rectangle + 1 for closure)
        print(f"Invalid rectangle: Rect has fewer or more than 5 points. Rect points: {rect}")  # Debugging message
        return None

    # Calculate the width and height from the polyline
    width = abs(rect[1].X - rect[0].X)
    height = abs(rect[2].Y - rect[1].Y)
    area = width * height
    perimeter = 2 * (width + height)
    aspect_ratio = width / height if height != 0 else 1  # Avoid division by zero
    
    # Debugging: Print the dimensions
    print(f"Rectangle dimensions - Width: {width}, Height: {height}, Area: {area}, Perimeter: {perimeter}, Aspect Ratio: {aspect_ratio}")
    
    return width, height, area, perimeter, aspect_ratio

def compare_rectangles(rect1, rect2, shape_weight=0.4, length_weight=0.3, area_weight=0.3):
    """
    Compares two rectangles based on shape (aspect ratio), perimeter, and area.
    Returns a similarity score between 0 and 1.
    """
    dims1 = get_dimensions(rect1)
    dims2 = get_dimensions(rect2)

    if not dims1 or not dims2:
        print("Invalid dimensions for comparison.")
        return 0  # Invalid rectangles, return lowest score

    width1, height1, area1, perimeter1, aspect_ratio1 = dims1
    width2, height2, area2, perimeter2, aspect_ratio2 = dims2

    # Shape Similarity (Aspect Ratio Comparison)
    shape_score = 1 - abs(aspect_ratio1 - aspect_ratio2) / max(aspect_ratio1, aspect_ratio2)
    print(f"Shape Score: {shape_score}")  # Debugging: Print shape score

    # Length Similarity (Perimeter Comparison)
    length_score = 1 - abs(perimeter1 - perimeter2) / max(perimeter1, perimeter2)
    print(f"Length Score: {length_score}")  # Debugging: Print length score

    # Area Similarity (Area Comparison)
    area_score = 1 - abs(area1 - area2) / max(area1, area2)
    print(f"Area Score: {area_score}")  # Debugging: Print area score

    # Weighted sum of scores
    final_score = (shape_score * shape_weight) + (length_score * length_weight) + (area_score * area_weight)

    # Debugging: Print final score
    print(f"Final Score: {final_score}")
    
    return round(final_score, 3)  # Round for better readability

def assign_color_based_on_score(score):
    """
    Assigns a color based on the similarity score.
    Returns a System.Drawing.Color object.
    """
    if score >= 0.9:
        return sd.Color.Green  # Very similar
    elif score >= 0.7:
        return sd.Color.Yellow  # Moderately similar
    else:
        return sd.Color.Red  # Not similar

def ensure_polyline_input(input_curve):
    """
    Ensures that the input is a valid Polyline object.
    If it's a Curve, it tries to coerce it into a Polyline object.
    """
    print(f"Ensuring input curve: {input_curve}")  # Debugging message
    # Check if it's already a Polyline
    if isinstance(input_curve, rg.Polyline):
        print(f"Input is already a valid Polyline: {input_curve}")  # Debugging message
        if input_curve.IsClosed:
            print("Polyline is closed.")  # Debugging message
        else:
            print("Polyline is not closed.")  # Debugging message
        return input_curve

    # Coerce the curve to a Polyline (if it's a valid curve)
    coerced_curve = rs.coercecurve(input_curve)
    if coerced_curve:
        if isinstance(coerced_curve, rg.Polyline):
            print(f"Coerced curve to Polyline: {coerced_curve}")  # Debugging message
            if coerced_curve.IsClosed:
                print("Coerced polyline is closed.")  # Debugging message
            else:
                print("Coerced polyline is not closed.")  # Debugging message
            return coerced_curve
        else:
            print("The coerced curve is not a Polyline.")  # Debugging message
    else:
        print("Curve coercion failed.")  # Debugging message
    return None

def main(possible_rects, ref_rect):
    # Ensure inputs are valid polylines by coercing curves
    valid_rects = []
    for rect in possible_rects:
        rect_polyline = ensure_polyline_input(rect)
        if rect_polyline:
            valid_rects.append(rect_polyline)
        else:
            print(f"Skipping invalid rectangle: {rect}")  # Debugging message

    # Ensure reference rectangle is a valid polyline
    ref_polyline = ensure_polyline_input(ref_rect)
    if not ref_polyline:
        print("Invalid reference rectangle.")
        return [], []  # Return empty lists if reference rectangle is invalid

    # Compare all valid rectangles with the reference rectangle
    scores = [compare_rectangles(rect, ref_polyline) for rect in valid_rects]

    # Output similarity scores and color code each rectangle based on its similarity score
    colored_rects = []
    for rect, score in zip(valid_rects, scores):
        # Assign color based on score
        color = assign_color_based_on_score(score)
        colored_rects.append((rect, color))  # Store the rectangle and its color

    # Output the rectangles and their corresponding colors

    output_rects = [rect for rect, color in colored_rects]
    output_colors = [color for rect, color in colored_rects]
    
    # Return both output_rects and output_colors for use in Grasshopper
    return scores, output_rects, output_colors

# The outputs in Grasshopper:
# Make sure you assign the outputs to variables like this:
output_scores, output_rectangles, output_colors = main(inputBounding, refBounding)


# Example call to the main function (replace with actual inputs in Grasshopper)
main(inputBounding, refBounding)
# ---------- end python_3_script_2 ----------
sort_list = SortList(
    Keys=python_3_script_2.output_scores,
    ValuesValuesA=python_3_script_2.output_rectangles,
    ValuesA=python_3_script_2.output_colors)  # -> reverse(Keys), reverse(ValuesValuesA), reverse(ValuesA)
similarity_score = Panel(python_3_script_2.output_scores)
previewlw_2 = CustomPreviewLineweights(
    Geometry=python_3_script_2.output_rectangles,
    Shader=python_3_script_2.output_colors,
    Thickness=Slider(8, range=0..8),
    Absolute=False)

# ----
panel_14 = Panel(panel_4)

# ---- group: visualize
geometry = ValueList({"Show bounding box": 0, "show detailed geometry": 1}, selected="show detailed geometry")
_3d_module_on_design = BooleanToggle(True)

# ----
# TO DO-LOAD GEOMETRIES FROM Speckle
# load all available objects in a list
# and select the one which matchen the Typename
panel_15 = Panel("https://speckle.xyz/projects/48b3051cfd/models/d8ac8f1b88")

# ---- group: change label color based on a threshold
score_threshold = Panel("0.8")
similarity_score_2 = Panel(python_3_script_2.output_scores)
score_label_color = ColourSwatch(SwatchColor=RGB(46, 46, 46))
smaller_than_4 = SmallerThan(FirstNumber=similarity_score_2, SecondNumber=score_threshold)  # -> SmallerThan, OrEqualTo
score_label_color_2 = ColourSwatch(SwatchColor=RGB(255, 0, 0))
stream_filter = StreamFilter(Gate=smaller_than_4.OrEqualTo, Stream0=score_label_color, Stream1=score_label_color_2)

# ----
curve_4 = Curve(region_union_3)
polygon_center = PolygonCenter(Polyline=curve_4)  # -> CenterV, CenterE, CenterA
_3d_module_height = Panel("3000")
unit_z = UnitZ(Factor=_3d_module_height)
extrude = Extrude(Base=curve_4, Direction=unit_z)
cap_holes = CapHoles(Brep=extrude)
preview = CustomPreview(Geometry=cap_holes, Material=ColourSwatch(SwatchColor=RGBA(255, 77, 77, 180)))

panel_16 = Panel(filter_3)
panel_17 = Panel(list_item)
concatenate = Concatenate(Fragment_A="Comparing:", Fragment_B=panel_16, A=" with ", B=panel_17)

# ----
# organize curves and surfaces  by apartment
select_reference_apt_2 = ValueList({"Apartment 1", "Apartment 2", "Apartment 3", "Apartment 4"}, selected="Apartment 1")
crv_6 = Curve(move_to_point.Moved)
brep_2 = Brep(move_to_point_2.Moved)

match_text_3 = MatchText(Text=panel_8, Pattern=select_reference_apt_2, Case=True)

cull_pattern_5 = CullPattern(List=crv_6, CullPattern=match_text_3)
cull_pattern_6 = CullPattern(List=brep_2, CullPattern=match_text_3)
cull_pattern_7 = CullPattern(List=python_3_script.roomTypes, CullPattern=match_text_3)
preview_2 = CustomPreview(Geometry=cull_pattern_6, Material=python_3_script.roomColors)

number_slider = Slider(4, range=0..5)  # disabled
series_2 = Series(Start=0, Step=1, Count=number_slider)  # disabled
item_3 = ListItem(List=cull_pattern_5, Index=series_2, Wrap=True)  # disabled
brec = BoundingRectangle(Geometry=item_3, Plane=PlaneXY(0, 0, 0), Axis=0, Slide=0, Union=True)  # -> Bounding, DimensionX, DimensionY; disabled
boundary = BoundarySurfaces(Edges=brec.Bounding)  # disabled
pull = PullCurve(Curve=item_3, Surface=boundary)  # disabled

# ---- group: sapce tags-candidate
area_6 = Area(Geometry=cull_pattern_5)  # -> Area, Centroid
sysunits_4 = GhPythonScript(N=area_6.Area, unitsFrom=my_model_is_in_3, unitsTo=i_want_to_convert_to_3, mag=what_are_the_untis_3)  # -> message, R; same code as sysunits
expression = Expression(x=sysunits_4.R, Expression="Format(\"{0:0.00}\",x)")
Z_2 = UnitZ(Factor=room_label_height)
move = Move(Geometry=area_6.Centroid, Motion=Z_2)  # -> Geometry, Transform
concat_2 = Concatenate(FragmentA=cull_pattern_7, FragmentC=":", FragmentB=expression, FragmentD=" m2")
ln_2 = Line(StartPoint=area_6.Centroid, EndPoint=move.Geometry)
gate = StreamGate(Stream=ln_2, Gate=show_room_labels)  # -> Target0, Target1
gate_2 = StreamGate(Stream=move.Geometry, Gate=show_room_labels)  # -> Target0, Target1
tag_2 = TextTag3D(Location=gate_2.Target1, Text=flatten(concat_2), Size=room_label_size, Colour=room_labler_color, Justification=5)
preview_3 = CustomPreview(Geometry=gate.Target1, Material=room_labler_color)

# ----
number_slider_2 = Slider(1, range=0..10)  # disabled
series_3 = Series(Start=0, Step=1, Count=number_slider_2)  # disabled
item_4 = ListItem(List=cull_pattern_5, Index=series_3, Wrap=True)  # disabled
explode_2 = Explode(Curve=item_4, Recursive=True)  # -> Segments, Vertices; disabled
strainghten_poly_lin = StrainghtenPolyLin(vec=explode_2.Segments, pt=explode_2.Vertices)  # disabled

swatch = ColourSwatch(SwatchColor=RGB(0, 247, 41))  # disabled
number_slider_3 = Slider(8, range=0..8)  # disabled
previewlw_3 = CustomPreviewLineweights(Geometry=strainghten_poly_lin, Shader=swatch, Thickness=number_slider_3, Absolute=False)  # disabled

previewlw_4 = CustomPreviewLineweights(Geometry=item_4, Shader=ColourSwatch(SwatchColor=RGB(247, 0, 0)), Thickness=Slider(8, range=0..8), Absolute=False)

# ---- group: space tages+_reference
panel_18 = Panel("500")
area_7 = Area(Geometry=curve_2)  # -> Area, Centroid
integer_2 = Integer(area_7.Area)
sysunits_5 = GhPythonScript(N=integer_2, unitsFrom=2, unitsTo=4, mag=2)  # -> message, R; same code as sysunits
panel_19 = Panel(list_item)
area_8 = Area(Geometry=boundary_surfaces)  # -> Area, Centroid
panel_20 = Panel(select_reference_apt)
Z_3 = UnitZ(Factor=room_label_height)
move_2 = Move(Geometry=area_7.Centroid, Motion=Z_3)  # -> Geometry, Transform
thickness = Slider(7, range=0..10)
ln_3 = Line(StartPoint=area_7.Centroid, EndPoint=move_2.Geometry)
concat_3 = Concatenate(FragmentA=panel_19, FragmentD=": ", FragmentE=panel_20)
gate_3 = StreamGate(Stream=ln_3, Gate=show_room_labels)  # -> Target0, Target1
gate_4 = StreamGate(Stream=move_2.Geometry, Gate=show_room_labels)  # -> Target0, Target1
custom_preview_lineweights = CustomPreviewLineweights(Geometry=region_union_2, Shader=ColourSwatch(SwatchColor=RGB(87, 87, 87)), Thickness=thickness, Absolute=False)
preview_4 = CustomPreview(Geometry=cull_pattern_6, Material=python_3_script.roomColors)
preview_5 = CustomPreview(Geometry=gate_3.Target1, Material=room_labler_color)
preview_6 = CustomPreview(Geometry=boundary_surfaces, Material=ColourSwatch(SwatchColor=RGB(153, 150, 150)))

# ----
addition = Addition(A=room_label_height, B=panel_18)
expression_2 = Expression(x=sysunits_5.R, Expression="Format(\"{0:0.00}\",x)")

# ---- group: space tages+_reference (continued)
Z_4 = UnitZ(Factor=addition)
move_3 = Move(Geometry=area_8.Centroid, Motion=Z_4)  # -> Geometry, Transform
ln_4 = Line(StartPoint=area_8.Centroid, EndPoint=move_3.Geometry)
gate_5 = StreamGate(Stream=move_3.Geometry, Gate=show_room_labels)  # -> Target0, Target1
gate_6 = StreamGate(Stream=ln_4, Gate=show_room_labels)  # -> Target0, Target1
concat_4 = Concatenate(FragmentA=cull_pattern_3, FragmentC=":", FragmentB=expression_2, FragmentD=" m2")
tag_3 = TextTag3D(Location=gate_5.Target1, Text=flatten(concat_3), Size=room_label_size, Colour=room_labler_color, Justification=5)
tag_4 = TextTag3D(Location=gate_4.Target1, Text=flatten(concat_4), Size=room_label_size, Colour=room_labler_color, Justification=5)
preview_7 = CustomPreview(Geometry=gate_6.Target1, Material=room_labler_color)

# ---- group: rotate module
area_9 = Area(Geometry=scale_5.Geometry)  # -> Area, Centroid
division_2 = Division(A=bounding_rectangle_3.DimensionX, B=bounding_rectangle_3.DimensionY)
panel_21 = Panel(division_2)

# ----
receive = Receive(
    Stream=panel_15,
    AutoReceive=False,
    CurrentComponentState="expired",
    ExpandOutput=True,
    LastInfoMessage="Evan Pantazis @ 11/19/2024 14:40:47: first assembly export (id:2d5ec2171e)",
    ReceiveOnOpen=False,
    ReceivedCommitId="2d5ec2171e",
    StreamWrapper="https://speckle.xyz/projects/48b3051cfd/models/3dmod_21_com",
    selectedKitName="Objects")  # -> Info, Data
list_item_3 = ListItem(List=receive.Data, Index=6, Wrap=True)
list_item_4 = ListItem(List=receive.Data, Index=0, Wrap=True)
bounding_rectangle_4 = BoundingRectangle(Geometry=list_item_4, Plane=PlaneXY(0, 0, 0), Axis=0, Slide=0, Union=True)  # -> Bounding, DimensionX, DimensionY
deconstruct_speckle_object = DeconstructSpeckleObject(SpeckleObject=list_item_3, selectedKitName="Objects")  # -> AcousticRequirements, EBKPh, Finshing, FireRating, FireRequirements_DE, HasElectricPipes, HasHeatingPipes, HasStiffeningFunction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

stream_filter_2 = StreamFilter(Gate=geometry, Stream0=cap_holes, Stream1=receive.Data)
stream_filter_3 = StreamFilter(Gate=geometry, Stream0=curve_4, Stream1=bounding_rectangle_4.Bounding)
stream_gate = StreamGate(Stream=stream_filter_2, Gate=_3d_module_on_design)  # -> Target0, Target1
stream_gate_2 = StreamGate(Stream=stream_filter_3, Gate=_3d_module_on_design)  # -> Target0, Target1

# ---- group: tags
select_no_of_top = Slider(1, range=0..4)
score_label_height = Slider(3503, range=0..7020)
show_score_labels = BooleanToggle(True)
score_label_size = Slider(584, range=0..600)
list_item_5 = ListItem(List=sort_list.Keys, Index=select_no_of_top, Wrap=True)
similarity_score_3 = Panel(list_item_5)
concat_5 = Concatenate(FragmentE="3d module fitting score", FragmentC=":", FragmentB=list_item_5)
Z_5 = UnitZ(Factor=score_label_height)
concat_6 = Concatenate(FragmentE=concat_5, FragmentC=concatenate)

# ----
list_item_6 = ListItem(List=sort_list.ValuesValuesA, Index=select_no_of_top, Wrap=True)
bounding_rectangle_5 = BoundingRectangle(Geometry=list_item_6, Plane=PlaneXY(0, 0, 0), Axis=0, Slide=0, Union=True)  # -> Bounding, DimensionX, DimensionY

# ---- group: rotate module (continued)
division_3 = Division(A=bounding_rectangle_5.DimensionX, B=bounding_rectangle_5.DimensionY)
panel_22 = Panel(division_3)
python_3_script_3 = Python3Script(ratio=division_3)  # -> out, rotationFlag
# ---------- python_3_script_3: Python ----------
"""Grasshopper Script"""
a = "Hello Python 3 in Grasshopper!"
print(a)
if (ratio < 1 and ratio >0.8):
    rotationFlag = 1
elif (ratio > 1 ):
    rotationFlag = 0
elif (ratio > 0.4 and ratio < 0.8 ):
    rotationFlag = 1
else:
    rotationFlag = 0
# ---------- end python_3_script_3 ----------
stream_filter_4 = StreamFilter(Gate=python_3_script_3.rotationFlag, Stream0="90", Stream1="0")
radians = Radians(Degrees=stream_filter_4)
rotate = Rotate(Geometry=scale_5.Geometry, Angle=radians, Plane=area_9.Centroid)  # -> Geometry, Transform

# ----
series_4 = Series(Start=0, Step=1, Count=select_no_of_top)

# ---- group: tags (continued)
list_item_7 = ListItem(List=sort_list.ValuesValuesA, Index=series_4, Wrap=True)
curve_5 = Curve(list_item_7)
area_10 = Area(Geometry=curve_5)  # -> Area, Centroid
move_4 = Move(Geometry=area_10.Centroid, Motion=Z_5)  # -> Geometry, Transform
ln_5 = Line(StartPoint=area_10.Centroid, EndPoint=move_4.Geometry)
gate_7 = StreamGate(Stream=ln_5, Gate=show_score_labels)  # -> Target0, Target1
gate_8 = StreamGate(Stream=move_4.Geometry, Gate=show_score_labels)  # -> Target0, Target1
tag_5 = TextTag3D(Location=gate_8.Target1, Text=flatten(concat_6), Size=score_label_size, Colour=stream_filter, Justification=5)
preview_8 = CustomPreview(Geometry=gate_7.Target1, Material=stream_filter)

# ----
area_11 = Area(Geometry=stream_gate_2.Target1)  # -> Area, Centroid
rotate_2 = Rotate(Geometry=stream_gate.Target1, Angle=radians, Plane=area_11.Centroid)  # -> Geometry, Transform
move_to_point_5 = MoveToPoint(Geometry=rotate_2.Geometry, PointA=area_11.Centroid, PointB=area_10.Centroid)  # -> Moved, Vector, Transform

# ---- group: visualize bounding box of 3d module
boundary_surfaces_2 = BoundarySurfaces(Edges=curve_5)
move_to_point_6 = MoveToPoint(Geometry=rotate.Geometry, PointA=area_9.Centroid, PointB=area_10.Centroid)  # -> Moved, Vector, Transform
preview_9 = CustomPreview(Geometry=boundary_surfaces_2, Material=python_3_script.roomColors)
previewlw_5 = CustomPreviewLineweights(
    Geometry=move_to_point_6.Moved,
    Shader=ColourSwatch(SwatchColor=RGB(0, 247, 41)),
    Thickness=Slider(8, range=0..8),
    Absolute=False)

# ----
previewlw_6 = CustomPreviewLineweights(
    Geometry=move_to_point_5.Moved,
    Shader=ColourSwatch(SwatchColor=RGB(117, 117, 117)),
    Thickness=Slider(8, range=0..8),
    Absolute=False)

# ==== cluster StrainghtenPolyLin
vec = ClusterInput()
pt = ClusterInput()
vec_2 = Vector(vec)
pt_2 = Point(pt)
pt_3 = Point(pt)
devec = DeconstructVector(Vector=vec_2)  # -> XComponent, YComponent, ZComponent
lng = ListLength(List=pt_2)
round = Round(Number=devec.XComponent)  # -> Nearest, Floor, Ceiling
round_2 = Round(Number=devec.YComponent)  # -> Nearest, Floor, Ceiling
round_3 = Round(Number=devec.ZComponent)  # -> Nearest, Floor, Ceiling
culln = CullNth(List=pt_3, CullFrequency=lng)
vec_3 = VectorXYZ(XComponent=round.Nearest, YComponent=round_2.Nearest, ZComponent=round_3.Nearest)  # -> Vector, Length
number_slider = Slider(66, range=1..100)
line = LineSDL(Start=culln, Direction=vec_3.Vector, Length="1")
ext = ExtendCurve(Curve=line, Type=0, Start=number_slider, End=number_slider)
ccx = CurveCurve(CurveA=ext, CurveB=graft(ext))  # -> Points, ParamsA, ParamsB
cp = ClosestPoint(Point=pt_3, Cloud=flatten(ccx.Points))  # -> ClosestPoint, CPIndex, Distance
pline = PolyLine(Vertices=cp.ClosestPoint, Closed=False)
pl = ClusterOutput(pline)
