# Grasshopper definition ReadcurvesANDExportCsvPolygonsForMSD.gh (Grasshopper 1.0.8)
# plug-ins: RhinoCodePluginGH, Pufferfish, EleFront, LunchBox

# ---- group: sample data
# Number of unique site IDs: 1130
# Number of unique building IDs: 2550
# Number of unique floor IDs: 5372
# Number of unique apartment IDs: 18269
# Number of unique unit IDs: 18902
panel = Panel("""ID1
ID2
ApartmentID
SiteID
BuildingID
PlanID
FloorID
UnitID
AreaID
UnitUsage
EntityType
EntitySubtype
geom
Elevation
Height
Zoning""")
panel_2 = Panel("""0
0
3c3b1d6ca8b4b9092480b8c75f9eaa81
1
100
1054
1588
7300
619311
RESIDENTIAL
area
BATHROOM
POLYGON ((33.69 11.16,33.69 14.16 , 36.4 14.16, 36.4 11.16, 33.69 11.16))
0
3
Zone3""")

# ----
# SEPARATORS
curve = Curve([<curve referenced from the Rhino model> x243])

# ----
# doors
curve_2 = Curve([<curve referenced from the Rhino model> x44])

# ----
# CORES
curve_3 = Curve([<curve referenced from the Rhino model> x4])

# ----
# Case Study A
# room Tags
id = Guid([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])

# ----
# windows
curve_4 = Curve([<curve referenced from the Rhino model> x28])

# ----
# room AREAS
curve_5 = Curve([<curve referenced from the Rhino model> x76])

read_data_from_xls = BooleanToggle(True)  # disabled
file_path_to_xls = FilePath("C:\Users\panz\Documents\GitHub\IBC\05_Floorplan_processing\Gh_parsing\IBC_MSD.xlsx")  # disabled

file_path = FilePath("C:\Users\panz\Documents\GitHub\IBC\05_Floorplan_processing\Gh_parsing\CaseStudy_2_KussnachtDxfToMSD_Test.csv")
file_path_2 = FilePath("C:\Users\panz\Documents\GitHub\IBC\05_Floorplan_processing\Gh_parsing\CaseStudy_3_WaldStrasseDxfToMSD_Test.csv")

# ----
# SEPARATORS
curve_6 = Curve([<curve referenced from the Rhino model> x105])

# ----
# room AREAS
curve_7 = Curve([<curve referenced from the Rhino model> x41])

reference_design = ValueList({"reference design 01": 0, "reference design 02": 1, "reference design 03": 2}, selected="reference design 01")  # disabled
path = FilePath("C:\Users\panz\Documents\GitHub\2025-AEC-Hackathon\json\ReferenceDesign_01\Reference01.json")  # disabled
path_2 = FilePath("C:\Users\panz\Documents\GitHub\IBC\05_Floorplan_processing\jsonExports\ReferenceDesign_02\ReferenceDesign_02_EP_bom.json")  # disabled
filter = StreamFilter(Gate=reference_design, Stream0=path, Stream1=path_2)  # disabled
python = GhPythonScript(file=filter)  # -> out, apartmentNames, roomTypes, roomPolylines, roomSurfaces, roomColors, adjacencies; disabled
# ---------- python: Python ----------
__author__ = "panz"
__version__ = "2024.11.11"

import rhinoscriptsyntax as rs
import json
import json
import Rhino.Geometry as rg

# Read and parse JSON data from the file
with open(file, 'r') as inputfile:
    data = json.load(inputfile)

# Extract panels (walls) data
panels_data = data.get("panels", {}).get("items", {})
if not panels_data:
    print("Warning: 'panels.items' key is missing or empty in JSON.")
    
    


# Extract apartment outlines from 'spaces'
spaces_data = data.get("spaces", {})
roomOutlines = []
roomPolylines =[]
apartmentNames = []
roomTypes = []
roomColors = []
roomSurfaces = []

for space_id, space in spaces_data.items():
    coordinates = space.get("coordinates")
    roomTypes.append(space.get("room_type"))
    apartmentNames.append(space.get("apartment"))
    outline_points = [[point["x"], point["y"], point["z"]] for point in coordinates]
    roomOutlines.append(outline_points)
print (len(roomOutlines))


roomType = "bathroom"

#get adjacencies
adjacencies =[]
#adjacency_data =data.get("room_adjacency").get(roomType)
adjacency_data =data.get("room_adjacency")
adjacencies = adjacency_data
print (adjacency_data) 



roomCounter = 0 
for index in range (0, len(spaces_data)):
    roomOutline = roomOutlines[index] 
    
    # Convert the point lists into Rhino Point3d objects
    polyline_points = [rg.Point3d(point[0], point[1], point[2]) for point in roomOutline]
    # Create the polyline using the list of Point3d objects
    polyline = rg.Polyline(polyline_points)
    
    
    #assign colors based on roomput
    if (roomTypes[index] == "living_room"):
        roomColors.append('255,100,0')
    elif (roomTypes[index] == "bedroom"):
        roomColors.append('153,137,255')
    elif (roomTypes[index] == "kitchen"):
        roomColors.append('0,0,220')
    elif (roomTypes[index] == "bathroom"):
        roomColors.append('151,255,255')
    elif (roomTypes[index] == "core"):
        roomColors.append('150,150,150')
        
    # create a surface
    roomSrfs = rg.Brep.CreatePlanarBreps(polyline.ToNurbsCurve())
    roomSurfaces.append(roomSrfs[0])
    # Ensure the polyline is closed if necessary (optional)
    if not polyline.IsClosed:
        polyline.Add(polyline[0])  # Add the first point to close the polyline
    # Output the polyline (e.g., to Grasshopper)
    roomPolylines.append(polyline)
    roomCounter +=1 
    #print ("created", roomCounter, "space polylines")
    #print(roomSurfaces)
# ---------- end python ----------

# ----
# Case Study B
# room Tags
id_2 = Guid([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])

# ----
# CORES
curve_8 = Curve(<curve referenced from the Rhino model>)

# ----
# windows
curve_9 = Curve([<curve referenced from the Rhino model> x13])

show_room_labels = BooleanToggle(True)  # disabled
room_labler_color = ColourSwatch(SwatchColor=RGB(87, 87, 87))  # disabled
room_label_height = Slider(1530, range=0..1530)  # disabled
room_label_size = Slider(191, range=0..250)  # disabled

# ----
# doors
curve_10 = Curve([<curve referenced from the Rhino model> x15])

show_room_tags = BooleanToggle(True)
text_tag_size = Panel("150")

user = GhPythonScript()  # -> user; disabled
# ---------- user: Python ----------
__author__ = "tommy.reslinski"
__version__ = "2020.10.27"

import rhinoscriptsyntax as rs
from os.path import expanduser

home = expanduser("~")
user = home[9:]
# ---------- end user ----------
relpath = RelPath(path=file_path_to_xls, user=user)  # disabled
panel_3 = Panel(relpath)  # disabled

sheetnames = Panel("""IBCXMSD
MSD""")  # disabled
select_sheet = ValueList({"IBCXMSD": 0, "MSD": 1}, selected="IBCXMSD")  # disabled

# ----
# entityType can be: area, separator(Wall), opening (Door, window)
# Case Study C
# room Tags
id_3 = Guid([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])

# ----
# room AREAS
curve_11 = Curve([<curve referenced from the Rhino model> x55])

# ----
# windows
curve_12 = Curve([<curve referenced from the Rhino model> x16])

# ----
# SEPARATORS
curve_13 = Curve([<curve referenced from the Rhino model> x87])

# ----
# doors
curve_14 = Curve([<curve referenced from the Rhino model> x29])

# ----
# CORES
curve_15 = Curve([<curve referenced from the Rhino model> x10])

# ----
# TO DO : READ FILE EXERT FROM MSD AND COMPARE
# 0. Import/Read
# MSD structured data
panel_4 = Panel(path_2)  # disabled

panel_5 = Panel("""reference design 01
reference design 02
reference design 03""")  # disabled
list_item = ListItem(List=panel_5, Index=reference_design, Wrap=True)  # disabled

# ---- group: move and scale
crv = Curve(python.roomPolylines)  # disabled
bounding_rectangle = BoundingRectangle(Geometry=crv, Plane=PlaneXY(0, 0, 0), Axis=0, Slide=0, Union=True)  # -> Bounding, DimensionX, DimensionY; disabled
panel_6 = Panel("0,0,0")  # disabled
panel_7 = Panel("1000")  # disabled
area = Area(Geometry=bounding_rectangle.Bounding)  # -> Area, Centroid; disabled
scale = Scale(Geometry=crv, Center=area.Centroid, Factor=panel_7)  # -> Geometry, Transform; disabled
scale_2 = Scale(Geometry=python.roomSurfaces, Center=area.Centroid, Factor=panel_7)  # -> Geometry, Transform; disabled
point = Point(panel_6)  # disabled
move_to_point = MoveToPoint(Geometry=scale.Geometry, PointA=area.Centroid, PointB=point)  # -> Moved, Vector, Transform; disabled
move_to_point_2 = MoveToPoint(Geometry=scale_2.Geometry, PointA=area.Centroid, PointB=point)  # -> Moved, Vector, Transform; disabled

# ----
# this number needs to match the no of rooms in on e apt
select_row_number_until_which_you_want_t = Slider(35, range=1..77)  # "select row number until which you want to read data"; disabled
panel_8 = Panel("0")  # disabled
series = Series(Start=panel_8, Step=1, Count=select_row_number_until_which_you_want_t)  # disabled

list_item_2 = ListItem(List=sheetnames, Index=select_sheet, Wrap=True)  # disabled
excel_reader = ExcelReader(ReadExcelData=read_data_from_xls, WorkbookPath=panel_3, WorksheetName=list_item_2)  # -> Exceptions, ExcelData; disabled
list_item_3 = ListItem(List=excel_reader.ExcelData, Index=series, Wrap=True)  # disabled

# ---- group: entrance
# ENTRANCE
dimesion_in_mm = Panel("1200")  # disabled
dimesion_in_mm_2 = Panel("200")  # disabled
rectangle = Rectangle(Plane=PlaneXY(0, 0, 0), XSize=dimesion_in_mm_2, YSize=dimesion_in_mm, Radius=0)  # -> Rectangle, Length; disabled
area_2 = Area(Geometry=rectangle.Rectangle)  # -> Area, Centroid; disabled

# ---- group: door
# DOORS
dimesion_in_mm_3 = Panel("900")  # disabled
dimesion_in_mm_4 = Panel("200")  # disabled
rectangle_2 = Rectangle(Plane=PlaneXY(0, 0, 0), XSize=dimesion_in_mm_4, YSize=dimesion_in_mm_3, Radius=0)  # -> Rectangle, Length; disabled
area_3 = Area(Geometry=rectangle_2.Rectangle)  # -> Area, Centroid; disabled

# ---- group: window
# WINDOWS
panel_9 = Panel("1000")  # disabled
dimesion_in_mm_5 = Panel("200")  # disabled
rectangle_3 = Rectangle(Plane=PlaneXY(0, 0, 0), XSize=dimesion_in_mm_5, YSize=panel_9, Radius=0)  # -> Rectangle, Length; disabled
area_4 = Area(Geometry=rectangle_3.Rectangle)  # -> Area, Centroid; disabled

# ----
# walls
wall_thickness = Slider(180, range=0..600)  # disabled

# ---- group: filter rooms
panel_10 = Panel("Apartment 1")  # disabled
panel_11 = Panel(python.apartmentNames)  # disabled
panel_12 = Panel(python.roomTypes)  # disabled
match_text = MatchText(Text=panel_11, Pattern=panel_10, Case=True)  # disabled
area_5 = Area(Geometry=move_to_point_2.Moved)  # -> Area, Centroid; disabled
cull_pattern = CullPattern(List=panel_12, CullPattern=match_text)  # disabled
cull_pattern_2 = CullPattern(List=move_to_point.Moved, CullPattern=match_text)  # disabled
cull_pattern_3 = CullPattern(List=area_5.Centroid, CullPattern=match_text)  # disabled
cull_pattern_4 = CullPattern(List=area_5.Area, CullPattern=match_text)  # disabled
curve_16 = Curve(cull_pattern_2)  # disabled

# ----
openingstopheight = Slider(2.2, range=0..6)
floortofloorheight = Slider(3, range=0..6)
openingbottomheight = Slider(1, range=0..1)
elevation = Slider(0, range=0..1)

# ----
# -"zone1" refers to a
# private space,
# 
# -"zone2" to a public space,
# -"zone3" to a service space, and
# -"zone4"
# to an outside place
cluster = Cluster(msd_formatted_data=list_item_3)  # -> row_number, apartment_id_2, site_id_2, building_id, plan_id, floor_id, unit_id, area_id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; disabled
panel_13 = Panel(cluster.apartment_id_2)  # disabled
panel_14 = Panel(cluster.entity_subtype)  # disabled

room_index = Panel("3")  # disabled
number_slider = Slider(0.354, range=0..1)  # disabled
list_item_4 = ListItem(List=curve_16, Index=room_index, Wrap=True)  # disabled
evaluate_curve = EvaluateCurve(Curve=reparameterize(list_item_4), Parameter=number_slider)  # -> Point, Tangent, Angle; disabled

room_index_2 = Panel("3")  # disabled
number_slider_2 = Slider(0.669, range=0..1)  # disabled
list_item_5 = ListItem(List=curve_16, Index=room_index_2, Wrap=True)  # disabled
evaluate_curve_2 = EvaluateCurve(Curve=reparameterize(list_item_5), Parameter=number_slider_2)  # -> Point, Tangent, Angle; disabled

room_index_3 = Panel("4")  # disabled
number_slider_3 = Slider(0.849, range=0..1)  # disabled
list_item_6 = ListItem(List=curve_16, Index=room_index_3, Wrap=True)  # disabled
evaluate_curve_3 = EvaluateCurve(Curve=reparameterize(list_item_6), Parameter=number_slider_3)  # -> Point, Tangent, Angle; disabled

room_index_4 = Panel("2")  # disabled
number_slider_4 = Slider(0.358, range=0..1)  # disabled
list_item_7 = ListItem(List=curve_16, Index=room_index_4, Wrap=True)  # disabled
evaluate_curve_4 = EvaluateCurve(Curve=reparameterize(list_item_7), Parameter=number_slider_4)  # -> Point, Tangent, Angle; disabled

room_index_5 = Panel("1")  # disabled
list_item_8 = ListItem(List=curve_16, Index=room_index_5, Wrap=True)  # disabled
evaluate_curve_5 = EvaluateCurve(Curve=reparameterize(list_item_8))  # -> Point, Tangent, Angle; disabled

room_index_6 = Panel("0")  # disabled
number_slider_5 = Slider(0.945, range=0..1)  # disabled
list_item_9 = ListItem(List=curve_16, Index=room_index_6, Wrap=True)  # disabled
evaluate_curve_6 = EvaluateCurve(Curve=reparameterize(list_item_9), Parameter=number_slider_5)  # -> Point, Tangent, Angle; disabled

room_index_7 = Panel("2")  # disabled
number_slider_6 = Slider(0.882, range=0..1)  # disabled
list_item_10 = ListItem(List=curve_16, Index=room_index_7, Wrap=True)  # disabled
evaluate_curve_7 = EvaluateCurve(Curve=reparameterize(list_item_10), Parameter=number_slider_6)  # -> Point, Tangent, Angle; disabled

number_slider_7 = Slider(0.608, range=0..1)  # disabled
list_item_11 = ListItem(List=curve_16, Index=0, Wrap=True)  # disabled
evaluate_curve_8 = EvaluateCurve(Curve=reparameterize(list_item_11), Parameter=number_slider_7)  # -> Point, Tangent, Angle; disabled

number_slider_8 = Slider(0.058, range=0..1)  # disabled
list_item_12 = ListItem(List=curve_16, Index=3, Wrap=True)  # disabled
evaluate_curve_9 = EvaluateCurve(Curve=reparameterize(list_item_12), Parameter=number_slider_8)  # -> Point, Tangent, Angle; disabled

colour_swatch = ColourSwatch(SwatchColor=RGB(0, 0, 0))

# ---- group: space tages+_reference
integer = Integer(cull_pattern_4)  # disabled
sysunits = GhPythonScript(N=integer, unitsFrom=2, unitsTo=4, mag=2)  # -> message, R; disabled
# ---------- sysunits: Python ----------
__author__ = "michael.lee"
__version__ = "2019.05.29"

import rhinoscriptsyntax as rs
intModelUnits = rs.UnitSystem()

if (intModelUnits == 0):
    message = "No unit system is assigned"
elif (intModelUnits == 1 ):
    message = "Your model is in Microns (1.0e-6 meters)"
elif (intModelUnits == 2 ):
    message = "Your model is in Millimeters (1.0e-3 meters)"
elif (intModelUnits == 3 ):
    message ="Your model is in Centimeters (1.0e-2 meters)"
elif (intModelUnits == 4 ):
    message = "Your model is in Meters"
elif (intModelUnits == 5 ):
    message = "Your model is in Kilometers (1.0e+3 meters)"
elif (intModelUnits == 6 ):
    message = "Your model is in Microinches (2.54e-8 meters, 1.0e-6 inches)"
elif (intModelUnits == 7 ):
    message = "Yourmodel is in Mils (2.54e-5 meters, 0.001 inches)"
elif (intModelUnits == 8 ):
    message = "Your model is in Inches (0.0254 meters)"
elif (intModelUnits == 9 ):
    message = "Your model is in Feet (0.3408 meters, 12 inches)"
elif (intModelUnits == 10 ):
    message = "Your model is in Miles (1609.344 meters, 5280 feet)"
else:
    message = "please check your inputs"



if (intModelUnits != unitsFrom ):
    message = "Caution! your model units are different from what you indicate, if this is in purpose you are good"
else:
    message = message + ". Converting units!"
    print(message)
    
if (N):
    R = N*pow(rs.UnitScale(unitsTo,unitsFrom),mag)

else:
    R = None
# ---------- end sysunits ----------
expression = Expression(x=sysunits.R, Expression="Format(\"{0:0.00}\",x)")  # disabled
Z = UnitZ(Factor=room_label_height)  # disabled
move = Move(Geometry=cull_pattern_3, Motion=Z)  # -> Geometry, Transform; disabled
panel_15 = Panel(":")  # disabled
panel_16 = Panel(" m2")  # disabled
ln = Line(StartPoint=cull_pattern_3, EndPoint=move.Geometry)  # disabled
gate = StreamGate(Stream=ln, Gate=show_room_labels)  # -> Target0, Target1; disabled
gate_2 = StreamGate(Stream=move.Geometry, Gate=show_room_labels)  # -> Target0, Target1; disabled
concat = Concatenate(FragmentA=cull_pattern, FragmentC=panel_15, FragmentB=expression, FragmentD=panel_16)  # disabled
preview = CustomPreview(Geometry=gate.Target1, Material=room_labler_color)  # disabled
tag = TextTag3D(Location=gate_2.Target1, Text=flatten(concat), Size=room_label_size, Colour=room_labler_color, Justification=5)  # disabled

# ----
# Zoning :
# 
# "zone1":refers to a
# private space,
# 
# "zone2": to a public space,
# "zone3": to a service space
# "zone4":
# to an outside place
zoning = Panel("""Zone1
Zone1
Zone3
Zone2
Zone3
Zone2
Zone1""")

region_union = RegionUnion(Curves=curve_16)  # disabled
panel_17 = Panel("-0.03")  # disabled
boundary_surfaces = BoundarySurfaces(Edges=region_union)  # disabled
unit_z = UnitZ(Factor=panel_17)  # disabled
room_labler_color_2 = ColourSwatch(SwatchColor=RGB(120, 120, 120))  # disabled
move_2 = Move(Geometry=boundary_surfaces, Motion=unit_z)  # -> Geometry, Transform; disabled
preview_2 = CustomPreview(Geometry=move_2.Geometry, Material=room_labler_color_2)  # disabled

# ---- group: visualize floorplan
region_union_2 = RegionUnion(Curves=move_to_point.Moved)  # disabled
panel_18 = Panel("-0.05")  # disabled
boundary_surfaces_2 = BoundarySurfaces(Edges=region_union_2)  # disabled
unit_z_2 = UnitZ(Factor=panel_18)  # disabled
room_labler_color_3 = ColourSwatch(SwatchColor=RGB(201, 201, 201))  # disabled
move_3 = Move(Geometry=boundary_surfaces_2, Motion=unit_z_2)  # -> Geometry, Transform; disabled
preview_3 = CustomPreview(Geometry=move_3.Geometry, Material=room_labler_color_3)  # disabled

# ---- group: move_orient openings / door
unit_y = UnitY(Factor=1)  # disabled
point_2 = Point([evaluate_curve_2.Point, evaluate_curve_5.Point, evaluate_curve_6.Point, evaluate_curve_4.Point, evaluate_curve_3.Point])  # disabled
vector = Vector([evaluate_curve_2.Tangent, evaluate_curve_5.Tangent, evaluate_curve_6.Tangent, evaluate_curve_4.Tangent, evaluate_curve_3.Tangent])  # disabled
curve_17 = Curve(rectangle_2.Rectangle)  # disabled
orient_direction = OrientDirection(Geometry=curve_17, PointA=area_3.Centroid, DirectionA=unit_y, PointB=point_2, DirectionB=vector)  # -> Geometry, Transform; disabled

# ---- group: move_orient openings / entrance
point_3 = Point(evaluate_curve.Point)  # disabled
vector_2 = Vector(evaluate_curve.Tangent)  # disabled
curve_18 = Curve(rectangle.Rectangle)  # disabled
orient_direction_2 = OrientDirection(Geometry=curve_18, PointA=area_2.Centroid, DirectionA=unit_y, PointB=point_3, DirectionB=vector_2)  # -> Geometry, Transform; disabled

# ---- group: move_orient openings / windows
point_4 = Point([evaluate_curve_8.Point, evaluate_curve_9.Point, evaluate_curve_7.Point])  # disabled
vector_3 = Vector([evaluate_curve_8.Tangent, evaluate_curve_9.Tangent, evaluate_curve_7.Tangent])  # disabled
curve_19 = Curve(rectangle_3.Rectangle)  # disabled
orient_direction_3 = OrientDirection(Geometry=curve_19, PointA=area_4.Centroid, DirectionA=unit_y, PointB=point_4, DirectionB=vector_3)  # -> Geometry, Transform; disabled

# ---- group: Gloabal for all curves
site_id = Panel("implenia_01")
building_id = Panel("2551")
planid = Panel("1054")
floorid = Panel("1588")

# ---- group: visualize walls
division = Division(A=wall_thickness, B=2)  # disabled
offset_curve = OffsetCurve(Curve=curve_16, Plane=PlaneXY(0, 0, 0), Distance=division, BothSides=True, Kinks=0, CapType=1)  # disabled

# ----
unitid = Panel("7300")
areaid = Panel("619311")
unitusage = Panel("RESIDENTIAL")
apartmentid = Panel("7300")
entitytype = Panel("area")

panel_19 = Panel("2")  # disabled
unit_z_3 = UnitZ(Factor=panel_19)  # disabled
move_4 = Move(Geometry=orient_direction_3.Geometry, Motion=unit_z_3)  # -> Geometry, Transform; disabled
boundary_surfaces_3 = BoundarySurfaces(Edges=move_4.Geometry)  # disabled
colour_swatch_2 = ColourSwatch(SwatchColor=RGB(0, 173, 189))  # disabled
custom_preview = CustomPreview(Geometry=boundary_surfaces_3, Material=colour_swatch_2)  # disabled

panel_20 = Panel("2")  # disabled
unit_z_4 = UnitZ(Factor=panel_20)  # disabled
move_5 = Move(Geometry=orient_direction.Geometry, Motion=unit_z_4)  # -> Geometry, Transform; disabled
boundary_surfaces_4 = BoundarySurfaces(Edges=move_5.Geometry)  # disabled
colour_swatch_3 = ColourSwatch(SwatchColor=RGB(189, 0, 0))  # disabled
custom_preview_2 = CustomPreview(Geometry=boundary_surfaces_4, Material=colour_swatch_3)  # disabled

panel_21 = Panel("1")  # disabled
unit_z_5 = UnitZ(Factor=panel_21)  # disabled
move_6 = Move(Geometry=offset_curve, Motion=unit_z_5)  # -> Geometry, Transform; disabled
boundary_surfaces_5 = BoundarySurfaces(Edges=move_6.Geometry)  # disabled
colour_swatch_4 = ColourSwatch(SwatchColor=RGB(0, 0, 0))  # disabled
custom_preview_3 = CustomPreview(Geometry=boundary_surfaces_5, Material=colour_swatch_4)  # disabled

panel_22 = Panel("2")  # disabled
unit_z_6 = UnitZ(Factor=panel_22)  # disabled
move_7 = Move(Geometry=orient_direction_2.Geometry, Motion=unit_z_6)  # -> Geometry, Transform; disabled
boundary_surfaces_6 = BoundarySurfaces(Edges=move_7.Geometry)  # disabled
colour_swatch_5 = ColourSwatch(SwatchColor=RGB(245, 131, 0))  # disabled
custom_preview_4 = CustomPreview(Geometry=boundary_surfaces_6, Material=colour_swatch_5)  # disabled

save_csv = BooleanToggle(True)
file_path_3 = FilePath("C:\Users\panz\Documents\GitHub\IBC\05_Floorplan_processing\Gh_parsing\CaseStudy_1_DohlenWegdxfToMSD_Test.csv")
value_list = ValueList({"case_Study_A-Dohlenweg": 0, "case_Study_B-Kusnacht": 1, "case_Study_C-Waldstrasse": 2}, selected="case_Study_A-Dohlenweg")

stream_filter = StreamFilter(Gate=value_list, Stream0=file_path_3, Stream1=file_path, Stream2=file_path_2)

panel_23 = Panel(stream_filter)

# ----
# CORES
stream_filter_2 = StreamFilter(Gate=value_list, Stream0=curve_3, Stream1=curve_8, Stream2=curve_15)

# ----
# windows
stream_filter_3 = StreamFilter(Gate=value_list, Stream0=curve_4, Stream1=curve_9, Stream2=curve_12)

# ----
# doors
stream_filter_4 = StreamFilter(Gate=value_list, Stream0=curve_2, Stream1=curve_10, Stream2=curve_14)

# ----
# room Tags
stream_filter_5 = StreamFilter(Gate=value_list, Stream0=id, Stream1=id_2, Stream2=id_3)

# ----
# SEPARATORS /Walls
stream_filter_6 = StreamFilter(Gate=value_list, Stream0=curve, Stream1=curve_6, Stream2=curve_13)

# ----
# room Boundaries
stream_filter_7 = StreamFilter(Gate=value_list, Stream0=curve_5, Stream1=curve_7, Stream2=curve_11)

python_2 = PythonScript(id=stream_filter_5)  # -> out, text, plane
# ---------- python_2: Python ----------
import rhinoscriptsyntax as rs
import Rhino as rc
import scriptcontext as sc

# Set the script context to the current Rhino doc
sc.doc = rc.RhinoDoc.ActiveDoc

# Do your Rhino doc business...
if id:
    tObj = rs.coercerhinoobject(id)
    text = tObj.DisplayText
    plane = tObj.Geometry.Plane
    
# Then set the script context back to the Grasshopper doc
sc.doc = ghdoc
# ---------- end python_2 ----------
pln = Plane(python_2.plane)
point_5 = Point(pln)
python_3_script = Python3Script(Rooms=stream_filter_7, RoomTags=python_2.text, Pts=point_5)  # -> out, RoomBoundaries, RoomTagsOut, RoomTagPoints; inputs Rooms: list of Curve, RoomTags: list, Pts: list of Point3d
# ---------- python_3_script: Python ----------
import Rhino
import System
import scriptcontext as sc
from Grasshopper import DataTree
from Grasshopper.Kernel.Data import GH_Path

tol = sc.doc.ModelAbsoluteTolerance
DEFAULT_TEXT = "N/A"

def unwrap(x):
    return x.Value if hasattr(x, "Value") else x

def to_curve(x):
    x = unwrap(x)
    if x is None:
        return None
    if isinstance(x, Rhino.Geometry.Curve):
        return x
    if isinstance(x, Rhino.Geometry.Polyline):
        return Rhino.Geometry.PolylineCurve(x)
    if isinstance(x, System.Guid):
        ro = sc.doc.Objects.FindId(x)
        if ro and isinstance(ro.Geometry, Rhino.Geometry.Curve):
            return ro.Geometry.DuplicateCurve()
    if isinstance(x, Rhino.DocObjects.ObjRef):
        c = x.Curve()
        return c.DuplicateCurve() if c else None
    return None

def to_point3d(x):
    x = unwrap(x)
    if x is None:
        return None
    if isinstance(x, Rhino.Geometry.Point3d):
        return x
    if isinstance(x, Rhino.Geometry.Point):
        return x.Location
    if isinstance(x, System.Guid):
        ro = sc.doc.Objects.FindId(x)
        if ro:
            g = ro.Geometry
            if isinstance(g, Rhino.Geometry.Point):
                return g.Location
    if isinstance(x, Rhino.DocObjects.ObjRef):
        p = x.Point()
        return p.Location if p else None
    return None

def curve_plane(crv):
    if not crv:
        return Rhino.Geometry.Plane.WorldXY
    ok, pl = crv.TryGetPlane()
    return pl if ok else Rhino.Geometry.Plane.WorldXY

def curve_area_and_centroid(crv):
    """
    Returns (area, centroid).
    If area centroid fails, falls back to bbox "area" proxy and bbox center.
    """
    if not crv:
        return (float("inf"), None)

    amp = None
    try:
        amp = Rhino.Geometry.AreaMassProperties.Compute(crv)
    except:
        amp = None

    if amp:
        return (abs(amp.Area), amp.Centroid)

    # bbox fallback
    try:
        bb = crv.GetBoundingBox(True)
        if bb.IsValid:
            dx = bb.Max.X - bb.Min.X
            dy = bb.Max.Y - bb.Min.Y
            dz = bb.Max.Z - bb.Min.Z
            bbox_area_proxy = abs(dx * dy) + abs(dy * dz) + abs(dx * dz)
            return (bbox_area_proxy, bb.Center)
    except:
        pass

    # last fallback
    try:
        return (float("inf"), crv.PointAtNormalizedLength(0.5))
    except:
        return (float("inf"), None)

# --- inputs ---
Rooms = list(Rooms) if Rooms else []
RoomTags = list(RoomTags) if RoomTags else []
Pts = list(Pts) if Pts else []

if len(RoomTags) != len(Pts):
    raise Exception("RoomTags and Pts must have the same length and matching order.")

room_curves = [to_curve(r) for r in Rooms]
label_pts   = [to_point3d(p) for p in Pts]

n_rooms = len(room_curves)
n_tags  = len(RoomTags)

# Precompute per-room info
room_planes   = [curve_plane(c) for c in room_curves]
room_area     = [None] * n_rooms
room_centroid = [None] * n_rooms

for i, crv in enumerate(room_curves):
    a, cpt = curve_area_and_centroid(crv)
    room_area[i] = a
    room_centroid[i] = cpt

# Step 1: Assign each TAG -> best ROOM (smallest-area containing curve)
room_to_tag_candidates = {i: [] for i in range(n_rooms)}
tag_to_room = [-1] * n_tags

for j, pt in enumerate(label_pts):
    if pt is None:
        continue

    containing_rooms = []
    for i, crv in enumerate(room_curves):
        if not crv:
            continue
        rel = crv.Contains(pt, room_planes[i], tol)
        if rel in (Rhino.Geometry.PointContainment.Inside,
                   Rhino.Geometry.PointContainment.Coincident):
            containing_rooms.append(i)

    if not containing_rooms:
        continue

    # Choose the smallest containing boundary (most likely the actual room, not apartment outline)
    best_i = min(containing_rooms, key=lambda i: room_area[i] if room_area[i] is not None else float("inf"))
    tag_to_room[j] = best_i
    room_to_tag_candidates[best_i].append(j)

# Step 2: Enforce one tag per room (pick closest to centroid if multiple)
RoomBoundaries = DataTree[object]()
RoomTagsOut    = DataTree[object]()
RoomTagPoints  = DataTree[object]()

used_tag = [False] * n_tags

for i, crv in enumerate(room_curves):
    path = GH_Path(i)

    RoomBoundaries.Add(crv, path)

    if not crv:
        RoomTagsOut.Add(DEFAULT_TEXT, path)
        RoomTagPoints.Add(None, path)
        continue

    candidates = room_to_tag_candidates.get(i, [])
    if candidates:
        cpt = room_centroid[i]
        if cpt is None:
            chosen = candidates[0]
        else:
            chosen = min(candidates, key=lambda j: label_pts[j].DistanceTo(cpt) if label_pts[j] else float("inf"))

        RoomTagsOut.Add(RoomTags[chosen], path)
        RoomTagPoints.Add(label_pts[chosen], path)
        used_tag[chosen] = True
    else:
        # No tag assigned -> centroid + N/A
        RoomTagsOut.Add(DEFAULT_TEXT, path)
        RoomTagPoints.Add(room_centroid[i], path)

Unassigned = [RoomTags[k] for k, u in enumerate(used_tag) if not u]
# ---------- end python_3_script ----------

merge = Merge(Data1=stream_filter_7, Data2=stream_filter_6, Data3=stream_filter_2, Data4=stream_filter_4, Data5=stream_filter_3)  # -> flatten(Result)
list_length = ListLength(List=merge)
no_of_shapes = Panel(list_length)
series_2 = Series(Start=1, Step=1, Count=list_length)

merge_2 = Merge(Data1=stream_filter_4, Data2=stream_filter_3)

unit_z_7 = UnitZ(Factor="2")
move_8 = Move(Geometry=merge_2, Motion=unit_z_7)  # -> Geometry, Transform
boundary_surfaces_7 = BoundarySurfaces(Edges=move_8.Geometry)
custom_preview_5 = CustomPreview(Geometry=boundary_surfaces_7, Material=ColourSwatch(SwatchColor=RGB(0, 173, 189)))

# ---- group: visualize floorplan
boundary_surfaces_8 = BoundarySurfaces(Edges=python_3_script.RoomBoundaries)
unit_z_8 = UnitZ(Factor="-0.05")
room_labler_color_4 = ColourSwatch(SwatchColor=RGB(201, 201, 201))
move_9 = Move(Geometry=boundary_surfaces_8, Motion=unit_z_8)  # -> Geometry, Transform
preview_4 = CustomPreview(Geometry=move_9.Geometry, Material=room_labler_color_4)

# ----
unit_z_9 = UnitZ(Factor="1")
move_10 = Move(Geometry=stream_filter_6, Motion=unit_z_9)  # -> Geometry, Transform
boundary_surfaces_9 = BoundarySurfaces(Edges=move_10.Geometry)
custom_preview_6 = CustomPreview(Geometry=boundary_surfaces_9, Material=ColourSwatch(SwatchColor=RGB(0, 0, 0)))

point_6 = Point(python_3_script.RoomTagPoints)

# ---- group: space tages+_reference
integer_2 = Integer(boundary_surfaces_8)
sysunits_2 = GhPythonScript(N=integer_2, unitsFrom=2, unitsTo=4, mag=2)  # -> message, R; same code as sysunits
Z_2 = UnitZ(Factor="500")
move_11 = Move(Geometry=point_6, Motion=Z_2)  # -> Geometry, Transform
expression_2 = Expression(x=sysunits_2.R, Expression="Format(\"{0:0.00}\",x)")
ln_2 = Line(StartPoint=point_6, EndPoint=move_11.Geometry)
gate_3 = StreamGate(Stream=ln_2, Gate=show_room_tags)  # -> Target0, Target1
gate_4 = StreamGate(Stream=move_11.Geometry, Gate=show_room_tags)  # -> Target0, Target1
concat_2 = Concatenate(FragmentA=python_3_script.RoomTagsOut, FragmentC=":", FragmentB=expression_2, FragmentD=" m2")
preview_5 = CustomPreview(Geometry=gate_3.Target1, Material=colour_swatch)
tag_2 = TextTag3D(Location=gate_4.Target1, Text=concat_2, Size=text_tag_size, Colour=colour_swatch, Justification=5)

# ---- group: only for area
entitysubtype = Panel(python_3_script.RoomTagsOut)

# ----
# Translate room tags from German to English
room_tags_to_be_translate = Panel("""Dusche
Vorzone
Reduit
Zimmer 1
Zimmer 2
Treppenhaus
Aufzug
Balkon
Wohnen|Essen|Kochen
Wohnen|Essen""")
panel_24 = Panel("""Bathroom
Corridor
Storage
Bedroom 1
Bedroom 2
Straicase
Elevator
Balcony
LivingRoom
DiningRoom""")
replace_members = ReplaceMembers(Set=entitysubtype, Find=room_tags_to_be_translate, Replace=panel_24)

panel_25 = Panel("""BATHROOM
CORRIDOR
STORAGE
ROOM
ROOM
STAIRCASE
SHAFT
BALCONY
LIVING_ROOM
DINING_ROOM""")
replace_members_2 = ReplaceMembers(Set=replace_members, Find=panel_24, Replace=panel_25)

python_3_script_2 = Python3Script(
    areasPolylines=flatten(python_3_script.RoomBoundaries),
    RoomType=flatten(python_3_script.RoomTagsOut),
    separatorsPolylines=flatten(stream_filter_6),
    CoresPolylines=flatten(stream_filter_2),
    doorsPolylines=stream_filter_4,
    windowsPolylines=stream_filter_3,
    Elevation=elevation,
    Height=elevation,
    OpeningBottomHeight=openingbottomheight,
    OpeningsTopHeight=openingstopheight,
    FloorToFloorHeight=floortofloorheight,
    SiteID=site_id,
    BuildingID=building_id,
    PlanID=planid,
    FloorID=floorid,
    UnitID=unitid,
    AreaID=areaid,
    UnitUsage=unitusage,
    EntityType=entitytype,
    EntitySubtype=flatten(replace_members_2),
    FilePath=stream_filter,
    saveCsv=save_csv)  # -> out, Lines, CSV; inputs areasPolylines: list of Curve, RoomType: list of String, separatorsPolylines: list of Curve, CoresPolylines: list of Curve, doorsPolylines: list of Curve, windowsPolylines: list of Curve, SiteID: list, BuildingID: list, FloorID: list, UnitID: list, AreaID: list, UnitUsage: list, EntityType: list, EntitySubtype: list, Zoning: list
# ---------- python_3_script_2: Python ----------
import Rhino.Geometry as rg
import unicodedata

#Evangelos PAntazis
# -------------------------
# Helper Function 
# -------------------------
def attr_value(lst, i, default=""):
    """Broadcast-friendly access for ROOM rows (indexed):
       - empty -> default
       - 1 item -> broadcast
       - else -> element i or default
    """
    if lst is None:
        return default
    try:
        n = len(lst)
    except:
        return lst
    if n == 0:
        return default
    if n == 1:
        return lst[0]
    return lst[i] if i < n else default

def attr_scalar(lst, default=""):
    """For NON-room rows: only accept scalar or single-item list. Otherwise default."""
    if lst is None:
        return default
    try:
        n = len(lst)
    except:
        return lst
    if n == 0:
        return default
    if n == 1:
        return lst[0]
    return default

def csv_escape(v):
    if v is None:
        s = ""
    else:
        s = str(v)
    s = s.replace('"', '""')
    return "\"{0}\"".format(s)

def as_text(v):
    if v is None:
        return ""
    if isinstance(v, (list, tuple)):
        return str(v[0]) if len(v) else ""
    return str(v)

def norm(s):
    s = as_text(s).strip().lower()
    s = unicodedata.normalize("NFKD", s)
    s = "".join(ch for ch in s if not unicodedata.combining(ch))
    s = " ".join(s.split())
    return s

# function to infer zoning based on roomType (entity_subtype)

def infer_zoning(entity_subtype):
    t = norm(entity_subtype)
    if not t or t == "unassigned":
        return "zone3"

    zone1_keys = ["zimmer 1", "zimmer 2", "zimmer 3", "zimmer 4", "bedroom 1", "bedroom 2", "bedroom 3", "bedroom 4"]
    if any(k in t for k in zone1_keys):
        return "zone1"

    zone2_keys = ["wohnen", "essen", "leben", "kuche", "wohnzimmer","vorzone", "livingRoom", "kitchen", "dining","corridor"]
    if any(k in t for k in zone2_keys):
        return "zone2"

    zone3_keys = ["reduit","wc","dusche","storage", "bathroom" , "shower"]
    if any(k in t for k in zone3_keys):
        return "zone3"

    zone4_keys = ["balkon", "terasse", "balcony",  "terrace"]
    if any(k in t for k in zone4_keys):
        return "zone4"


def curve_to_wkt(crv):
    """Closed -> POLYGON, open -> LINESTRING. Uses polyline if possible, else samples."""
    if crv is None:
        return ""

    poly = None
    if isinstance(crv, rg.PolylineCurve):
        poly = crv.ToPolyline()
    else:
        success, pl = crv.TryGetPolyline()
        if success:
            poly = pl
        else:
            # fallback sample
            try:
                t_params = crv.DivideByCount(20, True)
                pts = [crv.PointAt(t) for t in t_params]
            except:
                # last resort
                pts = [crv.PointAtStart, crv.PointAtEnd]
            poly = rg.Polyline(pts)

    pts = list(poly)
    if len(pts) < 2:
        return ""

    is_closed = crv.IsClosed or (pts[0].DistanceTo(pts[-1]) <= 1e-9)
    coords = ["{:.3f} {:.3f} {:.3f}".format(p.X, p.Y, p.Z) for p in pts]

    if is_closed:
        if coords[0] != coords[-1]:
            coords.append(coords[0])
        return "POLYGON((" + ", ".join(coords) + "))"
    else:
        return "LINESTRING(" + ", ".join(coords) + ")"

# -------------------------
# Prepare lists safely
# -------------------------
areasPolylines = list(areasPolylines) if areasPolylines else []
EntitySubtype = list(EntitySubtype) if EntitySubtype else []
RoomType = list(RoomType) if RoomType else []

separatorsPolylines = list(separatorsPolylines) if separatorsPolylines else []
CoresPolylines = list(CoresPolylines) if CoresPolylines else []
doorsPolylines = list(doorsPolylines) if doorsPolylines else []
windowsPolylines = list(windowsPolylines) if windowsPolylines else []

# Scalars (or broadcast single-item lists)
Elevation_s = attr_scalar(Elevation, "")
OpeningBottomHeight_s = attr_scalar(OpeningBottomHeight, "")
OpeningsTopHeight_s = attr_scalar(OpeningsTopHeight, "")
FloorToFloorHeight_s = attr_scalar(FloorToFloorHeight, "")

# -------------------------
# CSV header (added "roomtype")
# -------------------------
headers = [
    "Unnamed: 0.1",
    "ID1",
    "ID2",
    "apartment_id",
    "site_id",
    "building_id",
    "plan_id",
    "floor_id",
    "unit_id",
    "area_id",
    "unit_usage",
    "roomtype",
    "entity_type",
    "entity_subtype",
    "geom",
    "elevation",
    "height",
    "zoning",
]

lines = []
lines.append(",".join(headers))

row_index = 0

def add_row(crv, *,
            id_mode="scalar", room_i=0,
            unit_usage_override=None,
            roomtype_override=None,
            entity_type_override=None,
            entity_subtype_override=None,
            elevation_override=None,
            height_override=None,
            zoning_override=None,
            infer_room_zoning=False):
    """Create one CSV row for one curve."""
    global row_index

    wkt = curve_to_wkt(crv)

    # IDs / metadata
    if id_mode == "rooms":
        id1_val = attr_value(ID1, room_i)
        id2_val = attr_value(ID2, room_i)
        apartment_id_val = attr_value(ApartmentID, room_i)
        site_id_val = attr_value(SiteID, room_i)
        building_id_val = attr_value(BuildingID, room_i)
        plan_id_val = attr_value(PlanID, room_i)
        floor_id_val = attr_value(FloorID, room_i)
        unit_id_val = attr_value(UnitID, room_i)
        area_id_val = attr_value(AreaID, room_i)
        unit_usage_val = attr_value(UnitUsage, room_i)
        entity_type_val = attr_value(EntityType, room_i)
    else:
        # Non-room rows: only broadcast scalars/singletons, otherwise blank
        id1_val = attr_scalar(ID1, "")
        id2_val = attr_scalar(ID2, "")
        apartment_id_val = attr_scalar(ApartmentID, "")
        site_id_val = attr_scalar(SiteID, "")
        building_id_val = attr_scalar(BuildingID, "")
        plan_id_val = attr_scalar(PlanID, "")
        floor_id_val = attr_scalar(FloorID, "")
        unit_id_val = attr_scalar(UnitID, "")
        area_id_val = attr_scalar(AreaID, "")
        unit_usage_val = attr_scalar(UnitUsage, "")
        entity_type_val = attr_scalar(EntityType, "")

    # Overrides
    if unit_usage_override is not None: unit_usage_val = unit_usage_override
    if entity_type_override is not None: entity_type_val = entity_type_override

    # roomtype
    roomtype_val = ""
    if id_mode == "rooms":
        rt = attr_value(RoomType, room_i, default="")
        if not str(rt).strip():
            rt = as_text(attr_value(EntitySubtype, room_i, default=""))
        roomtype_val = rt
    else:
        roomtype_val = roomtype_override if roomtype_override is not None else ""

    # entity_subtype
    if id_mode == "rooms":
        es = as_text(attr_value(EntitySubtype, room_i, default=""))
    else:
        es = entity_subtype_override if entity_subtype_override is not None else ""

    # elevation/height/zoning
    elevation_val = attr_value(Elevation, room_i) if id_mode == "rooms" else Elevation_s
    height_val = attr_value(Height, room_i) if id_mode == "rooms" else attr_scalar(Height, "")

    if elevation_override is not None: elevation_val = elevation_override
    if height_override is not None: height_val = height_override

    zoning_val = attr_value(Zoning, room_i, default="") if id_mode == "rooms" else ""
    if zoning_override is not None:
        zoning_val = zoning_override
    elif infer_room_zoning:
        if not str(zoning_val).strip():
            zoning_val = infer_zoning(es)

    # entity_subtype override last
    if entity_subtype_override is not None:
        es = entity_subtype_override

    # assemble row
    values = [
        row_index,
        id1_val,
        id2_val,
        apartment_id_val,
        site_id_val,
        building_id_val,
        plan_id_val,
        floor_id_val,
        unit_id_val,
        area_id_val,
        unit_usage_val,
        roomtype_val,
        entity_type_val,
        es,
        wkt,
        elevation_val,
        height_val,
        zoning_val
    ]
    lines.append(",".join(csv_escape(v) for v in values))
    row_index += 1

# -------------------------
# 1) Rooms (C)
# -------------------------
for i, crv in enumerate(areasPolylines):
    add_row(crv, id_mode="rooms", room_i=i, infer_room_zoning=True)

# -------------------------
# 2) Separators
# -------------------------
for crv in separatorsPolylines:
    add_row(crv,
            id_mode="scalar",
            roomtype_override="Structure",
            zoning_override="Structure",
            elevation_override=Elevation_s)

# -------------------------
# 3) Cores
# -------------------------
for crv in CoresPolylines:
    add_row(crv,
            id_mode="scalar",
            roomtype_override="Structure",
            zoning_override="Structure",
            entity_subtype_override="SHAFT",
            height_override=FloorToFloorHeight_s,
            elevation_override=Elevation_s)

# -------------------------
# 4) Doors
# -------------------------
for crv in doorsPolylines:
    add_row(crv,
            id_mode="scalar",
            roomtype_override="DOOR",
            zoning_override="DOOR",
            entity_subtype_override="DOOR",
            height_override=OpeningsTopHeight_s,
            elevation_override=Elevation_s)

# -------------------------
# 5) Windows
# NOTE: using elevation = OpeningBottomHeight, height = OpeningsTopHeight
# (if you prefer "height = top-bottom", tell me and I’ll adjust)
# -------------------------
for crv in windowsPolylines:
    add_row(crv,
            id_mode="scalar",
            roomtype_override="WINDOW",
            zoning_override="WINDOW",
            entity_subtype_override="WINDOW",
            height_override=OpeningsTopHeight_s,
            elevation_override=OpeningBottomHeight_s)

# -------------------------
# Outputs + optional save
# -------------------------
CSV = "\n".join(lines)
Lines = lines

try:
    if saveCsv and FilePath:
        with open(FilePath, "w", encoding="utf-8", newline="") as f:
            f.write(CSV)
        print("CSV saved to:", FilePath)
except Exception as e:
    print("Error writing file:", e)
# ---------- end python_3_script_2 ----------
panel_26 = Panel(python_3_script_2.out)
panel_27 = Panel(python_3_script_2.Lines)

# ----
# TO DO : EXPORT POLYGON FROM OPENINGS
# AND STRUCTURE DATA  LIKE MSD
# AND SAVE
curve_20 = Curve([<curve referenced from the Rhino model> x10])  # disabled
panel_28 = Panel("""Zimmer 1
Zimmer 2
Dusche
Vorzone
WC
Wohnen|Essen|Kochen
Reduit""")  # disabled
panel_29 = Panel("""0;0
0;1
0;2
0;3
0;4
0;5
0;6""")  # disabled
panel_30 = Panel("geom")  # disabled
read_data_from_xls_2 = BooleanToggle(True)  # disabled
worksheet = Panel("implenia")  # disabled
graft_tree = GraftTree(Tree=panel_30, IncludeEmptyLists=True, IncludeNullItems=True)  # disabled

# ---- group: characerize spaces
explode = Explode(Curve=curve_20, Recursive=True)  # -> Segments, Vertices; disabled
file_path_4 = FilePath("C:\Users\panz\Desktop\IBC_MSD - Copy.xlsx")  # disabled
deconstruct = Deconstruct(Point=explode.Vertices)  # -> XComponent, YComponent, ZComponent; disabled
panel_31 = Panel(" ")  # disabled
panel_32 = Panel(panel_28)  # disabled
concatenate = Concatenate(Fragment_A=deconstruct.XComponent, Fragment_B=panel_31, A=deconstruct.YComponent)  # disabled
python_3_script_3 = Python3Script(coords=concatenate)  # -> out, output; inputs coords: list; disabled
# ---------- python_3_script_3: Python ----------
"""Grasshopper Script"""
a = "Hello Python 3 in Grasshopper!"
coords = [
    (40.65, 15.65),
    (44.04, 15.65),
    (44.04, 11.16),
    (40.65, 11.16),
    (40.65, 15.65)
]

# Format as WKT Polygon
wkt_polygon = "POLYGON((" + ", ".join(f"{x} {y}" for x, y in coords) + "))"
output = wkt_polygon
print(output)
# ---------- end python_3_script_3 ----------
panel_33 = Panel(python_3_script_3.output)  # disabled

# ---- group: walls
concatenate_2 = Concatenate(Fragment_A=deconstruct.XComponent, Fragment_B=panel_31, A=deconstruct.YComponent)  # disabled
python_3_script_4 = Python3Script(coords=concatenate_2)  # -> out, output; inputs coords: list; disabled; same code as python_3_script_3
panel_34 = Panel(python_3_script_4.output)  # disabled

# ----
panel_35 = Panel(concatenate)  # disabled
create_tree = CreateTree(Data=panel_34, Path=panel_29)  # disabled
excel_write = ExcelWrite(
    WriteExcelData=read_data_from_xls_2,
    WorkbookPath=file_path_4,
    WorksheetName=worksheet,
    ColumnHeadings=panel_30,
    Data=flatten(create_tree),
    ClearSheet=False)  # disabled
panel_36 = Panel(excel_write)  # disabled

# ==== cluster RelPath
user = ClusterInput()
panel = Panel("curletto")
user_2 = Text(user)
path = ClusterInput()
path_2 = FilePath(path)
rep = ReplaceText(Text=path_2, Find="panz", Replace=user_2, RecursiveReplace=False)
panel_2 = Panel(path_2)
split = TextSplit(Text=rep, Separators="\")
panel_3 = Panel(rep)
panel_4 = Panel(split)
item = ListItem(List=split, Index=0, Wrap=True)  # -> Item1, Item, Item1_2, Item2, Item3, Item4
concat = Concatenate(FragmentA=item.Item, FragmentE=user_2, FragmentB="\", FragmentD=item.Item4)
path_3 = FilePath(rep)
path_4 = ClusterOutput(path_3)
panel_5 = Panel(path_3)

# ==== cluster Cluster
msd_formatted_data = ClusterInput()
explode_tree = ExplodeTree(Data=msd_formatted_data)  # -> Branch0, Branch1, Branch2, Branch3, Branch4, Branch5, Branch6, Branch7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

data = Data(explode_tree.Branch0)
list_item = ListItem(List=explode_tree.Branch0, Index=0, Wrap=True)
cull_index = CullIndex(List=data, Indices=0, Wrap=True)
panel = Panel(cull_index)
column_title = Panel(list_item)

data_2 = Data(explode_tree.Branch11)
cull_index_2 = CullIndex(List=data_2, Indices=0, Wrap=True)
list_item_2 = ListItem(List=explode_tree.Branch11, Index=0, Wrap=True)
panel_2 = Panel(cull_index_2)
column_title_2 = Panel(list_item_2)

data_3 = Data(explode_tree.Branch16)
cull_index_3 = CullIndex(List=data_3, Indices=0, Wrap=True)
list_item_3 = ListItem(List=explode_tree.Branch16, Index=0, Wrap=True)
panel_3 = Panel(cull_index_3)
column_title_3 = Panel(list_item_3)

data_4 = Data(explode_tree.Branch15)
list_item_4 = ListItem(List=explode_tree.Branch15, Index=0, Wrap=True)
cull_index_4 = CullIndex(List=data_4, Indices=0, Wrap=True)
panel_4 = Panel(cull_index_4)
column_title_4 = Panel(list_item_4)

data_5 = Data(explode_tree.Branch14)
list_item_5 = ListItem(List=explode_tree.Branch14, Index=0, Wrap=True)
cull_index_5 = CullIndex(List=data_5, Indices=0, Wrap=True)
panel_5 = Panel(cull_index_5)
column_title_5 = Panel(list_item_5)

data_6 = Data(explode_tree.Branch17)
cull_index_6 = CullIndex(List=data_6, Indices=0, Wrap=True)
list_item_6 = ListItem(List=explode_tree.Branch17, Index=0, Wrap=True)
column_title_6 = Panel(list_item_6)

data_7 = Data(explode_tree.Branch13)
cull_index_7 = CullIndex(List=data_7, Indices=0, Wrap=True)
list_item_7 = ListItem(List=explode_tree.Branch13, Index=0, Wrap=True)
panel_6 = Panel(cull_index_7)
column_title_7 = Panel(list_item_7)

data_8 = Data(explode_tree.Branch12)
cull_index_8 = CullIndex(List=data_8, Indices=0, Wrap=True)
list_item_8 = ListItem(List=explode_tree.Branch12, Index=0, Wrap=True)
panel_7 = Panel(cull_index_8)
column_title_8 = Panel(list_item_8)

data_9 = Data(explode_tree.Branch6)
cull_index_9 = CullIndex(List=data_9, Indices=0, Wrap=True)
list_item_9 = ListItem(List=explode_tree.Branch6, Index=0, Wrap=True)
panel_8 = Panel(cull_index_9)
column_title_9 = Panel(list_item_9)

data_10 = Data(explode_tree.Branch2)
list_item_10 = ListItem(List=explode_tree.Branch2, Index=0, Wrap=True)
cull_index_10 = CullIndex(List=data_10, Indices=0, Wrap=True)
column_title_10 = Panel(list_item_10)
panel_9 = Panel(cull_index_10)

data_11 = Data(explode_tree.Branch4)
list_item_11 = ListItem(List=explode_tree.Branch4, Index=0, Wrap=True)
cull_index_11 = CullIndex(List=data_11, Indices=0, Wrap=True)
panel_10 = Panel(cull_index_11)
site_id = Panel(list_item_11)

data_12 = Data(explode_tree.Branch3)
list_item_12 = ListItem(List=explode_tree.Branch3, Index=0, Wrap=True)
cull_index_12 = CullIndex(List=data_12, Indices=0, Wrap=True)
apartment_id = Panel(list_item_12)
panel_11 = Panel(cull_index_12)

data_13 = Data(explode_tree.Branch5)
cull_index_13 = CullIndex(List=data_13, Indices=0, Wrap=True)
list_item_13 = ListItem(List=explode_tree.Branch5, Index=0, Wrap=True)
panel_12 = Panel(cull_index_13)
column_title_11 = Panel(list_item_13)

data_14 = Data(explode_tree.Branch10)
cull_index_14 = CullIndex(List=data_14, Indices=0, Wrap=True)
list_item_14 = ListItem(List=explode_tree.Branch10, Index=0, Wrap=True)
panel_13 = Panel(cull_index_14)
column_title_12 = Panel(list_item_14)

data_15 = Data(explode_tree.Branch9)
cull_index_15 = CullIndex(List=data_15, Indices=0, Wrap=True)
list_item_15 = ListItem(List=explode_tree.Branch9, Index=0, Wrap=True)
panel_14 = Panel(cull_index_15)
column_title_13 = Panel(list_item_15)

data_16 = Data(explode_tree.Branch8)
cull_index_16 = CullIndex(List=data_16, Indices=0, Wrap=True)
list_item_16 = ListItem(List=explode_tree.Branch8, Index=0, Wrap=True)
panel_15 = Panel(cull_index_16)
column_title_14 = Panel(list_item_16)

data_17 = Data(explode_tree.Branch7)
cull_index_17 = CullIndex(List=data_17, Indices=0, Wrap=True)
list_item_17 = ListItem(List=explode_tree.Branch7, Index=0, Wrap=True)
panel_16 = Panel(cull_index_17)
column_title_15 = Panel(list_item_17)

list_item_18 = ListItem(List=explode_tree.Branch1, Index=0, Wrap=True)

data_18 = Data(explode_tree.Branch1)
cull_index_18 = CullIndex(List=data_18, Indices=0, Wrap=True)
panel_17 = Panel(cull_index_18)
column_title_16 = Panel(list_item_18)

unit_id = ClusterOutput(cull_index_16)
building_id = ClusterOutput(cull_index_13)
plan_id = ClusterOutput(cull_index_9)
unit_usage = ClusterOutput(cull_index_14)
area_id = ClusterOutput(cull_index_15)
row_number = ClusterOutput(cull_index_10)
apartment_id_2 = ClusterOutput(cull_index_12)
floor_id = ClusterOutput(cull_index_17)
roomtype = ClusterOutput(cull_index_6)
# -"zone1" refers to a
# private space,
# 
# -"zone2" to a public space,
# -"zone3" to a service space, and
# -"zone4"
# to an outside place
zoning = ClusterOutput(cull_index_3)  # zone 1 private
entity_subtype = ClusterOutput(cull_index_8)
geometry = ClusterOutput(cull_index_7)
site_id_2 = ClusterOutput(cull_index_11)
elevation = ClusterOutput(cull_index_5)
entity_type = ClusterOutput(cull_index_2)
height = ClusterOutput(cull_index_4)
