# Grasshopper definition test-svg-export.gh (Grasshopper 1.0.8)
# plug-ins: Pufferfish, GraphicPlus, ShapeDiverForGrasshopper

text = DirectTextInput(maxlength=10000, text="Test")
color_1 = ColourSwatch(SwatchColor=RGB(255, 0, 255))
color_2 = ColourSwatch(SwatchColor=RGB(0, 0, 255))
panel = Panel(text)
merge = Merge(Data1=color_1, Data2=color_2, Data3=color_1)
text_shape = TextShape(Text=text, Plane=PlaneXY(0, 0, 0))
circle = Circle(Plane=PlaneXY(0, 0, 0), Radius=Slider(100, range=1..100))
last_index = LastIndex(List=merge)
font = Font(TextShape=text_shape, FontFamily="Arial", FontSize=20, Bold=False, Italic=False, Underline=False, Justification=4)
range = Range(Domain=Domain(0, 1), Steps=last_index)  # -> flatten(Range)
gradient_radial_fill = GradientRadialFill(ShapeGeometry=circle, Colors=merge, Parameters=range)
shape_link = ShapeLink(ShapeGeometry=font, Hyperlink="https://www.shapediver.com")
drop_shadow = DropShadow(
    ShapeGeometry=gradient_radial_fill,
    ShadowBlurRadius=Slider(100, range=1..100),
    ShadowOffset=Slider(10, range=1..100),
    ShadowAngle=Slider(45, range=1..100))
panel_2 = Panel("""10
5
10
5""")
bounding_rectangle = BoundingRectangle(Geometry=circle, Plane=PlaneXY(0, 0, 0), Axis=0, Slide=0, Union=True)  # -> Bounding, DimensionX, DimensionY
stroke = Stroke(ShapeGeometry=drop_shadow, Color=RGB(255, 0, 0), Weight=2, Pattern=panel_2, EndCap=0)
panel_3 = Panel("""Key 1
Key 2""")
shape_data = ShapeData(ShapeGeometry=shape_link, ID="thisIsText")
offset_curve = OffsetCurve(Curve=bounding_rectangle.Bounding, Distance=50, Corners=1)  # -> flatten(Curve)
shape_data_2 = ShapeData(ShapeGeometry=stroke, ID="thisIsCircle", Keys=panel_3)
shape_settings = ShapeSettings(ShapeGeometry=shape_data_2, Layer="main :: circle")
shape_settings_2 = ShapeSettings(ShapeGeometry=shape_data, Layer="main :: text")
merge_2 = Merge(Data1=shape_settings, Data2=shape_settings_2)
construct_drawing = ConstructDrawing(ShapesGeometry=merge_2, Boundary=offset_curve, Color=RGBA(255, 255, 255, 0), Units=0)  # -> Drawing, Boundary
svg_text = SVGText(DrawingsShapesGeometry=construct_drawing.Drawing)
drawing_to_bitmap = DrawingToBitmap(DrawingsShapesGeometry=construct_drawing.Drawing, PPI=300)
image_export_options = ImageExportOptions(Format="png", QualityLevel=100, N=False)
gltf_2_0_material = GlTF20Material(
    BaseColorFactor=RGB(255, 255, 255),
    BaseColorTexture=drawing_to_bitmap,
    MetallicFactor=0,
    RoughnessFactor=1,
    EmissiveFactor=RGB(0, 0, 0),
    AlphaMode="BLEND",
    AlphaCutoff=0.5,
    DoubleSided=True)
mesh_plane = MeshPlane(Boundary=offset_curve, WidthCount=1, HeightCount=1)  # -> Mesh, Area
stringtostream = CSharpScript(txt=svg_text)  # -> out, stream; inputs txt: String
# ---------- stringtostream: C# usings ----------
using System.IO;
using System.Text;
# ---------- stringtostream: C# ----------
    stream = StringToStream(txt);
# ---------- stringtostream: C# additional code ----------
  public static Stream StringToStream(string input)
  {
    MemoryStream stream = new MemoryStream();
    using (StreamWriter writer = new StreamWriter(stream, Encoding.UTF8, 1024, true))
    {
      writer.Write(input);
      writer.Flush();  // Make sure all data is written to the stream
    }

    // Reset the position of the stream to the beginning
    stream.Position = 0;
    return stream;
  }
# ---------- end stringtostream ----------
stream_export_options = StreamExportOptions(ContentType="svg,image/svg+xml", N=False)
download_image = DownloadExport(Data=drawing_to_bitmap, Options=image_export_options, Name="testImage")
download_svg = DownloadExport(Data=stringtostream.stream, Options=stream_export_options, Name="test")
gltf_2_0_display = GlTF20Display(Geometry=mesh_plane.Mesh, Material=gltf_2_0_material)
