# Grasshopper definition test-svg-export.gh (Grasshopper 1.0.7)
# plug-ins: ShapeDiverForGrasshopper, GraphicPlus, Pufferfish

color_1 = ColourSwatch(SwatchColor=RGB(255, 0, 255))
color_2 = ColourSwatch(SwatchColor=RGB(0, 0, 255))
text = DirectTextInput(maxlength=10000, text="Test")
text_2 = TextShape(Text=text, Plane=PlaneXY(0, 0, 0))
cir = Circle(Plane=PlaneXY(0, 0, 0), Radius=Slider(100, range=1..100))
merge = Merge(Data1=color_1, Data2=color_2, Data3=color_1)
lastdex = LastIndex(List=merge)
font = Font(TextShape=text_2, FontFamily="Arial", FontSize=20, Bold=False, Italic=False, Underline=False, Justification=4)
range = Range(Domain=Domain(0, 1), Steps=lastdex)  # -> flatten(Range)
link = ShapeLink(ShapeGeometry=font, Hyperlink="https://www.shapediver.com")
radial_gradient = GradientRadialFill(ShapeGeometry=cir, Colors=merge, Parameters=range)
shadow = DropShadow(
    ShapeGeometry=radial_gradient,
    ShadowBlurRadius=Slider(100, range=1..100),
    ShadowOffset=Slider(10, range=1..100),
    ShadowAngle=Slider(45, range=1..100))
panel = Panel("""10
5
10
5""")
brec = BoundingRectangle(Geometry=cir, Plane=PlaneXY(0, 0, 0), Axis=0, Slide=0, Union=True)  # -> Bounding, DimensionX, DimensionY
stroke = Stroke(ShapeGeometry=shadow, Color=RGB(255, 0, 0), Weight=2, Pattern=panel, EndCap=0)
panel_2 = Panel("""Key 1
Key 2""")
offset = OffsetCurve(Curve=brec.Bounding, Distance=50, Corners=1)  # -> flatten(Curve)
data = ShapeData(ShapeGeometry=link, ID="thisIsText")
data_2 = ShapeData(ShapeGeometry=stroke, ID="thisIsCircle", Keys=panel_2)
settings = ShapeSettings(ShapeGeometry=data_2, Layer="main :: circle")
settings_2 = ShapeSettings(ShapeGeometry=data, Layer="main :: text")
merge_2 = Merge(Data1=settings, Data2=settings_2)
drawing = ConstructDrawing(ShapesGeometry=merge_2, Boundary=offset, Color=RGBA(255, 255, 255, 0), Units=0)  # -> Drawing, Boundary
exportimg = ImageExportOptions(Format="png", QualityLevel=100, N=False)
drawingtobmp = DrawingToBitmap(DrawingsShapesGeometry=drawing.Drawing, PPI=300)
svgtxt = SVGText(DrawingsShapesGeometry=drawing.Drawing)
stringtostream = CSharpScript(txt=svgtxt)  # -> out, stream; inputs txt: String
# ---------- stringtostream: C# usings ----------
using System.IO;
using System.Text;
# ---------- stringtostream: C# ----------
    stream = StringToStream(txt);
# ---------- stringtostream: C# additional code ----------
  public static Stream StringToStream(string input)
  {
    MemoryStream stream = new MemoryStream();
    using (StreamWriter writer = new StreamWriter(stream, Encoding.UTF8, 1024, true))
    {
      writer.Write(input);
      writer.Flush();  // Make sure all data is written to the stream
    }

    // Reset the position of the stream to the beginning
    stream.Position = 0;
    return stream;
  }
# ---------- end stringtostream ----------
gltf2material = GlTF20Material(
    BaseColorFactor=RGB(255, 255, 255),
    BaseColorTexture=drawingtobmp,
    MetallicFactor=0,
    RoughnessFactor=1,
    EmissiveFactor=RGB(0, 0, 0),
    AlphaMode="BLEND",
    AlphaCutoff=0.5,
    DoubleSided=True)
exportstream = StreamExportOptions(ContentType="svg,image/svg+xml", N=False)
mplane = MeshPlane(Boundary=offset, WidthCount=1, HeightCount=1)  # -> Mesh, Area
download_svg = DownloadExport(Data=stringtostream.stream, Options=exportstream, Name="test")
download_image = DownloadExport(Data=drawingtobmp, Options=exportimg, Name="testImage")
gltfdisplay = GlTF20Display(Geometry=mplane.Mesh, Material=gltf2material)
