# Grasshopper definition readFlooplan_andFormat_ToMSD_csv.gh (Grasshopper 1.0.8)

# ----
# room boundaries
pipeline = GeometryPipeline(
    GroupByLayer=False,
    GroupByType=False,
    IncludeHidden=True,
    IncludeLocked=True,
    LayerFilter="*areas",
    NameFilter="*",
    SublayerFiltering=True,
    TypeFilter=4)
crv = Curve(pipeline)

# ----
# window boundaries
pipeline_2 = GeometryPipeline(
    GroupByLayer=False,
    GroupByType=False,
    IncludeHidden=True,
    IncludeLocked=True,
    LayerFilter="*windows",
    NameFilter="*",
    SublayerFiltering=True,
    TypeFilter=4)
crv_2 = Curve(pipeline_2)

# ----
# walls
pipeline_3 = GeometryPipeline(
    GroupByLayer=False,
    GroupByType=False,
    IncludeHidden=True,
    IncludeLocked=True,
    LayerFilter="*walls",
    NameFilter="*",
    SublayerFiltering=True,
    TypeFilter=4)
crv_3 = Curve(pipeline_3)

# ----
# door boundaries
pipeline_4 = GeometryPipeline(
    GroupByLayer=False,
    GroupByType=False,
    IncludeHidden=True,
    IncludeLocked=True,
    LayerFilter="*doors",
    NameFilter="*",
    SublayerFiltering=True,
    TypeFilter=4)
crv_4 = Curve(pipeline_4)

# ----
# room tags
panel = Panel("textTags")
py3 = Python3Script(layerName=panel)  # -> out, guids, texts, origins, planes
# ---------- py3: Python ----------
import Rhino
import System

# INPUT:
# layerName: str

# OUTPUTS:
# guids   : list[System.Guid]
# texts   : list[str]
# origins : list[Rhino.Geometry.Point3d]
# planes  : list[Rhino.Geometry.Plane]

guids, texts, origins, planes = [], [], [], []

doc = Rhino.RhinoDoc.ActiveDoc
if doc is None or not layerName:
    # leave outputs empty
    pass
else:
    # Find layer by full path first (e.g. "A::B"), then by simple name
    layer_index = doc.Layers.FindByFullPath(layerName, -1)
    if layer_index < 0:
        layer_index = doc.Layers.Find(layerName, True)

    if layer_index >= 0:
        for rh_obj in doc.Objects:
            if rh_obj is None or rh_obj.Attributes is None:
                continue
            if rh_obj.Attributes.LayerIndex != layer_index:
                continue

            geom = rh_obj.Geometry
            if geom is None:
                continue

            # Regular annotation text in Rhino is typically TextEntity
            if isinstance(geom, Rhino.Geometry.TextEntity):
                guids.append(rh_obj.Id)

                # Text content
                # PlainText is usually what you want; Text may include formatting depending on source
                try:
                    texts.append(geom.PlainText)
                except:
                    texts.append(geom.Text)

                # Placement / orientation
                # TextEntity has a Plane describing its position/orientation
                pl = geom.Plane
                planes.append(pl)
                origins.append(pl.Origin)
# ---------- end py3 ----------
panel_2 = Panel(py3.texts)

save_csv = BooleanToggle(True)
csvpath = FilePath("C:\Users\panz\Downloads\impelnia_caseStudy_3_test1.csv")

crv_5 = Curve(crv_2)
crv_6 = Curve(crv_3)
crv_7 = Curve(crv)
crv_8 = Curve(crv_4)

# ---- group: Reference text objects from Rhino
pt = Point(py3.origins)
txt = Text(py3.texts)

# ----
number_slider = Slider(0, range=0..1)
number_slider_2 = Slider(0, range=0..2.2)
number_slider_3 = Slider(0, range=0..2.2)
number_slider_4 = Slider(3, range=0..5)
number_slider_5 = Slider(0.9, range=0..2)
number_slider_6 = Slider(0.054, range=0..1)

save_json = BooleanToggle(True)
json = FilePath("C:\Users\panz\Downloads\impelnia_caseStudy_3_test1.json")

py3_2 = Python3Script(Rooms=crv_7)  # -> out, RoomBoundaries, RoomTagsOut, RoomTagPoints; inputs Rooms: list, RoomTags: list; disabled
# ---------- py3_2: Python ----------
import Rhino
import System
import scriptcontext as sc
from Grasshopper import DataTree
from Grasshopper.Kernel.Data import GH_Path

tol = sc.doc.ModelAbsoluteTolerance
DEFAULT_TEXT = "N/A"

def unwrap(x):
    return x.Value if hasattr(x, "Value") else x

def to_curve(x):
    x = unwrap(x)
    if x is None:
        return None
    if isinstance(x, Rhino.Geometry.Curve):
        return x
    if isinstance(x, Rhino.Geometry.Polyline):
        return Rhino.Geometry.PolylineCurve(x)
    if isinstance(x, System.Guid):
        ro = sc.doc.Objects.FindId(x)
        if ro and isinstance(ro.Geometry, Rhino.Geometry.Curve):
            return ro.Geometry.DuplicateCurve()
    if isinstance(x, Rhino.DocObjects.ObjRef):
        c = x.Curve()
        return c.DuplicateCurve() if c else None
    return None

def to_point3d(x):
    x = unwrap(x)
    if x is None:
        return None
    if isinstance(x, Rhino.Geometry.Point3d):
        return x
    if isinstance(x, Rhino.Geometry.Point):
        return x.Location
    if isinstance(x, System.Guid):
        ro = sc.doc.Objects.FindId(x)
        if ro:
            g = ro.Geometry
            if isinstance(g, Rhino.Geometry.Point):
                return g.Location
    if isinstance(x, Rhino.DocObjects.ObjRef):
        p = x.Point()
        return p.Location if p else None
    return None

def curve_plane(crv):
    if not crv:
        return Rhino.Geometry.Plane.WorldXY
    ok, pl = crv.TryGetPlane()
    return pl if ok else Rhino.Geometry.Plane.WorldXY

def curve_area_and_centroid(crv):
    """
    Returns (area, centroid).
    If area centroid fails, falls back to bbox "area" proxy and bbox center.
    """
    if not crv:
        return (float("inf"), None)

    amp = None
    try:
        amp = Rhino.Geometry.AreaMassProperties.Compute(crv)
    except:
        amp = None

    if amp:
        return (abs(amp.Area), amp.Centroid)

    # bbox fallback
    try:
        bb = crv.GetBoundingBox(True)
        if bb.IsValid:
            dx = bb.Max.X - bb.Min.X
            dy = bb.Max.Y - bb.Min.Y
            dz = bb.Max.Z - bb.Min.Z
            bbox_area_proxy = abs(dx * dy) + abs(dy * dz) + abs(dx * dz)
            return (bbox_area_proxy, bb.Center)
    except:
        pass

    # last fallback
    try:
        return (float("inf"), crv.PointAtNormalizedLength(0.5))
    except:
        return (float("inf"), None)

# --- inputs ---
Rooms = list(Rooms) if Rooms else []
RoomTags = list(RoomTags) if RoomTags else []
Pts = list(Pts) if Pts else []

if len(RoomTags) != len(Pts):
    raise Exception("RoomTags and Pts must have the same length and matching order.")

room_curves = [to_curve(r) for r in Rooms]
label_pts   = [to_point3d(p) for p in Pts]

n_rooms = len(room_curves)
n_tags  = len(RoomTags)

# Precompute per-room info
room_planes   = [curve_plane(c) for c in room_curves]
room_area     = [None] * n_rooms
room_centroid = [None] * n_rooms

for i, crv in enumerate(room_curves):
    a, cpt = curve_area_and_centroid(crv)
    room_area[i] = a
    room_centroid[i] = cpt

# Step 1: Assign each TAG -> best ROOM (smallest-area containing curve)
room_to_tag_candidates = {i: [] for i in range(n_rooms)}
tag_to_room = [-1] * n_tags

for j, pt in enumerate(label_pts):
    if pt is None:
        continue

    containing_rooms = []
    for i, crv in enumerate(room_curves):
        if not crv:
            continue
        rel = crv.Contains(pt, room_planes[i], tol)
        if rel in (Rhino.Geometry.PointContainment.Inside,
                   Rhino.Geometry.PointContainment.Coincident):
            containing_rooms.append(i)

    if not containing_rooms:
        continue

    # Choose the smallest containing boundary (most likely the actual room, not apartment outline)
    best_i = min(containing_rooms, key=lambda i: room_area[i] if room_area[i] is not None else float("inf"))
    tag_to_room[j] = best_i
    room_to_tag_candidates[best_i].append(j)

# Step 2: Enforce one tag per room (pick closest to centroid if multiple)
RoomBoundaries = DataTree[object]()
RoomTagsOut    = DataTree[object]()
RoomTagPoints  = DataTree[object]()

used_tag = [False] * n_tags

for i, crv in enumerate(room_curves):
    path = GH_Path(i)

    RoomBoundaries.Add(crv, path)

    if not crv:
        RoomTagsOut.Add(DEFAULT_TEXT, path)
        RoomTagPoints.Add(None, path)
        continue

    candidates = room_to_tag_candidates.get(i, [])
    if candidates:
        cpt = room_centroid[i]
        if cpt is None:
            chosen = candidates[0]
        else:
            chosen = min(candidates, key=lambda j: label_pts[j].DistanceTo(cpt) if label_pts[j] else float("inf"))

        RoomTagsOut.Add(RoomTags[chosen], path)
        RoomTagPoints.Add(label_pts[chosen], path)
        used_tag[chosen] = True
    else:
        # No tag assigned -> centroid + N/A
        RoomTagsOut.Add(DEFAULT_TEXT, path)
        RoomTagPoints.Add(room_centroid[i], path)

Unassigned = [RoomTags[k] for k, u in enumerate(used_tag) if not u]
# ---------- end py3_2 ----------
format_floorplan_as_csv = Python3Script(
    Rooms=crv_7,
    Walls=crv_6,
    Windows=crv_5,
    Doors=crv_8,
    TagTxt=txt,
    TagPts=pt,
    Tolerance=number_slider_6,
    DefaultWindowElevation=number_slider_5,
    DefaultRoomHeight=number_slider_4,
    DefaultWallHeight=number_slider,
    DefaultDoorHeight=number_slider_3,
    DefaultWindowHeight=number_slider_2,
    CsvPath=csvpath,
    WriteCsv=save_csv)  # -> out, OK, Report, Rows, DebugTagTypes, RoomTagPtsOut, RoomTagTxtOut, RoomTagIndexOut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; inputs Rooms: list of Curve, Walls: list of Curve, Windows: list of Curve, Doors: list of Curve, TagTxt: list, TagPts: list of Point3d, WriteCsv: Boolean; disabled
# ---------- format_floorplan_as_csv: Python ----------
"""
MSD CSV Exporter for DXF-imported polygons in Grasshopper (multi-unit support)
Rhino 8 CPython-safe (no TryGetPolyline by-ref, no PolylineCurve iteration)

INPUTS (keep these names in GH):
  Rooms, Walls, Windows, Doors : lists of Rhino.Geometry.Curve (polygons)
  TagPts : list of points (Point3d OR Guid OR Rhino point objects)
  TagTxt : list of strings
  CsvPath : full output csv path
  WriteCsv : bool (if False, just prepares Rows, does not write file)

OPTIONAL INPUTS:
  Units : list of unit boundary polygons (curves) (preferred multi-unit method)
  UnitLabelRegex : regex string for unit labels like A01, B12 (fallback multi-unit method)
  ExistingCsvPath : optional existing MSD csv path to continue IDs (max+1)
  DefaultWindowElevation, DefaultRoomHeight, DefaultWallHeight, DefaultDoorHeight, DefaultWindowHeight : numbers
  Tolerance : numeric Toleranceerance (suggest 0.05..0.5 depending on DXF units)

OUTPUTS (create these outputs in GH):
  OK : bool
  Report : string
  Rows : list of row dicts
  TagAssignments : debug strings (tag text + point + assigned room index)
  RoomTagTxtOut : list[str] length == Rooms (roomtype per room, incl. N/A)
  RoomTagPtsOut : list[Point3d] length == Rooms (centroid per room)
  RoomCrvsOut : list[Curve] length == Rooms (room curves)
"""

import os, sys, csv, uuid, re
import System
import Rhino
from Rhino.Geometry import Point3d, Plane, AreaMassProperties
import json

# -----------------------------
# Polyline-safe utilities (Rhino 8 CPython)
# -----------------------------

def polyline_points_from_any(obj, Tolerance=0.01):
    """Return list[Point3d] from Polyline / PolylineCurve / Curve with TryGetPolyline()."""
    if obj is None:
        return None

    if isinstance(obj, Rhino.Geometry.Polyline):
        return [obj[i] for i in range(obj.Count)]

    if isinstance(obj, Rhino.Geometry.PolylineCurve):
        try:
            ok, pl = obj.TryGetPolyline()  # CPython overload
            if ok and pl:
                return [pl[i] for i in range(pl.Count)]
        except:
            pass
        try:
            pl = obj.ToPolyline()
            return [pl[i] for i in range(pl.Count)]
        except:
            return None

    if isinstance(obj, Rhino.Geometry.Curve):
        try:
            ok, pl = obj.TryGetPolyline()
            if ok and pl:
                return [pl[i] for i in range(pl.Count)]
        except:
            pass

    return None

def ensure_closed_curve(curve, Tolerance):
    if curve is None:
        return None
    if curve.IsClosed:
        return curve

    pts = polyline_points_from_any(curve, Tolerance)
    if pts and len(pts) >= 3:
        if pts[0].DistanceTo(pts[-1]) > Tolerance:
            pts.append(pts[0])
        return Rhino.Geometry.PolylineCurve(pts)

    try:
        plc = curve.ToPolyline(Tolerance, Tolerance, 0.0, 0.0)  # PolylineCurve
        pts2 = polyline_points_from_any(plc, Tolerance)
        if pts2 and len(pts2) >= 3:
            if pts2[0].DistanceTo(pts2[-1]) > Tolerance:
                pts2.append(pts2[0])
            return Rhino.Geometry.PolylineCurve(pts2)
        return plc if plc else curve
    except:
        return curve

def curve_centroid(curve):
    try:
        amp = AreaMassProperties.Compute(curve)
        if amp:
            return amp.Centroid
    except:
        pass
    try:
        return curve.GetBoundingBox(True).Center
    except:
        return Point3d(0, 0, 0)

def curve_to_wkt_polygon(curve, Tolerance):
    c = ensure_closed_curve(curve, Tolerance)
    if c is None:
        return ""
    pts = polyline_points_from_any(c, Tolerance)

    if not pts or len(pts) < 3:
        # sample fallback
        try:
            dom = c.Domain
            segs = 64
            pts = []
            for i in range(segs + 1):
                t = dom.T0 + (dom.T1 - dom.T0) * (float(i) / float(segs))
                pts.append(c.PointAt(t))
        except:
            return ""

    if len(pts) < 3:
        return ""

    if pts[0].DistanceTo(pts[-1]) > Tolerance:
        pts.append(pts[0])

    coord = ["{0} {1}".format(float(p.X), float(p.Y)) for p in pts]
    return "POLYGON (({0}))".format(", ".join(coord))

# -----------------------------
# Robust 2D point-in-polygon (DXF-friendly)
# -----------------------------

def _point_on_segment_2d(p, a, b, Tolerance):
    ax, ay = a.X, a.Y
    bx, by = b.X, b.Y
    px, py = p.X, p.Y
    vx, vy = bx-ax, by-ay
    wx, wy = px-ax, py-ay
    seg_len2 = vx*vx + vy*vy
    if seg_len2 == 0.0:
        dx, dy = px-ax, py-ay
        return (dx*dx + dy*dy) <= Tolerance*Tolerance
    t = (wx*vx + wy*vy) / seg_len2
    if t < 0.0: t = 0.0
    elif t > 1.0: t = 1.0
    cx = ax + t*vx
    cy = ay + t*vy
    dx, dy = px-cx, py-cy
    return (dx*dx + dy*dy) <= Tolerance*Tolerance

def point_in_polygon_xy(curve, pt, Tolerance):
    c = ensure_closed_curve(curve, Tolerance)
    if c is None:
        return False

    pts = polyline_points_from_any(c, Tolerance)
    if not pts or len(pts) < 3:
        return False

    # close
    if pts[0].DistanceTo(pts[-1]) > Tolerance:
        pts = pts + [pts[0]]

    p = Point3d(pt.X, pt.Y, 0.0)

    # boundary as inside
    for i in range(len(pts)-1):
        a = Point3d(pts[i].X, pts[i].Y, 0.0)
        b = Point3d(pts[i+1].X, pts[i+1].Y, 0.0)
        if _point_on_segment_2d(p, a, b, Tolerance):
            return True

    inside = False
    x, y = p.X, p.Y
    for i in range(len(pts)-1):
        x1, y1 = pts[i].X, pts[i].Y
        x2, y2 = pts[i+1].X, pts[i+1].Y
        if (y1 > y) != (y2 > y):
            x_int = x1 + (y - y1) * (x2 - x1) / (y2 - y1)
            if x_int >= x:
                inside = not inside
    return inside

# -----------------------------
# CSV + normalization logic
# -----------------------------

def roomtype_from_tag_text(txt):
    """
    Map certain tags to MSD roomtype rules.
    - elevator/shaft/stairs => "structure"
    Otherwise returns cleaned text (or "N/A").
    """
    t = normalize_roomtype(txt)
    tl = t.strip().lower()
    tl = re.sub(r"\s+", " ", tl)

    if tl in ["elevator", "shaft", "stairs"]:
        return "structure"

    return t

def is_ironpython():
    return sys.platform == "cli"

def safe_open_csv(path):
    if is_ironpython():
        return open(path, "wb")
    else:
        return open(path, "w", newline="")

def normalize_roomtype(txt):
    if txt is None:
        return "N/A"
    t = str(txt).strip()
    return t if t else "N/A"

def to_entity_subtype_from_text(txt):
    t = normalize_roomtype(txt)
    if t == "N/A":
        return "N/A"
    t2 = re.sub(r"\s+", "_", t.strip().upper())
    # optional normalizations
    t2 = t2.replace("BED_ROOM", "BEDROOM")
    t2 = t2.replace("LIVINGROOM", "LIVING_ROOM")
    t2 = t2.replace("DININGROOM", "DINING_ROOM")
    return t2


def to_entity_subtype_from_roomtype(roomtype):
    rt = normalize_roomtype(roomtype)
    if rt == "N/A":
        return "N/A"
    rt2 = re.sub(r"\s+", "_", rt.strip().upper())
    rt2 = rt2.replace("BED_ROOM", "BEDROOM")
    rt2 = rt2.replace("LIVINGROOM", "LIVING_ROOM")
    rt2 = rt2.replace("DININGROOM", "DINING_ROOM")
    return rt2

def zoning_for_roomtype(roomtype):
    rt = normalize_roomtype(roomtype).strip().lower()
    rt = re.sub(r"\s+", " ", rt)

    # structure rooms
    if rt in ["structure", "elevator", "shaft", "stairs"]:
        return "structure"

    if rt in ["bedroom", "bed room", "room"]:
        return "zone 1"
    if rt in ["livingroom", "living room", "kitchen", "diningroom", "dining room"]:
        return "zone2"
    if rt in ["bathroom", "wc", "storage","corridor","reduit"]:
        return "zone3"
    if rt in ["balcony"]:
        return "zone4"

    return "N/A"

# -----------------------------
#Predict roomtype for rooms that are still "N/A"
#provide some rules so that roomtype can be inferred/predicted based on the neighbors  for rooms do not have a text tag/roomtype="N/a"
# -----------------------------
PREDICT_RULES = [
    # your example:
    {"result": "kitchen", "match": ["living room", "LivingRoom", "dining room", "diningroom","Corridor"], "min_votes": 1, "k": 4},

    # examples you can add:
    {"result": "structure", "match": ["structure"], "min_votes": 2, "k": 3},

]
#Normalizer function for text tag
def _rt_key(rt):
    if rt is None:
        return "n/a"
    s = str(rt).strip().lower()
    s = re.sub(r"\s+", " ", s)
    s = s.replace("_", " ")
    return s if s else "n/a"

# “vote” helper functiion 
def _votes(neighbor_types, aliases):
    """
    Count how many neighbors match any alias in aliases.
    neighbor_types should already be normalized via _rt_key.
    """
    aset = set([_rt_key(a) for a in aliases])
    return sum(1 for t in neighbor_types if t in aset)


def find_nearest_room_indices(i, centroids, k=3, exclude_self=True):
    """
    Return indices of k nearest rooms to room i.
    """
    ci = centroids[i]
    dlist = []
    for j, cj in enumerate(centroids):
        if exclude_self and j == i:
            continue
        dlist.append((ci.DistanceTo(cj), j))
    dlist.sort(key=lambda x: x[0])
    return [j for (_, j) in dlist[:k]]

def predict_roomtype_from_neighbors(room_i, roomtype_by_room_index, centroids, rules):
    """
    For rooms whose current type is N/A, predict from neighbor votes.
    Returns predicted string or "N/A".
    """
    current = _rt_key(roomtype_by_room_index.get(room_i, "N/A"))
    if current != "n/a":
        return roomtype_by_room_index.get(room_i, "N/A")

    for rule in rules:
        k = int(rule.get("k", 3))
        min_votes = int(rule.get("min_votes", 2))
        nbrs = find_nearest_room_indices(room_i, centroids, k=k)

        # neighbor types (ignore N/A)
        neighbor_types = []
        for j in nbrs:
            t = _rt_key(roomtype_by_room_index.get(j, "N/A"))
            if t != "n/a":
                neighbor_types.append(t)

        if not neighbor_types:
            continue

        if _votes(neighbor_types, rule["match"]) >= min_votes:
            return rule["result"]

    return "N/A"
#check adjacency of door to shaft, elevator)
def is_adjacent_to_special_room(door_curve, room_curves, subtype_by_room_index, Tolerance):
    """
    Returns True if door is within a small distance of any special room (ELEVATOR/SHAFT).
    Uses point sampling on the door curve for robustness.
    """
    if door_curve is None or not room_curves:
        return False

    # distance threshold (tune if needed)
    max_dist = max(Tolerance * 20.0, Tolerance)  # e.g. Tolerance=0.05 -> 1.0; Tolerance=0.01 -> 0.2

    # Build sample points from door
    samples = []
    try:
        samples.append(door_curve.GetBoundingBox(True).Center)
    except:
        samples.append(Point3d(0, 0, 0))

    # add polyline vertices + midpoints if possible
    pts = polyline_points_from_any(ensure_closed_curve(door_curve, Tolerance), Tolerance)
    if pts and len(pts) >= 2:
        # flatten & unique-ish
        pts2 = [Point3d(p.X, p.Y, 0.0) for p in pts]
        # vertices
        for p in pts2:
            samples.append(p)
        # midpoints
        for i in range(len(pts2) - 1):
            a = pts2[i]; b = pts2[i+1]
            samples.append(Point3d((a.X + b.X) * 0.5, (a.Y + b.Y) * 0.5, 0.0))

    # flatten bbox sample too
    samples = [Point3d(p.X, p.Y, 0.0) for p in samples if p is not None]

    # Check against special rooms
    for i, r in enumerate(room_curves):
        sub = (subtype_by_room_index.get(i, "N/A") or "N/A").strip().upper()
        if sub not in ["ELEVATOR", "SHAFT","STAIRS","STAIRCASE" ]:
            continue

        # quick bbox reject
        try:
            if door_curve.GetBoundingBox(True).DistanceTo(r.GetBoundingBox(True)) > max_dist:
                continue
        except:
            pass

        # precise distance check: sample points -> closest point on room boundary
        for p in samples:
            try:
                ok, t = r.ClosestPoint(p)
                if not ok:
                    continue
                q = r.PointAt(t)
                if q.DistanceTo(p) <= max_dist:
                    return True
            except:
                pass

    return False


def nearest_room_index(curve, room_curves):
    if not room_curves:
        return -1
    try:
        p = curve.GetBoundingBox(True).Center
    except:
        p = Point3d(0, 0, 0)

    best_i = -1
    best_d = 1e300
    for i, rc in enumerate(room_curves):
        try:
            ok, t = rc.ClosestPoint(p)
            q = rc.PointAt(t) if ok else curve_centroid(rc)
            d = q.DistanceTo(p)
        except:
            d = curve_centroid(rc).DistanceTo(p)
        if d < best_d:
            best_d = d
            best_i = i
    return best_i

def read_existing_max_ids(existing_csv_path):
    if not existing_csv_path:
        return None
    if not os.path.exists(existing_csv_path):
        return None
    maxes = {"site_id": 0, "building_id": 0, "floor_id": 0}
    try:
        with open(existing_csv_path, "r") as f:
            reader = csv.DictReader(f)
            for row in reader:
                for k in ["site_id", "building_id", "floor_id"]:
                    v = row.get(k, "")
                    try:
                        iv = int(float(v))
                        if iv > maxes[k]:
                            maxes[k] = iv
                    except:
                        pass
        return maxes
    except:
        return None

# -----------------------------
# Tag collection from (TagPts, TagTxt)
# -----------------------------

def coerce_point3d(x):
    """Coerce Point3d / Rhino Point / GH point-like / Guid -> Point3d."""
    if x is None:
        return None
    if isinstance(x, Point3d):
        return x
    if isinstance(x, Rhino.Geometry.Point):
        return x.Location

    # Guid -> Rhino doc lookup (point object)
    try:
        if isinstance(x, System.Guid):
            ro = Rhino.RhinoDoc.ActiveDoc.Objects.FindId(x)
            if ro:
                g = ro.Geometry
                if isinstance(g, Rhino.Geometry.Point):
                    return g.Location
                if hasattr(g, "Location") and isinstance(g.Location, Point3d):
                    return g.Location
            return None
    except:
        pass

    # point-like with X/Y(/Z)
    if hasattr(x, "X") and hasattr(x, "Y"):
        try:
            z = x.Z if hasattr(x, "Z") else 0.0
            return Point3d(float(x.X), float(x.Y), float(z))
        except:
            return None

    return None

def collect_tags_from_pts_txt(TagPts, TagTxt):
    out = []
    if not TagPts or not TagTxt:
        return out
    n = min(len(TagPts), len(TagTxt))
    for i in range(n):
        pt = coerce_point3d(TagPts[i])
        if pt is None:
            continue
        out.append({"pt": pt, "txt": normalize_roomtype(TagTxt[i])})
    return out

# -----------------------------
# Multi-unit assignment
# -----------------------------

def is_unit_label(s, pattern):
    try:
        return re.match(pattern, s.strip()) is not None
    except:
        return False

def assign_rooms_to_units_by_boundary(room_curves, unit_curves, Tolerance):
    unit_curves = [ensure_closed_curve(u, Tolerance) for u in (unit_curves or []) if u]
    unit_index_to_unit_id = {j: (j + 1) for j in range(len(unit_curves))}
    unit_ids_by_room = {}
    for i, rc in enumerate(room_curves):
        cpt = curve_centroid(rc)
        assigned = 0
        for j, uc in enumerate(unit_curves):
            if point_in_polygon_xy(uc, cpt, Tolerance):
                assigned = unit_index_to_unit_id[j]
                break
        unit_ids_by_room[i] = assigned
    return unit_ids_by_room, unit_index_to_unit_id

def assign_rooms_to_units_by_labels(room_curves, tag_dicts, Tolerance, label_regex):
    unit_tags = [t for t in tag_dicts if is_unit_label(t["txt"], label_regex)]
    if not unit_tags:
        return {i: 1 for i in range(len(room_curves))}, {"UNIT_1": 1}

    room_label = {}
    # containment
    for i, rc in enumerate(room_curves):
        for ut in unit_tags:
            if point_in_polygon_xy(rc, ut["pt"], Tolerance):
                room_label[i] = ut["txt"].strip().upper()
                break

    # nearest
    for i, rc in enumerate(room_curves):
        if i in room_label:
            continue
        cpt = curve_centroid(rc)
        best_lab = None
        best_d = 1e300
        for ut in unit_tags:
            d = cpt.DistanceTo(ut["pt"])
            if d < best_d:
                best_d = d
                best_lab = ut["txt"].strip().upper()
        room_label[i] = best_lab if best_lab else "UNIT_1"

    labels = sorted(list(set(room_label.values())))
    label_to_unit_id = {lab: (k + 1) for k, lab in enumerate(labels)}
    room_unit_id = {i: label_to_unit_id[room_label[i]] for i in room_label}
    return room_unit_id, label_to_unit_id

# -----------------------------
# Helper functions for JSON
# -----------------------------
def to_snake_case_roomname(txt):
    t = normalize_roomtype(txt).strip().lower()
    t = t.replace("_", " ")
    t = re.sub(r"\s+", "_", t)                 # spaces -> underscore
    t = re.sub(r"[^a-z0-9_]", "", t)           # strip weird chars
    t = re.sub(r"_+", "_", t).strip("_")
    return t if t else "n_a"

def curve_to_xyz_dict_list(curve, tol):
    c = ensure_closed_curve(curve, tol)
    pts = polyline_points_from_any(c, tol)
    if not pts or len(pts) < 2:
        return []
    if pts[0].DistanceTo(pts[-1]) > tol:
        pts = pts + [pts[0]]
    return [{"x": float(p.X), "y": float(p.Y), "z": float(p.Z)} for p in pts]

def curve_segments_xy(curve, tol):
    c = ensure_closed_curve(curve, tol)
    pts = polyline_points_from_any(c, tol)
    if not pts or len(pts) < 2:
        return []
    if pts[0].DistanceTo(pts[-1]) > tol:
        pts = pts + [pts[0]]
    segs = []
    for i in range(len(pts) - 1):
        a = pts[i]; b = pts[i + 1]
        if a.DistanceTo(b) <= tol:
            continue
        segs.append((a, b))
    return segs


# -----------------------------
# Main: read inputs safely
# -----------------------------

WriteCsv = WriteCsv if 'WriteCsv' in globals() else False

Rooms = Rooms if 'Rooms' in globals() else []
Walls = Walls if 'Walls' in globals() else []
Windows = Windows if 'Windows' in globals() else []
Doors = Doors if 'Doors' in globals() else []

TagPts = TagPts if 'TagPts' in globals() else []
TagTxt = TagTxt if 'TagTxt' in globals() else []

Units = Units if 'Units' in globals() else None

CsvPath = CsvPath if 'CsvPath' in globals() else None
ExistingCsvPath = ExistingCsvPath if 'ExistingCsvPath' in globals() else None

JsonPath = JsonPath if 'JsonPath' in globals() else None
WriteJson = WriteJson if 'WriteJson' in globals() else False
DefaultWallThickness = DefaultWallThickness if 'DefaultWallThickness' in globals() else 0.2

# if user didn't supply JsonPath, derive it from CsvPath
if (not JsonPath) and CsvPath:
    JsonPath = os.path.splitext(CsvPath)[0] + ".json"

DefaultWindowElevation = DefaultWindowElevation if 'DefaultWindowElevation' in globals() else 1.0
DefaultRoomHeight = DefaultRoomHeight if 'DefaultRoomHeight' in globals() else 2.7
DefaultWallHeight = DefaultWallHeight if 'DefaultWallHeight' in globals() else 2.7
DefaultDoorHeight = DefaultDoorHeight if 'DefaultDoorHeight' in globals() else 2.1
DefaultWindowHeight = DefaultWindowHeight if 'DefaultWindowHeight' in globals() else 1.5

Tolerance = Tolerance if 'Tolerance' in globals() else 0.05
UnitLabelRegex = UnitLabelRegex if 'UnitLabelRegex' in globals() else r"^[A-Za-z]\d{2,}$"

# Outputs (init)
OK = False
Report = ""
Rows = []
TagAssignments = []
RoomTagTxtOut = []
RoomTagPtsOut = []
RoomCrvsOut = []
RoomTagIndexOut = []

WallCrvsOut = []
WallPtsOut = []
WallTxtOut = []
WallRoomIndexOut = []

OpeningCrvsOut = []
OpeningPtsOut = []
OpeningTxtOut = []
OpeningRoomIndexOut = []



if not CsvPath:
    OK = False
    Report = "CsvPath is empty. Provide a full file path."
else:
    # IDs
    maxes = read_existing_max_ids(ExistingCsvPath)
    if maxes:
        site_id = maxes["site_id"] + 1
        building_id = maxes["building_id"] + 1
        floor_id = maxes["floor_id"] + 1
    else:
        site_id = 1
        building_id = 1
        floor_id = 1

    plan_id = str(uuid.uuid4())
    unit_usage = "RESIDENTIAL"

    # Close curves
    room_curves = [ensure_closed_curve(c, Tolerance) for c in (Rooms or []) if c]
    wall_curves = [ensure_closed_curve(c, Tolerance) for c in (Walls or []) if c]
    window_curves = [ensure_closed_curve(c, Tolerance) for c in (Windows or []) if c]
    door_curves = [ensure_closed_curve(c, Tolerance) for c in (Doors or []) if c]

    # Tags -> assign roomtypes
    tags = collect_tags_from_pts_txt(TagPts, TagTxt)
    tags_found = len(tags)

    tag_origin_export = []        # (txt, pt, room_i)
    matched_real_tags = 0

    # Tags -> assign roomtypes
    tags = collect_tags_from_pts_txt(TagPts, TagTxt)
    tags_found = len(tags)

    roomtype_by_room_index = {}   # room_i -> tag string
    subtype_by_room_index = {}
    tag_origin_export = []        # (txt, pt, room_i)
    matched_real_tags = 0

    for tg in tags:
        pt = tg["pt"]
        pt = Point3d(pt.X, pt.Y, 0.0)

        raw_txt = normalize_roomtype(tg["txt"])           # e.g. "elevator"
        raw_subtype = to_entity_subtype_from_text(raw_txt) # e.g. "ELEVATOR"
        mapped_roomtype = "structure" if raw_txt.strip().lower() in ["elevator", "shaft", "stairs", "staircase"]  else raw_txt

        # map roomtype (special tags become "structure")
        raw_low = raw_txt.strip().lower()
        mapped_roomtype = "structure" if raw_low in ["elevator", "shaft", "stairs", "staircase"] else raw_txt

        # 1) try containment
        found = -1
        for i, rc in enumerate(room_curves):
            if point_in_polygon_xy(rc, pt, Tolerance):
                found = i
                break

        # 2) fallback: nearest room centroid (prevents "everything becomes N/A")
        if found == -1 and room_curves:
            best_i = -1
            best_d = 1e300
            for i, rc in enumerate(room_curves):
                d = curve_centroid(rc).DistanceTo(pt)
                if d < best_d:
                    best_d = d
                    best_i = i
            found = best_i

        if found != -1:
            # only set once per room (first wins)
            if found not in roomtype_by_room_index:
                roomtype_by_room_index[found] = mapped_roomtype
                subtype_by_room_index[found] = raw_subtype

    # Add N/A for rooms without tags
    virtual_tags_added = 0
    for i, rc in enumerate(room_curves):
        if i not in roomtype_by_room_index:
            roomtype_by_room_index[i] = "N/A"
            subtype_by_room_index[i] = "N/A"
            virtual_tags_added += 1

    
    # --- Predict roomtype for remaining N/A rooms based on 3 nearest rooms ---
    room_centroids = [curve_centroid(rc) for rc in room_curves]
    predicted_count = 0
    for i in range(len(room_curves)):
        if _rt_key(roomtype_by_room_index.get(i, "N/A")) == "n/a":
            pred = predict_roomtype_from_neighbors(i, roomtype_by_room_index, room_centroids, PREDICT_RULES)
            if pred != "N/A":
                roomtype_by_room_index[i] = pred
                # If subtype was N/A, update it to match predicted roomtype
                if subtype_by_room_index.get(i, "N/A") == "N/A":
                    subtype_by_room_index[i] = to_entity_subtype_from_text(pred)

                predicted_count += 1

    # Multi-unit assignment
    if Units and len(Units) > 0:
        room_unit_id, _ = assign_rooms_to_units_by_boundary(room_curves, Units, Tolerance)
        unit_method = "Units boundary polygons"
    else:
        room_unit_id, _ = assign_rooms_to_units_by_labels(room_curves, tags, Tolerance, UnitLabelRegex)
        unit_method = "Unit label tags (regex fallback)"

    for i in range(len(room_curves)):
        if room_unit_id.get(i, 0) == 0:
            room_unit_id[i] = 1
    
    # JSON structure - schema
    json_obj = {
        "panels": {
            "attributes": {},
            "items": {},
            "max_key": 0
        },
        "spaces": {}
    }

    panel_k = 0

    for i, rc in enumerate(room_curves):
        rt_raw = roomtype_by_room_index.get(i, "N/A")
        room_name = to_snake_case_roomname(rt_raw)

        uid = int(room_unit_id.get(i, 1))
        apt_name = "Apartment {0}".format(uid)

        # spaces entry
        json_obj["spaces"][str(i)] = {
            "room_type": room_name,
            "apartment": apt_name,
            "coordinates": curve_to_xyz_dict_list(rc, Tolerance)
        }

        # panels from the room boundary edges
        for a, b in curve_segments_xy(rc, Tolerance):
            json_obj["panels"]["items"][str(panel_k)] = {
                "panel_type": "WAL_21_CNI_REN",
                "start_point": [float(a.X), float(a.Y), 0.0],
                "end_point":   [float(b.X), float(b.Y), 0.0],
                "height": float(DefaultWallHeight),
                "thickness": float(DefaultWallThickness),
                "room": room_name,
                "apartment": apt_name
            }
            panel_k += 1

    json_obj["panels"]["max_key"] = panel_k


    # CSV schema
    headers = [
        "index","Unnamed: 0.1","Unnamed: 0.2","apartment_id","site_id","building_id",
        "plan_id","floor_id","unit_id","area_id","unit_usage","entity_type","entity_subtype",
        "geom","elevation","height","zoning","roomtype"
    ]

    rows = []
    idx = [0]

    def add_row(entity_type, entity_subtype, geom_wkt, elevation, height, zoning, roomtype, unit_id_value):
        r = {}
        r["index"] = idx[0]
        r["Unnamed: 0.1"] = idx[0]
        r["Unnamed: 0.2"] = idx[0]
        r["unit_id"] = int(unit_id_value)
        r["apartment_id"] = int(unit_id_value)
        r["site_id"] = site_id
        r["building_id"] = building_id
        r["plan_id"] = plan_id
        r["floor_id"] = floor_id
        r["area_id"] = ""
        r["unit_usage"] = unit_usage
        r["entity_type"] = entity_type
        r["entity_subtype"] = entity_subtype
        r["geom"] = geom_wkt
        r["elevation"] = float(elevation)
        r["height"] = float(height)
        r["zoning"] = zoning
        r["roomtype"] = roomtype
        rows.append(r)
        idx[0] += 1

    

        


    # Rooms
    for i, rc in enumerate(room_curves):
        rt = roomtype_by_room_index.get(i, "N/A")          # mapped roomtype ("structure" possible)
        sub = subtype_by_room_index.get(i, to_entity_subtype_from_roomtype(rt))  # original tag subtype
        geom = curve_to_wkt_polygon(rc, Tolerance)
        uid = room_unit_id.get(i, 1)
        nr = nearest_room_index(rc, room_curves)

        add_row(
            "area",
            sub,                         # <-- subtype from original text tag
            geom,
            0.0,
            DefaultRoomHeight,
            zoning_for_roomtype(rt),     # <-- zoning becomes "structure" when rt="structure"
            rt,                          # <-- roomtype is mapped ("structure")
            uid
        )

        # Room- debug outputs 
        RoomTagTxtOut.append(roomtype_by_room_index.get(i, "N/A"))  # includes N/A
        RoomTagPtsOut.append(curve_centroid(rc))                    # centroid per room
        RoomCrvsOut.append(rc)                               # the provided room curve
        RoomTagIndexOut.append(nr)
        

    # Walls (assign to nearest room's unit)
    # Walls (roomtype = "structure")
    for wc in wall_curves:
        geom = curve_to_wkt_polygon(wc, Tolerance)
        ri = nearest_room_index(wc, room_curves)
        uid = room_unit_id.get(ri, 1) if ri != -1 else 1

        wall_roomtype = "structure"

        # debug outputs
        WallCrvsOut.append(wc)
        WallPtsOut.append(curve_centroid(wc))
        WallTxtOut.append(wall_roomtype)
        WallRoomIndexOut.append(ri)

        add_row("separator", "WALL", geom, 0.0, DefaultWallHeight,
                "structure", wall_roomtype, uid)
   
    # Windows
    for win in window_curves:
        geom = curve_to_wkt_polygon(win, Tolerance)
        ri = nearest_room_index(win, room_curves)
        uid = room_unit_id.get(ri, 1) if ri != -1 else 1

        opening_roomtype = "window"
        
        # debug geometry outputs
        OpeningCrvsOut.append(win)
        OpeningPtsOut.append(curve_centroid(win))
        OpeningTxtOut.append(opening_roomtype)

        #add row to csv
        add_row("opening", "WINDOW", geom, float(DefaultWindowElevation), DefaultWindowHeight,
                "window", "window", uid)


    # Doors
    # Doors (roomtype = "doors" or "Entrance Door")
    for dr in door_curves:
        geom = curve_to_wkt_polygon(dr, Tolerance)
        ri = nearest_room_index(dr, room_curves)
        uid = room_unit_id.get(ri, 1) if ri != -1 else 1
        #check if door is a main entrance 
        is_entrance = is_adjacent_to_special_room(dr, room_curves, subtype_by_room_index, Tolerance)

        if is_entrance:
            entity_subtype = "ENTRANCE_DOOR"
            zoning = "Entrance Door"
            opening_roomtype = "Entrance Door"
        else:
            entity_subtype = "DOOR"
            zoning = "door"
            opening_roomtype = "door"

        # debug outputs
        OpeningCrvsOut.append(dr)
        OpeningPtsOut.append(curve_centroid(dr))
        OpeningTxtOut.append(opening_roomtype)
        OpeningRoomIndexOut.append(ri)

        add_row("opening", entity_subtype, geom, 0.0, DefaultDoorHeight,
                zoning, opening_roomtype, uid)




    

    # Write CSV if requested
    try:
        if not WriteCsv:
            OK = True
            Report = (
                "WriteCsv is False -> CSV not written.\n"
                "Rows prepared: {0}\n"
                "Rooms:{1} Walls:{2} Windows:{3} Doors:{4}\n"
                "Tags found: {5}\n"
                "Tags matched to rooms: {6}\n"
                "N/A tags added: {7}\n"
                "Unit assignment method: {8}\n"
                "Set WriteCsv=True to write to: {9}"
            ).format(
                len(rows), len(room_curves), len(wall_curves), len(window_curves), len(door_curves),
                tags_found, matched_real_tags, virtual_tags_added, unit_method, CsvPath
            )
            Rows = rows
        else:
            out_dir = os.path.dirname(CsvPath)
            if out_dir and not os.path.exists(out_dir):
                os.makedirs(out_dir)

            f = safe_open_csv(CsvPath)
            try:
                writer = csv.DictWriter(f, fieldnames=headers, quoting=csv.QUOTE_MINIMAL)
                writer.writeheader()
                for r in rows:
                    writer.writerow(r)
            finally:
                f.close()

            OK = True
            Report = (
                "Wrote {0} rows to: {1}\n"
                "Rooms:{2} Walls:{3} Windows:{4} Doors:{5}\n"
                "Tags found: {6}\n"
                "Tags matched to rooms: {7}\n"
                "N/A tags added: {8}\n"
                "Unit assignment method: {9}\n"
                "IDs => site:{10} building:{11} floor:{12} plan_id:{13}"
            ).format(
                len(rows), CsvPath,
                len(room_curves), len(wall_curves), len(window_curves), len(door_curves),
                tags_found, matched_real_tags, virtual_tags_added, unit_method,
                site_id, building_id, floor_id, plan_id
            )
            Report += "\nTags found: {0}".format(tags_found)
            Report += "\nTags matched (after fallback): {0}".format(matched_real_tags)
            Report += "\nPredicted roomtypes (from neighbors): {0}".format(predicted_count)

            Rows = rows
        # Write JSON if requested
        if WriteJson and JsonPath:
            out_dir = os.path.dirname(JsonPath)
            if out_dir and not os.path.exists(out_dir):
                os.makedirs(out_dir)

            with open(JsonPath, "w") as jf:
                json.dump(json_obj, jf, indent=2)

            Report += "\nWrote JSON to: {0}".format(JsonPath)

    except Exception as e:
        OK = False
        Report = "Failed writing CSV: {0}".format(str(e))
        Rows = rows
# ---------- end format_floorplan_as_csv ----------

# ---- group: wokring only with csv
format_floorplan_as_csv_2 = Python3Script(
    Rooms=crv_7,
    Walls=crv_6,
    Windows=crv_5,
    Doors=crv_8,
    TagTxt=txt,
    TagPts=pt,
    Tolerance=number_slider_6,
    DefaultWindowElevation=number_slider_5,
    DefaultRoomHeight=number_slider_4,
    DefaultWallHeight=number_slider,
    DefaultDoorHeight=number_slider_3,
    DefaultWindowHeight=number_slider_2,
    CsvPath=csvpath,
    WriteCsv=save_csv)  # -> out, OK, Report, Rows, DebugTagTypes, RoomTagPtsOut, RoomTagTxtOut, RoomTagIndexOut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; inputs Rooms: list of Curve, Walls: list of Curve, Windows: list of Curve, Doors: list of Curve, TagTxt: list, TagPts: list of Point3d, WriteCsv: Boolean
# ---------- format_floorplan_as_csv_2: Python ----------
"""
MSD CSV Exporter for DXF-imported polygons in Grasshopper (multi-unit support)
Rhino 8 CPython-safe (no TryGetPolyline by-ref, no PolylineCurve iteration)

INPUTS (keep these names in GH):
  Rooms, Walls, Windows, Doors : lists of Rhino.Geometry.Curve (polygons)
  TagPts : list of points (Point3d OR Guid OR Rhino point objects)
  TagTxt : list of strings
  CsvPath : full output csv path
  WriteCsv : bool (if False, just prepares Rows, does not write file)

OPTIONAL INPUTS:
  Units : list of unit boundary polygons (curves) (preferred multi-unit method)
  UnitLabelRegex : regex string for unit labels like A01, B12 (fallback multi-unit method)
  ExistingCsvPath : optional existing MSD csv path to continue IDs (max+1)
  DefaultWindowElevation, DefaultRoomHeight, DefaultWallHeight, DefaultDoorHeight, DefaultWindowHeight : numbers
  Tolerance : numeric Toleranceerance (suggest 0.05..0.5 depending on DXF units)

OUTPUTS (create these outputs in GH):
  OK : bool
  Report : string
  Rows : list of row dicts
  TagAssignments : debug strings (tag text + point + assigned room index)
  RoomTagTxtOut : list[str] length == Rooms (roomtype per room, incl. N/A)
  RoomTagPtsOut : list[Point3d] length == Rooms (centroid per room)
  RoomCrvsOut : list[Curve] length == Rooms (room curves)
"""

import os, sys, csv, uuid, re
import System
import Rhino
from Rhino.Geometry import Point3d, Plane, AreaMassProperties

# -----------------------------
# Polyline-safe utilities (Rhino 8 CPython)
# -----------------------------

def polyline_points_from_any(obj, Tolerance=0.01):
    """Return list[Point3d] from Polyline / PolylineCurve / Curve with TryGetPolyline()."""
    if obj is None:
        return None

    if isinstance(obj, Rhino.Geometry.Polyline):
        return [obj[i] for i in range(obj.Count)]

    if isinstance(obj, Rhino.Geometry.PolylineCurve):
        try:
            ok, pl = obj.TryGetPolyline()  # CPython overload
            if ok and pl:
                return [pl[i] for i in range(pl.Count)]
        except:
            pass
        try:
            pl = obj.ToPolyline()
            return [pl[i] for i in range(pl.Count)]
        except:
            return None

    if isinstance(obj, Rhino.Geometry.Curve):
        try:
            ok, pl = obj.TryGetPolyline()
            if ok and pl:
                return [pl[i] for i in range(pl.Count)]
        except:
            pass

    return None

def ensure_closed_curve(curve, Tolerance):
    if curve is None:
        return None
    if curve.IsClosed:
        return curve

    pts = polyline_points_from_any(curve, Tolerance)
    if pts and len(pts) >= 3:
        if pts[0].DistanceTo(pts[-1]) > Tolerance:
            pts.append(pts[0])
        return Rhino.Geometry.PolylineCurve(pts)

    try:
        plc = curve.ToPolyline(Tolerance, Tolerance, 0.0, 0.0)  # PolylineCurve
        pts2 = polyline_points_from_any(plc, Tolerance)
        if pts2 and len(pts2) >= 3:
            if pts2[0].DistanceTo(pts2[-1]) > Tolerance:
                pts2.append(pts2[0])
            return Rhino.Geometry.PolylineCurve(pts2)
        return plc if plc else curve
    except:
        return curve

def curve_centroid(curve):
    try:
        amp = AreaMassProperties.Compute(curve)
        if amp:
            return amp.Centroid
    except:
        pass
    try:
        return curve.GetBoundingBox(True).Center
    except:
        return Point3d(0, 0, 0)

def curve_to_wkt_polygon(curve, Tolerance):
    c = ensure_closed_curve(curve, Tolerance)
    if c is None:
        return ""
    pts = polyline_points_from_any(c, Tolerance)

    if not pts or len(pts) < 3:
        # sample fallback
        try:
            dom = c.Domain
            segs = 64
            pts = []
            for i in range(segs + 1):
                t = dom.T0 + (dom.T1 - dom.T0) * (float(i) / float(segs))
                pts.append(c.PointAt(t))
        except:
            return ""

    if len(pts) < 3:
        return ""

    if pts[0].DistanceTo(pts[-1]) > Tolerance:
        pts.append(pts[0])

    coord = ["{0} {1}".format(float(p.X), float(p.Y)) for p in pts]
    return "POLYGON (({0}))".format(", ".join(coord))

# -----------------------------
# Robust 2D point-in-polygon (DXF-friendly)
# -----------------------------

def _point_on_segment_2d(p, a, b, Tolerance):
    ax, ay = a.X, a.Y
    bx, by = b.X, b.Y
    px, py = p.X, p.Y
    vx, vy = bx-ax, by-ay
    wx, wy = px-ax, py-ay
    seg_len2 = vx*vx + vy*vy
    if seg_len2 == 0.0:
        dx, dy = px-ax, py-ay
        return (dx*dx + dy*dy) <= Tolerance*Tolerance
    t = (wx*vx + wy*vy) / seg_len2
    if t < 0.0: t = 0.0
    elif t > 1.0: t = 1.0
    cx = ax + t*vx
    cy = ay + t*vy
    dx, dy = px-cx, py-cy
    return (dx*dx + dy*dy) <= Tolerance*Tolerance

def point_in_polygon_xy(curve, pt, Tolerance):
    c = ensure_closed_curve(curve, Tolerance)
    if c is None:
        return False

    pts = polyline_points_from_any(c, Tolerance)
    if not pts or len(pts) < 3:
        return False

    # close
    if pts[0].DistanceTo(pts[-1]) > Tolerance:
        pts = pts + [pts[0]]

    p = Point3d(pt.X, pt.Y, 0.0)

    # boundary as inside
    for i in range(len(pts)-1):
        a = Point3d(pts[i].X, pts[i].Y, 0.0)
        b = Point3d(pts[i+1].X, pts[i+1].Y, 0.0)
        if _point_on_segment_2d(p, a, b, Tolerance):
            return True

    inside = False
    x, y = p.X, p.Y
    for i in range(len(pts)-1):
        x1, y1 = pts[i].X, pts[i].Y
        x2, y2 = pts[i+1].X, pts[i+1].Y
        if (y1 > y) != (y2 > y):
            x_int = x1 + (y - y1) * (x2 - x1) / (y2 - y1)
            if x_int >= x:
                inside = not inside
    return inside

# -----------------------------
# CSV + normalization logic
# -----------------------------

def roomtype_from_tag_text(txt):
    """
    Map certain tags to MSD roomtype rules.
    - elevator/shaft/stairs => "structure"
    Otherwise returns cleaned text (or "N/A").
    """
    t = normalize_roomtype(txt)
    tl = t.strip().lower()
    tl = re.sub(r"\s+", " ", tl)

    if tl in ["elevator", "shaft", "stairs"]:
        return "structure"

    return t

def is_ironpython():
    return sys.platform == "cli"

def safe_open_csv(path):
    if is_ironpython():
        return open(path, "wb")
    else:
        return open(path, "w", newline="")

def normalize_roomtype(txt):
    if txt is None:
        return "N/A"
    t = str(txt).strip()
    return t if t else "N/A"

def to_entity_subtype_from_text(txt):
    t = normalize_roomtype(txt)
    if t == "N/A":
        return "N/A"
    t2 = re.sub(r"\s+", "_", t.strip().upper())
    # optional normalizations
    t2 = t2.replace("BED_ROOM", "BEDROOM")
    t2 = t2.replace("LIVINGROOM", "LIVING_ROOM")
    t2 = t2.replace("DININGROOM", "DINING_ROOM")
    return t2


def to_entity_subtype_from_roomtype(roomtype):
    rt = normalize_roomtype(roomtype)
    if rt == "N/A":
        return "N/A"
    rt2 = re.sub(r"\s+", "_", rt.strip().upper())
    rt2 = rt2.replace("BED_ROOM", "BEDROOM")
    rt2 = rt2.replace("LIVINGROOM", "LIVING_ROOM")
    rt2 = rt2.replace("DININGROOM", "DINING_ROOM")
    return rt2

def zoning_for_roomtype(roomtype):
    rt = normalize_roomtype(roomtype).strip().lower()
    rt = re.sub(r"\s+", " ", rt)

    # structure rooms
    if rt in ["structure", "elevator", "shaft", "stairs"]:
        return "structure"

    if rt in ["bedroom", "bed room", "room"]:
        return "zone 1"
    if rt in ["livingroom", "living room", "kitchen", "diningroom", "dining room"]:
        return "zone2"
    if rt in ["bathroom", "wc", "storage","corridor","reduit"]:
        return "zone3"
    if rt in ["balcony"]:
        return "zone4"

    return "N/A"

# -----------------------------
#Predict roomtype for rooms that are still "N/A"
#provide some rules so that roomtype can be inferred/predicted based on the neighbors  for rooms do not have a text tag/roomtype="N/a"
# -----------------------------
PREDICT_RULES = [
    # your example:
    {"result": "kitchen", "match": ["living room", "LivingRoom", "dining room", "diningroom","Corridor"], "min_votes": 1, "k": 4},

    # examples you can add:
    {"result": "structure", "match": ["structure"], "min_votes": 2, "k": 3},

]
#Normalizer function for text tag
def _rt_key(rt):
    if rt is None:
        return "n/a"
    s = str(rt).strip().lower()
    s = re.sub(r"\s+", " ", s)
    s = s.replace("_", " ")
    return s if s else "n/a"

# “vote” helper functiion 
def _votes(neighbor_types, aliases):
    """
    Count how many neighbors match any alias in aliases.
    neighbor_types should already be normalized via _rt_key.
    """
    aset = set([_rt_key(a) for a in aliases])
    return sum(1 for t in neighbor_types if t in aset)


def find_nearest_room_indices(i, centroids, k=3, exclude_self=True):
    """
    Return indices of k nearest rooms to room i.
    """
    ci = centroids[i]
    dlist = []
    for j, cj in enumerate(centroids):
        if exclude_self and j == i:
            continue
        dlist.append((ci.DistanceTo(cj), j))
    dlist.sort(key=lambda x: x[0])
    return [j for (_, j) in dlist[:k]]

def predict_roomtype_from_neighbors(room_i, roomtype_by_room_index, centroids, rules):
    """
    For rooms whose current type is N/A, predict from neighbor votes.
    Returns predicted string or "N/A".
    """
    current = _rt_key(roomtype_by_room_index.get(room_i, "N/A"))
    if current != "n/a":
        return roomtype_by_room_index.get(room_i, "N/A")

    for rule in rules:
        k = int(rule.get("k", 3))
        min_votes = int(rule.get("min_votes", 2))
        nbrs = find_nearest_room_indices(room_i, centroids, k=k)

        # neighbor types (ignore N/A)
        neighbor_types = []
        for j in nbrs:
            t = _rt_key(roomtype_by_room_index.get(j, "N/A"))
            if t != "n/a":
                neighbor_types.append(t)

        if not neighbor_types:
            continue

        if _votes(neighbor_types, rule["match"]) >= min_votes:
            return rule["result"]

    return "N/A"
#check adjacency of door to shaft, elevator)
def is_adjacent_to_special_room(door_curve, room_curves, subtype_by_room_index, Tolerance):
    """
    Returns True if door is within a small distance of any special room (ELEVATOR/SHAFT).
    Uses point sampling on the door curve for robustness.
    """
    if door_curve is None or not room_curves:
        return False

    # distance threshold (tune if needed)
    max_dist = max(Tolerance * 20.0, Tolerance)  # e.g. Tolerance=0.05 -> 1.0; Tolerance=0.01 -> 0.2

    # Build sample points from door
    samples = []
    try:
        samples.append(door_curve.GetBoundingBox(True).Center)
    except:
        samples.append(Point3d(0, 0, 0))

    # add polyline vertices + midpoints if possible
    pts = polyline_points_from_any(ensure_closed_curve(door_curve, Tolerance), Tolerance)
    if pts and len(pts) >= 2:
        # flatten & unique-ish
        pts2 = [Point3d(p.X, p.Y, 0.0) for p in pts]
        # vertices
        for p in pts2:
            samples.append(p)
        # midpoints
        for i in range(len(pts2) - 1):
            a = pts2[i]; b = pts2[i+1]
            samples.append(Point3d((a.X + b.X) * 0.5, (a.Y + b.Y) * 0.5, 0.0))

    # flatten bbox sample too
    samples = [Point3d(p.X, p.Y, 0.0) for p in samples if p is not None]

    # Check against special rooms
    for i, r in enumerate(room_curves):
        sub = (subtype_by_room_index.get(i, "N/A") or "N/A").strip().upper()
        if sub not in ["ELEVATOR", "SHAFT","STAIRS","STAIRCASE" ]:
            continue

        # quick bbox reject
        try:
            if door_curve.GetBoundingBox(True).DistanceTo(r.GetBoundingBox(True)) > max_dist:
                continue
        except:
            pass

        # precise distance check: sample points -> closest point on room boundary
        for p in samples:
            try:
                ok, t = r.ClosestPoint(p)
                if not ok:
                    continue
                q = r.PointAt(t)
                if q.DistanceTo(p) <= max_dist:
                    return True
            except:
                pass

    return False


def nearest_room_index(curve, room_curves):
    if not room_curves:
        return -1
    try:
        p = curve.GetBoundingBox(True).Center
    except:
        p = Point3d(0, 0, 0)

    best_i = -1
    best_d = 1e300
    for i, rc in enumerate(room_curves):
        try:
            ok, t = rc.ClosestPoint(p)
            q = rc.PointAt(t) if ok else curve_centroid(rc)
            d = q.DistanceTo(p)
        except:
            d = curve_centroid(rc).DistanceTo(p)
        if d < best_d:
            best_d = d
            best_i = i
    return best_i

def read_existing_max_ids(existing_csv_path):
    if not existing_csv_path:
        return None
    if not os.path.exists(existing_csv_path):
        return None
    maxes = {"site_id": 0, "building_id": 0, "floor_id": 0}
    try:
        with open(existing_csv_path, "r") as f:
            reader = csv.DictReader(f)
            for row in reader:
                for k in ["site_id", "building_id", "floor_id"]:
                    v = row.get(k, "")
                    try:
                        iv = int(float(v))
                        if iv > maxes[k]:
                            maxes[k] = iv
                    except:
                        pass
        return maxes
    except:
        return None

# -----------------------------
# Tag collection from (TagPts, TagTxt)
# -----------------------------

def coerce_point3d(x):
    """Coerce Point3d / Rhino Point / GH point-like / Guid -> Point3d."""
    if x is None:
        return None
    if isinstance(x, Point3d):
        return x
    if isinstance(x, Rhino.Geometry.Point):
        return x.Location

    # Guid -> Rhino doc lookup (point object)
    try:
        if isinstance(x, System.Guid):
            ro = Rhino.RhinoDoc.ActiveDoc.Objects.FindId(x)
            if ro:
                g = ro.Geometry
                if isinstance(g, Rhino.Geometry.Point):
                    return g.Location
                if hasattr(g, "Location") and isinstance(g.Location, Point3d):
                    return g.Location
            return None
    except:
        pass

    # point-like with X/Y(/Z)
    if hasattr(x, "X") and hasattr(x, "Y"):
        try:
            z = x.Z if hasattr(x, "Z") else 0.0
            return Point3d(float(x.X), float(x.Y), float(z))
        except:
            return None

    return None

def collect_tags_from_pts_txt(TagPts, TagTxt):
    out = []
    if not TagPts or not TagTxt:
        return out
    n = min(len(TagPts), len(TagTxt))
    for i in range(n):
        pt = coerce_point3d(TagPts[i])
        if pt is None:
            continue
        out.append({"pt": pt, "txt": normalize_roomtype(TagTxt[i])})
    return out

# -----------------------------
# Multi-unit assignment
# -----------------------------

def is_unit_label(s, pattern):
    try:
        return re.match(pattern, s.strip()) is not None
    except:
        return False

def assign_rooms_to_units_by_boundary(room_curves, unit_curves, Tolerance):
    unit_curves = [ensure_closed_curve(u, Tolerance) for u in (unit_curves or []) if u]
    unit_index_to_unit_id = {j: (j + 1) for j in range(len(unit_curves))}
    unit_ids_by_room = {}
    for i, rc in enumerate(room_curves):
        cpt = curve_centroid(rc)
        assigned = 0
        for j, uc in enumerate(unit_curves):
            if point_in_polygon_xy(uc, cpt, Tolerance):
                assigned = unit_index_to_unit_id[j]
                break
        unit_ids_by_room[i] = assigned
    return unit_ids_by_room, unit_index_to_unit_id

def assign_rooms_to_units_by_labels(room_curves, tag_dicts, Tolerance, label_regex):
    unit_tags = [t for t in tag_dicts if is_unit_label(t["txt"], label_regex)]
    if not unit_tags:
        return {i: 1 for i in range(len(room_curves))}, {"UNIT_1": 1}

    room_label = {}
    # containment
    for i, rc in enumerate(room_curves):
        for ut in unit_tags:
            if point_in_polygon_xy(rc, ut["pt"], Tolerance):
                room_label[i] = ut["txt"].strip().upper()
                break

    # nearest
    for i, rc in enumerate(room_curves):
        if i in room_label:
            continue
        cpt = curve_centroid(rc)
        best_lab = None
        best_d = 1e300
        for ut in unit_tags:
            d = cpt.DistanceTo(ut["pt"])
            if d < best_d:
                best_d = d
                best_lab = ut["txt"].strip().upper()
        room_label[i] = best_lab if best_lab else "UNIT_1"

    labels = sorted(list(set(room_label.values())))
    label_to_unit_id = {lab: (k + 1) for k, lab in enumerate(labels)}
    room_unit_id = {i: label_to_unit_id[room_label[i]] for i in room_label}
    return room_unit_id, label_to_unit_id

# -----------------------------
# Main: read inputs safely
# -----------------------------

WriteCsv = WriteCsv if 'WriteCsv' in globals() else False

Rooms = Rooms if 'Rooms' in globals() else []
Walls = Walls if 'Walls' in globals() else []
Windows = Windows if 'Windows' in globals() else []
Doors = Doors if 'Doors' in globals() else []

TagPts = TagPts if 'TagPts' in globals() else []
TagTxt = TagTxt if 'TagTxt' in globals() else []

Units = Units if 'Units' in globals() else None

CsvPath = CsvPath if 'CsvPath' in globals() else None
ExistingCsvPath = ExistingCsvPath if 'ExistingCsvPath' in globals() else None

DefaultWindowElevation = DefaultWindowElevation if 'DefaultWindowElevation' in globals() else 1.0
DefaultRoomHeight = DefaultRoomHeight if 'DefaultRoomHeight' in globals() else 2.7
DefaultWallHeight = DefaultWallHeight if 'DefaultWallHeight' in globals() else 2.7
DefaultDoorHeight = DefaultDoorHeight if 'DefaultDoorHeight' in globals() else 2.1
DefaultWindowHeight = DefaultWindowHeight if 'DefaultWindowHeight' in globals() else 1.5

Tolerance = Tolerance if 'Tolerance' in globals() else 0.05
UnitLabelRegex = UnitLabelRegex if 'UnitLabelRegex' in globals() else r"^[A-Za-z]\d{2,}$"

# Outputs (init)
OK = False
Report = ""
Rows = []
TagAssignments = []
RoomTagTxtOut = []
RoomTagPtsOut = []
RoomCrvsOut = []
RoomTagIndexOut = []

WallCrvsOut = []
WallPtsOut = []
WallTxtOut = []
WallRoomIndexOut = []

OpeningCrvsOut = []
OpeningPtsOut = []
OpeningTxtOut = []
OpeningRoomIndexOut = []



if not CsvPath:
    OK = False
    Report = "CsvPath is empty. Provide a full file path."
else:
    # IDs
    maxes = read_existing_max_ids(ExistingCsvPath)
    if maxes:
        site_id = maxes["site_id"] + 1
        building_id = maxes["building_id"] + 1
        floor_id = maxes["floor_id"] + 1
    else:
        site_id = 1
        building_id = 1
        floor_id = 1

    plan_id = str(uuid.uuid4())
    unit_usage = "RESIDENTIAL"

    # Close curves
    room_curves = [ensure_closed_curve(c, Tolerance) for c in (Rooms or []) if c]
    wall_curves = [ensure_closed_curve(c, Tolerance) for c in (Walls or []) if c]
    window_curves = [ensure_closed_curve(c, Tolerance) for c in (Windows or []) if c]
    door_curves = [ensure_closed_curve(c, Tolerance) for c in (Doors or []) if c]

    # Tags -> assign roomtypes
    tags = collect_tags_from_pts_txt(TagPts, TagTxt)
    tags_found = len(tags)

    tag_origin_export = []        # (txt, pt, room_i)
    matched_real_tags = 0

    # Tags -> assign roomtypes
    tags = collect_tags_from_pts_txt(TagPts, TagTxt)
    tags_found = len(tags)

    roomtype_by_room_index = {}   # room_i -> tag string
    subtype_by_room_index = {}
    tag_origin_export = []        # (txt, pt, room_i)
    matched_real_tags = 0

    for tg in tags:
        pt = tg["pt"]
        pt = Point3d(pt.X, pt.Y, 0.0)

        raw_txt = normalize_roomtype(tg["txt"])           # e.g. "elevator"
        raw_subtype = to_entity_subtype_from_text(raw_txt) # e.g. "ELEVATOR"
        mapped_roomtype = "structure" if raw_txt.strip().lower() in ["elevator", "shaft", "stairs", "staircase"]  else raw_txt

        # map roomtype (special tags become "structure")
        raw_low = raw_txt.strip().lower()
        mapped_roomtype = "structure" if raw_low in ["elevator", "shaft", "stairs", "staircase"] else raw_txt

        # 1) try containment
        found = -1
        for i, rc in enumerate(room_curves):
            if point_in_polygon_xy(rc, pt, Tolerance):
                found = i
                break

        # 2) fallback: nearest room centroid (prevents "everything becomes N/A")
        if found == -1 and room_curves:
            best_i = -1
            best_d = 1e300
            for i, rc in enumerate(room_curves):
                d = curve_centroid(rc).DistanceTo(pt)
                if d < best_d:
                    best_d = d
                    best_i = i
            found = best_i

        if found != -1:
            # only set once per room (first wins)
            if found not in roomtype_by_room_index:
                roomtype_by_room_index[found] = mapped_roomtype
                subtype_by_room_index[found] = raw_subtype

    # Add N/A for rooms without tags
    virtual_tags_added = 0
    for i, rc in enumerate(room_curves):
        if i not in roomtype_by_room_index:
            roomtype_by_room_index[i] = "N/A"
            subtype_by_room_index[i] = "N/A"
            virtual_tags_added += 1

    
    # --- Predict roomtype for remaining N/A rooms based on 3 nearest rooms ---
    room_centroids = [curve_centroid(rc) for rc in room_curves]
    predicted_count = 0
    for i in range(len(room_curves)):
        if _rt_key(roomtype_by_room_index.get(i, "N/A")) == "n/a":
            pred = predict_roomtype_from_neighbors(i, roomtype_by_room_index, room_centroids, PREDICT_RULES)
            if pred != "N/A":
                roomtype_by_room_index[i] = pred
                # If subtype was N/A, update it to match predicted roomtype
                if subtype_by_room_index.get(i, "N/A") == "N/A":
                    subtype_by_room_index[i] = to_entity_subtype_from_text(pred)

                predicted_count += 1

    # Multi-unit assignment
    if Units and len(Units) > 0:
        room_unit_id, _ = assign_rooms_to_units_by_boundary(room_curves, Units, Tolerance)
        unit_method = "Units boundary polygons"
    else:
        room_unit_id, _ = assign_rooms_to_units_by_labels(room_curves, tags, Tolerance, UnitLabelRegex)
        unit_method = "Unit label tags (regex fallback)"

    for i in range(len(room_curves)):
        if room_unit_id.get(i, 0) == 0:
            room_unit_id[i] = 1

    # CSV schema
    headers = [
        "index","Unnamed: 0.1","Unnamed: 0.2","apartment_id","site_id","building_id",
        "plan_id","floor_id","unit_id","area_id","unit_usage","entity_type","entity_subtype",
        "geom","elevation","height","zoning","roomtype"
    ]

    rows = []
    idx = [0]

    def add_row(entity_type, entity_subtype, geom_wkt, elevation, height, zoning, roomtype, unit_id_value):
        r = {}
        r["index"] = idx[0]
        r["Unnamed: 0.1"] = idx[0]
        r["Unnamed: 0.2"] = idx[0]
        r["unit_id"] = int(unit_id_value)
        r["apartment_id"] = int(unit_id_value)
        r["site_id"] = site_id
        r["building_id"] = building_id
        r["plan_id"] = plan_id
        r["floor_id"] = floor_id
        r["area_id"] = ""
        r["unit_usage"] = unit_usage
        r["entity_type"] = entity_type
        r["entity_subtype"] = entity_subtype
        r["geom"] = geom_wkt
        r["elevation"] = float(elevation)
        r["height"] = float(height)
        r["zoning"] = zoning
        r["roomtype"] = roomtype
        rows.append(r)
        idx[0] += 1

    

        


    # Rooms
    for i, rc in enumerate(room_curves):
        rt = roomtype_by_room_index.get(i, "N/A")          # mapped roomtype ("structure" possible)
        sub = subtype_by_room_index.get(i, to_entity_subtype_from_roomtype(rt))  # original tag subtype
        geom = curve_to_wkt_polygon(rc, Tolerance)
        uid = room_unit_id.get(i, 1)
        nr = nearest_room_index(rc, room_curves)

        add_row(
            "area",
            sub,                         # <-- subtype from original text tag
            geom,
            0.0,
            DefaultRoomHeight,
            zoning_for_roomtype(rt),     # <-- zoning becomes "structure" when rt="structure"
            rt,                          # <-- roomtype is mapped ("structure")
            uid
        )

        # Room- debug outputs 
        RoomTagTxtOut.append(roomtype_by_room_index.get(i, "N/A"))  # includes N/A
        RoomTagPtsOut.append(curve_centroid(rc))                    # centroid per room
        RoomCrvsOut.append(rc)                               # the provided room curve
        RoomTagIndexOut.append(nr)
        

    # Walls (assign to nearest room's unit)
    # Walls (roomtype = "structure")
    for wc in wall_curves:
        geom = curve_to_wkt_polygon(wc, Tolerance)
        ri = nearest_room_index(wc, room_curves)
        uid = room_unit_id.get(ri, 1) if ri != -1 else 1

        wall_roomtype = "structure"

        # debug outputs
        WallCrvsOut.append(wc)
        WallPtsOut.append(curve_centroid(wc))
        WallTxtOut.append(wall_roomtype)
        WallRoomIndexOut.append(ri)

        add_row("separator", "WALL", geom, 0.0, DefaultWallHeight,
                "structure", wall_roomtype, uid)
   
    # Windows
    for win in window_curves:
        geom = curve_to_wkt_polygon(win, Tolerance)
        ri = nearest_room_index(win, room_curves)
        uid = room_unit_id.get(ri, 1) if ri != -1 else 1

        opening_roomtype = "window"
        
        # debug geometry outputs
        OpeningCrvsOut.append(win)
        OpeningPtsOut.append(curve_centroid(win))
        OpeningTxtOut.append(opening_roomtype)

        #add row to csv
        add_row("opening", "WINDOW", geom, float(DefaultWindowElevation), DefaultWindowHeight,
                "window", "window", uid)


    # Doors
    # Doors (roomtype = "doors" or "Entrance Door")
    for dr in door_curves:
        geom = curve_to_wkt_polygon(dr, Tolerance)
        ri = nearest_room_index(dr, room_curves)
        uid = room_unit_id.get(ri, 1) if ri != -1 else 1
        #check if door is a main entrance 
        is_entrance = is_adjacent_to_special_room(dr, room_curves, subtype_by_room_index, Tolerance)

        if is_entrance:
            entity_subtype = "ENTRANCE_DOOR"
            zoning = "Entrance Door"
            opening_roomtype = "Entrance Door"
        else:
            entity_subtype = "DOOR"
            zoning = "door"
            opening_roomtype = "door"

        # debug outputs
        OpeningCrvsOut.append(dr)
        OpeningPtsOut.append(curve_centroid(dr))
        OpeningTxtOut.append(opening_roomtype)
        OpeningRoomIndexOut.append(ri)

        add_row("opening", entity_subtype, geom, 0.0, DefaultDoorHeight,
                zoning, opening_roomtype, uid)




    

    # Write CSV if requested
    try:
        if not WriteCsv:
            OK = True
            Report = (
                "WriteCsv is False -> CSV not written.\n"
                "Rows prepared: {0}\n"
                "Rooms:{1} Walls:{2} Windows:{3} Doors:{4}\n"
                "Tags found: {5}\n"
                "Tags matched to rooms: {6}\n"
                "N/A tags added: {7}\n"
                "Unit assignment method: {8}\n"
                "Set WriteCsv=True to write to: {9}"
            ).format(
                len(rows), len(room_curves), len(wall_curves), len(window_curves), len(door_curves),
                tags_found, matched_real_tags, virtual_tags_added, unit_method, CsvPath
            )
            Rows = rows
        else:
            out_dir = os.path.dirname(CsvPath)
            if out_dir and not os.path.exists(out_dir):
                os.makedirs(out_dir)

            f = safe_open_csv(CsvPath)
            try:
                writer = csv.DictWriter(f, fieldnames=headers, quoting=csv.QUOTE_MINIMAL)
                writer.writeheader()
                for r in rows:
                    writer.writerow(r)
            finally:
                f.close()

            OK = True
            Report = (
                "Wrote {0} rows to: {1}\n"
                "Rooms:{2} Walls:{3} Windows:{4} Doors:{5}\n"
                "Tags found: {6}\n"
                "Tags matched to rooms: {7}\n"
                "N/A tags added: {8}\n"
                "Unit assignment method: {9}\n"
                "IDs => site:{10} building:{11} floor:{12} plan_id:{13}"
            ).format(
                len(rows), CsvPath,
                len(room_curves), len(wall_curves), len(window_curves), len(door_curves),
                tags_found, matched_real_tags, virtual_tags_added, unit_method,
                site_id, building_id, floor_id, plan_id
            )
            Report += "\nTags found: {0}".format(tags_found)
            Report += "\nTags matched (after fallback): {0}".format(matched_real_tags)
            Report += "\nPredicted roomtypes (from neighbors): {0}".format(predicted_count)

            Rows = rows

    except Exception as e:
        OK = False
        Report = "Failed writing CSV: {0}".format(str(e))
        Rows = rows
# ---------- end format_floorplan_as_csv_2 ----------

# ----
format_floorplan_as_json = Python3Script(
    Rooms=crv_7,
    Walls=crv_6,
    Windows=crv_5,
    Doors=crv_8,
    RoomTypes=format_floorplan_as_csv_2.RoomTagTxtOut,
    RoomUnitIds=format_floorplan_as_csv_2.RoomTagIndexOut,
    Tolerance=number_slider_6,
    DefaultWindowElevation=number_slider_5,
    DefaultRoomHeight=number_slider_4,
    DefaultWallHeight=number_slider,
    DefaultWallThickness=Slider(0.25, range=0..1),
    DefaultDoorHeight=number_slider_3,
    DefaultWindowHeight=number_slider_2,
    AngleTolDeg=Slider(12, range=0..20),
    JsonPath=json,
    WriteJson=save_json)  # -> out, OK, Report, JsonObj; inputs Rooms: list of Curve, Walls: list of Curve, Windows: list of Curve, Doors: list of Curve, RoomTypes: list of String, RoomUnitIds: list of Int32, Tolerance: Double, DefaultWindowElevation: Double, DefaultWallHeight: Double, DefaultWallThickness: Double, DefaultDoorHeight: Double, DefaultWindowHeight: Double, AngleTolDeg: Double, JsonPath: String, WriteJson: Boolean
# ---------- format_floorplan_as_json: Python ----------
# ==============================
# GH Python (Rhino 8 CPython) JSON Exporter
# Panels from wall/window/door THICK polygons using kinked spine (pair-opposite-edges)
# + fallback PCA spine (Fix 2)
# + debug counters per type (Fix 3)
# ==============================

import os, json, math, re
import Rhino
from Rhino.Geometry import Point3d, AreaMassProperties

# -----------------------------
# Inputs (safe defaults)
# -----------------------------
Rooms = Rooms if 'Rooms' in globals() else []
Walls = Walls if 'Walls' in globals() else []
Windows = Windows if 'Windows' in globals() else []
Doors = Doors if 'Doors' in globals() else []

RoomTypes = RoomTypes if 'RoomTypes' in globals() else None
RoomUnitIds = RoomUnitIds if 'RoomUnitIds' in globals() else None

JsonPath = JsonPath if 'JsonPath' in globals() else None
WriteJson = WriteJson if 'WriteJson' in globals() else False

Tolerance = Tolerance if 'Tolerance' in globals() else 0.05
AngleTolDeg = AngleTolDeg if 'AngleTolDeg' in globals() else 12.0

DefaultWallHeight = DefaultWallHeight if 'DefaultWallHeight' in globals() else 2.7
DefaultWindowHeight = DefaultWindowHeight if 'DefaultWindowHeight' in globals() else 1.5
DefaultDoorHeight = DefaultDoorHeight if 'DefaultDoorHeight' in globals() else 2.1
DefaultWallThickness = DefaultWallThickness if 'DefaultWallThickness' in globals() else 0.2

OK = False
Report = ""
JsonObj = None

# -----------------------------
# Grasshopper "None-safe" numeric helpers
# -----------------------------
def num_or(x, default):
    try:
        if x is None:
            return float(default)
        return float(x)
    except:
        return float(default)

Tolerance = num_or(Tolerance, 0.05)
AngleTolDeg = num_or(AngleTolDeg, 12.0)
DefaultWallHeight = num_or(DefaultWallHeight, 2.7)
DefaultWindowHeight = num_or(DefaultWindowHeight, 1.5)
DefaultDoorHeight = num_or(DefaultDoorHeight, 2.1)
DefaultWallThickness = num_or(DefaultWallThickness, 0.2)
WriteJson = bool(WriteJson) if (WriteJson is not None) else False

# -----------------------------
# Polyline-safe utilities
# -----------------------------
def polyline_points_from_any(obj, tol=0.01):
    if obj is None:
        return None

    if isinstance(obj, Rhino.Geometry.Polyline):
        return [obj[i] for i in range(obj.Count)]

    if isinstance(obj, Rhino.Geometry.PolylineCurve):
        try:
            ok, pl = obj.TryGetPolyline()
            if ok and pl:
                return [pl[i] for i in range(pl.Count)]
        except:
            pass
        try:
            pl = obj.ToPolyline()
            return [pl[i] for i in range(pl.Count)]
        except:
            return None

    if isinstance(obj, Rhino.Geometry.Curve):
        # 1) TryGetPolyline
        try:
            ok, pl = obj.TryGetPolyline()
            if ok and pl:
                return [pl[i] for i in range(pl.Count)]
        except:
            pass

        # 2) Convert to polyline (critical for NurbsCurve/PolyCurve)
        try:
            plc = obj.ToPolyline(tol, tol, 0.0, 0.0)
            if plc:
                try:
                    ok, pl = plc.TryGetPolyline()
                    if ok and pl:
                        return [pl[i] for i in range(pl.Count)]
                except:
                    pass
        except:
            pass

    return None

def ensure_closed_curve(curve, tol):
    if curve is None:
        return None
    if curve.IsClosed:
        return curve

    pts = polyline_points_from_any(curve, tol)
    if pts and len(pts) >= 3:
        if pts[0].DistanceTo(pts[-1]) > tol:
            pts.append(pts[0])
        return Rhino.Geometry.PolylineCurve(pts)

    try:
        plc = curve.ToPolyline(tol, tol, 0.0, 0.0)
        pts2 = polyline_points_from_any(plc, tol)
        if pts2 and len(pts2) >= 3:
            if pts2[0].DistanceTo(pts2[-1]) > tol:
                pts2.append(pts2[0])
            return Rhino.Geometry.PolylineCurve(pts2)
        return plc if plc else curve
    except:
        return curve

def curve_centroid(curve):
    try:
        amp = AreaMassProperties.Compute(curve)
        if amp:
            return amp.Centroid
    except:
        pass
    try:
        return curve.GetBoundingBox(True).Center
    except:
        return Point3d(0, 0, 0)

def to_snake_case_roomname(txt):
    if txt is None:
        return "n_a"
    t = str(txt).strip().lower()
    t = t.replace("_", " ")
    t = re.sub(r"\s+", "_", t)
    t = re.sub(r"[^a-z0-9_]", "", t)
    t = re.sub(r"_+", "_", t).strip("_")
    return t if t else "n_a"

def curve_to_xyz_dict_list(curve, tol):
    c = ensure_closed_curve(curve, tol)
    pts = polyline_points_from_any(c, tol)
    if not pts or len(pts) < 2:
        return []
    if pts[0].DistanceTo(pts[-1]) > tol:
        pts = pts + [pts[0]]
    return [{"x": float(p.X), "y": float(p.Y), "z": float(p.Z)} for p in pts]

def nearest_room_index(curve, room_curves):
    if not room_curves:
        return -1
    try:
        p = curve.GetBoundingBox(True).Center
    except:
        p = Point3d(0, 0, 0)

    best_i = -1
    best_d = 1e300
    for i, rc in enumerate(room_curves):
        try:
            ok, t = rc.ClosestPoint(p)
            q = rc.PointAt(t) if ok else curve_centroid(rc)
            d = q.DistanceTo(p)
        except:
            d = curve_centroid(rc).DistanceTo(p)
        if d < best_d:
            best_d = d
            best_i = i
    return best_i

# -----------------------------
# Kinked spine extraction (pair opposite edges) + canonical direction fix
# -----------------------------
def _unit_xy(dx, dy, eps=1e-12):
    L = math.sqrt(dx*dx + dy*dy)
    if L < eps:
        return (0.0, 0.0, 0.0)
    return (dx/L, dy/L, L)

def _angle_mod_pi(ux, uy):
    ang = math.atan2(uy, ux)
    if ang < 0: ang += math.pi
    if ang >= math.pi: ang -= math.pi
    return ang

def _ang_diff_mod_pi(a, b):
    d = abs(a - b)
    return min(d, math.pi - d)

def _dot_xy(ax, ay, bx, by):
    return ax*bx + ay*by

def _midline_segment_for_edge_pair(e, f, tol):
    # overlap along u
    u1 = max(min(e["u0"], e["u1"]), min(f["u0"], f["u1"]))
    u2 = min(max(e["u0"], e["u1"]), max(f["u0"], f["u1"]))
    overlap = u2 - u1
    if overlap <= tol:
        return None

    # distance between supporting lines (thickness)
    sep = abs(e["v"] - f["v"])
    if sep <= tol:
        return None

    # reject end caps: thickness should be smaller than run length
    if sep >= overlap:
        return None

    v_center = 0.5 * (e["v"] + f["v"])
    ux, uy = e["ux"], e["uy"]
    nx, ny = e["nx"], e["ny"]

    pA = Point3d(float(ux*u1 + nx*v_center), float(uy*u1 + ny*v_center), 0.0)
    pB = Point3d(float(ux*u2 + nx*v_center), float(uy*u2 + ny*v_center), 0.0)

    if pA.DistanceTo(pB) <= tol:
        return None

    return (pA, pB, float(sep), float(overlap))

def polygon_center_spine_polyline(curve, tol=0.05, angle_tol_deg=12.0):
    c = ensure_closed_curve(curve, tol)
    pts = polyline_points_from_any(c, tol)
    if not pts or len(pts) < 4:
        return None, 0.0

    if pts[0].DistanceTo(pts[-1]) > tol:
        pts = pts + [pts[0]]
    ring = pts[:-1]  # remove duplicate close

    if len(ring) < 3:
        return None, 0.0

    min_edge_len = max(tol * 2.0, 1e-6)
    ang_tol = math.radians(float(angle_tol_deg))

    edges = []
    n = len(ring)
    for i in range(n):
        p0 = ring[i]
        p1 = ring[(i+1) % n]
        dx = p1.X - p0.X
        dy = p1.Y - p0.Y
        ux, uy, L = _unit_xy(dx, dy)
        if L < min_edge_len:
            continue

        # --- IMPORTANT FIX: canonicalize direction so normals don't flip ---
        if (ux < 0.0) or (abs(ux) < 1e-12 and uy < 0.0):
            ux = -ux
            uy = -uy

        ang = _angle_mod_pi(ux, uy)
        nx, ny = (-uy, ux)

        u0 = _dot_xy(p0.X, p0.Y, ux, uy)
        u1 = _dot_xy(p1.X, p1.Y, ux, uy)
        v0 = _dot_xy(p0.X, p0.Y, nx, ny)
        v1 = _dot_xy(p1.X, p1.Y, nx, ny)
        v = 0.5 * (v0 + v1)

        edges.append({"ux":ux,"uy":uy,"nx":nx,"ny":ny,"ang":ang,"u0":u0,"u1":u1,"v":v,"L":L})

    if len(edges) < 2:
        return None, 0.0

    used = set()
    center_segments = []
    thicknesses = []

    for a in range(len(edges)):
        if a in used:
            continue
        e = edges[a]
        best = None
        best_score = -1e300

        for b in range(len(edges)):
            if b == a or b in used:
                continue
            f = edges[b]
            if _ang_diff_mod_pi(e["ang"], f["ang"]) > ang_tol:
                continue

            seg = _midline_segment_for_edge_pair(e, f, tol)
            if not seg:
                continue

            pA, pB, sep, overlap = seg
            score = overlap - 0.25 * sep
            if score > best_score:
                best_score = score
                best = (b, seg)

        if best:
            b, seg = best
            used.add(a); used.add(b)
            pA, pB, sep, overlap = seg
            center_segments.append(Rhino.Geometry.LineCurve(pA, pB))
            thicknesses.append(sep)

    if not center_segments:
        return None, 0.0

    joined = Rhino.Geometry.Curve.JoinCurves(center_segments, tol)
    if not joined or len(joined) == 0:
        spine = max(center_segments, key=lambda crv: crv.GetLength())
    else:
        spine = max(joined, key=lambda crv: crv.GetLength())

    thicknesses.sort()
    t_est = thicknesses[len(thicknesses)//2] if thicknesses else 0.0
    return spine, float(t_est)

def spine_to_segments(spine_curve, tol):
    if spine_curve is None:
        return []
    pts = None
    try:
        ok, pl = spine_curve.TryGetPolyline()
        if ok and pl:
            pts = [pl[i] for i in range(pl.Count)]
    except:
        pass

    if not pts:
        # sample fallback (last resort)
        dom = spine_curve.Domain
        segs = 10
        pts = [spine_curve.PointAt(dom.T0 + (dom.T1-dom.T0)*i/float(segs)) for i in range(segs+1)]

    out = []
    for i in range(len(pts)-1):
        a = Point3d(float(pts[i].X), float(pts[i].Y), 0.0)
        b = Point3d(float(pts[i+1].X), float(pts[i+1].Y), 0.0)
        if a.DistanceTo(b) > tol:
            out.append((a,b))
    return out

# -----------------------------
# Fix 2: PCA fallback spine segment (always produces a panel if possible)
# -----------------------------
def polygon_center_spine_pca_segment(curve, tol):
    c = ensure_closed_curve(curve, tol)
    pts = polyline_points_from_any(c, tol)
    if not pts or len(pts) < 3:
        return None, None, 0.0

    if pts[0].DistanceTo(pts[-1]) <= tol and len(pts) > 3:
        pts = pts[:-1]

    mx = sum(p.X for p in pts) / float(len(pts))
    my = sum(p.Y for p in pts) / float(len(pts))

    sxx = sxy = syy = 0.0
    for p in pts:
        dx = p.X - mx; dy = p.Y - my
        sxx += dx*dx; sxy += dx*dy; syy += dy*dy

    theta = 0.5 * math.atan2(2.0*sxy, (sxx - syy))
    ux = math.cos(theta); uy = math.sin(theta)
    nx = -uy; ny = ux

    min_u =  1e300; max_u = -1e300
    min_v =  1e300; max_v = -1e300
    for p in pts:
        dx = p.X - mx; dy = p.Y - my
        du = dx*ux + dy*uy
        dv = dx*nx + dy*ny
        min_u = min(min_u, du); max_u = max(max_u, du)
        min_v = min(min_v, dv); max_v = max(max_v, dv)

    a = Point3d(mx + ux*min_u, my + uy*min_u, 0.0)
    b = Point3d(mx + ux*max_u, my + uy*max_u, 0.0)
    thickness = max_v - min_v
    return a, b, float(thickness)

# -----------------------------
# Main JSON build
# -----------------------------
try:
    if not JsonPath:
        OK = False
        Report = "JsonPath is empty."
    else:
        room_curves = [ensure_closed_curve(c, Tolerance) for c in (Rooms or []) if c]
        wall_curves = [ensure_closed_curve(c, Tolerance) for c in (Walls or []) if c]
        window_curves = [ensure_closed_curve(c, Tolerance) for c in (Windows or []) if c]
        door_curves = [ensure_closed_curve(c, Tolerance) for c in (Doors or []) if c]

        Report = "DBG inputs => Rooms:{0} Walls:{1} Windows:{2} Doors:{3}".format(
            len(room_curves), len(wall_curves), len(window_curves), len(door_curves)
        )

        def room_type_at(i):
            if RoomTypes and i is not None and i >= 0 and i < len(RoomTypes):
                return to_snake_case_roomname(RoomTypes[i])
            return "n_a"

        def unit_id_at(i):
            if RoomUnitIds and i is not None and i >= 0 and i < len(RoomUnitIds):
                try:
                    return int(RoomUnitIds[i])
                except:
                    return 1
            return 1

        def apartment_name(uid):
            return "Apartment {0}".format(int(uid))

        def panel_type_for(kind):
            k = (kind or "").upper()
            if k == "WINDOW": return "WIN"
            if k in ["DOOR","ENTRANCE_DOOR"]: return "DOR"
            return "WAL_21_CNI_REN"

        json_obj = {
            "panels": {"attributes": {}, "items": {}, "max_key": 0},
            "spaces": {}
        }

        # spaces
        for i, rc in enumerate(room_curves):
            uid = unit_id_at(i)
            json_obj["spaces"][str(i)] = {
                "room_type": room_type_at(i),
                "apartment": apartment_name(uid),
                "coordinates": curve_to_xyz_dict_list(rc, Tolerance)
            }

        # panels counter (mutable box)
        k = [0]

        def add_panels_from_polys(poly_curves, kind, height):
            # Fix 3: debug counters per type
            ok_polys = 0
            bad_polys = 0
            panels_added = 0

            for pc in poly_curves:
                spine, t_est = polygon_center_spine_polyline(pc, Tolerance, AngleTolDeg)
                segs = spine_to_segments(spine, Tolerance)

                # Fix 2: fallback to PCA if no segments
                if not segs:
                    a, b, t2 = polygon_center_spine_pca_segment(pc, Tolerance)
                    if a and b:
                        segs = [(a, b)]
                        if (t_est is None) or (t_est <= Tolerance):
                            t_est = t2

                if segs:
                    ok_polys += 1
                else:
                    bad_polys += 1
                    continue

                ri = nearest_room_index(pc, room_curves)
                uid = unit_id_at(ri) if ri != -1 else 1
                room_name = room_type_at(ri) if ri != -1 else "n_a"
                apt = apartment_name(uid)

                thickness = t_est if (t_est is not None and t_est > Tolerance) else float(DefaultWallThickness)

                for (a, b) in segs:
                    json_obj["panels"]["items"][str(k[0])] = {
                        "panel_type": panel_type_for(kind),
                        "start_point": [float(a.X), float(a.Y), 0.0],
                        "end_point":   [float(b.X), float(b.Y), 0.0],
                        "height": float(height),
                        "thickness": float(thickness),
                        "room": room_name,
                        "apartment": apt,
                        "entity_subtype": kind
                    }
                    k[0] += 1
                    panels_added += 1

            # append debug line
            nonlocal_report[0] += "\nDBG {0}: polys={1}, ok={2}, bad={3}, panels_added={4}".format(
                kind, len(poly_curves), ok_polys, bad_polys, panels_added
            )

        # Python scoping helper for Report mutation inside function
        nonlocal_report = [Report]

        add_panels_from_polys(wall_curves, "WALL", DefaultWallHeight)
        add_panels_from_polys(window_curves, "WINDOW", DefaultWindowHeight)
        add_panels_from_polys(door_curves, "DOOR", DefaultDoorHeight)

        Report = nonlocal_report[0]

        json_obj["panels"]["max_key"] = k[0]

        # Write if requested
        if WriteJson:
            out_dir = os.path.dirname(JsonPath)
            if out_dir and not os.path.exists(out_dir):
                os.makedirs(out_dir)
            with open(JsonPath, "w") as f:
                json.dump(json_obj, f, indent=2)

        OK = True
        Report += "\nBuilt panels: {0}, spaces: {1}. {2}".format(
            k[0], len(room_curves),
            ("Wrote JSON to: " + JsonPath) if WriteJson else "WriteJson is False (not written)."
        )
        JsonObj = json_obj

except Exception as e:
    OK = False
    Report = "JSON export failed: {0}".format(str(e))
    JsonObj = None
# ---------- end format_floorplan_as_json ----------
panel_3 = Panel(format_floorplan_as_json.Report)
panel_4 = Panel(format_floorplan_as_csv_2.Report)
panel_5 = Panel(format_floorplan_as_csv_2.RoomTagIndexOut)

swatch = ColourSwatch(SwatchColor=RGB(0, 0, 0))
Z = UnitZ(Factor="0.01")

boundary = BoundarySurfaces(Edges=format_floorplan_as_csv_2.RoomCrvsOut)
preview = CustomPreview(Geometry=boundary, Material=ColourSwatch(SwatchColor=RGB(153, 153, 153)))
tag = TextTag(Location=format_floorplan_as_csv_2.RoomTagPtsOut, Text=format_floorplan_as_csv_2.RoomTagTxtOut, Colour=swatch)

boundary_2 = BoundarySurfaces(Edges=format_floorplan_as_csv_2.WallCrvsOut)
tag_2 = TextTag(Location=format_floorplan_as_csv_2.WallPtsOut, Text=format_floorplan_as_csv_2.WallTxtOut, Colour=swatch)
preview_2 = CustomPreview(Geometry=boundary_2, Material=ColourSwatch(SwatchColor=RGB(0, 0, 0)))

boundary_3 = BoundarySurfaces(Edges=format_floorplan_as_csv_2.OpeningCrvsOut)
tag_3 = TextTag(Location=format_floorplan_as_csv_2.OpeningPtsOut, Text=format_floorplan_as_csv_2.OpeningTxtOut, Colour=swatch)

move = Move(Geometry=boundary_3, Motion=Z)  # -> Geometry, Transform
item = ListItem(List=boundary_2, Index=Slider(18, range=0..100), Wrap=True)

preview_3 = CustomPreview(Geometry=move.Geometry, Material=ColourSwatch(SwatchColor=RGB(33, 225, 255)))
