# Grasshopper definition IMPLENIA_BlockS_CLT demo_GH.gh (Grasshopper 1.0.8)
# plug-ins: DreamBlock_CLT.Components

roof_panel_direction = ValueList({"Pitch Perpendicular": 1, "Pitch Lengthwise": 0}, selected="Pitch Perpendicular")
# Geometry parameters
# Project Name
project_name = Panel("IMPLENIA")
# Roof or Floor
roof_or_floor = ValueList({"Roof": 0, "Floor": 1}, selected="Roof")
roof_clt_width_lowest = Slider(300, range=0..2000)

# ----
# Roof Frame
# Roof Frame L connectors
# Roof Beam
roof_frame_l_connector_half_length = Slider(600, range=0..1000)
roof_beam = BooleanToggle(False)
roof_frame_l_connector_thickness = Slider(18, range=0..100)
roof_frame_board_thickness = Slider(45, range=0..100)
roof_frame_board_invasion = Slider(5, range=0..10)
roof_frame_end_boards = BooleanToggle(False)
roof_frame_l_connectors = BooleanToggle(False)
roof_frame_board_height = Slider(145, range=0..1000)
roof_frame_board_step = Slider(435, range=0..1000)
roof_frame_board_step_min = Slider(200, range=0..1000)
roof_frame = BooleanToggle(False)
roof_beam_height = Slider(240, range=0..1000)
roof_beam_thickness = Slider(150, range=0..1000)
roof_beam_gap = Slider(3, range=0..10)
roof_beam_thickness_2 = Number(roof_beam_thickness)
roof_beam_height_2 = Number(roof_beam_height)
roof_beam_gap_2 = Number(roof_beam_gap)
roof_beam_bool = Boolean(roof_beam)
roof_frame_l_connector_half_length_2 = Number(roof_frame_l_connector_half_length)
roof_frame_l_connector_thickness_2 = Number(roof_frame_l_connector_thickness)
roof_frame_l_connectors_bool = Boolean(roof_frame_l_connectors)
roof_frame_board_step_2 = Number(roof_frame_board_step)
roof_frame_board_thickness_2 = Number(roof_frame_board_thickness)
roof_frame_board_invasion_2 = Number(roof_frame_board_invasion)
roof_frame_board_step_min_2 = Number(roof_frame_board_step_min)
roof_frame_board_height_2 = Number(roof_frame_board_height)
roof_frame_bool = Boolean(roof_frame)
roof_frame_end_boards_bool = Boolean(roof_frame_end_boards)

roof_clt_width_reduce_first_panel = Slider(0, range=-200..3000)
# Roof Division
roof_clt_thickness = Slider(60, range=0..100)
roof_clt_width = Slider(2350, range=0..10000)
roof_clt_width_extra = Slider(10, range=0..1000)
project_part_number = Slider(1, range=1..10)
include_project_part_number = BooleanToggle(False)
roof_slope_angle = Slider(15, range=0..80)
roof_flat = BooleanToggle(True)
roof_slope_angle_2 = Slider(0, range=0..80)
floor_beams_2_thickness = Slider(100, range=0..1000)
# Roof
roof_pitch_angle = Slider(0, range=-30..30)
floor_beams_2_height = Slider(240, range=0..1000)
# Floor
floor_clt_thickness = Slider(60, range=0..100)
# Floor Beams
floor_panel_width = Slider(2200, range=600..10000)
floor_beams_1_height = Slider(300, range=0..1000)
roof_or_floor_height = Slider(3000, range=2000..7000)
floor_beams_gap = Slider(1, range=0..1)
floor_beams_1_thickness = Slider(150, range=0..1000)
floor_beams_2_numbers = Panel("0,2,4,6")
floor_beams = BooleanToggle(True)
# Connectors
connector_depth = Slider(20, range=0..100)
connector_width = Slider(150, range=0..1000)
loft_clt_thickness = Slider(60, range=0..100)
# Loft
loft_height = Slider(2688, range=0..10000)
partition_dividers_layer = Text("!DB_Partitions divider line")
filter = StreamFilter(Gate=include_project_part_number, Stream1=project_part_number)
project_name_2 = Text(project_name)
roof_panel_direction_bool = Boolean(roof_panel_direction)
floor_beams_1_thickness_2 = Number(floor_beams_1_thickness)
floor_beams_bool = Boolean(floor_beams)
roof_pitch_angle_2 = Number(roof_pitch_angle)
roof_slope_angle_3 = Number(roof_slope_angle)
roof_clt_thickness_2 = Number(roof_clt_thickness)
roof_clt_width_2 = Number(roof_clt_width)
roof_flat_bool = Boolean(roof_flat)
floor_beams_2_numbers_2 = Text(floor_beams_2_numbers)
floor_beams_1_height_2 = Number(floor_beams_1_height)
roof_or_floor_bool = Boolean(roof_or_floor)
roof_slope_angle_2_2 = Number(roof_slope_angle_2)  # disabled
floor_beams_2_thickness_2 = Number(floor_beams_2_thickness)
floor_clt_thickness_2 = Number(floor_clt_thickness)
floor_beams_2_height_2 = Number(floor_beams_2_height)
floor_panel_width_2 = Number(floor_panel_width)
floor_beams_gap_2 = Number(floor_beams_gap)
connector_depth_2 = Number(connector_depth)
connector_width_2 = Number(connector_width)
roof_or_floor_height_2 = Number(roof_or_floor_height)
loft_clt_thickness_2 = Number(loft_clt_thickness)
loft_height_2 = Number(loft_height)
roof_clt_width_lowest_2 = Number(roof_clt_width_lowest)
roof_clt_width_reduce_first_panel_2 = Number(roof_clt_width_reduce_first_panel)
roof_clt_width_extra_2 = Number(roof_clt_width_extra)
project_part_number_2 = Integer(filter)
walls_div_type = ValueList({"Quarter": 1, "Connector": 0}, selected="Connector")
walls_div_openings_type_3_numbers = Panel("")
walls_div_openings_type_3_flip_numbers = Panel("")
walls_div_connector_flip_side_numbers = Panel("")

# ----
# Wall openings
wall_opening_1_height_2_mm = Slider(2200, range=-1000..3000)
wall_opening_1_height_1_mm = Slider(0, range=0..3000)
wall_openings_all_height_2_mm = Slider(2100, range=-1000..5000)
wall_openings_all_height_1_mm = Slider(0, range=-1000..3000)
wall_opening_4_height_1_mm = Slider(0, range=0..3000)
wall_opening_4_height_2_mm = Slider(2170, range=-1000..3000)
wall_opening_3_height_1_mm = Slider(900, range=0..3000)
wall_opening_2_height_2_mm = Slider(1200, range=-1000..4000)
wall_opening_3_height_2_mm = Slider(1300, range=-1000..3000)
wall_opening_5_height_1_mm = Slider(0, range=0..3000)
wall_opening_5_height_2_mm = Slider(2100, range=-1000..3000)
wall_opening_2_height_1_mm = Slider(900, range=-1000..3000)
wall_opening_3_numbers = Panel("")
wall_opening_4_numbers = Panel("")
wall_opening_1_numbers = Panel("2,3")
wall_opening_2_numbers = Panel("1,4,5,6,8,9")
wall_opening_5_numbers = Panel("")
entwine = Entwine(Branch00=wall_openings_all_height_1_mm, Branch01=wall_openings_all_height_2_mm, FlattenInputs=True)  # -> flatten(Result)
join = TextJoin(Text=entwine, Join="/")
repeat = RepeatData(Data=join, Length=10)
db_opening_data_gh = DBOpeningDataGh(
    PreviousOpenings_data=repeat,
    NewOpenings_numbers=wall_opening_1_numbers,
    NewOpenings_data1=wall_opening_1_height_1_mm,
    NewOpenings_data2=wall_opening_1_height_2_mm)
db_opening_data_gh_2 = DBOpeningDataGh(
    PreviousOpenings_data=db_opening_data_gh,
    NewOpenings_numbers=wall_opening_2_numbers,
    NewOpenings_data1=wall_opening_2_height_1_mm,
    NewOpenings_data2=wall_opening_2_height_2_mm)
db_opening_data_gh_3 = DBOpeningDataGh(
    PreviousOpenings_data=db_opening_data_gh_2,
    NewOpenings_numbers=wall_opening_3_numbers,
    NewOpenings_data1=wall_opening_3_height_1_mm,
    NewOpenings_data2=wall_opening_3_height_2_mm)
db_opening_data_gh_4 = DBOpeningDataGh(
    PreviousOpenings_data=db_opening_data_gh_3,
    NewOpenings_numbers=wall_opening_4_numbers,
    NewOpenings_data1=wall_opening_4_height_1_mm,
    NewOpenings_data2=wall_opening_4_height_2_mm)
db_opening_data_gh_5 = DBOpeningDataGh(
    PreviousOpenings_data=db_opening_data_gh_4,
    NewOpenings_numbers=wall_opening_5_numbers,
    NewOpenings_data1=wall_opening_5_height_1_mm,
    NewOpenings_data2=wall_opening_5_height_2_mm)

walls_div_openings_type_3_support_radius = Slider(32, range=0..1000)
walls_div_quarter_choose_dir_numbers = Panel("")
walls_extend_down = BooleanToggle(False)
walls_div_quarter_gap = Slider(4, range=0..10)
walls_div_openings_type_3_support_width = Slider(80, range=0..1000)
walls_div_openings_type_3_flip = BooleanToggle(False)
walls_div_quarter_correspond_thick = BooleanToggle(False)
# Walls extend down
consider_floor_thickness = BooleanToggle(True)
walls_div_openings_type_2_numbers = Panel("1")
walls_div_openings_type_1_numbers = Panel("")
walls_div_connector_flip_side = BooleanToggle(False)
walls_extend_down_dist = Slider(200, range=0..1000)
walls_div_quarter_size = Slider(60, range=0..200)
walls_div_clt_width_lowest = Slider(300, range=0..2000)
walls_div_openings_type_3 = BooleanToggle(False)
floor_thickness = Slider(50, range=0..200)
walls_div_clt_width = Slider(2900, range=0..10000)
# Walls division
walls_corner_angle_limit = Slider(60, range=0..90)
walls_div_quarter_choose_dir = BooleanToggle(True)
walls_top_beam_height = Slider(2400, range=0..10000)
walls_div_by_width = BooleanToggle(False)
walls_div_openings_type_2_support_width = Slider(80, range=0..1000)
walls_div_direction_numbers = Panel("0")
walls_top_height = Slider(3000, range=0..10000)
walls_clt_thickness_2 = Slider(180, range=40..180)
# Walls
walls_сontour_outward = BooleanToggle(True)
walls_clt_thickness_2_numbers = Panel("")
walls_div_direction = BooleanToggle(False)
# Walls top beam
walls_top_beam = BooleanToggle(False)
walls_clt_thickness = Slider(400, range=0..400)
walls_corners_direction_numbers = Panel("1,3")
walls_div_openings_type_2 = BooleanToggle(True)
walls_div_openings_type_1 = BooleanToggle(False)
walls_corners_direction = BooleanToggle(False)
walls_top_beam_numbers = Panel("")
db_bools_series_gh = DBBoolsSeriesGh(TogglePosition_bool=walls_top_beam, ToggleNumbers_Txt=walls_top_beam_numbers)
db_bools_series_gh_2 = DBBoolsSeriesGh(TogglePosition_bool=walls_div_direction, ToggleNumbers_Txt=walls_div_direction_numbers)
db_bools_series_gh_3 = DBBoolsSeriesGh(TogglePosition_bool=walls_div_openings_type_3, ToggleNumbers_Txt=walls_div_openings_type_3_numbers)
db_bools_series_gh_4 = DBBoolsSeriesGh(TogglePosition_bool=walls_div_openings_type_3_flip, ToggleNumbers_Txt=walls_div_openings_type_3_flip_numbers)
db_bools_series_gh_5 = DBBoolsSeriesGh(TogglePosition_bool=walls_div_connector_flip_side, ToggleNumbers_Txt=walls_div_connector_flip_side_numbers)
db_bools_series_gh_6 = DBBoolsSeriesGh(TogglePosition_bool=walls_div_quarter_choose_dir, ToggleNumbers_Txt=walls_div_quarter_choose_dir_numbers)
db_bools_series_gh_7 = DBBoolsSeriesGh(TogglePosition_bool=walls_div_openings_type_1, ToggleNumbers_Txt=walls_div_openings_type_1_numbers)
db_bools_series_gh_8 = DBBoolsSeriesGh(TogglePosition_bool=walls_div_openings_type_2, ToggleNumbers_Txt=walls_div_openings_type_2_numbers)
db_bools_series_gh_9 = DBBoolsSeriesGh(TogglePosition_bool=walls_corners_direction, ToggleNumbers_Txt=walls_corners_direction_numbers)
walls_extend_down_bool = Boolean(walls_extend_down)
consider_floor_thickness_bool = Boolean(consider_floor_thickness)
floor_thickness_2 = Number(floor_thickness)
walls_extend_down_dist_2 = Number(walls_extend_down_dist)
walls_div_by_width_bool = Boolean(walls_div_by_width)
walls_div_clt_width_lowest_2 = Number(walls_div_clt_width_lowest)
walls_div_clt_width_2 = Number(walls_div_clt_width)
walls_div_type_2 = Boolean(walls_div_type)
walls_top_height_2 = Number(walls_top_height)
walls_div_openings_type_2_support_width_2 = Integer(walls_div_openings_type_2_support_width)
walls_div_quarter_correspond_thick_bool = Boolean(walls_div_quarter_correspond_thick)
walls_div_quarter_size_2 = Integer(walls_div_quarter_size)
walls_div_quarter_gap_2 = Number(walls_div_quarter_gap)
walls_top_beam_bools = Boolean(db_bools_series_gh)
walls_div_openings_type_3_support_radius_2 = Integer(walls_div_openings_type_3_support_radius)
walls_div_openings_type_3_support_width_2 = Integer(walls_div_openings_type_3_support_width)
walls_top_beam_height_2 = Number(walls_top_beam_height)
walls_div_openings_type_3_bools = Boolean(db_bools_series_gh_3)
walls_div_direction_bools = Boolean(db_bools_series_gh_2)
walls_div_connector_flip_side_bools = Boolean(db_bools_series_gh_5)
walls_div_openings_type_3_flip_bools = Boolean(db_bools_series_gh_4)
walls_div_openings_type_1_bools = Boolean(db_bools_series_gh_7)
walls_div_quarter_choose_dir_bools = Boolean(db_bools_series_gh_6)
walls_div_openings_type_2_bools = Boolean(db_bools_series_gh_8)
walls_corners_direction_bools = Boolean(db_bools_series_gh_9)
walls_clt_thickness_2_numbers_2 = Text(walls_clt_thickness_2_numbers)
walls_сontour_outward_bool = Boolean(walls_сontour_outward)
walls_clt_thickness_2_2 = Number(walls_clt_thickness_2)
walls_corner_angle_limit_2 = Number(walls_corner_angle_limit)
walls_clt_thickness_3 = Number(walls_clt_thickness)
consider_floor_thickness_bool_2 = Boolean(consider_floor_thickness_bool)
floor_thickness_3 = Number(floor_thickness_2)
db_opening_and_floor_gh = DBOpeningAndFloorGh(
    Openings_data=db_opening_data_gh_5,
    ConsiderFloorThickness_bool=consider_floor_thickness_bool_2,
    FloorThickness=floor_thickness_3)
wall_openings_data = Text(db_opening_and_floor_gh)

# ----
# Partitions
# Partitions division
partitions_div_type = ValueList({"Quarter": 1, "Connector": 0}, selected="Connector")
partitions_div_openings_type_3_support_r = Slider(30, range=0..1000)  # "Partitions div openings type 3 support radius"
partitions_div_openings_type_3_numbers = Panel("")
partitions_div_openings_type_3_support_w = Slider(60, range=0..1000)  # "Partitions div openings type 3 support width"
partitions_div_openings_type_3_flip_numb = Panel("")  # "Partitions div openings type 3 flip numbers"
partitions_div_openings_type_2_numbers = Panel("")
partitions_div_openings_type_1_numbers = Panel("")
partitions_div_openings_type_3 = BooleanToggle(True)
partitions_div_openings_type_3_flip = BooleanToggle(False)
partitions_top_height = Slider(3000, range=0..10000)
partitions_div_openings_type_2_support_w = Slider(50, range=0..1000)  # "Partitions div openings type 2 support width"
partitions_div_quarter_choose_dir_number = Panel("")  # "Partitions div quarter choose dir numbers"
partitions_div_openings_type_2 = BooleanToggle(False)
partitions_div_openings_type_1 = BooleanToggle(False)
partitions_div_quarter_choose_dir = BooleanToggle(True)
partitions_div_connector_flip_side_numbe = Panel("")  # "Partitions div connector flip side numbers"
partitions_clt_thickness = Slider(100, range=0..100)
partitions_clt_thickness_2 = Slider(400, range=0..600)
partitions_clt_thickness_2_numbers = Panel("1,8")
partitions_div_connector_flip_side = BooleanToggle(False)
partitions_div_quarter_size = Slider(60, range=0..200)
partitions_div_quarter_correspond_thick = BooleanToggle(False)
partitions_div_by_width = BooleanToggle(False)
partitions_div_quarter_gap = Slider(4, range=0..10)
partitions_div_direction_numbers = Panel("")
partitions_div_direction = BooleanToggle(True)
partitions_div_clt_width_lowest = Slider(300, range=0..2000)
partitions_div_clt_width = Slider(1200, range=0..10000)
db_bools_series_gh_10 = DBBoolsSeriesGh(TogglePosition_bool=partitions_div_direction, ToggleNumbers_Txt=partitions_div_direction_numbers)
db_bools_series_gh_11 = DBBoolsSeriesGh(TogglePosition_bool=partitions_div_openings_type_3, ToggleNumbers_Txt=partitions_div_openings_type_3_numbers)
db_bools_series_gh_12 = DBBoolsSeriesGh(TogglePosition_bool=partitions_div_openings_type_2, ToggleNumbers_Txt=partitions_div_openings_type_2_numbers)
db_bools_series_gh_13 = DBBoolsSeriesGh(TogglePosition_bool=partitions_div_openings_type_1, ToggleNumbers_Txt=partitions_div_openings_type_1_numbers)
db_bools_series_gh_14 = DBBoolsSeriesGh(TogglePosition_bool=partitions_div_openings_type_3_flip, ToggleNumbers_Txt=partitions_div_openings_type_3_flip_numb)
db_bools_series_gh_15 = DBBoolsSeriesGh(TogglePosition_bool=partitions_div_quarter_choose_dir, ToggleNumbers_Txt=partitions_div_quarter_choose_dir_number)
db_bools_series_gh_16 = DBBoolsSeriesGh(TogglePosition_bool=partitions_div_connector_flip_side, ToggleNumbers_Txt=partitions_div_connector_flip_side_numbe)
partitions_clt_thickness_2_numbers_2 = Text(partitions_clt_thickness_2_numbers)
partitions_top_height_2 = Number(partitions_top_height)
partitions_clt_thickness_3 = Number(partitions_clt_thickness)
partitions_clt_thickness_2_2 = Number(partitions_clt_thickness_2)
partitions_div_by_width_bool = Boolean(partitions_div_by_width)
partitions_div_clt_width_lowest_2 = Number(partitions_div_clt_width_lowest)
partitions_div_quarter_size_2 = Integer(partitions_div_quarter_size)
partitions_div_clt_width_2 = Number(partitions_div_clt_width)
partitions_div_type_2 = Boolean(partitions_div_type)
partitions_div_quarter_correspond_thick_2 = Boolean(partitions_div_quarter_correspond_thick)  # "Partitions div quarter correspond thick_bool"
partitions_div_quarter_gap_2 = Number(partitions_div_quarter_gap)
partitions_div_openings_type_3_support_r_2 = Integer(partitions_div_openings_type_3_support_r)  # "Partitions div openings type 3 support radius"
partitions_div_openings_type_3_support_w_2 = Integer(partitions_div_openings_type_3_support_w)  # "Partitions div openings type 3 support width"
partitions_div_openings_type_2_support_w_2 = Integer(partitions_div_openings_type_2_support_w)  # "Partitions div openings type 2 support width"
partitions_div_direction_bools = Boolean(db_bools_series_gh_10)
partitions_div_openings_type_2_bools = Boolean(db_bools_series_gh_12)
partitions_div_openings_type_1_bools = Boolean(db_bools_series_gh_13)
partitions_div_connector_flip_side_bools = Boolean(db_bools_series_gh_16)
partitions_div_quarter_choose_dir_bools = Boolean(db_bools_series_gh_15)
partitions_div_openings_type_3_bools = Boolean(db_bools_series_gh_11)
partitions_div_openings_type_3_flip_bool = Boolean(db_bools_series_gh_14)  # "Partitions div openings type 3 flip_bools"

partition_opening_3_height_2_mm = Slider(2095, range=-1000..3000)
partitions_top_beam_numbers = Panel("")
partitions_top_beam_height = Slider(2200, range=0..10000)
partition_openings_all_height_2_mm = Slider(2200, range=-1000..3000)
# Partition openings
partition_openings_all_height_1_mm = Slider(0, range=0..3000)
partition_opening_1_height_2_mm = Slider(1500, range=-1000..3000)
partition_opening_1_height_1_mm = Slider(0, range=0..3000)
# Partitions top beam
partitions_top_beam = BooleanToggle(False)
partition_opening_2_height_2_mm = Slider(351, range=-1000..3000)
partition_opening_2_height_1_mm = Slider(0, range=0..3000)
partition_opening_3_height_1_mm = Slider(0, range=0..3000)
partition_opening_4_height_2_mm = Slider(1103, range=-1000..3000)
partition_opening_4_height_1_mm = Slider(520, range=0..3000)
partitions_clt_thickness_2_3 = Slider(371, range=0..600)
partition_opening_1_numbers = Panel("")
partition_opening_2_numbers = Panel("")
partition_opening_3_numbers = Panel("")
partition_opening_4_numbers = Panel("")
db_bools_series_gh_17 = DBBoolsSeriesGh(TogglePosition_bool=partitions_top_beam, ToggleNumbers_Txt=partitions_top_beam_numbers)
entwine_2 = Entwine(Branch00=partition_openings_all_height_1_mm, Branch01=partition_openings_all_height_2_mm, FlattenInputs=True)  # -> flatten(Result)
partitions_top_beam_height_2 = Number(partitions_top_beam_height)
join_2 = TextJoin(Text=entwine_2, Join="/")
partitions_top_beam_bools = Boolean(db_bools_series_gh_17)
repeat_2 = RepeatData(Data=join_2, Length=10)
db_opening_data_gh_6 = DBOpeningDataGh(
    PreviousOpenings_data=repeat_2,
    NewOpenings_numbers=partition_opening_1_numbers,
    NewOpenings_data1=partition_opening_1_height_1_mm,
    NewOpenings_data2=partition_opening_1_height_2_mm)
db_opening_data_gh_7 = DBOpeningDataGh(
    PreviousOpenings_data=db_opening_data_gh_6,
    NewOpenings_numbers=partition_opening_2_numbers,
    NewOpenings_data1=partition_opening_2_height_1_mm,
    NewOpenings_data2=partition_opening_2_height_2_mm)
db_opening_data_gh_8 = DBOpeningDataGh(
    PreviousOpenings_data=db_opening_data_gh_7,
    NewOpenings_numbers=partition_opening_3_numbers,
    NewOpenings_data1=partition_opening_3_height_1_mm,
    NewOpenings_data2=partition_opening_3_height_2_mm)
db_opening_data_gh_9 = DBOpeningDataGh(
    PreviousOpenings_data=db_opening_data_gh_8,
    NewOpenings_numbers=partition_opening_4_numbers,
    NewOpenings_data1=partition_opening_4_height_1_mm,
    NewOpenings_data2=partition_opening_4_height_2_mm)
consider_floor_thickness_bool_3 = Boolean(consider_floor_thickness_bool)
floor_thickness_4 = Number(floor_thickness_2)
db_opening_and_floor_gh_2 = DBOpeningAndFloorGh(
    Openings_data=db_opening_data_gh_9,
    ConsiderFloorThickness_bool=consider_floor_thickness_bool_3,
    FloorThickness=floor_thickness_4)
partition_openings_data = Text(db_opening_and_floor_gh_2)

# ----
# AUX  Geometry
roof_frame_board_thickness_3 = Number(roof_frame_board_thickness_2)
roof_frame_board_invasion_3 = Number(roof_frame_board_invasion_2)
roof_frame_board_height_3 = Number(roof_frame_board_height_2)
connector_width_3 = Number(connector_width_2)
connector_depth_3 = Number(connector_depth_2)
db_connector_gh = DBConnectorGh(ConnectorDepth=connector_depth_3, ConnectorWidth=connector_width_3)
db_roof_board_gh = DBRoofBoardGh(
    RoofFrameBoardThickness=roof_frame_board_thickness_3,
    RoofFrameBoardHeight=roof_frame_board_height_3,
    RoofFrameBoardInvasion=roof_frame_board_invasion_3)
connector_rec = Rectangle(db_connector_gh)
roof_board_rec = Rectangle(db_roof_board_gh)

# ----
# SHOW
show_panel_tags = BooleanToggle(False)
# Display properties
show_text_marks = BooleanToggle(True)
draw_roof = BooleanToggle(False)
show_text_marks_2 = Boolean(show_text_marks)
show_panel_tags_2 = Boolean(show_panel_tags)
draw_roof_bool = Boolean(draw_roof)

swatch = ColourSwatch(SwatchColor=RGB(255, 0, 0))

# ----
# Get lines from Rhino
panel = Panel("!DB_Partitions middle line")

floor_restrict_connector_layer = Text("!DB_Floor connector ban")
floor_add_contour_layer = Text("!DB_Floor forced panels")
floor_add_trim_layer = Text("!DB_Floor trim lines")
floor_add_hole_layer = Text("!DB_Floor holes")
floor_trim_dir_layer = Text("!DB_Floor division direction")
beam_layer = Text("!DB_Floor beams middle line")

partition_openings_layer = Text("!DB_Partition openings contour")
partition_dividers_layer_2 = Text("!DB_Partitions divider line")
partition_layer = Text(panel)
openings_layer = Text("!DB_Wall openings contour")
dividers_layer = Text("!DB_Walls divider line")
pitch_layer = Text("!DB_Pitch line")
plan_layer = Text("!DB_Plan contour")
loft_layer = Text("!DB_Loft contour")

entwine_3 = Entwine(
    Branch00=plan_layer,
    Branch01=pitch_layer,
    Branch02=partition_layer,
    Branch03=loft_layer,
    Branch04=openings_layer,
    Branch05=dividers_layer,
    Branch06=partition_openings_layer,
    Branch07=partition_dividers_layer_2,
    Branch09=floor_add_trim_layer,
    Branch010=floor_add_hole_layer,
    Branch011=floor_add_contour_layer,
    Branch012=floor_trim_dir_layer,
    Branch013=floor_restrict_connector_layer,
    Branch014=beam_layer,
    FlattenInputs=True)
m_objects = QueryModelObjects(Layer=entwine_3, Locked=True, Hidden=True, AutoUpdateState=True)
bang = ExplodeTree(Data=m_objects)  # -> Branch0, Branch1, Branch2, Branch3, Branch4, Branch5, Branch6, Branch7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
floor_beams_middle_line = Curve(flatten(bang.Branch14))
floor_division_direction = Curve(flatten(bang.Branch12))
partition_openings_contour = Curve(flatten(bang.Branch6))
floor_connector_ban = Curve(flatten(bang.Branch13))
wall_openings_contour = Curve(flatten(bang.Branch4))
floor_forced_panels = Curve(flatten(bang.Branch11))
partitions_divider_line = Curve(flatten(bang.Branch7))
floor_trim_lines = Curve(flatten(bang.Branch9))
plan_contour = Curve(flatten(bang.Branch0))
floor_holes = Curve(flatten(bang.Branch10))
pitch_line = Curve(flatten(bang.Branch1))
partitions_middle_line = Curve(flatten(bang.Branch2))
loft_contour = Curve(flatten(bang.Branch3))
walls_divider_line = Curve(flatten(bang.Branch5))

# ----
# OUTER WALLS Constructor
# Geometry
# outputs
# Geometry
# inputs
# Data
# inputs
# Data
# outputs
walls_corners_direction_bools_2 = Boolean(walls_corners_direction_bools)
walls_clt_thickness_2_numbers_3 = Text(walls_clt_thickness_2_numbers_2)
walls_сontour_outward_bool_2 = Boolean(walls_сontour_outward_bool)
walls_corner_angle_limit_3 = Number(walls_corner_angle_limit_2)
walls_clt_thickness_2_3 = Number(walls_clt_thickness_2_2)
walls_clt_thickness_4 = Number(walls_clt_thickness_3)
plan_contour_2 = Curve(plan_contour)
db_outer_walls_gh = DBOuterWallsGh(
    PlanContour=plan_contour_2,
    WallsСontourOutward_bool=walls_сontour_outward_bool_2,
    WallsCltThickness=walls_clt_thickness_4,
    WallsCltThickness2=walls_clt_thickness_2_3,
    WallsCltThickness2_numbers=walls_clt_thickness_2_numbers_3,
    WallsCornersDirection_bools=walls_corners_direction_bools_2,
    WallsCornerAngleLimit=walls_corner_angle_limit_3)  # -> Plan_Brep, PlanContour_outer, PlanContour_inner, WallsContour, WallsLongestLineMiddle, WallsPlaneMiddle, WallsPlaneOuter, WallsThicknessSorted
walls_longest_line_middle = Line(db_outer_walls_gh.WallsLongestLineMiddle)
walls_thickness_sorted = Integer(db_outer_walls_gh.WallsThicknessSorted)
plan_contour_outer = Curve(db_outer_walls_gh.PlanContour_outer)
plan_contour_inner = Curve(db_outer_walls_gh.PlanContour_inner)
walls_plane_middle = Plane(db_outer_walls_gh.WallsPlaneMiddle)
walls_plane_outer = Plane(db_outer_walls_gh.WallsPlaneOuter)
walls_contour = Curve(db_outer_walls_gh.WallsContour)
plan_brep = Brep(db_outer_walls_gh.Plan_Brep)

# ----
# ROOF Constructor
roof_or_floor_height_3 = Number(roof_or_floor_height_2)
roof_slope_angle_4 = Number(roof_slope_angle_3)
roof_slope_angle_2_3 = Number(roof_slope_angle_2_2)
roof_pitch_angle_3 = Number(roof_pitch_angle_2)
roof_clt_thickness_3 = Number(roof_clt_thickness_2)
roof_or_floor_bool_2 = Boolean(roof_or_floor_bool)
roof_flat_bool_2 = Boolean(roof_flat_bool)
plan_contour_inner_2 = Curve(plan_contour_inner)
pitch_line_2 = Line(pitch_line)
not = GateNot(A=roof_or_floor_bool_2)
db_roof_constructor_gh = DBRoofConstructorGh(
    TurnON=not,
    PitchLine=pitch_line_2,
    RoofFlat_bool=roof_flat_bool_2,
    RoofHeight=roof_or_floor_height_3,
    RoofPitchAngle=roof_pitch_angle_3,
    RoofSlopeAngle=roof_slope_angle_4,
    RoofSlopeAngle2=roof_slope_angle_2_3,
    RoofCltThickness=roof_clt_thickness_3,
    PlanContour_inner=plan_contour_inner_2)  # -> PitchLine_long, PitchSimmetry_Pln, Slope_Plns, SlopeSurfaces, RoofBrepForIntersect, RoofCltThicknessVector, RoofCltThicknessCoef
pitch_line_long = Line(db_roof_constructor_gh.PitchLine_long)
pitch_simmetry_pln = Plane(db_roof_constructor_gh.PitchSimmetry_Pln)
slope_plns = Plane(db_roof_constructor_gh.Slope_Plns)
slope_surfaces = Surface(db_roof_constructor_gh.SlopeSurfaces)
roof_clt_thickness_vector = Vector(db_roof_constructor_gh.RoofCltThicknessVector)
roof_brep_for_intersect = Brep(db_roof_constructor_gh.RoofBrepForIntersect)
roof_clt_thickness_coef = Number(db_roof_constructor_gh.RoofCltThicknessCoef)

# ----
# FLOOR
# Geometry
# inputs
# Data
# inputs
roof_or_floor_bool_3 = Boolean(roof_or_floor_bool)
roof_or_floor_height_4 = Number(roof_or_floor_height_2)
floor_clt_thickness_3 = Number(floor_clt_thickness_2)
plan_contour_outer_2 = Curve(plan_contour_outer)
floor_trim_lines_2 = Curve(floor_trim_lines)
floor_panel_width_3 = Number(floor_panel_width_2)
floor_division_direction_2 = Curve(floor_division_direction)
floor_forced_panels_2 = Curve(floor_forced_panels)
floor_connector_ban_2 = Curve(floor_connector_ban)
connector_rec_2 = Rectangle(connector_rec)
floor_holes_2 = Curve(floor_holes)
db_floor_gh = DBFloorGh(
    TurnON=roof_or_floor_bool_3,
    FloorContour=plan_contour_outer_2,
    FloorTrimLines=floor_trim_lines_2,
    FloorHoles=floor_holes_2,
    FloorForcedPanels=floor_forced_panels_2,
    FloorDivisionDirection=floor_division_direction_2,
    FloorConnectorBan=floor_connector_ban_2,
    Connector_Rec=connector_rec_2,
    FloorHeight=roof_or_floor_height_4,
    FloorPanelWidth=floor_panel_width_3,
    FloorCltThickness=floor_clt_thickness_3)  # -> Floor_Breps, FloorPanel_Plns, FloorBoxForIntersect, FloorSurfaceForIntersect, Floor_Plane
floor_breps = Brep(db_floor_gh.Floor_Breps)
floor_box_for_intersect = Brep(db_floor_gh.FloorBoxForIntersect)
floor_panel_plns = Plane(db_floor_gh.FloorPanel_Plns)
floor_plane = Plane(db_floor_gh.Floor_Plane)
floor_surface_for_intersect = Brep(db_floor_gh.FloorSurfaceForIntersect)

plan_contour_inner_3 = Curve(plan_contour_inner)
loft_contour_2 = Curve(graft(loft_contour))
loft_clt_thickness_3 = Number(loft_clt_thickness_2)
loft_height_3 = Number(loft_height_2)

# ----
# Loft Breps
number_slider = Slider(2, range=0..10)
cir = Circle(Plane=PlaneXY(0, 0, 0), Radius=1)
Z = UnitZ(Factor=loft_clt_thickness_3)
Z_2 = UnitZ(Factor="20000")
rint = RegionIntersection(CurvesA=plan_contour_inner_3, CurvesB=loft_contour_2)
Z_3 = UnitZ(Factor=loft_height_3)
flip = FlipCurve(Curve=rint, Guide=cir)  # -> Curve, Flag
offset = OffsetCurve(Curve=flip.Curve, Distance=number_slider, Corners=1)
move = Move(Geometry=flip.Curve, Motion=Z_3)  # -> Geometry, Transform
move_2 = Move(Geometry=offset, Motion=Z_3)  # -> Geometry, Transform
boundary = BoundarySurfaces(Edges=move.Geometry)
boundary_2 = BoundarySurfaces(Edges=move_2.Geometry)
extr = Extrude(Base=boundary, Direction=Z)
extr_2 = Extrude(Base=boundary_2, Direction=Z_2)
xy = XYPlane(Origin=Point(0, 0, 0))
bbox = BoundingBox(Content=extr, Plane=xy)  # -> Box, Box_2
area = Area(Geometry=bbox.Box)  # -> Area, Centroid
pl_origin = PlaneOrigin(Base=xy, Origin=area.Centroid)
loft_sub_breps = Brep(extr_2)
loft_breps = Brep(extr)
loft_planes = Plane(pl_origin)

# ----
# ROOF Beam
pitch_line_long_2 = Line(pitch_line_long)
roof_beam_bool_2 = Boolean(roof_beam_bool)
roof_beam_thickness_3 = Number(roof_beam_thickness_2)
roof_beam_gap_3 = Number(roof_beam_gap_2)
roof_brep_for_intersect_2 = Brep(roof_brep_for_intersect)
roof_beam_height_3 = Number(roof_beam_height_2)
plan_brep_2 = Brep(plan_brep)
db_roof_beam_gh = DBRoofBeamGh(
    TurnON=roof_beam_bool_2,
    PitchLine_long=pitch_line_long_2,
    BeamThickness=roof_beam_thickness_3,
    BeamHeight=roof_beam_height_3,
    BeamGap=roof_beam_gap_3,
    RoofBrepForIntersect=roof_brep_for_intersect_2,
    Plan_Brep=plan_brep_2)  # -> RoofBeam_Brep, RoofBeam_Plane, RoofBeam_SubBrep
roof_beam_sub_brep = Brep(db_roof_beam_gh.RoofBeam_SubBrep)
roof_beam_brep = Brep(db_roof_beam_gh.RoofBeam_Brep)
roof_beam_plane = Plane(db_roof_beam_gh.RoofBeam_Plane)

# ----
# PARTITIONS Constructor
# Geometry
# inputs
# Geometry
# outputs
# Data
# inputs
# Data
# outputs
partitions_clt_thickness_2_numbers_3 = Text(partitions_clt_thickness_2_numbers_2)
partitions_clt_thickness_2_4 = Number(partitions_clt_thickness_2_2)
partitions_clt_thickness_4 = Number(partitions_clt_thickness_3)
partitions_middle_line_2 = Line(partitions_middle_line)
plan_contour_inner_4 = Curve(plan_contour_inner)
db_partitions_gh = DBPartitionsGh(
    PartitionsMiddleLine=partitions_middle_line_2,
    PlanContour_inner=plan_contour_inner_4,
    PartitionsCltThickness=partitions_clt_thickness_4,
    PartitionsCltThickness2=partitions_clt_thickness_2_4,
    PartitionsCltThickness2_numbers=partitions_clt_thickness_2_numbers_3)  # -> PartitionsContour, PartitionsLongestLineMiddle, PartitionsPlaneMiddle, PartitionsThicknessSorted
partitions_longest_line_middle = Line(db_partitions_gh.PartitionsLongestLineMiddle)
partitions_thickness_sorted = Number(db_partitions_gh.PartitionsThicknessSorted)
partitions_plane_middle = Plane(db_partitions_gh.PartitionsPlaneMiddle)
partitions_contour = Curve(db_partitions_gh.PartitionsContour)

# ----
# ROOF Breps
# perpendicular
# Geometry
# inputs
# Data
# inputs
roof_panel_direction_bool_2 = Boolean(roof_panel_direction_bool)
roof_clt_thickness_vector_2 = Vector(roof_clt_thickness_vector)
plan_contour_outer_3 = Curve(plan_contour_outer)
pitch_simmetry_pln_2 = Plane(pitch_simmetry_pln)
roof_clt_thickness_coef_2 = Number(roof_clt_thickness_coef)
roof_clt_thickness_4 = Number(roof_clt_thickness_2)
roof_clt_width_lowest_3 = Number(roof_clt_width_lowest_2)
roof_clt_width_reduce_first_panel_3 = Number(roof_clt_width_reduce_first_panel_2)
roof_clt_width_3 = Number(roof_clt_width_2)
roof_clt_width_extra_3 = Number(roof_clt_width_extra_2)
roof_frame_end_boards_bool_2 = Boolean(roof_frame_end_boards_bool)
roof_frame_board_step_min_3 = Number(roof_frame_board_step_min_2)
roof_frame_board_step_3 = Number(roof_frame_board_step_2)
roof_frame_l_connectors_bool_2 = Boolean(roof_frame_l_connectors_bool)
roof_frame_l_connector_half_length_3 = Number(roof_frame_l_connector_half_length_2)
roof_frame_l_connector_thickness_3 = Number(roof_frame_l_connector_thickness_2)
roof_frame_bool_2 = Boolean(roof_frame_bool)
connector_rec_3 = Rectangle(connector_rec)
roof_board_rec_2 = Rectangle(roof_board_rec)
slope_surfaces_2 = Surface(slope_surfaces)
pitch_line_long_3 = Line(pitch_line_long)
plan_brep_3 = Brep(plan_brep)
slope_plns_2 = Plane(slope_plns)
db_roof_brep_perp = DBRoofBrepPerpGh(
    TurnON=roof_panel_direction_bool_2,
    PitchLine_long=pitch_line_long_3,
    PitchSimmetry_Pln=pitch_simmetry_pln_2,
    Slope_Plns=slope_plns_2,
    PlanContour_outer=plan_contour_outer_3,
    Plan_Brep=plan_brep_3,
    RoofCltThicknessVector=roof_clt_thickness_vector_2,
    Connector_Rec=connector_rec_3,
    RoofBoard_Rec=roof_board_rec_2,
    SlopeSurfaces=slope_surfaces_2,
    RoofCltThickness=roof_clt_thickness_4,
    RoofCltThicknessCoef=roof_clt_thickness_coef_2,
    RoofCltWidth=roof_clt_width_3,
    RoofCltWidthLowest=roof_clt_width_lowest_3,
    RoofCltWidthReduceFirstPanel=roof_clt_width_reduce_first_panel_3,
    RoofCltWidthExtra=roof_clt_width_extra_3,
    RoofFrame_bool=roof_frame_bool_2,
    RoofFrameEndBoards_bool=roof_frame_end_boards_bool_2,
    RoofFrameBoardStep=roof_frame_board_step_3,
    RoofFrameBoardStepMin=roof_frame_board_step_min_3,
    RoofFrameLConnectors_bool=roof_frame_l_connectors_bool_2,
    RoofFrameLConnectorHalfLength=roof_frame_l_connector_half_length_3,
    RoofFrameLConnectorThickness=roof_frame_l_connector_thickness_3)  # -> RoofPanelPerp_Breps, RoofPanelPerp_Plns, RoofFramePerp_Breps, RoofLConnector_Breps
roof_panel_perp_breps = Brep(db_roof_brep_perp.RoofPanelPerp_Breps)
roof_panel_perp_plns = Plane(db_roof_brep_perp.RoofPanelPerp_Plns)
roof_frame_perp_breps = Brep(db_roof_brep_perp.RoofFramePerp_Breps)
roof_l_connector_breps = Brep(db_roof_brep_perp.RoofLConnector_Breps)

# ----
# FLOOR Beams
# Geometry
# inputs
# Data
# inputs
floor_beams_1_thickness_3 = Number(floor_beams_1_thickness_2)
floor_beams_2_thickness_3 = Number(floor_beams_2_thickness_2)
floor_beams_2_numbers_3 = Text(floor_beams_2_numbers_2)
floor_beams_1_height_3 = Number(floor_beams_1_height_2)
floor_beams_2_height_3 = Number(floor_beams_2_height_2)
roof_or_floor_height_5 = Number(roof_or_floor_height_2)
floor_beams_gap_3 = Number(floor_beams_gap_2)
floor_beams_bool_2 = Boolean(floor_beams_bool)
roof_or_floor_bool_4 = Boolean(roof_or_floor_bool)
roof_flat_bool_3 = Boolean(roof_flat_bool)
floor_beams_middle_line_2 = Curve(floor_beams_middle_line)
walls_contour_2 = Curve(walls_contour)
partitions_contour_2 = Curve(partitions_contour)
or = GateOr(A=roof_or_floor_bool_4, B=roof_flat_bool_3)
merge = Merge(Data1=walls_contour_2, Data2=partitions_contour_2)  # -> flatten(Result)
and = GateAnd(A=or, B=floor_beams_bool_2)
db_floor_beams_gh = DBFloorBeamsGh(
    TurnON=and,
    BeamsMiddleLine=floor_beams_middle_line_2,
    WallsContour=merge,
    Beams1Thickness=floor_beams_1_thickness_3,
    Beams2Thickness=floor_beams_2_thickness_3,
    Beams1Height=floor_beams_1_height_3,
    Beams2Height=floor_beams_2_height_3,
    Beams2Numbers=floor_beams_2_numbers_3,
    BeamsGap=floor_beams_gap_3,
    FloorHeight=roof_or_floor_height_5)  # -> Beams_Breps, Beams_SubBreps, Beams_Planes
floor_beams_breps = Brep(db_floor_beams_gh.Beams_Breps)
floor_beams_sub_breps = Brep(db_floor_beams_gh.Beams_SubBreps)
floor_beams_planes = Plane(db_floor_beams_gh.Beams_Planes)

# ----
# ROOF Breps
# lengthwise
# Geometry
# inputs
# Data
# inputs
roof_panel_direction_bool_3 = Boolean(roof_panel_direction_bool)
roof_clt_thickness_vector_3 = Vector(roof_clt_thickness_vector)
roof_clt_width_lowest_4 = Number(roof_clt_width_lowest_2)
roof_clt_width_reduce_first_panel_4 = Number(roof_clt_width_reduce_first_panel_2)
roof_clt_width_4 = Number(roof_clt_width_2)
roof_frame_bool_3 = Boolean(roof_frame_bool)
roof_frame_board_step_min_4 = Number(roof_frame_board_step_min_2)
roof_frame_board_step_4 = Number(roof_frame_board_step_2)
roof_board_rec_3 = Rectangle(roof_board_rec)
connector_rec_4 = Rectangle(connector_rec)
slope_plns_3 = Plane(slope_plns)
plan_brep_4 = Brep(plan_brep)
not_2 = GateNot(A=roof_panel_direction_bool_3)
db_roof_brep_lw_gh = DBRoofBrepLwGh(
    TurnON=not_2,
    Slope_Plns=slope_plns_3,
    Plan_Brep=plan_brep_4,
    RoofCltThicknessVector=roof_clt_thickness_vector_3,
    Connector_Rec=connector_rec_4,
    RoofBoard_Rec=roof_board_rec_3,
    RoofCltWidth=roof_clt_width_4,
    RoofCltWidthLowest=roof_clt_width_lowest_4,
    RoofCltWidthReduceFirstPanel=roof_clt_width_reduce_first_panel_4,
    RoofFrame_bool=roof_frame_bool_3,
    RoofFrameBoardStep=roof_frame_board_step_4,
    RoofFrameBoardStepMin=roof_frame_board_step_min_4)  # -> RoofPanelLw_Breps, RoofPanelLw_Plns, RoofFrameLw_Breps
roof_frame_lw_breps = Brep(db_roof_brep_lw_gh.RoofFrameLw_Breps)
roof_panel_lw_breps = Brep(db_roof_brep_lw_gh.RoofPanelLw_Breps)
roof_panel_lw_plns = Plane(db_roof_brep_lw_gh.RoofPanelLw_Plns)

# ----
# Loft Text Marks
project_part_number_3 = Integer(project_part_number_2)
project_name_3 = Text(project_name_2)
loft_breps_2 = Brep(loft_breps)
db_marks_gh = DBMarksGh(
    Project_name=project_name_3,
    PanelClass_name="L",
    ProjectPart_number=project_part_number_3,
    GeometryStuctured=loft_breps_2)
loft_marks_txt = Text(db_marks_gh)

roof_panel_lw_breps_2 = Brep(roof_panel_lw_breps)
roof_panel_perp_breps_2 = Brep(roof_panel_perp_breps)

roof_frame_lw_breps_2 = Brep(roof_frame_lw_breps)
roof_frame_perp_breps_2 = Brep(roof_frame_perp_breps)

# ----
# Choose Roof or Floor
floor_box_for_intersect_2 = Brep(floor_box_for_intersect)
roof_brep_for_intersect_3 = Brep(roof_brep_for_intersect)
roof_or_floor_bool_5 = Boolean(roof_or_floor_bool)
floor_surface_for_intersect_2 = Brep(floor_surface_for_intersect)
slope_surfaces_3 = Surface(slope_surfaces)
roof_panel_direction_bool_4 = Boolean(roof_panel_direction_bool)
roof_panel_lw_plns_2 = Plane(roof_panel_lw_plns)
roof_panel_perp_plns_2 = Plane(roof_panel_perp_plns)
floor_panel_plns_2 = Plane(floor_panel_plns)
floor_breps_2 = Brep(floor_breps)
join_3 = BrepJoin(Breps=flatten(slope_surfaces_3))  # -> Breps, Closed
filter_2 = StreamFilter(Gate=roof_or_floor_bool_5, Stream0=roof_brep_for_intersect_3, Stream1=floor_box_for_intersect_2)
filter_3 = StreamFilter(Gate=roof_panel_direction_bool_4, Stream0=roof_panel_lw_plns_2, Stream1=roof_panel_perp_plns_2)
filter_4 = StreamFilter(Gate=roof_panel_direction_bool_4, Stream0=roof_frame_lw_breps_2, Stream1=roof_frame_perp_breps_2)
filter_5 = StreamFilter(Gate=roof_panel_direction_bool_4, Stream0=roof_panel_lw_breps_2, Stream1=roof_panel_perp_breps_2)
roof_or_floor_bool_6 = Boolean(roof_or_floor_bool)
filter_6 = StreamFilter(Gate=roof_or_floor_bool_5, Stream0=join_3.Breps, Stream1=floor_surface_for_intersect_2)
filter_7 = StreamFilter(Gate=roof_or_floor_bool_6, Stream0=filter_3, Stream1=floor_panel_plns_2)
filter_8 = StreamFilter(Gate=roof_or_floor_bool_6, Stream0=filter_5, Stream1=floor_breps_2)
walls_top_cutting_surface = Brep(filter_6)
walls_top_cutting_body = Brep(filter_2)
draw_roof_bool_2 = Boolean(draw_roof_bool)
filter_9 = StreamFilter(Gate=draw_roof_bool_2, Stream1=filter_8)
filter_10 = StreamFilter(Gate=draw_roof_bool_2, Stream1=filter_7)
filter_11 = StreamFilter(Gate=draw_roof_bool_2, Stream1=filter_4)
roof_boards_breps = Brep(filter_11)
roof_breps_choosed = Brep(filter_9)
roof_planes_choosed = Plane(filter_10)

# ----
# OUTER WALLS Openings
# Geometry
# inputs
# Data
# inputs
walls_top_cutting_surface_2 = Brep(walls_top_cutting_surface)
walls_longest_line_middle_2 = Line(walls_longest_line_middle)
wall_openings_contour_2 = Curve(wall_openings_contour)
wall_openings_data_2 = Text(wall_openings_data)
db_openings_gh = DBOpeningsGh(
    WallsMiddleLine=walls_longest_line_middle_2,
    OpeningsContour=wall_openings_contour_2,
    WallsTopCuttingSurface=walls_top_cutting_surface_2,
    OpeningsData=wall_openings_data_2,
    SortOpenings_bool=Toggle(True))  # -> WallOpeningsContour_sorted, WallDivideByOpenings_pts, WallOpenings_crvs, WallOpenings_breps
wall_divide_by_openings_pts = Point(db_openings_gh.WallDivideByOpenings_pts)
wall_openings_contour_sorted = Curve(db_openings_gh.WallOpeningsContour_sorted)
wall_openings_crvs = Curve(db_openings_gh.WallOpenings_crvs)
wall_openings_breps = Brep(db_openings_gh.WallOpenings_breps)

# ----
# PARTITIONS Openings
partitions_longest_line_middle_2 = Line(partitions_longest_line_middle)
partition_openings_contour_2 = Curve(partition_openings_contour)
walls_top_cutting_surface_3 = Brep(walls_top_cutting_surface)
partition_openings_data_2 = Text(partition_openings_data)
db_openings_gh_2 = DBOpeningsGh(
    WallsMiddleLine=partitions_longest_line_middle_2,
    OpeningsContour=partition_openings_contour_2,
    WallsTopCuttingSurface=walls_top_cutting_surface_3,
    OpeningsData=partition_openings_data_2,
    SortOpenings_bool=Toggle(True))  # -> WallOpeningsContour_sorted, WallDivideByOpenings_pts, WallOpenings_crvs, WallOpenings_breps
partition_openings_contour_sorted = Curve(db_openings_gh_2.WallOpeningsContour_sorted)
partition_divide_by_openings_pts = Point(db_openings_gh_2.WallDivideByOpenings_pts)
partition_openings_crvs = Curve(db_openings_gh_2.WallOpenings_crvs)
partition_openings_breps = Brep(db_openings_gh_2.WallOpenings_breps)

# ----
# Roof Text Marks
project_part_number_4 = Integer(project_part_number_2)
roof_breps_choosed_2 = Brep(roof_breps_choosed)
project_name_4 = Text(project_name_2)
clean = CleanTree(RemoveNulls=True, RemoveInvalid=True, RemoveEmpty=True, Tree=roof_breps_choosed_2)
db_marks_gh_2 = DBMarksGh(Project_name=project_name_4, PanelClass_name="R", ProjectPart_number=project_part_number_4, GeometryStuctured=clean)
roof_marks_txt = Text(db_marks_gh_2)

# ----
# Choose Beams
floor_beams_sub_breps_2 = Brep(flatten(floor_beams_sub_breps))
roof_beam_sub_brep_2 = Brep(flatten(roof_beam_sub_brep))
floor_beams_planes_2 = Plane(flatten(floor_beams_planes))
floor_beams_breps_2 = Brep(flatten(floor_beams_breps))
roof_beam_plane_2 = Plane(flatten(roof_beam_plane))
roof_beam_brep_2 = Brep(flatten(roof_beam_brep))
merge_2 = Merge(Data1=floor_beams_breps_2, Data2=roof_beam_brep_2)
merge_3 = Merge(Data1=floor_beams_sub_breps_2, Data2=roof_beam_sub_brep_2)
merge_4 = Merge(Data1=floor_beams_planes_2, Data2=roof_beam_plane_2)
beams_sub_breps = Brep(graft(merge_3))
beams_planes = Plane(graft(merge_4))
beams_breps = Brep(graft(merge_2))

# ----
# OUTER WALLS Breps
# Geometry
# inputs
# Data
# inputs
walls_thickness_sorted_2 = Integer(walls_thickness_sorted)
walls_div_by_width_bool_2 = Boolean(walls_div_by_width_bool)
walls_div_direction_bools_2 = Boolean(walls_div_direction_bools)
walls_div_clt_width_3 = Number(walls_div_clt_width_2)
walls_div_clt_width_lowest_3 = Number(walls_div_clt_width_lowest_2)
consider_floor_thickness_bool_4 = Boolean(consider_floor_thickness_bool)
walls_div_quarter_size_3 = Integer(walls_div_quarter_size_2)
walls_div_quarter_gap_3 = Number(walls_div_quarter_gap_2)
floor_thickness_5 = Number(floor_thickness_2)
walls_extend_down_bool_2 = Boolean(walls_extend_down_bool)
walls_extend_down_dist_3 = Number(walls_extend_down_dist_2)
walls_div_openings_type_2_bools_2 = Boolean(walls_div_openings_type_2_bools)
walls_div_type_3 = Boolean(walls_div_type_2)
walls_div_connector_flip_side_bools_2 = Boolean(walls_div_connector_flip_side_bools)
walls_div_quarter_correspond_thick_bool_2 = Boolean(walls_div_quarter_correspond_thick_bool)
walls_div_quarter_choose_dir_bools_2 = Boolean(walls_div_quarter_choose_dir_bools)
walls_clt_thickness_5 = Number(walls_clt_thickness_3)
walls_top_beam_bools_2 = Boolean(walls_top_beam_bools)
walls_div_openings_type_1_bools_2 = Boolean(walls_div_openings_type_1_bools)
walls_div_openings_type_2_support_width_3 = Integer(walls_div_openings_type_2_support_width_2)
walls_div_openings_type_3_flip_bools_2 = Boolean(walls_div_openings_type_3_flip_bools)
walls_top_beam_height_3 = Number(walls_top_beam_height_2)
walls_div_openings_type_3_support_width_3 = Integer(walls_div_openings_type_3_support_width_2)
walls_div_openings_type_3_support_radius_3 = Integer(walls_div_openings_type_3_support_radius_2)
walls_div_openings_type_3_bools_2 = Boolean(walls_div_openings_type_3_bools)
walls_top_height_3 = Number(walls_top_height_2)
walls_longest_line_middle_3 = Line(walls_longest_line_middle)
wall_openings_contour_sorted_2 = Curve(wall_openings_contour_sorted)
wall_divide_by_openings_pts_2 = Point(wall_divide_by_openings_pts)
walls_top_cutting_body_2 = Brep(walls_top_cutting_body)
wall_openings_breps_2 = Brep(wall_openings_breps)
plan_contour_inner_5 = Curve(plan_contour_inner)
walls_plane_middle_2 = Plane(walls_plane_middle)
wall_openings_crvs_2 = Curve(wall_openings_crvs)
walls_divider_line_2 = Curve(walls_divider_line)
beams_sub_breps_2 = Brep(beams_sub_breps)
connector_rec_5 = Rectangle(connector_rec)
walls_contour_3 = Curve(walls_contour)
db_walls_brep_gh = DBWallsBrepGh(
    WallsContour=walls_contour_3,
    WallsLongestLineMiddle=walls_longest_line_middle_3,
    WallsPlaneMiddle=walls_plane_middle_2,
    WallOpenings_breps=wall_openings_breps_2,
    WallOpenings_crvs=wall_openings_crvs_2,
    WallOpeningsContour_sorted=wall_openings_contour_sorted_2,
    WallDivideByOpenings_pts=wall_divide_by_openings_pts_2,
    WallsDividerLine=walls_divider_line_2,
    Connector_Rec=connector_rec_5,
    PlanContour_inner=plan_contour_inner_5,
    WallsTopCuttingBody=walls_top_cutting_body_2,
    Beams_SubBreps=beams_sub_breps_2,
    WallsThicknessSorted=walls_thickness_sorted_2,
    WallsDivByWidth_bool=walls_div_by_width_bool_2,
    WallsDivDirection_bools=walls_div_direction_bools_2,
    WallsDivCltWidth=walls_div_clt_width_3,
    WallsDivCltWidthLowest=walls_div_clt_width_lowest_3,
    WallsDivType=walls_div_type_3,
    WallsDivConnectorFlipSide_bools=walls_div_connector_flip_side_bools_2,
    WallsDivQuarterSize=walls_div_quarter_size_3,
    WallsDivQuarterCorrespondThick_bool=walls_div_quarter_correspond_thick_bool_2,
    WallsDivQuarterGap=walls_div_quarter_gap_3,
    WallsDivQuarterChooseDir_bools=walls_div_quarter_choose_dir_bools_2,
    ConsiderFloorThickness_bool=consider_floor_thickness_bool_4,
    FloorThickness=floor_thickness_5,
    WallsExtendDown_bool=walls_extend_down_bool_2,
    WallsExtendDownDist=walls_extend_down_dist_3,
    WallsCltThicknessForWallExtension=walls_clt_thickness_5,
    WallsTopBeam_bools=walls_top_beam_bools_2,
    WallsTopBeamHeight=walls_top_beam_height_3,
    WallsDivOpeningsType1_bools=walls_div_openings_type_1_bools_2,
    WallsDivOpeningsType2_bools=walls_div_openings_type_2_bools_2,
    WallsDivOpeningsType2SupportWidth=walls_div_openings_type_2_support_width_3,
    WallsDivOpeningsType3_bools=walls_div_openings_type_3_bools_2,
    WallsDivOpeningsType3SupportWidth=walls_div_openings_type_3_support_width_3,
    WallsDivOpeningsType3SupportRadius=walls_div_openings_type_3_support_radius_3,
    WallsDivOpeningsType3Flip_bools=walls_div_openings_type_3_flip_bools_2,
    WallsTopHeight=walls_top_height_3)  # -> WallPanels_Plns, WallPanels_Breps
wall_panels_plns = Plane(db_walls_brep_gh.WallPanels_Plns)
wall_panels_breps = Brep(db_walls_brep_gh.WallPanels_Breps)

# ----
# PARTITIONS Breps
# Geometry
# inputs
# Data
# inputs
partition_openings_contour_sorted_2 = Curve(partition_openings_contour_sorted)
partitions_longest_line_middle_3 = Line(partitions_longest_line_middle)
partition_divide_by_openings_pts_2 = Point(partition_divide_by_openings_pts)
partitions_div_openings_type_3_bools_2 = Boolean(partitions_div_openings_type_3_bools)
partitions_div_openings_type_3_support_w_3 = Integer(partitions_div_openings_type_3_support_w_2)  # "Partitions div openings type 3 support width"
partitions_div_openings_type_3_flip_bool_2 = Boolean(partitions_div_openings_type_3_flip_bool)  # "Partitions div openings type 3 flip_bools"
partitions_div_openings_type_1_bools_2 = Boolean(partitions_div_openings_type_1_bools)
partitions_div_openings_type_2_bools_2 = Boolean(partitions_div_openings_type_2_bools)
partitions_div_openings_type_2_support_w_3 = Integer(partitions_div_openings_type_2_support_w_2)  # "Partitions div openings type 2 support width"
partitions_div_openings_type_3_support_r_3 = Integer(partitions_div_openings_type_3_support_r_2)  # "Partitions div openings type 3 support radius"
partitions_top_beam_bools_2 = Boolean(partitions_top_beam_bools)
partitions_top_beam_height_3 = Number(partitions_top_beam_height_2)
partition_openings_breps_2 = Brep(partition_openings_breps)
partitions_top_height_3 = Number(partitions_top_height_2)
partitions_div_clt_width_3 = Number(partitions_div_clt_width_2)
partitions_div_clt_width_lowest_3 = Number(partitions_div_clt_width_lowest_2)
partitions_plane_middle_2 = Plane(partitions_plane_middle)
partitions_div_direction_bools_2 = Boolean(partitions_div_direction_bools)
partitions_div_by_width_bool_2 = Boolean(partitions_div_by_width_bool)
partitions_div_quarter_size_3 = Integer(partitions_div_quarter_size_2)
partitions_div_quarter_correspond_thick_3 = Boolean(partitions_div_quarter_correspond_thick_2)  # "Partitions div quarter correspond thick_bool"
partitions_thickness_sorted_2 = Integer(partitions_thickness_sorted)
partitions_div_type_3 = Boolean(partitions_div_type_2)
partitions_div_connector_flip_side_bools_2 = Boolean(partitions_div_connector_flip_side_bools)
consider_floor_thickness_bool_5 = Boolean(consider_floor_thickness_bool)
partitions_div_quarter_gap_3 = Number(partitions_div_quarter_gap_2)
partitions_div_quarter_choose_dir_bools_2 = Boolean(partitions_div_quarter_choose_dir_bools)
floor_thickness_6 = Number(floor_thickness_2)
partition_openings_crvs_2 = Curve(partition_openings_crvs)
walls_top_cutting_body_3 = Brep(walls_top_cutting_body)
partitions_contour_3 = Curve(partitions_contour)
partitions_divider_line_2 = Curve(partitions_divider_line)
plan_contour_inner_6 = Curve(plan_contour_inner)
beams_sub_breps_3 = Brep(beams_sub_breps)
connector_rec_6 = Rectangle(connector_rec)
loft_sub_breps_2 = Brep(loft_sub_breps)
db_walls_brep_gh_2 = DBWallsBrepGh(
    WallsContour=partitions_contour_3,
    WallsLongestLineMiddle=partitions_longest_line_middle_3,
    WallsPlaneMiddle=partitions_plane_middle_2,
    WallOpenings_breps=partition_openings_breps_2,
    WallOpenings_crvs=partition_openings_crvs_2,
    WallOpeningsContour_sorted=partition_openings_contour_sorted_2,
    WallDivideByOpenings_pts=partition_divide_by_openings_pts_2,
    WallsDividerLine=partitions_divider_line_2,
    Connector_Rec=connector_rec_6,
    PlanContour_inner=plan_contour_inner_6,
    WallsTopCuttingBody=walls_top_cutting_body_3,
    Beams_SubBreps=beams_sub_breps_3,
    Loft_SubBreps=loft_sub_breps_2,
    WallsThicknessSorted=partitions_thickness_sorted_2,
    WallsDivByWidth_bool=partitions_div_by_width_bool_2,
    WallsDivDirection_bools=partitions_div_direction_bools_2,
    WallsDivCltWidth=partitions_div_clt_width_3,
    WallsDivCltWidthLowest=partitions_div_clt_width_lowest_3,
    WallsDivType=partitions_div_type_3,
    WallsDivConnectorFlipSide_bools=partitions_div_connector_flip_side_bools_2,
    WallsDivQuarterSize=partitions_div_quarter_size_3,
    WallsDivQuarterCorrespondThick_bool=partitions_div_quarter_correspond_thick_3,
    WallsDivQuarterGap=partitions_div_quarter_gap_3,
    WallsDivQuarterChooseDir_bools=partitions_div_quarter_choose_dir_bools_2,
    ConsiderFloorThickness_bool=consider_floor_thickness_bool_5,
    FloorThickness=floor_thickness_6,
    WallsExtendDown_bool=Toggle(False),
    WallsTopBeam_bools=partitions_top_beam_bools_2,
    WallsTopBeamHeight=partitions_top_beam_height_3,
    WallsDivOpeningsType1_bools=partitions_div_openings_type_1_bools_2,
    WallsDivOpeningsType2_bools=partitions_div_openings_type_2_bools_2,
    WallsDivOpeningsType2SupportWidth=partitions_div_openings_type_2_support_w_3,
    WallsDivOpeningsType3_bools=partitions_div_openings_type_3_bools_2,
    WallsDivOpeningsType3SupportWidth=partitions_div_openings_type_3_support_w_3,
    WallsDivOpeningsType3SupportRadius=partitions_div_openings_type_3_support_r_3,
    WallsDivOpeningsType3Flip_bools=partitions_div_openings_type_3_flip_bool_2,
    WallsTopHeight=partitions_top_height_3)  # -> WallPanels_Plns, WallPanels_Breps
partition_panels_breps = Brep(db_walls_brep_gh_2.WallPanels_Breps)
partition_panels_plns = Plane(db_walls_brep_gh_2.WallPanels_Plns)

# ----
# Walls Text Marks
project_part_number_5 = Integer(project_part_number_2)
wall_panels_breps_2 = Brep(wall_panels_breps)
project_name_5 = Text(project_name_2)
db_marks_gh_3 = DBMarksGh(
    Project_name=project_name_5,
    PanelClass_name="W",
    ProjectPart_number=project_part_number_5,
    GeometryStuctured=wall_panels_breps_2)
wall_marks_txt = Text(db_marks_gh_3)

# ----
# Partition Text Marks
partition_panels_breps_2 = Brep(partition_panels_breps)
project_part_number_6 = Integer(project_part_number_2)
project_name_6 = Text(project_name_2)
db_marks_gh_4 = DBMarksGh(
    Project_name=project_name_6,
    PanelClass_name="P",
    ProjectPart_number=project_part_number_6,
    GeometryStuctured=partition_panels_breps_2)
partition_marks_txt = Text(db_marks_gh_4)

# ----
# Beams Text Marks
project_part_number_7 = Integer(project_part_number_2)
project_name_7 = Text(project_name_2)
beams_breps_2 = Brep(beams_breps)
db_marks_gh_5 = DBMarksGh(
    Project_name=project_name_7,
    PanelClass_name="BR",
    ProjectPart_number=project_part_number_7,
    GeometryStuctured=beams_breps_2)
beams_marks_txt = Text(db_marks_gh_5)

partition_panels_breps_3 = Brep(partition_panels_breps)
roof_breps_choosed_3 = Brep(roof_breps_choosed)
wall_panels_breps_3 = Brep(wall_panels_breps)
beams_breps_3 = Brep(beams_breps)
loft_breps_3 = Brep(loft_breps)

# ----
# ALL Breps
roof_l_connector_breps_2 = Brep(roof_l_connector_breps)
roof_boards_breps_2 = Brep(roof_boards_breps)
merge_5 = Merge(Data1=flatten(roof_boards_breps_2), Data2=flatten(roof_l_connector_breps_2))
merge_6 = Merge(
    Data1=flatten(wall_panels_breps_3),
    Data2=flatten(roof_breps_choosed_3),
    Data3=flatten(partition_panels_breps_3),
    Data4=flatten(beams_breps_3),
    Data5=flatten(loft_breps_3))
all_aux_breps = Brep(merge_5)
all_clt_breps = Brep(merge_6)

# ----
# ALL Planes
roof_planes_choosed_2 = Plane(roof_planes_choosed)
partition_panels_plns_2 = Plane(partition_panels_plns)
wall_panels_plns_2 = Plane(wall_panels_plns)
beams_planes_2 = Plane(beams_planes)
loft_planes_2 = Plane(loft_planes)
merge_7 = Merge(
    Data1=flatten(wall_panels_plns_2),
    Data2=flatten(roof_planes_choosed_2),
    Data3=flatten(partition_panels_plns_2),
    Data4=flatten(beams_planes_2),
    Data5=flatten(loft_planes_2))
all_breps_center_plns = Plane(merge_7)

# ----
# Plane Markers
int = Integer(200)
int_2 = Integer(100)
all_breps_center_plns_2 = Plane(all_breps_center_plns)
pt = ConstructPoint(XCoordinate=0, YCoordinate=0, ZCoordinate=0)
pt_2 = ConstructPoint(XCoordinate=int_2, YCoordinate=0, ZCoordinate=0)
pt_3 = ConstructPoint(XCoordinate=0, YCoordinate=int, ZCoordinate=0)
merge_8 = Merge(Data1=pt_2, Data2=pt, Data3=pt_3)
pline = PolyLine(Vertices=merge_8, Closed=False)
orient = Orient(Geometry=pline, Source=PlaneXY(0, 0, 0), Target=all_breps_center_plns_2)  # -> Geometry, Transform
plane_markers = Curve(orient.Geometry)

partition_marks_txt_2 = Text(partition_marks_txt)
beams_marks_txt_2 = Text(beams_marks_txt)
loft_marks_txt_2 = Text(loft_marks_txt)
roof_marks_txt_2 = Text(roof_marks_txt)
# ALL Marks
wall_marks_txt_2 = Text(wall_marks_txt)

merge_9 = Merge(
    Data1=flatten(wall_marks_txt_2),
    Data2=flatten(roof_marks_txt_2),
    Data3=flatten(partition_marks_txt_2),
    Data4=flatten(beams_marks_txt_2),
    Data5=flatten(loft_marks_txt_2))
all_text_marks = Text(merge_9)

# ---- group: Show partition numbers
partitions_longest_line_middle_4 = Line(flatten(partitions_longest_line_middle))
show_text_marks_3 = Boolean(show_text_marks_2)
filter_12 = StreamFilter(Gate=show_text_marks_3, Stream1=partitions_longest_line_middle_4)
line = Line(filter_12)
lng = ListLength(List=line)
domain = Domain(Domain(600, 1500))
random = Random(Range=domain, Number=lng, Seed=Slider(7, range=0..10))
neg = Negative(Value=random)
Z_4 = UnitZ(Factor=neg)
curvepoint = PointOnCurve(line, parameter=0.5)
series = Series(Start=1, Step=1, Count=lng)
move_3 = Move(Geometry=line, Motion=Z_4)  # -> Geometry, Transform
long = LongestList(ListA="partition_", ListB=series, PaddingMode=2)  # -> ListA, ListB
crv_cp = CurveClosestPoint(Point=curvepoint, Curve=move_3.Geometry)  # -> Point, Parameter, Distance
concat = Concatenate(FragmentA=long.ListA, FragmentB=long.ListB)
ln = Line(StartPoint=curvepoint, EndPoint=crv_cp.Point)
tag = TextTag(Location=crv_cp.Point, Text=concat, Colour=swatch)

# ---- group: Show wall corners numbers
offset_2 = Panel("300")
plan_contour_outer_4 = Curve(plan_contour_outer)
show_text_marks_4 = Boolean(show_text_marks_2)
filter_13 = StreamFilter(Gate=show_text_marks_4, Stream1=plan_contour_outer_4)
neg_2 = Negative(Value=offset_2)
offset_3 = Offset(Curve=filter_13, Distance=neg_2, Plane=PlaneXY(0, 0, 0), Corners=1)
explode = Explode(Curve=offset_3, Recursive=True)  # -> Segments, Vertices
end = EndPoints(Curve=explode.Segments)  # -> Start, End
lng_2 = ListLength(List=end.Start)
series_2 = Series(Start=1, Step=1, Count=lng_2)
tag_2 = TextTag(Location=end.Start, Text=series_2)

# ---- group: Show panel tags
all_breps_center_plns_3 = Plane(all_breps_center_plns)
show_panel_tags_3 = Boolean(show_panel_tags_2)
all_text_marks_2 = Text(all_text_marks)
tag_size = Panel("100")
filter_14 = StreamFilter(Gate=show_panel_tags_3, Stream1=all_breps_center_plns_3)
tag_3 = TextTag3D(Location=filter_14, Text=all_text_marks_2, Size=tag_size, Justification=5)

# ---- group: Show colourful geometry
all_clt_breps_2 = Brep(flatten(all_clt_breps))
all_aux_breps_2 = Brep(all_aux_breps)
dom = ConstructDomain(DomainStart=0, DomainEnd=254)
lng_3 = ListLength(List=all_clt_breps_2)
random_2 = Random(Range=dom, Number=lng_3, Seed=4)  # -> graft(Random)
random_3 = Random(Range=dom, Number=lng_3, Seed=3)  # -> graft(Random)
random_4 = Random(Range=dom, Number=lng_3, Seed=2)  # -> graft(Random)
wires = BrepWireframe(Brep=all_clt_breps_2, Density=-1)  # -> flatten(Wireframe)
rgb = ColourRGB(Alpha=255, Red=random_4, Green=random_3, Blue=random_2)
preview = CustomPreview(Geometry=graft(all_clt_breps_2), Material=rgb)
preview_2 = CustomPreview(Geometry=wires, Material=ColourSwatch(SwatchColor=RGB(0, 0, 0)))
preview_3 = CustomPreview(Geometry=all_aux_breps_2, Material=ColourSwatch(SwatchColor=RGB(99, 79, 32)))

# ---- group: Show partition openings tags
partitions_longest_line_middle_5 = Line(flatten(partitions_longest_line_middle))
partition_openings_contour_sorted_3 = Curve(partition_openings_contour_sorted)
show_text_marks_5 = Boolean(show_text_marks_2)
filter_15 = StreamFilter(Gate=show_text_marks_5, Stream1=partitions_longest_line_middle_5)
pcen = PolygonCenter(Polyline=partition_openings_contour_sorted_3)  # -> graft(CenterV), CenterE, CenterA
crv_cp_2 = CurveClosestPoint(Point=pcen.CenterV, Curve=filter_15)  # -> Point, Parameter, Distance
sort = SortList(Keys=crv_cp_2.Distance, ValuesA=filter_15, ValuesB=crv_cp_2.Parameter)  # -> Keys, ValuesA, ValuesB
item = ListItem(List=sort.ValuesB, Index=0, Wrap=True)  # -> flatten(Item)
item_2 = ListItem(List=sort.ValuesA, Index=0, Wrap=True)  # -> flatten(Item)
eval = EvaluateCurve(Curve=item_2, Parameter=item)  # -> Point, Tangent, Angle
Z_5 = UnitZ(Factor=1)
lng_4 = ListLength(List=eval.Point)
domain_2 = Domain(Domain(350, 650))
vrot = Rotate(Vector=eval.Tangent, Axis=Z_5, Angle=degrees(90))
random_5 = Random(Range=domain_2, Number=lng_4, Seed=Slider(3, range=0..10))
series_3 = Series(Start=1, Step=1, Count=lng_4)
line_2 = LineSDL(Start=eval.Point, Direction=vrot, Length=random_5)
end_2 = EndPoints(Curve=line_2)  # -> Start, End
long_2 = LongestList(ListA="p-open_", ListB=series_3, PaddingMode=2)  # -> ListA, ListB
concat_2 = Concatenate(FragmentA=long_2.ListA, FragmentB=long_2.ListB)
tag_4 = TextTag(Location=end_2.End, Text=concat_2)

# ----
# Check
all_clt_breps_3 = Brep(flatten(all_clt_breps))
all_text_marks_3 = Text(flatten(all_text_marks))
plane_markers_2 = Curve(flatten(plane_markers))
lng_5 = ListLength(List=plane_markers_2)
lng_6 = ListLength(List=all_text_marks_3)
lng_7 = ListLength(List=all_clt_breps_3)
planes_count = Panel(lng_5)
breps_count = Panel(lng_7)
marks_count = Panel(lng_6)

# ---- group: Show wall numbers
plan_contour_outer_5 = Curve(plan_contour_outer)
show_text_marks_6 = Boolean(show_text_marks_2)
explode_2 = Explode(Curve=plan_contour_outer_5, Recursive=True)  # -> Segments, Vertices
offset_4 = Panel("1000")
filter_16 = StreamFilter(Gate=show_text_marks_6, Stream1=explode_2.Segments)
line_3 = Line(filter_16)
neg_3 = Negative(Value=offset_4)
lng_8 = ListLength(List=line_3)
curvepoint_2 = PointOnCurve(line_3, parameter=0.5)
offset_5 = OffsetCurve(Curve=line_3, Distance=neg_3, Plane=PlaneXY(0, 0, 0), Corners=1)
series_4 = Series(Start=1, Step=1, Count=lng_8)
pshift = ShiftPaths(Data=offset_5, Offset=-1)
long_3 = LongestList(ListA="wall_", ListB=series_4, PaddingMode=2)  # -> ListA, ListB
crv_cp_3 = CurveClosestPoint(Point=curvepoint_2, Curve=pshift)  # -> Point, Parameter, Distance
concat_3 = Concatenate(FragmentA=long_3.ListA, FragmentB=long_3.ListB)
ln_2 = Line(StartPoint=curvepoint_2, EndPoint=crv_cp_3.Point)
tag_5 = TextTag(Location=crv_cp_3.Point, Text=concat_3, Colour=swatch)

# ---- group: Show wall openings tags
wall_openings_contour_sorted_3 = Curve(wall_openings_contour_sorted)
plan_contour_outer_6 = Curve(plan_contour_outer)
show_text_marks_7 = Boolean(show_text_marks_2)
filter_17 = StreamFilter(Gate=show_text_marks_7, Stream1=plan_contour_outer_6)
pcen_2 = PolygonCenter(Polyline=wall_openings_contour_sorted_3)  # -> CenterV, CenterE, CenterA
crv_cp_4 = CurveClosestPoint(Point=pcen_2.CenterV, Curve=filter_17)  # -> Point, Parameter, Distance
eval_2 = EvaluateCurve(Curve=filter_17, Parameter=crv_cp_4.Parameter)  # -> Point, Tangent, Angle
Z_6 = UnitZ(Factor=1)
vrot_2 = Rotate(Vector=eval_2.Tangent, Axis=Z_6, Angle=degrees(90))
lng_9 = ListLength(List=eval_2.Point)
domain_3 = Domain(Domain(350, 650))
random_6 = Random(Range=domain_3, Number=lng_9, Seed=2)
series_5 = Series(Start=1, Step=1, Count=lng_9)
line_4 = LineSDL(Start=eval_2.Point, Direction=vrot_2, Length=random_6)
end_3 = EndPoints(Curve=line_4)  # -> Start, End
long_4 = LongestList(ListA="open_", ListB=series_5, PaddingMode=2)  # -> ListA, ListB
concat_4 = Concatenate(FragmentA=long_4.ListA, FragmentB=long_4.ListB)
tag_6 = TextTag(Location=end_3.End, Text=concat_4, Colour=swatch)

# ----
# Bake
all_aux_breps_3 = Brep(all_aux_breps)
all_clt_breps_4 = Brep(all_clt_breps)
plane_markers_3 = Curve(plane_markers)
all_text_marks_4 = Text(all_text_marks)
