# Grasshopper definition ReadcsvANDExportPolygonsForMSD.gh (Grasshopper 1.0.8)
# plug-ins: RhinoCodePluginGH, Pufferfish, EleFront, LunchBox

# ---- group: sample data
# Number of unique site IDs: 1130
# Number of unique building IDs: 2550
# Number of unique floor IDs: 5372
# Number of unique apartment IDs: 18269
# Number of unique unit IDs: 18902
panel = Panel("""ID1
ID2
ApartmentID
SiteID
BuildingID
PlanID
FloorID
UnitID
AreaID
UnitUsage
EntityType
EntitySubtype
geom
Elevation
Height
Zoning""")
panel_2 = Panel("""0
0
3c3b1d6ca8b4b9092480b8c75f9eaa81
1
100
1054
1588
7300
619311
RESIDENTIAL
area
BATHROOM
POLYGON ((33.69 11.16,33.69 14.16 , 36.4 14.16, 36.4 11.16, 33.69 11.16))
0
3
Zone3""")

# ----
panel_3 = Panel("""Zimmer 1
Zimmer 2
Dusche
Vorzone
WC
Wohnen|Essen|Kochen
Reduit""")
curve = Curve([<curve referenced from the Rhino model> x7])

geom = Panel("POLYGON ((33.69 11.16,33.69 14.16 , 36.4 14.16, 36.4 11.16, 33.69 11.16))")

reference_design = ValueList({"reference design 01": 0, "reference design 02": 1, "reference design 03": 2}, selected="reference design 01")
path = FilePath("C:\Users\panz\Documents\GitHub\2025-AEC-Hackathon\json\ReferenceDesign_01\Reference01.json")
path_2 = FilePath("C:\Users\panz\Documents\GitHub\IBC\05_Floorplan_processing\jsonExports\ReferenceDesign_02\ReferenceDesign_02_EP_bom.json")
filter = StreamFilter(Gate=reference_design, Stream0=path, Stream1=path_2)
python = GhPythonScript(file=filter)  # -> out, apartmentNames, roomTypes, roomPolylines, roomSurfaces, roomColors, adjacencies
# ---------- python: Python ----------
__author__ = "panz"
__version__ = "2024.11.11"

import rhinoscriptsyntax as rs
import json
import json
import Rhino.Geometry as rg

# Read and parse JSON data from the file
with open(file, 'r') as inputfile:
    data = json.load(inputfile)

# Extract panels (walls) data
panels_data = data.get("panels", {}).get("items", {})
if not panels_data:
    print("Warning: 'panels.items' key is missing or empty in JSON.")
    
    


# Extract apartment outlines from 'spaces'
spaces_data = data.get("spaces", {})
roomOutlines = []
roomPolylines =[]
apartmentNames = []
roomTypes = []
roomColors = []
roomSurfaces = []

for space_id, space in spaces_data.items():
    coordinates = space.get("coordinates")
    roomTypes.append(space.get("room_type"))
    apartmentNames.append(space.get("apartment"))
    outline_points = [[point["x"], point["y"], point["z"]] for point in coordinates]
    roomOutlines.append(outline_points)
print (len(roomOutlines))


roomType = "bathroom"

#get adjacencies
adjacencies =[]
#adjacency_data =data.get("room_adjacency").get(roomType)
adjacency_data =data.get("room_adjacency")
adjacencies = adjacency_data
print (adjacency_data) 



roomCounter = 0 
for index in range (0, len(spaces_data)):
    roomOutline = roomOutlines[index] 
    
    # Convert the point lists into Rhino Point3d objects
    polyline_points = [rg.Point3d(point[0], point[1], point[2]) for point in roomOutline]
    # Create the polyline using the list of Point3d objects
    polyline = rg.Polyline(polyline_points)
    
    
    #assign colors based on roomput
    if (roomTypes[index] == "living_room"):
        roomColors.append('255,100,0')
    elif (roomTypes[index] == "bedroom"):
        roomColors.append('153,137,255')
    elif (roomTypes[index] == "kitchen"):
        roomColors.append('0,0,220')
    elif (roomTypes[index] == "bathroom"):
        roomColors.append('151,255,255')
    elif (roomTypes[index] == "core"):
        roomColors.append('150,150,150')
        
    # create a surface
    roomSrfs = rg.Brep.CreatePlanarBreps(polyline.ToNurbsCurve())
    roomSurfaces.append(roomSrfs[0])
    # Ensure the polyline is closed if necessary (optional)
    if not polyline.IsClosed:
        polyline.Add(polyline[0])  # Add the first point to close the polyline
    # Output the polyline (e.g., to Grasshopper)
    roomPolylines.append(polyline)
    roomCounter +=1 
    #print ("created", roomCounter, "space polylines")
    #print(roomSurfaces)
# ---------- end python ----------

show_room_labels = BooleanToggle(True)
room_labler_color = ColourSwatch(SwatchColor=RGB(87, 87, 87))
room_label_height = Slider(1530, range=0..1530)
room_label_size = Slider(191, range=0..250)

# ----
# 0. Import/Read
# MSD structured data
read_data_from_xls = BooleanToggle(True)
file_path_to_xls = FilePath("C:\Users\panz\Documents\GitHub\IBC\05_Floorplan_processing\Gh_parsing\IBC_MSD.xlsx")

# ----
# TO DO : EXPORT POLYGON FROM OPENINGS
# AND STRUCTURE DATA  LIKE MSD
# AND SAVE
file_path = FilePath("C:\Users\panz\Desktop\IBC_MSD - Copy.xlsx")

# ---- group: characerize spaces
explode = Explode(Curve=curve, Recursive=True)  # -> Segments, Vertices
deconstruct = Deconstruct(Point=explode.Vertices)  # -> XComponent, YComponent, ZComponent
panel_4 = Panel(" ")
panel_5 = Panel(panel_3)
concatenate = Concatenate(Fragment_A=deconstruct.XComponent, Fragment_B=panel_4, A=deconstruct.YComponent)
python_3_script = Python3Script(coords=concatenate)  # -> out, output; inputs coords: list
# ---------- python_3_script: Python ----------
"""Grasshopper Script"""
a = "Hello Python 3 in Grasshopper!"
coords = [
    (40.65, 15.65),
    (44.04, 15.65),
    (44.04, 11.16),
    (40.65, 11.16),
    (40.65, 15.65)
]

# Format as WKT Polygon
wkt_polygon = "POLYGON((" + ", ".join(f"{x} {y}" for x, y in coords) + "))"
output = wkt_polygon
print(output)
# ---------- end python_3_script ----------
panel_6 = Panel(python_3_script.output)

# ----
panel_7 = Panel(path_2)

# ----
# Zoning :
# 
# "zone1":refers to a
# private space,
# 
# "zone2": to a public space,
# "zone3": to a service space
# "zone4":
# to an outside place
zoning = Panel("""Zone1
Zone1
Zone3
Zone2
Zone3
Zone2
Zone1""")

list_length = ListLength(List=curve)

user = GhPythonScript()  # -> user
# ---------- user: Python ----------
__author__ = "tommy.reslinski"
__version__ = "2020.10.27"

import rhinoscriptsyntax as rs
from os.path import expanduser

home = expanduser("~")
user = home[9:]
# ---------- end user ----------
relpath = RelPath(path=file_path_to_xls, user=user)
panel_8 = Panel(relpath)

sheetnames = Panel("""IBCXMSD
MSD""")
# TO DO : READ FILE EXERT FROM MSD AND COMPARE
select_sheet = ValueList({"IBCXMSD": 0, "MSD": 1}, selected="IBCXMSD")

panel_9 = Panel("""reference design 01
reference design 02
reference design 03""")
list_item = ListItem(List=panel_9, Index=reference_design, Wrap=True)

floorid = Panel("1588")
planid = Panel("1054")
building_id = Panel("2551")

# ---- group: walls
concatenate_2 = Concatenate(Fragment_A=deconstruct.XComponent, Fragment_B=panel_4, A=deconstruct.YComponent)
python_3_script_2 = Python3Script(coords=concatenate_2)  # -> out, output; inputs coords: list; same code as python_3_script
panel_10 = Panel(python_3_script_2.output)

# ----
areaid = Panel("619311")
unitid = Panel("7300")
unitusage = Panel("RESIDENTIAL")

# ----
# entityType can be: area, separator(Wall), opening (Door, window)
entitytype = Panel("area")

elevation = Panel("0")
height = Panel("0")
entitysubtype = Panel("BATHROOM")

# ---- group: move and scale
crv = Curve(python.roomPolylines)
bounding_rectangle = BoundingRectangle(Geometry=crv, Plane=PlaneXY(0, 0, 0), Axis=0, Slide=0, Union=True)  # -> Bounding, DimensionX, DimensionY
area = Area(Geometry=bounding_rectangle.Bounding)  # -> Area, Centroid
scale = Scale(Geometry=crv, Center=area.Centroid, Factor="1000")  # -> Geometry, Transform
scale_2 = Scale(Geometry=python.roomSurfaces, Center=area.Centroid, Factor="1000")  # -> Geometry, Transform
point = Point("0,0,0")
move_to_point = MoveToPoint(Geometry=scale.Geometry, PointA=area.Centroid, PointB=point)  # -> Moved, Vector, Transform
move_to_point_2 = MoveToPoint(Geometry=scale_2.Geometry, PointA=area.Centroid, PointB=point)  # -> Moved, Vector, Transform

# ----
series = Series(Start=1, Step=1, Count=list_length)
panel_11 = Panel(concatenate)
file_path_2 = FilePath("C:\Users\panz\Documents\GitHub\IBC\05_Floorplan_processing\Gh_parsing\dwgToMSD_Test.csv")
save_csv = BooleanToggle(True)
panel_12 = Panel("""Unnamed: 0.1	
Unnamed: 0	
apartment_id	
site_id	building_id	
plan_id	floor_id	
unit_id	area_id	
unit_usage	
entity_type	
entity_subtype	
geom	
elevation	
height	
zoning	
roomtype""")

# ----
# this number needs to match the no of rooms in on e apt
select_row_number_until_which_you_want_t = Slider(35, range=1..77)  # "select row number until which you want to read data"
series_2 = Series(Start="0", Step=1, Count=select_row_number_until_which_you_want_t)

# ---- group: entrance
# ENTRANCE
dimesion_in_mm = Panel("1200")
dimesion_in_mm_2 = Panel("200")
rectangle = Rectangle(Plane=PlaneXY(0, 0, 0), XSize=dimesion_in_mm_2, YSize=dimesion_in_mm, Radius=0)  # -> Rectangle, Length
area_2 = Area(Geometry=rectangle.Rectangle)  # -> Area, Centroid

# ---- group: door
# DOORS
dimesion_in_mm_3 = Panel("900")
dimesion_in_mm_4 = Panel("200")
rectangle_2 = Rectangle(Plane=PlaneXY(0, 0, 0), XSize=dimesion_in_mm_4, YSize=dimesion_in_mm_3, Radius=0)  # -> Rectangle, Length
area_3 = Area(Geometry=rectangle_2.Rectangle)  # -> Area, Centroid

# ---- group: window
# WINDOWS
panel_13 = Panel("1000")
dimesion_in_mm_5 = Panel("200")
rectangle_3 = Rectangle(Plane=PlaneXY(0, 0, 0), XSize=dimesion_in_mm_5, YSize=panel_13, Radius=0)  # -> Rectangle, Length
area_4 = Area(Geometry=rectangle_3.Rectangle)  # -> Area, Centroid

# ----
# walls
wall_thickness = Slider(180, range=0..600)

list_item_2 = ListItem(List=sheetnames, Index=select_sheet, Wrap=True)
excel_reader = ExcelReader(ReadExcelData=read_data_from_xls, WorkbookPath=panel_8, WorksheetName=list_item_2)  # -> Exceptions, ExcelData
list_item_3 = ListItem(List=excel_reader.ExcelData, Index=series_2, Wrap=True)

# ---- group: filter rooms
panel_14 = Panel(python.apartmentNames)
panel_15 = Panel(python.roomTypes)
match_text = MatchText(Text=panel_14, Pattern="Apartment 1", Case=True)
area_5 = Area(Geometry=move_to_point_2.Moved)  # -> Area, Centroid
cull_pattern = CullPattern(List=panel_15, CullPattern=match_text)
cull_pattern_2 = CullPattern(List=move_to_point.Moved, CullPattern=match_text)
cull_pattern_3 = CullPattern(List=area_5.Centroid, CullPattern=match_text)
cull_pattern_4 = CullPattern(List=area_5.Area, CullPattern=match_text)
curve_2 = Curve(cull_pattern_2)

# ----
python_3_script_3 = Python3Script(
    C=curve,
    ID1=series,
    EntityType=entitytype,
    EntitySubtype=panel_3,
    Elevation=elevation,
    Height=height,
    Zoning=zoning,
    FilePath=file_path_2,
    saveCsv=save_csv)  # -> out, Lines, CSV; inputs C: list of Curve, SiteID: list, BuildingID: list, FloorID: list, UnitID: list, AreaID: list, UnitUsage: list, EntityType: list, EntitySubtype: list, Height: list, Zoning: list
# ---------- python_3_script_3: Python ----------
import Rhino.Geometry as rg

# Inputs:
# C: list of curves
# RoomType: list of strings
# ID1, ID2, ApartmentID, SiteID, BuildingID, PlanID, FloorID,
# UnitID, AreaID, UnitUsage, EntityType, EntitySubtype,
# Elevation, Height, Zoning: lists or single values
# FilePath: optional string to save CSV (e.g. "C:\\temp\\rooms.csv")

# Outputs:
# Lines: list of CSV lines
# CSV: full CSV text

def attr_value(lst, i, default=""):
    """Broadcast-friendly access:
       - if list is empty → default
       - if list has 1 item → use that for all rows
       - else → use element i (if exists) or default
    """
    if lst is None:
        return default
    try:
        n = len(lst)
    except:
        # Not a sequence → treat as scalar
        return lst

    if n == 0:
        return default
    if n == 1:
        return lst[0]
    if i < n:
        return lst[i]
    return default

def csv_escape(v):
    """Convert value to CSV-safe string with quotes."""
    if v is None:
        s = ""
    else:
        s = str(v)
    s = s.replace('"', '""')
    return "\"{0}\"".format(s)

lines = []

# CSV header
headers = [
    "Unnamed: 0.1",
    "ID1",
    "ID2",
    "apartment_id",
    "site_id",
    "building_id",
    "plan_id",
    "floor_id",
    "unit_id",
    "area_id",
    "unit_usage",
    "entity_type",
    "entity_subtype",
    "geom",
    "elevation",
    "height",
    "zoning",

]

lines.append(",".join(headers))

# Build rows
for i, crv in enumerate(C):
    # --- build geometry as WKT POLYGON (3D) ---
    poly = None

    if isinstance(crv, rg.PolylineCurve):
        poly = crv.ToPolyline()
    else:
        success, polyline = crv.TryGetPolyline()
        if success:
            poly = polyline
        else:
            # fallback: sample curve
            t_params = crv.DivideByCount(20, True)
            pts = [crv.PointAt(t) for t in t_params]
            poly = rg.Polyline(pts)

    coord_strings = []
    for pt in poly:
        coord_strings.append("{:.3f} {:.3f} {:.3f}".format(pt.X, pt.Y, pt.Z))

    # ensure closed polygon
    if coord_strings and coord_strings[0] != coord_strings[-1]:
        coord_strings.append(coord_strings[0])

    wkt_polygon = "POLYGON((" + ", ".join(coord_strings) + "))"

    # --- collect attribute values for this row ---
    unnamed = i  # index column, you can do i+1 if you prefer 1-based
    id1_val = attr_value(ID1, i)
    id2_val = attr_value(ID2, i)
    apartment_id_val = attr_value(ApartmentID, i)
    site_id_val = attr_value(SiteID, i)
    building_id_val = attr_value(BuildingID, i)
    plan_id_val = attr_value(PlanID, i)
    floor_id_val = attr_value(FloorID, i)
    unit_id_val = attr_value(UnitID, i)
    area_id_val = attr_value(AreaID, i)
    unit_usage_val = attr_value(UnitUsage, i)
    entity_type_val = attr_value(EntityType, i)
    entity_subtype_val = attr_value(EntitySubtype, i)
    elevation_val = attr_value(Elevation, i)
    height_val = attr_value(Height, i)
    zoning_val = attr_value(Zoning, i)


    # --- assemble row in header order ---
    values = [
        unnamed,
        id1_val,
        id2_val,
        apartment_id_val,
        site_id_val,
        building_id_val,
        plan_id_val,
        floor_id_val,
        unit_id_val,
        area_id_val,
        unit_usage_val,
        entity_type_val,
        entity_subtype_val,
        wkt_polygon,
        elevation_val,
        height_val,
        zoning_val

    ]

    row = ",".join(csv_escape(v) for v in values)
    lines.append(row)

# Outputs
CSV = "\n".join(lines)
Lines = lines

# Outputs
CSV = "\n".join(lines)
Lines = lines

# Optional: write CSV directly if Save toggle is True
try:
    if saveCsv and FilePath:
        with open(FilePath, "w") as f:
            f.write(CSV)
        print("CSV saved to:", FilePath)
except Exception as e:
    print("Error writing file:", e)
# ---------- end python_3_script_3 ----------
panel_16 = Panel("""0;0
0;1
0;2
0;3
0;4
0;5
0;6""")
panel_17 = Panel(python_3_script_3.out)
read_data_from_xls_2 = BooleanToggle(True)
worksheet = Panel("implenia")
create_tree = CreateTree(Data=panel_10, Path=panel_16)
graft_tree = GraftTree(Tree="geom", IncludeEmptyLists=True, IncludeNullItems=True)

room_index = Panel("3")
list_item_4 = ListItem(List=curve_2, Index=room_index, Wrap=True)
evaluate_curve = EvaluateCurve(Curve=reparameterize(list_item_4), Parameter=Slider(0.354, range=0..1))  # -> Point, Tangent, Angle

room_index_2 = Panel("3")
list_item_5 = ListItem(List=curve_2, Index=room_index_2, Wrap=True)
evaluate_curve_2 = EvaluateCurve(Curve=reparameterize(list_item_5), Parameter=Slider(0.669, range=0..1))  # -> Point, Tangent, Angle

room_index_3 = Panel("4")
list_item_6 = ListItem(List=curve_2, Index=room_index_3, Wrap=True)
evaluate_curve_3 = EvaluateCurve(Curve=reparameterize(list_item_6), Parameter=Slider(0.849, range=0..1))  # -> Point, Tangent, Angle

room_index_4 = Panel("2")
list_item_7 = ListItem(List=curve_2, Index=room_index_4, Wrap=True)
evaluate_curve_4 = EvaluateCurve(Curve=reparameterize(list_item_7), Parameter=Slider(0.358, range=0..1))  # -> Point, Tangent, Angle

room_index_5 = Panel("1")
list_item_8 = ListItem(List=curve_2, Index=room_index_5, Wrap=True)
evaluate_curve_5 = EvaluateCurve(Curve=reparameterize(list_item_8))  # -> Point, Tangent, Angle

room_index_6 = Panel("0")
list_item_9 = ListItem(List=curve_2, Index=room_index_6, Wrap=True)
evaluate_curve_6 = EvaluateCurve(Curve=reparameterize(list_item_9), Parameter=Slider(0.945, range=0..1))  # -> Point, Tangent, Angle

room_index_7 = Panel("2")
list_item_10 = ListItem(List=curve_2, Index=room_index_7, Wrap=True)
evaluate_curve_7 = EvaluateCurve(Curve=reparameterize(list_item_10), Parameter=Slider(0.882, range=0..1))  # -> Point, Tangent, Angle

list_item_11 = ListItem(List=curve_2, Index=0, Wrap=True)
evaluate_curve_8 = EvaluateCurve(Curve=reparameterize(list_item_11), Parameter=Slider(0.608, range=0..1))  # -> Point, Tangent, Angle

list_item_12 = ListItem(List=curve_2, Index=3, Wrap=True)
evaluate_curve_9 = EvaluateCurve(Curve=reparameterize(list_item_12), Parameter=Slider(0.058, range=0..1))  # -> Point, Tangent, Angle

# ----
# -"zone1" refers to a
# private space,
# 
# -"zone2" to a public space,
# -"zone3" to a service space, and
# -"zone4"
# to an outside place
cluster = Cluster(msd_formatted_data=list_item_3)  # -> row_number, apartment_id_2, site_id_2, building_id, plan_id, floor_id, unit_id, area_id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
panel_18 = Panel(cluster.apartment_id_2)
panel_19 = Panel(cluster.entity_subtype)

merge = Merge()
excel_write = ExcelWrite(
    WriteExcelData=read_data_from_xls_2,
    WorkbookPath=file_path,
    WorksheetName=worksheet,
    ColumnHeadings="geom",
    Data=flatten(create_tree),
    ClearSheet=False)

# ---- group: space tages+_reference
integer = Integer(cull_pattern_4)
sysunits = GhPythonScript(N=integer, unitsFrom=2, unitsTo=4, mag=2)  # -> message, R
# ---------- sysunits: Python ----------
__author__ = "michael.lee"
__version__ = "2019.05.29"

import rhinoscriptsyntax as rs
intModelUnits = rs.UnitSystem()

if (intModelUnits == 0):
    message = "No unit system is assigned"
elif (intModelUnits == 1 ):
    message = "Your model is in Microns (1.0e-6 meters)"
elif (intModelUnits == 2 ):
    message = "Your model is in Millimeters (1.0e-3 meters)"
elif (intModelUnits == 3 ):
    message ="Your model is in Centimeters (1.0e-2 meters)"
elif (intModelUnits == 4 ):
    message = "Your model is in Meters"
elif (intModelUnits == 5 ):
    message = "Your model is in Kilometers (1.0e+3 meters)"
elif (intModelUnits == 6 ):
    message = "Your model is in Microinches (2.54e-8 meters, 1.0e-6 inches)"
elif (intModelUnits == 7 ):
    message = "Yourmodel is in Mils (2.54e-5 meters, 0.001 inches)"
elif (intModelUnits == 8 ):
    message = "Your model is in Inches (0.0254 meters)"
elif (intModelUnits == 9 ):
    message = "Your model is in Feet (0.3408 meters, 12 inches)"
elif (intModelUnits == 10 ):
    message = "Your model is in Miles (1609.344 meters, 5280 feet)"
else:
    message = "please check your inputs"



if (intModelUnits != unitsFrom ):
    message = "Caution! your model units are different from what you indicate, if this is in purpose you are good"
else:
    message = message + ". Converting units!"
    print(message)
    
if (N):
    R = N*pow(rs.UnitScale(unitsTo,unitsFrom),mag)

else:
    R = None
# ---------- end sysunits ----------
expression = Expression(x=sysunits.R, Expression="Format(\"{0:0.00}\",x)")
Z = UnitZ(Factor=room_label_height)
move = Move(Geometry=cull_pattern_3, Motion=Z)  # -> Geometry, Transform
ln = Line(StartPoint=cull_pattern_3, EndPoint=move.Geometry)
gate = StreamGate(Stream=ln, Gate=show_room_labels)  # -> Target0, Target1
gate_2 = StreamGate(Stream=move.Geometry, Gate=show_room_labels)  # -> Target0, Target1
concat = Concatenate(FragmentA=cull_pattern, FragmentC=":", FragmentB=expression, FragmentD=" m2")
preview = CustomPreview(Geometry=gate.Target1, Material=room_labler_color)
tag = TextTag3D(Location=gate_2.Target1, Text=flatten(concat), Size=room_label_size, Colour=room_labler_color, Justification=5)

# ----
region_union = RegionUnion(Curves=curve_2)
boundary_surfaces = BoundarySurfaces(Edges=region_union)
unit_z = UnitZ(Factor="-0.03")
room_labler_color_2 = ColourSwatch(SwatchColor=RGB(120, 120, 120))
move_2 = Move(Geometry=boundary_surfaces, Motion=unit_z)  # -> Geometry, Transform
preview_2 = CustomPreview(Geometry=move_2.Geometry, Material=room_labler_color_2)

# ---- group: visualize floorplan
region_union_2 = RegionUnion(Curves=move_to_point.Moved)
boundary_surfaces_2 = BoundarySurfaces(Edges=region_union_2)
unit_z_2 = UnitZ(Factor="-0.05")
room_labler_color_3 = ColourSwatch(SwatchColor=RGB(201, 201, 201))
move_3 = Move(Geometry=boundary_surfaces_2, Motion=unit_z_2)  # -> Geometry, Transform
preview_3 = CustomPreview(Geometry=move_3.Geometry, Material=room_labler_color_3)

# ----
panel_20 = Panel(excel_write)

# ---- group: move_orient openings / door
unit_y = UnitY(Factor=1)
point_2 = Point([evaluate_curve_2.Point, evaluate_curve_5.Point, evaluate_curve_6.Point, evaluate_curve_4.Point, evaluate_curve_3.Point])
vector = Vector([evaluate_curve_2.Tangent, evaluate_curve_5.Tangent, evaluate_curve_6.Tangent, evaluate_curve_4.Tangent, evaluate_curve_3.Tangent])
curve_3 = Curve(rectangle_2.Rectangle)
orient_direction = OrientDirection(Geometry=curve_3, PointA=area_3.Centroid, DirectionA=unit_y, PointB=point_2, DirectionB=vector)  # -> Geometry, Transform

# ---- group: move_orient openings / entrance
point_3 = Point(evaluate_curve.Point)
vector_2 = Vector(evaluate_curve.Tangent)
curve_4 = Curve(rectangle.Rectangle)
orient_direction_2 = OrientDirection(Geometry=curve_4, PointA=area_2.Centroid, DirectionA=unit_y, PointB=point_3, DirectionB=vector_2)  # -> Geometry, Transform

# ---- group: move_orient openings / windows
point_4 = Point([evaluate_curve_8.Point, evaluate_curve_9.Point, evaluate_curve_7.Point])
vector_3 = Vector([evaluate_curve_8.Tangent, evaluate_curve_9.Tangent, evaluate_curve_7.Tangent])
curve_5 = Curve(rectangle_3.Rectangle)
orient_direction_3 = OrientDirection(Geometry=curve_5, PointA=area_4.Centroid, DirectionA=unit_y, PointB=point_4, DirectionB=vector_3)  # -> Geometry, Transform

# ---- group: visualize walls
division = Division(A=wall_thickness, B=2)
offset_curve = OffsetCurve(Curve=curve_2, Plane=PlaneXY(0, 0, 0), Distance=division, BothSides=True, Kinks=0, CapType=1)

# ----
unit_z_3 = UnitZ(Factor="2")
move_4 = Move(Geometry=orient_direction_3.Geometry, Motion=unit_z_3)  # -> Geometry, Transform
boundary_surfaces_3 = BoundarySurfaces(Edges=move_4.Geometry)
custom_preview = CustomPreview(Geometry=boundary_surfaces_3, Material=ColourSwatch(SwatchColor=RGB(0, 173, 189)))

unit_z_4 = UnitZ(Factor="2")
move_5 = Move(Geometry=orient_direction.Geometry, Motion=unit_z_4)  # -> Geometry, Transform
boundary_surfaces_4 = BoundarySurfaces(Edges=move_5.Geometry)
custom_preview_2 = CustomPreview(Geometry=boundary_surfaces_4, Material=ColourSwatch(SwatchColor=RGB(189, 0, 0)))

unit_z_5 = UnitZ(Factor="1")
move_6 = Move(Geometry=offset_curve, Motion=unit_z_5)  # -> Geometry, Transform
boundary_surfaces_5 = BoundarySurfaces(Edges=move_6.Geometry)
custom_preview_3 = CustomPreview(Geometry=boundary_surfaces_5, Material=ColourSwatch(SwatchColor=RGB(0, 0, 0)))

unit_z_6 = UnitZ(Factor="2")
move_7 = Move(Geometry=orient_direction_2.Geometry, Motion=unit_z_6)  # -> Geometry, Transform
boundary_surfaces_6 = BoundarySurfaces(Edges=move_7.Geometry)
custom_preview_4 = CustomPreview(Geometry=boundary_surfaces_6, Material=ColourSwatch(SwatchColor=RGB(245, 131, 0)))

# ==== cluster RelPath
user = ClusterInput()
panel = Panel("curletto")
user_2 = Text(user)
path = ClusterInput()
path_2 = FilePath(path)
rep = ReplaceText(Text=path_2, Find="panz", Replace=user_2, RecursiveReplace=False)
panel_2 = Panel(path_2)
split = TextSplit(Text=rep, Separators="\")
panel_3 = Panel(rep)
panel_4 = Panel(split)
item = ListItem(List=split, Index=0, Wrap=True)  # -> Item1, Item, Item1_2, Item2, Item3, Item4
concat = Concatenate(FragmentA=item.Item, FragmentE=user_2, FragmentB="\", FragmentD=item.Item4)
path_3 = FilePath(rep)
path_4 = ClusterOutput(path_3)
panel_5 = Panel(path_3)

# ==== cluster Cluster
msd_formatted_data = ClusterInput()
explode_tree = ExplodeTree(Data=msd_formatted_data)  # -> Branch0, Branch1, Branch2, Branch3, Branch4, Branch5, Branch6, Branch7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

data = Data(explode_tree.Branch0)
list_item = ListItem(List=explode_tree.Branch0, Index=0, Wrap=True)
cull_index = CullIndex(List=data, Indices=0, Wrap=True)
panel = Panel(cull_index)
column_title = Panel(list_item)

data_2 = Data(explode_tree.Branch11)
cull_index_2 = CullIndex(List=data_2, Indices=0, Wrap=True)
list_item_2 = ListItem(List=explode_tree.Branch11, Index=0, Wrap=True)
panel_2 = Panel(cull_index_2)
column_title_2 = Panel(list_item_2)

data_3 = Data(explode_tree.Branch16)
cull_index_3 = CullIndex(List=data_3, Indices=0, Wrap=True)
list_item_3 = ListItem(List=explode_tree.Branch16, Index=0, Wrap=True)
panel_3 = Panel(cull_index_3)
column_title_3 = Panel(list_item_3)

data_4 = Data(explode_tree.Branch15)
list_item_4 = ListItem(List=explode_tree.Branch15, Index=0, Wrap=True)
cull_index_4 = CullIndex(List=data_4, Indices=0, Wrap=True)
panel_4 = Panel(cull_index_4)
column_title_4 = Panel(list_item_4)

data_5 = Data(explode_tree.Branch14)
list_item_5 = ListItem(List=explode_tree.Branch14, Index=0, Wrap=True)
cull_index_5 = CullIndex(List=data_5, Indices=0, Wrap=True)
panel_5 = Panel(cull_index_5)
column_title_5 = Panel(list_item_5)

data_6 = Data(explode_tree.Branch17)
cull_index_6 = CullIndex(List=data_6, Indices=0, Wrap=True)
list_item_6 = ListItem(List=explode_tree.Branch17, Index=0, Wrap=True)
column_title_6 = Panel(list_item_6)

data_7 = Data(explode_tree.Branch13)
cull_index_7 = CullIndex(List=data_7, Indices=0, Wrap=True)
list_item_7 = ListItem(List=explode_tree.Branch13, Index=0, Wrap=True)
panel_6 = Panel(cull_index_7)
column_title_7 = Panel(list_item_7)

data_8 = Data(explode_tree.Branch12)
cull_index_8 = CullIndex(List=data_8, Indices=0, Wrap=True)
list_item_8 = ListItem(List=explode_tree.Branch12, Index=0, Wrap=True)
panel_7 = Panel(cull_index_8)
column_title_8 = Panel(list_item_8)

data_9 = Data(explode_tree.Branch6)
cull_index_9 = CullIndex(List=data_9, Indices=0, Wrap=True)
list_item_9 = ListItem(List=explode_tree.Branch6, Index=0, Wrap=True)
panel_8 = Panel(cull_index_9)
column_title_9 = Panel(list_item_9)

data_10 = Data(explode_tree.Branch2)
list_item_10 = ListItem(List=explode_tree.Branch2, Index=0, Wrap=True)
cull_index_10 = CullIndex(List=data_10, Indices=0, Wrap=True)
column_title_10 = Panel(list_item_10)
panel_9 = Panel(cull_index_10)

data_11 = Data(explode_tree.Branch4)
list_item_11 = ListItem(List=explode_tree.Branch4, Index=0, Wrap=True)
cull_index_11 = CullIndex(List=data_11, Indices=0, Wrap=True)
panel_10 = Panel(cull_index_11)
site_id = Panel(list_item_11)

data_12 = Data(explode_tree.Branch3)
list_item_12 = ListItem(List=explode_tree.Branch3, Index=0, Wrap=True)
cull_index_12 = CullIndex(List=data_12, Indices=0, Wrap=True)
apartment_id = Panel(list_item_12)
panel_11 = Panel(cull_index_12)

data_13 = Data(explode_tree.Branch5)
cull_index_13 = CullIndex(List=data_13, Indices=0, Wrap=True)
list_item_13 = ListItem(List=explode_tree.Branch5, Index=0, Wrap=True)
panel_12 = Panel(cull_index_13)
column_title_11 = Panel(list_item_13)

data_14 = Data(explode_tree.Branch10)
cull_index_14 = CullIndex(List=data_14, Indices=0, Wrap=True)
list_item_14 = ListItem(List=explode_tree.Branch10, Index=0, Wrap=True)
panel_13 = Panel(cull_index_14)
column_title_12 = Panel(list_item_14)

data_15 = Data(explode_tree.Branch9)
cull_index_15 = CullIndex(List=data_15, Indices=0, Wrap=True)
list_item_15 = ListItem(List=explode_tree.Branch9, Index=0, Wrap=True)
panel_14 = Panel(cull_index_15)
column_title_13 = Panel(list_item_15)

data_16 = Data(explode_tree.Branch8)
cull_index_16 = CullIndex(List=data_16, Indices=0, Wrap=True)
list_item_16 = ListItem(List=explode_tree.Branch8, Index=0, Wrap=True)
panel_15 = Panel(cull_index_16)
column_title_14 = Panel(list_item_16)

data_17 = Data(explode_tree.Branch7)
cull_index_17 = CullIndex(List=data_17, Indices=0, Wrap=True)
list_item_17 = ListItem(List=explode_tree.Branch7, Index=0, Wrap=True)
panel_16 = Panel(cull_index_17)
column_title_15 = Panel(list_item_17)

list_item_18 = ListItem(List=explode_tree.Branch1, Index=0, Wrap=True)

data_18 = Data(explode_tree.Branch1)
cull_index_18 = CullIndex(List=data_18, Indices=0, Wrap=True)
panel_17 = Panel(cull_index_18)
column_title_16 = Panel(list_item_18)

unit_id = ClusterOutput(cull_index_16)
building_id = ClusterOutput(cull_index_13)
plan_id = ClusterOutput(cull_index_9)
unit_usage = ClusterOutput(cull_index_14)
area_id = ClusterOutput(cull_index_15)
row_number = ClusterOutput(cull_index_10)
apartment_id_2 = ClusterOutput(cull_index_12)
floor_id = ClusterOutput(cull_index_17)
roomtype = ClusterOutput(cull_index_6)
# -"zone1" refers to a
# private space,
# 
# -"zone2" to a public space,
# -"zone3" to a service space, and
# -"zone4"
# to an outside place
zoning = ClusterOutput(cull_index_3)  # zone 1 private
entity_subtype = ClusterOutput(cull_index_8)
geometry = ClusterOutput(cull_index_7)
site_id_2 = ClusterOutput(cull_index_11)
elevation = ClusterOutput(cull_index_5)
entity_type = ClusterOutput(cull_index_2)
height = ClusterOutput(cull_index_4)
