# Grasshopper definition parseJson01_formatForMSD.gh (Grasshopper 1.0.7)
# plug-ins: ShapeDiverForGrasshopper

panel = Panel("""{
	"points":
	[
 		{
 		 "x": 0,
		 "y": 0,
		 "z":0
		},
		{
		 "x": 10,
		 "y": 10,
		 "z":0
		},
		{
		 "x": 30,
		 "y": 60,
		 "z":0
		},
	],
	"position": 0 
}""")
panel_2 = Panel("""{
"curves":[
{	
"points":
	[
 		{
 		 "x": 0,
		 "z":0
		},
		{
		 "x": 30,
		 "z":100
		},
		{
		 "x": 60,
		 "z":100
		},
		{
		 "x": 90,
		 "z":0
		},
	],
	"position": 0 
},
{	
"points":
	[
 		{
 		 "x": 0,
		 "z":0
		},
		{
		 "x": 30,
		 "z": 60
		},
		{
		 "x": 50,
		 "z": 70
		},
		{
		 "x": 90,
		 "z": 0
		},
	],
	"position": 200 
},
{	
"points":
	[
 		{
 		 "x": 0,
		 "z":0
		},
		{
		 "x": 30,
		 "z": 60
		},
		{
		 "x": 70,
		 "z": 80
		},
		{
		 "x": 90,
		 "z": 0
		},
	],
	"position": 400 
},
]
}""")
panel_3 = Panel("""{
"curves":[
{	
"points":
	[
 		{
 		 "x": 0,
		 "y": 0,
		 "z":0
		},
		{
		 "x": 10,
		 "y": 10,
		 "z":0
		},
		{
		 "x": 30,
		 "y": 60,
		 "z":0
		},
	],
	"position": 0 
},
{	
"points":
	[
 		{
 		 "x": 0,
		 "y": 0,
		 "z":0
		},
		{
		 "x": 30,
		 "y": 30,
		 "z": 60
		},
		{
		 "x": 60,
		 "y": 70,
		 "z": 100
		},
	],
	"position": 200 
},

]
}""")
parsejson = ParseJSON(JSON=panel)
accessjson = AccessJSON(Object=parsejson, AddressString="points")
parsejson_2 = ParseJSON(JSON=panel_2)
parsejson_3 = ParseJSON(JSON=panel_3)
accessjson_2 = AccessJSON(Object=accessjson, AddressString="y")
accessjson_3 = AccessJSON(Object=accessjson, AddressString="x")
accessjson_4 = AccessJSON(Object=parsejson_2, AddressString="curves")
accessjson_5 = AccessJSON(Object=parsejson_3, AddressString="curves")
accessjson_6 = AccessJSON(Object=accessjson_4, AddressString="points")
accessjson_7 = AccessJSON(Object=accessjson_5, AddressString="points")
accessjson_8 = AccessJSON(Object=accessjson_4, AddressString="position")
pt = ConstructPoint(XCoordinate=accessjson_3, YCoordinate=accessjson_2, ZCoordinate=0)
accessjson_9 = AccessJSON(Object=accessjson_6, AddressString="x")
accessjson_10 = AccessJSON(Object=accessjson_6, AddressString="z")
accessjson_11 = AccessJSON(Object=accessjson_7, AddressString="y")
accessjson_12 = AccessJSON(Object=accessjson_7, AddressString="x")
accessjson_13 = AccessJSON(Object=accessjson_7, AddressString="z")
pt_2 = ConstructPoint(XCoordinate=accessjson_9, YCoordinate=accessjson_8, ZCoordinate=accessjson_10)
pt_3 = ConstructPoint(XCoordinate=accessjson_12, YCoordinate=accessjson_11, ZCoordinate=accessjson_13)
concat = Concatenate(FragmentA="curves[")
intcrv = Interpolate(Vertices=pt_3, Degree=3, Periodic=False, KnotStyle=1)  # -> Curve, Length, Domain
intcrv_2 = Interpolate(Vertices=pt_2, Degree=3, Periodic=False, KnotStyle=1)  # -> Curve, Length, Domain
num2pt = NumbersToPoints(Numbers=[1, 2, 3], Mask=4)
