# Grasshopper definition test-createGraph-from-flooplanAND-export-svg.gh (Grasshopper 1.0.8)
# plug-ins: Pufferfish, Human, GraphicPlus, ShapeDiverForGrasshopper, GraphMLAnalyzer

path = FilePath("C:\Users\panz\Downloads\Dolphin_4\roomdic_template.json")

# ---- group: Local Source_samples
panel = Panel("C:\Users\panz\Downloads\Dolphin_4\sample_AgraphMLs\AgraphMLs\")
panel_2 = Panel("C:\Users\panz\Downloads\Dolphin_4\sample_AgraphMLs\AgraphMLs\Roomgraph_0g1LxT9G8NLrgwoAht0_0.0.graphml")
toggle = BooleanToggle(True)

# ----
panel_3 = Panel("C:\Users\panz\Documents\GitHub\IBC\05_Floorplan_processing\jsonExports\ReferenceDesign_01\updated_walls_and_rooms_graph.graphml")

select_reference_apt = ValueList({"Apartment 1", "Apartment 2", "Apartment 3", "Apartment 4"}, selected="Apartment 1")
candidate_design = ValueList({"candidate 11001": 0, "candidate 12001": 1, "candidate 12005": 2, "candidate 12009": 3, "candidate 14007": 4, "candidate 14012": 5, "candidate 18003": 6, "candidate 21004": 7, "candidate MSD-399": 8}, selected="candidate 14007")

curve = Curve([<curve referenced from the Rhino model> x7])
panel_5 = Panel("C:\Users\panz\Downloads\Dolphin_4\sample_AgraphMLs\AgraphMLs\Roomgraph_3cLrn0oJg$eAz0SSv$xjBG_0.0.graphml")

# ---- group: Local Source
panel_6 = Panel(panel_3)
panel_7 = Panel(panel_5)
agraphmlreader = AgraphMLAgraphMLReader(FolderPath=panel_6)  # -> AgraphMLs, Amount, File
agraphmlfilechecker = AgraphMLFileChecker(AgraphMLFilePath=panel_7, SupressWarnings=Toggle(False))  # -> ListOfErrors, StateOfResult, AGraphMLString
panel_8 = Panel(agraphmlfilechecker.AGraphMLString)
panel_9 = Panel(agraphmlfilechecker.ListOfErrors)
panel_10 = Panel(agraphmlreader.Amount)
panel_11 = Panel(agraphmlreader.File)
panel_12 = Panel(agraphmlreader.AgraphMLs)

# ----
path_2 = FilePath("C:\Users\panz\Documents\GitHub\IBC\05_Floorplan_processing\45613.json")
path_3 = FilePath("C:\Users\panz\Documents\GitHub\IBC\05_Floorplan_processing\45774.json")

# ----
# READ json
# with floorplan
panel_13 = Panel("""candidate design 11001
candidate design 12001
candidate design 12005
candidate design 12009
candidate design 14007
candidate design 14012
candidate design 18003
candidate design 21004
MSD Building_ID: 399
MSD Building_ID: XXX""")
path_4 = FilePath("C:\Users\panz\Documents\GitHub\2025-AEC-Hackathon\json\GenericDesign_11001\11001.json")
path_5 = FilePath("C:\Users\panz\Documents\GitHub\2025-AEC-Hackathon\json\GenericDesign_12005\12005.json")
path_6 = FilePath("C:\Users\panz\Documents\GitHub\2025-AEC-Hackathon\json\GenericDesign_12001\12001.json")
path_7 = FilePath("C:\Users\panz\Documents\GitHub\2025-AEC-Hackathon\json\GenericDesign_14012\14012.json")
path_8 = FilePath("C:\Users\panz\Documents\GitHub\2025-AEC-Hackathon\json\GenericDesign_12009\12009.json")
path_9 = FilePath("C:\Users\panz\Documents\GitHub\2025-AEC-Hackathon\json\GenericDesign_14007\14007.json")
path_10 = FilePath("C:\Users\panz\Documents\GitHub\2025-AEC-Hackathon\json\GenericDesign_18003\18003.json")
path_11 = FilePath("C:\Users\panz\Documents\GitHub\2025-AEC-Hackathon\json\GenericDesign_21004\21004.json")
list_item = ListItem(List=panel_13, Index=candidate_design, Wrap=True)
filter = StreamFilter(
    Gate=candidate_design,
    Stream0=path_4,
    Stream1=path_6,
    Stream2=path_5,
    Stream3=path_8,
    Stream4=path_9,
    Stream5=path_7,
    Stream6=path_10,
    Stream7=path_11,
    Stream8=path_2,
    Stream9=path_3)

panel_14 = Panel(filter)

# ----
# aGraphML detection and creation
panel_15 = Panel("C:\Users\panz\Downloads\roomdic_template.json")
semantic_graph = SemanticGraph(DictionaryFIlePath=panel_15)
# aGraphML analyses
panel_16 = Panel(semantic_graph)

# ---- group: Local Source_IBC
panel_17 = Panel("C:\Users\panz\Downloads\Dolphin_4\sample_AgraphMLs\AgraphMLs\Roomgraph_0g1LxT9G8NLrgwoAht0_0.0.graphml")
panel_18 = Panel("C:\Users\panz\Downloads\Dolphin_4\sample_AgraphMLs\AgraphMLs\")
agraphmlreader_2 = AgraphMLAgraphMLReader(FolderPath=panel_18)  # -> AgraphMLs, Amount, File
agraphmlfilechecker_2 = AgraphMLFileChecker(AgraphMLFilePath=panel_17, SupressWarnings=Toggle(True))  # -> ListOfErrors, StateOfResult, AGraphMLString
panel_19 = Panel(agraphmlreader_2.Amount)
panel_20 = Panel(agraphmlfilechecker_2.AGraphMLString)
panel_21 = Panel(agraphmlfilechecker_2.ListOfErrors)
panel_22 = Panel(agraphmlreader_2.File)
panel_23 = Panel(agraphmlreader_2.AgraphMLs)

# ---- group: Local Source_samples
panel_24 = Panel("C:\Users\panz\Downloads\Dolphin_4\sample_AgraphMLs\AgraphMLs\Roomgraph_0g1LxT9G8NLrgwoAht0_0.0.graphml")
panel_25 = Panel("C:\Users\panz\Downloads\Dolphin_4\sample_AgraphMLs\AgraphMLs\")
agraphmlreader_3 = AgraphMLAgraphMLReader(FolderPath=panel_25)  # -> AgraphMLs, Amount, File
agraphmlfilechecker_3 = AgraphMLFileChecker(AgraphMLFilePath=panel_24, SupressWarnings=Toggle(True))  # -> ListOfErrors, StateOfResult, AGraphMLString
panel_26 = Panel(agraphmlreader_3.Amount)
panel_27 = Panel(agraphmlfilechecker_3.AGraphMLString)
panel_28 = Panel(agraphmlfilechecker_3.ListOfErrors)
panel_29 = Panel(agraphmlreader_3.File)
panel_30 = Panel(agraphmlreader_3.AgraphMLs)

# ----
panel_31 = Panel(agraphmlfilechecker_2.StateOfResult)
panel_32 = Panel(agraphmlfilechecker_3.StateOfResult)

# ---- group: Filter
# Syntax für FilterRules:
# 
# id:id1|id2|id3
# roomType:<typ_1>|<type_2>|...|<type_n>
# roomName:<name>
# zone:<name>
# windowExist:<true or false>
# enclosedRoom:<true or false>
# light:[<= >= != < > =] <number>
# privacy:[<= >= != < > =] <number>
# area:[<= >= != < > =] <number>
# corners:[<= >= != < > =] <number>
# edgeType:<one of below> [<= >= != < > =] <number>
# 
# ANY
# CONNECTION
# DOOR
# ENTRY
# PASSAGE
# WALL
# WINDOW
# 
# Leerzeilen werden ignoriert!
# //das ist ein Kommentar
panel_33 = Panel("""roomType:BATH|SLEEPING|WORKING|LIVING
area:>3
edgeType:ANY >= 2
aaa//ich bin ein Fehler
//ich bin ein kommentar

//leerzeilen werden ignoriert""")
list = ValueList({"id", "roomType", "roomName", "zone", "windowExist", "enclosedRoom", "light", "privacy", "area", "center", "corners"}, selected="area")
data = Data(agraphmlreader_3.AgraphMLs)
data_2 = Data(agraphmlfilechecker_3.AGraphMLString)
agraphmlfilter = AgraphMLAgraphMLFilter(AgraphMLs=data, FilterRules=panel_33)  # -> AgraphMLs, Amount, FilterInfo, ErrorList
agraphmlroomfilter = AgraphMLRoomFilter(AgraphML=data_2, FilterRules=panel_33, Info=list)  # -> AgraphML, Info, ErrorList
panel_34 = Panel(agraphmlroomfilter.ErrorList)
panel_35 = Panel(agraphmlfilter.ErrorList)
panel_36 = Panel(agraphmlfilter.AgraphMLs)
panel_37 = Panel(agraphmlfilter.FilterInfo)
panel_38 = Panel(agraphmlroomfilter.AgraphML)
panel_39 = Panel(agraphmlroomfilter.Info)
panel_40 = Panel(agraphmlfilter.Amount)

# ---- group: Statistics
# Decimals is optional input!
# Right Click on component name (e.g. RoomAreaShare) to reveal additional menu items like the sorting option.
# Area Shares sum up to 1 (or 100, depending on representation)
# Every component offers a short description by dragging the mouse over the component's name.
# The outputs are currently two lists: edgetype labels and the corresponding values. Every entry in the first list corresponds to an entry in the second list. (e.g. The LIVING item of the first list has an area share of 25.9 percent)
# Both Roomtypes can be the same. In this case, the component checks if two rooms of the same types are connected
# Use the right-click menu to output probabilistic values instead of average edge count values
data_3 = Data(agraphmlreader_3.AgraphMLs)
data_4 = Data(agraphmlreader_3.AgraphMLs)
data_5 = Data(agraphmlreader_3.AgraphMLs)
roomareashare = AgraphMLRoomAreaShareCalculator(AGraphMLList=data_3, Decimals=3)  # -> RoomTypes, AreaShares
room_2_room_edges = AGraphMLRoom2RoomEdgeOccurrences(AGraphMLList=data_4, Roomtype1="CORRIDOR", Roomtype2="KITCHEN", DecimalsRounding="2")  # -> Edgetypes, EdgeProbabilities
averageroomedges = AGraphMLAverageEdgeOccurrencesForOneRoomtype(AGraphMLList=data_5, Roomtype="CORRIDOR", DecimalsRounding="2")  # -> EdgetypeLabels, EdgetypeCount
panel_41 = Panel(room_2_room_edges.Edgetypes)
panel_42 = Panel(room_2_room_edges.EdgeProbabilities)
panel_43 = Panel(averageroomedges.EdgetypeLabels)
panel_44 = Panel(averageroomedges.EdgetypeCount)
panel_45 = Panel(roomareashare.RoomTypes)
panel_46 = Panel(roomareashare.AreaShares)

# ----
number_slider = Slider(127.483, range=0..410)
colour_swatch = ColourSwatch(SwatchColor=RGB(76, 76, 76))

# ---- group: Analyzer
data_6 = Data(agraphmlfilechecker.AGraphMLString)
data_7 = Data(agraphmlfilechecker.AGraphMLString)
data_8 = Data(agraphmlfilechecker.AGraphMLString)
edgesanalyser = EdgesAnalyser(AGraphMLString=data_6)  # -> SourcePoint, TargetPoint, DataConnectionType
nodesanalyser = NodesAnalyser(AGraphMLString=data_7)  # -> DataID, DataRoomType, NodeCenter, DataCorners
graphanalyser = GraphAnalyser(AGraphMLString=data_8)  # -> StartValue, EndValue
panel_47 = Panel(edgesanalyser.SourcePoint)
panel_48 = Panel(edgesanalyser.TargetPoint)
split = TextSplit(Text=nodesanalyser.DataCorners, Separators=";")
panel_49 = Panel(edgesanalyser.DataConnectionType)
ln = Line(StartPoint=graphanalyser.StartValue, EndPoint=graphanalyser.EndValue)

# ----
explode_tree = ExplodeTree(Data=nodesanalyser.DataCorners)  # -> Branch0, Branch1, Branch2, Branch3, Branch4, Branch5

# ---- group: Analyzer (continued)
pline = PolyLine(
    Vertices=[explode_tree.Branch0, explode_tree.Branch1, explode_tree.Branch2, explode_tree.Branch3, explode_tree.Branch4, explode_tree.Branch5],
    Closed=True)

# ----
group = Group(Objects=flatten([pline, ln]))
bounding_rectangle = BoundingRectangle(Geometry=group, Plane=PlaneXY(0, 0, 0), Axis=0, Slide=0, Union=True)  # -> Bounding, DimensionX, DimensionY
area = Area(Geometry=bounding_rectangle.Bounding)  # -> Area, Centroid
scale = Scale(Geometry=nodesanalyser.NodeCenter, Center=area.Centroid, Factor="1000")  # -> Geometry, Transform
scale_2 = Scale(Geometry=pline, Center=area.Centroid, Factor="1000")  # -> Geometry, Transform
scale_3 = Scale(Geometry=ln, Center=area.Centroid, Factor="1000")  # -> Geometry, Transform

match_text = MatchText(Text="WALL", Pattern=panel_49, Case=True)
dispatch = Dispatch(List=panel_49, DispatchPattern=match_text)  # -> ListA, ListB
dispatch_2 = Dispatch(List=scale_3.Geometry, DispatchPattern=match_text)  # -> ListA, ListB

# ---- group: TEXT
font_size = Panel("60")
text_shape = TextShape(Text=nodesanalyser.DataRoomType, Plane=scale.Geometry)
font = Font(TextShape=text_shape, FontFamily="Arial", FontSize=font_size, Bold=False, Italic=False, Underline=False, Justification=4)
shape_link = ShapeLink(ShapeGeometry=font, Hyperlink="https://www.shapediver.com")
shape_data = ShapeData(ShapeGeometry=shape_link, ID="thisIsText")
shape_settings = ShapeSettings(ShapeGeometry=shape_data, Layer="main :: text")

# ----
group_2 = Group(Objects=flatten(scale_2.Geometry))
offset_for_frame = Panel("400")
bounding_rectangle_2 = BoundingRectangle(Geometry=group_2, Plane=PlaneXY(0, 0, 0), Axis=0, Slide=0, Union=True)  # -> Bounding, DimensionX, DimensionY
area_2 = Area(Geometry=bounding_rectangle_2.Bounding)  # -> Area, Centroid
offset_curve = OffsetCurve(Curve=bounding_rectangle_2.Bounding, Distance=offset_for_frame, Corners=1)  # -> flatten(Curve)
bounding_rectangle_3 = BoundingRectangle(Geometry=offset_curve, Plane=PlaneXY(0, 0, 0), Axis=0, Slide=0, Union=True)  # -> Bounding, DimensionX, DimensionY

match_text_2 = MatchText(Text="DOOR", Pattern=dispatch.ListB, Case=True)
dispatch_3 = Dispatch(List=dispatch_2.ListB, DispatchPattern=match_text_2)  # -> ListA, ListB
curve_2 = Curve(dispatch_3.ListA)

panel_50 = Panel("""Key 1
Key 2""")
stroke = Stroke(ShapeGeometry=scale_2.Geometry, Color="0,0,0", Weight="6", Pattern="10", EndCap=0)
shape_data_2 = ShapeData(ShapeGeometry=stroke, ID="thisIsCircle", Keys=panel_50)
custom_preview_lineweights = CustomPreviewLineweights(
    Geometry=scale_2.Geometry,
    Shader=ColourSwatch(SwatchColor=RGB(0, 0, 0)),
    Thickness=Slider(3, range=1..10),
    Absolute=False)
shape_settings_2 = ShapeSettings(ShapeGeometry=shape_data_2, Layer="main :: room")

dispatch_4 = Dispatch(List=dispatch.ListB, DispatchPattern=match_text_2)  # -> ListA, ListB

curve_3 = Curve(dispatch_3.ListB)
evaluate_curve = EvaluateCurve(Curve=curve_3, Parameter=0.5)  # -> Point, Tangent, Angle
panel_51 = Panel(dispatch_4.ListB)
text_tag_3d = TextTag3D(Location=evaluate_curve.Point, Text=panel_51, Size=number_slider, Colour=colour_swatch, Justification=5)
custom_preview_lineweights_2 = CustomPreviewLineweights(Geometry=curve_3, Shader=ColourSwatch(SwatchColor=RGB(250, 217, 0)), Absolute=False)

panel_52 = Panel(dispatch_4.ListA)
evaluate_curve_2 = EvaluateCurve(Curve=curve_2, Parameter=0.5)  # -> Point, Tangent, Angle
text_tag_3d_2 = TextTag3D(
    Location=scale.Geometry,
    Text=nodesanalyser.DataRoomType,
    Size=Slider(151.333, range=0..260),
    Colour=ColourSwatch(SwatchColor=RGB(76, 76, 76)),
    Justification=5)
custom_preview_lineweights_3 = CustomPreviewLineweights(Geometry=curve_2, Shader=ColourSwatch(SwatchColor=RGB(0, 250, 54)), Absolute=False)
merge = Merge(Data1=shape_settings_2, Data2=shape_settings)  # -> flatten(Result)
text_tag_3d_3 = TextTag3D(Location=evaluate_curve_2.Point, Text=panel_52, Size=number_slider, Colour=colour_swatch, Justification=5)

panel_53 = Panel(merge)
construct_drawing = ConstructDrawing(
    ShapesGeometry=merge,
    Boundary=offset_curve,
    Width=bounding_rectangle_3.DimensionX,
    Height=bounding_rectangle_3.DimensionY,
    Color=RGBA(255, 255, 255, 0),
    Units=4)  # -> Drawing, Boundary
svg_text = SVGText(DrawingsShapesGeometry=construct_drawing.Drawing)
stringtostream = CSharpScript(txt=svg_text)  # -> out, stream; inputs txt: String
# ---------- stringtostream: C# usings ----------
using System.IO;
using System.Text;
# ---------- stringtostream: C# ----------
    stream = StringToStream(txt);
# ---------- stringtostream: C# additional code ----------
  public static Stream StringToStream(string input)
  {
    MemoryStream stream = new MemoryStream();
    using (StreamWriter writer = new StreamWriter(stream, Encoding.UTF8, 1024, true))
    {
      writer.Write(input);
      writer.Flush();  // Make sure all data is written to the stream
    }

    // Reset the position of the stream to the beginning
    stream.Position = 0;
    return stream;
  }
# ---------- end stringtostream ----------
stream_export_options = StreamExportOptions(ContentType="svg,image/svg+xml", N=False)
download_svg = DownloadExport(Data=stringtostream.stream, Options=stream_export_options, Name="testSVG")

drawing_to_bitmap = DrawingToBitmap(DrawingsShapesGeometry=construct_drawing.Drawing, PPI=300)  # disabled
mesh_plane = MeshPlane(Boundary=offset_curve, WidthCount=1, HeightCount=1)  # -> Mesh, Area; disabled
gltf_2_0_material = GlTF20Material(
    BaseColorFactor=RGB(255, 255, 255),
    BaseColorTexture=drawing_to_bitmap,
    MetallicFactor=0,
    RoughnessFactor=1,
    EmissiveFactor=RGB(0, 0, 0),
    AlphaMode="BLEND",
    AlphaCutoff=0.5,
    DoubleSided=True)  # disabled
image_export_options = ImageExportOptions(Format="png", QualityLevel=100, N=False)  # disabled
panel_54 = Panel("testImage")  # disabled
download_image = DownloadExport(Data=drawing_to_bitmap, Options=image_export_options, Name=panel_54)  # disabled
gltf_2_0_display = GlTF20Display(Geometry=mesh_plane.Mesh, Material=gltf_2_0_material)  # disabled
