# Grasshopper definition test-flooplan-svg-export.gh (Grasshopper 1.0.8)
# plug-ins: RhinoCodePluginGH, Pufferfish, Human, GraphicPlus, ShapeDiverForGrasshopper, GraphMLAnalyzer

select_reference_apt = ValueList({"Apartment 1", "Apartment 2", "Apartment 3", "Apartment 4"}, selected="Apartment 1")  # disabled
candidate_design = ValueList({"candidate 11001": 0, "candidate 12001": 1, "candidate 12005": 2, "candidate 12009": 3, "candidate 14007": 4, "candidate 14012": 5, "candidate 18003": 6, "candidate 21004": 7, "candidate MSD-399": 8}, selected="candidate 14007")  # disabled

guid = Guid()

curve = Curve([<curve referenced from the Rhino model> x243])
curve_2 = Curve([<curve referenced from the Rhino model> x11])

curve_3 = Curve([<curve referenced from the Rhino model> x11])
curve_4 = Curve([<curve referenced from the Rhino model> x11])

# ---- group: openings
curve_5 = Curve([<curve referenced from the Rhino model> x71])

# ----
point = Point([<point referenced from the Rhino model> x4])
curve_6 = Curve([<curve referenced from the Rhino model> x7])
curve_7 = Curve([<curve referenced from the Rhino model> x7])

# ---- group: CORES
curve_8 = Curve([<curve referenced from the Rhino model> x4])

# ----
curve_closest_point = CurveClosestPoint(Point=point, Curve=curve_8)  # -> Point, Parameter, Distance
boundary_surfaces = BoundarySurfaces(Edges=curve)
python_3_script = Python3Script(roomPolylines=curve_8)  # -> out, a; inputs roomPolylines: list of Curve
# ---------- python_3_script: Python ----------
import Rhino

def curve_to_wkt_polygon(crv):
    rc, poly = crv.TryGetPolyline()
    if rc:
        pts = list(poly)
    else:
        div = 50
        ts = [float(i)/div for i in range(div+1)]
        pts = [crv.PointAt(t) for t in ts]

    if pts[0].DistanceTo(pts[-1]) > 1e-6:
        pts.append(pts[0])

    coord_str = ", ".join(["{} {}".format(p.X, p.Y) for p in pts])
    return "POLYGON(({}))".format(coord_str)


site_id_out = []
building_id_out = []
plan_id_out = []
floor_id_out = []

apartment_id_out = []
unit_id_out = []
area_id_out = []

unit_usage_out = []
entity_type_out = []
entity_subtype_out = []
roomtype_out = []
zoning_out = []
geom_out = []
elevation_out = []
height_out = []

for i, (crv, name, e_sub, z, ap) in enumerate(zip(R, RN, ES, ZN, AP)):
    # IDs and constants
    site_id_out.append(Sid)
    building_id_out.append(Bid)
    plan_id_out.append(Pid)
    floor_id_out.append(Fid)

    # apartment & unit
    ap_id = ap if ap is not None else "COMMON"
    apartment_id_out.append(ap_id)
    unit_id_out.append(ap_id)  # as specified

    # area_id: e.g. A_01_R01 / COMMON_R01
    area_suffix = "R{:02d}".format(i+1)
    area_id = "{}_{}".format(ap_id, area_suffix)
    area_id_out.append(area_id)

    # unit_usage:
    # Zone 1: bedroom-type (Zimmer) → RESIDENTIAL
    # Zone 2: kitchen, corridor, living → RESIDENTIAL
    # Zone 3: bath, WC, storage, Reduit → RESIDENTIAL
    # Zone 4: elevator, shaft, stair core → CIRCULATION_CORE
    if z == 4:
        u_use = "CIRCULATION_CORE"
    else:
        u_use = "RESIDENTIAL"
    unit_usage_out.append(u_use)

    # entity_type is always "area" for rooms
    entity_type_out.append("area")

    # entity_subtype directly from classifier (ROOM, KITCHEN, BATHROOM, CORRIDOR, BALCONY, etc.)
    entity_subtype_out.append(e_sub)

    # roomtype is the label text as-is
    roomtype_out.append(name)

    # zoning integer
    zoning_out.append(z)

    # geometry WKT
    geom_out.append(curve_to_wkt_polygon(crv))

    # elevation & height
    # For rooms:
    #   elevation = floor_elevation (e.g. 0.00)
    #   height = story_height (e.g. 2.50)
    elevation_out.append(float(Elv))
    height_out.append(float(Hst))

# outputs
site_id = site_id_out
building_id = building_id_out
plan_id = plan_id_out
floor_id = floor_id_out

apartment_id = apartment_id_out
unit_id = unit_id_out
area_id = area_id_out

unit_usage = unit_usage_out
entity_type = entity_type_out
entity_subtype = entity_subtype_out
roomtype = roomtype_out
zoning = zoning_out
geom = geom_out
elevation = elevation_out
height = height_out
# ---------- end python_3_script ----------
boundary_surfaces_2 = BoundarySurfaces(Edges=curve_5)
text_object_info = TextObjectInfo()  # -> Plane, Text, Size, Alignment, VerticalAlignment
custom_preview = CustomPreview(Geometry=boundary_surfaces_2, Material=ColourSwatch(SwatchColor=RGB(0, 255, 255)))
custom_preview_2 = CustomPreview(Geometry=boundary_surfaces, Material=ColourSwatch(SwatchColor=RGB(0, 3, 3)))
panel = Panel(text_object_info.Text)
group = Group(Objects=flatten(curve_7))

panel_2 = Panel("C:\Users\panz\Downloads\roomdic_template.json")  # disabled
semantic_graph = SemanticGraph(DictionaryFIlePath=panel_2)  # disabled
panel_3 = Panel(semantic_graph)  # disabled

# ---- group: Local Source_IBC
panel_4 = Panel("C:\Users\panz\Downloads\Dolphin_4\sample_AgraphMLs\AgraphMLs\Roomgraph_0g1LxT9G8NLrgwoAht0_0.0.graphml")  # disabled
panel_5 = Panel("C:\Users\panz\Downloads\Dolphin_4\sample_AgraphMLs\AgraphMLs\")  # disabled
toggle = BooleanToggle(True)  # disabled
agraphmlreader = AgraphMLAgraphMLReader(FolderPath=panel_5)  # -> AgraphMLs, Amount, File; disabled
agraphmlfilechecker = AgraphMLFileChecker(AgraphMLFilePath=panel_4, SupressWarnings=toggle)  # -> ListOfErrors, StateOfResult, AGraphMLString; disabled
panel_6 = Panel(agraphmlreader.Amount)  # disabled
panel_7 = Panel(agraphmlfilechecker.AGraphMLString)  # disabled
panel_8 = Panel(agraphmlfilechecker.ListOfErrors)  # disabled
panel_9 = Panel(agraphmlreader.File)  # disabled
panel_10 = Panel(agraphmlreader.AgraphMLs)  # disabled

# ---- group: Local Source_samples
panel_11 = Panel("C:\Users\panz\Downloads\Dolphin_4\sample_AgraphMLs\AgraphMLs\Roomgraph_0g1LxT9G8NLrgwoAht0_0.0.graphml")  # disabled
panel_12 = Panel("C:\Users\panz\Downloads\Dolphin_4\sample_AgraphMLs\AgraphMLs\")  # disabled
toggle_2 = BooleanToggle(True)  # disabled
agraphmlreader_2 = AgraphMLAgraphMLReader(FolderPath=panel_12)  # -> AgraphMLs, Amount, File; disabled
agraphmlfilechecker_2 = AgraphMLFileChecker(AgraphMLFilePath=panel_11, SupressWarnings=toggle_2)  # -> ListOfErrors, StateOfResult, AGraphMLString; disabled
panel_13 = Panel(agraphmlreader_2.Amount)  # disabled
panel_14 = Panel(agraphmlfilechecker_2.AGraphMLString)  # disabled
panel_15 = Panel(agraphmlfilechecker_2.ListOfErrors)  # disabled
panel_16 = Panel(agraphmlreader_2.File)  # disabled
panel_17 = Panel(agraphmlreader_2.AgraphMLs)  # disabled

# ----
group_2 = Group(Objects=flatten(curve_6))
group_3 = Group(Objects=flatten(curve_4))
group_4 = Group(Objects=flatten(curve_3))

group_5 = Group(Objects=flatten(curve_2))
bounding_rectangle = BoundingRectangle(Geometry=group_5, Plane=PlaneXY(0, 0, 0), Axis=0, Slide=0, Union=True)  # -> Bounding, DimensionX, DimensionY
area = Area(Geometry=bounding_rectangle.Bounding)  # -> Area, Centroid
scale = Scale(Geometry=curve_2, Center=area.Centroid, Factor="1")  # -> Geometry, Transform

group_6 = Group(Objects=flatten(curve_8))
bounding_rectangle_2 = BoundingRectangle(Geometry=group_6, Plane=PlaneXY(0, 0, 0), Axis=0, Slide=0, Union=True)  # -> Bounding, DimensionX, DimensionY
area_2 = Area(Geometry=bounding_rectangle_2.Bounding)  # -> Area, Centroid
scale_2 = Scale(Geometry=curve_8, Center=area_2.Centroid, Factor="1")  # -> Geometry, Transform

bounding_rectangle_3 = BoundingRectangle(Geometry=group, Plane=PlaneXY(0, 0, 0), Axis=0, Slide=0, Union=True)  # -> Bounding, DimensionX, DimensionY
bounding_rectangle_4 = BoundingRectangle(Geometry=group_2, Plane=PlaneXY(0, 0, 0), Axis=0, Slide=0, Union=True)  # -> Bounding, DimensionX, DimensionY
bounding_rectangle_5 = BoundingRectangle(Geometry=group_3, Plane=PlaneXY(0, 0, 0), Axis=0, Slide=0, Union=True)  # -> Bounding, DimensionX, DimensionY
bounding_rectangle_6 = BoundingRectangle(Geometry=group_4, Plane=PlaneXY(0, 0, 0), Axis=0, Slide=0, Union=True)  # -> Bounding, DimensionX, DimensionY
area_3 = Area(Geometry=bounding_rectangle_3.Bounding)  # -> Area, Centroid
area_4 = Area(Geometry=bounding_rectangle_4.Bounding)  # -> Area, Centroid
area_5 = Area(Geometry=bounding_rectangle_5.Bounding)  # -> Area, Centroid
area_6 = Area(Geometry=bounding_rectangle_6.Bounding)  # -> Area, Centroid
scale_3 = Scale(Geometry=curve_7, Center=area_3.Centroid, Factor="1")  # -> Geometry, Transform
scale_4 = Scale(Geometry=curve_6, Center=area_4.Centroid, Factor="1")  # -> Geometry, Transform
scale_5 = Scale(Geometry=curve_4, Center=area_5.Centroid, Factor="1")  # -> Geometry, Transform
scale_6 = Scale(Geometry=curve_3, Center=area_6.Centroid, Factor="1")  # -> Geometry, Transform
scale_7 = Scale(Geometry=curve_5, Center=area.Centroid, Factor="1")  # -> Geometry, Transform
scale_8 = Scale(Geometry=curve, Center=area.Centroid, Factor="1")  # -> Geometry, Transform

group_7 = Group(Objects=flatten(scale.Geometry))
offset_for_frame = Panel("1000")
bounding_rectangle_7 = BoundingRectangle(Geometry=group_7, Plane=PlaneXY(0, 0, 0), Axis=0, Slide=0, Union=True)  # -> Bounding, DimensionX, DimensionY
area_7 = Area(Geometry=bounding_rectangle_7.Bounding)  # -> Area, Centroid
offset_curve = OffsetCurve(Curve=bounding_rectangle_7.Bounding, Distance=offset_for_frame, Corners=1)  # -> flatten(Curve)
bounding_rectangle_8 = BoundingRectangle(Geometry=offset_curve, Plane=PlaneXY(0, 0, 0), Axis=0, Slide=0, Union=True)  # -> Bounding, DimensionX, DimensionY

match_text = MatchText(Text="WALL", Case=True)
dispatch = Dispatch(DispatchPattern=match_text)  # -> ListA, ListB
dispatch_2 = Dispatch(List=scale_8.Geometry, DispatchPattern=match_text)  # -> ListA, ListB

# ---- group: TEXT
font_size = Panel("60")
text_shape = TextShape(Plane=text_object_info.Plane)
font = Font(TextShape=text_shape, FontFamily="Arial", FontSize=font_size, Bold=False, Italic=False, Underline=False, Justification=4)
shape_link = ShapeLink(ShapeGeometry=font, Hyperlink="https://www.shapediver.com")
shape_data = ShapeData(ShapeGeometry=shape_link, ID="thisIsText")
shape_settings = ShapeSettings(ShapeGeometry=shape_data, Layer="main :: text")

# ----
panel_18 = Panel("""Key 1
Key 2""")
stroke = Stroke(ShapeGeometry=scale_5.Geometry, Color="0,0,0", Weight="6", Pattern="10", EndCap=0)
custom_preview_lineweights = CustomPreviewLineweights(
    Geometry=scale_5.Geometry,
    Shader=ColourSwatch(SwatchColor=RGB(0, 0, 0)),
    Thickness=Slider(3, range=1..10),
    Absolute=False)
shape_data_2 = ShapeData(ShapeGeometry=stroke, ID="thisIsCircle", Keys=panel_18)
shape_settings_2 = ShapeSettings(ShapeGeometry=shape_data_2, Layer="main :: area")

panel_19 = Panel("""Key 1
Key 2""")
stroke_2 = Stroke(ShapeGeometry=scale_3.Geometry, Color="0,0,0", Weight="6", Pattern="10", EndCap=0)
custom_preview_lineweights_2 = CustomPreviewLineweights(
    Geometry=scale_3.Geometry,
    Shader=ColourSwatch(SwatchColor=RGB(0, 0, 0)),
    Thickness=Slider(3, range=1..10),
    Absolute=False)
shape_data_3 = ShapeData(ShapeGeometry=stroke_2, ID="thisIsCircle", Keys=panel_19)
shape_settings_3 = ShapeSettings(ShapeGeometry=shape_data_3, Layer="main :: area")

panel_20 = Panel("""Key 1
Key 2""")
stroke_3 = Stroke(ShapeGeometry=scale_4.Geometry, Color="0,0,0", Weight="6", Pattern="10", EndCap=0)
custom_preview_lineweights_3 = CustomPreviewLineweights(
    Geometry=scale_4.Geometry,
    Shader=ColourSwatch(SwatchColor=RGB(0, 0, 0)),
    Thickness=Slider(3, range=1..10),
    Absolute=False)
shape_data_4 = ShapeData(ShapeGeometry=stroke_3, ID="thisIsCircle", Keys=panel_20)
shape_settings_4 = ShapeSettings(ShapeGeometry=shape_data_4, Layer="main :: area")

panel_21 = Panel("""Key 1
Key 2""")
stroke_4 = Stroke(ShapeGeometry=scale_6.Geometry, Color="0,0,0", Weight="6", Pattern="10", EndCap=0)
custom_preview_lineweights_4 = CustomPreviewLineweights(
    Geometry=scale_6.Geometry,
    Shader=ColourSwatch(SwatchColor=RGB(0, 0, 0)),
    Thickness=Slider(3, range=1..10),
    Absolute=False)
shape_data_5 = ShapeData(ShapeGeometry=stroke_4, ID="thisIsCircle", Keys=panel_21)
shape_settings_5 = ShapeSettings(ShapeGeometry=shape_data_5, Layer="main :: area")

panel_22 = Panel("""Key 1
Key 2""")
stroke_5 = Stroke(ShapeGeometry=scale.Geometry, Color="0,0,0", Weight="6", Pattern="10", EndCap=0)
custom_preview_lineweights_5 = CustomPreviewLineweights(Geometry=scale.Geometry, Shader=ColourSwatch(SwatchColor=RGB(0, 0, 0)), Thickness=Slider(3, range=1..10), Absolute=False)
shape_data_6 = ShapeData(ShapeGeometry=stroke_5, ID="thisIsCircle", Keys=panel_22)
shape_settings_6 = ShapeSettings(ShapeGeometry=shape_data_6, Layer="main :: area")

panel_23 = Panel("""Key 1
Key 2""")
stroke_6 = Stroke(ShapeGeometry=scale_2.Geometry, Color="0,0,0", Weight="6", Pattern="10", EndCap=0)
custom_preview_lineweights_6 = CustomPreviewLineweights(
    Geometry=scale_2.Geometry,
    Shader=ColourSwatch(SwatchColor=RGB(0, 0, 0)),
    Thickness=Slider(3, range=1..10),
    Absolute=False)
shape_data_7 = ShapeData(ShapeGeometry=stroke_6, ID="thisIsCircle", Keys=panel_23)
shape_settings_7 = ShapeSettings(ShapeGeometry=shape_data_7, Layer="main :: area")

match_text_2 = MatchText(Text="DOOR", Pattern=dispatch.ListB, Case=True)
dispatch_3 = Dispatch(List=dispatch_2.ListB, DispatchPattern=match_text_2)  # -> ListA, ListB
curve_9 = Curve(dispatch_3.ListA)

dispatch_4 = Dispatch(List=dispatch.ListB, DispatchPattern=match_text_2)  # -> ListA, ListB
panel_24 = Panel(dispatch_4.ListA)
number_slider = Slider(127.483, range=0..410)
colour_swatch = ColourSwatch(SwatchColor=RGB(76, 76, 76))

curve_10 = Curve(dispatch_3.ListB)
evaluate_curve = EvaluateCurve(Curve=curve_10, Parameter=0.5)  # -> Point, Tangent, Angle
panel_25 = Panel(dispatch_4.ListB)
text_tag_3d = TextTag3D(Location=evaluate_curve.Point, Text=panel_25, Size=number_slider, Colour=colour_swatch, Justification=5)
custom_preview_lineweights_7 = CustomPreviewLineweights(Geometry=curve_10, Shader=ColourSwatch(SwatchColor=RGB(250, 217, 0)), Absolute=False)

# ---- group: Filter
# Syntax für FilterRules:
# 
# id:id1|id2|id3
# roomType:<typ_1>|<type_2>|...|<type_n>
# roomName:<name>
# zone:<name>
# windowExist:<true or false>
# enclosedRoom:<true or false>
# light:[<= >= != < > =] <number>
# privacy:[<= >= != < > =] <number>
# area:[<= >= != < > =] <number>
# corners:[<= >= != < > =] <number>
# edgeType:<one of below> [<= >= != < > =] <number>
# 
# ANY
# CONNECTION
# DOOR
# ENTRY
# PASSAGE
# WALL
# WINDOW
# 
# Leerzeilen werden ignoriert!
# //das ist ein Kommentar
panel_26 = Panel("""roomType:BATH|SLEEPING|WORKING|LIVING
area:>3
edgeType:ANY >= 2
aaa//ich bin ein Fehler
//ich bin ein kommentar

//leerzeilen werden ignoriert""")  # disabled
list = ValueList({"id", "roomType", "roomName", "zone", "windowExist", "enclosedRoom", "light", "privacy", "area", "center", "corners"}, selected="area")  # disabled
data = Data(agraphmlreader_2.AgraphMLs)  # disabled
data_2 = Data(agraphmlfilechecker_2.AGraphMLString)  # disabled
agraphmlfilter = AgraphMLAgraphMLFilter(AgraphMLs=data, FilterRules=panel_26)  # -> AgraphMLs, Amount, FilterInfo, ErrorList; disabled
agraphmlroomfilter = AgraphMLRoomFilter(AgraphML=data_2, FilterRules=panel_26, Info=list)  # -> AgraphML, Info, ErrorList; disabled
panel_27 = Panel(agraphmlroomfilter.ErrorList)  # disabled
panel_28 = Panel(agraphmlfilter.ErrorList)  # disabled
panel_29 = Panel(agraphmlfilter.AgraphMLs)  # disabled
panel_30 = Panel(agraphmlfilter.FilterInfo)  # disabled
panel_31 = Panel(agraphmlroomfilter.AgraphML)  # disabled
panel_32 = Panel(agraphmlroomfilter.Info)  # disabled
panel_33 = Panel(agraphmlfilter.Amount)  # disabled

# ----
evaluate_curve_2 = EvaluateCurve(Curve=curve_9, Parameter=0.5)  # -> Point, Tangent, Angle
text_tag_3d_2 = TextTag3D(
    Location=scale_7.Geometry,
    Size=Slider(151.333, range=0..260),
    Colour=ColourSwatch(SwatchColor=RGB(76, 76, 76)),
    Justification=5)
custom_preview_lineweights_8 = CustomPreviewLineweights(Geometry=curve_9, Shader=ColourSwatch(SwatchColor=RGB(0, 250, 54)), Absolute=False)
text_tag_3d_3 = TextTag3D(Location=evaluate_curve_2.Point, Text=panel_24, Size=number_slider, Colour=colour_swatch, Justification=5)
merge = Merge(Data1=shape_settings_7, Data2=shape_settings_6, Data3=shape_settings_5, Data4=shape_settings_2, Data5=shape_settings_4)

panel_34 = Panel(merge)
construct_drawing = ConstructDrawing(
    ShapesGeometry=merge,
    Boundary=offset_curve,
    Width=bounding_rectangle_8.DimensionX,
    Height=bounding_rectangle_8.DimensionY,
    Color=RGBA(255, 255, 255, 0),
    Units=4)  # -> Drawing, Boundary
svg_text = SVGText(DrawingsShapesGeometry=construct_drawing.Drawing)
stringtostream = CSharpScript(txt=svg_text)  # -> out, stream; inputs txt: String
# ---------- stringtostream: C# usings ----------
using System.IO;
using System.Text;
# ---------- stringtostream: C# ----------
    stream = StringToStream(txt);
# ---------- stringtostream: C# additional code ----------
  public static Stream StringToStream(string input)
  {
    MemoryStream stream = new MemoryStream();
    using (StreamWriter writer = new StreamWriter(stream, Encoding.UTF8, 1024, true))
    {
      writer.Write(input);
      writer.Flush();  // Make sure all data is written to the stream
    }

    // Reset the position of the stream to the beginning
    stream.Position = 0;
    return stream;
  }
# ---------- end stringtostream ----------
stream_export_options = StreamExportOptions(ContentType="svg,image/svg+xml", N=False)
download_svg = DownloadExport(Data=stringtostream.stream, Options=stream_export_options, Name="DohlenWegtestSVG")

drawing_to_bitmap = DrawingToBitmap(DrawingsShapesGeometry=construct_drawing.Drawing, PPI=300)  # disabled
mesh_plane = MeshPlane(Boundary=offset_curve, WidthCount=1, HeightCount=1)  # -> Mesh, Area; disabled
gltf_2_0_material = GlTF20Material(
    BaseColorFactor=RGB(255, 255, 255),
    BaseColorTexture=drawing_to_bitmap,
    MetallicFactor=0,
    RoughnessFactor=1,
    EmissiveFactor=RGB(0, 0, 0),
    AlphaMode="BLEND",
    AlphaCutoff=0.5,
    DoubleSided=True)  # disabled
image_export_options = ImageExportOptions(Format="png", QualityLevel=100, N=False)  # disabled
panel_35 = Panel("testImage")  # disabled
download_image = DownloadExport(Data=drawing_to_bitmap, Options=image_export_options, Name=panel_35)  # disabled
gltf_2_0_display = GlTF20Display(Geometry=mesh_plane.Mesh, Material=gltf_2_0_material)  # disabled

# ----
# READ json
# with floorplan
panel_36 = Panel("""candidate design 11001
candidate design 12001
candidate design 12005
candidate design 12009
candidate design 14007
candidate design 14012
candidate design 18003
candidate design 21004
MSD Building_ID: 399
MSD Building_ID: XXX""")  # disabled
path = FilePath("C:\Users\panz\Documents\GitHub\2025-AEC-Hackathon\json\GenericDesign_11001\11001.json")  # disabled
path_2 = FilePath("C:\Users\panz\Documents\GitHub\2025-AEC-Hackathon\json\GenericDesign_12005\12005.json")  # disabled
path_3 = FilePath("C:\Users\panz\Documents\GitHub\2025-AEC-Hackathon\json\GenericDesign_12001\12001.json")  # disabled
path_4 = FilePath("C:\Users\panz\Documents\GitHub\2025-AEC-Hackathon\json\GenericDesign_14012\14012.json")  # disabled
path_5 = FilePath("C:\Users\panz\Documents\GitHub\2025-AEC-Hackathon\json\GenericDesign_12009\12009.json")  # disabled
path_6 = FilePath("C:\Users\panz\Documents\GitHub\2025-AEC-Hackathon\json\GenericDesign_14007\14007.json")  # disabled
path_7 = FilePath("C:\Users\panz\Documents\GitHub\2025-AEC-Hackathon\json\GenericDesign_18003\18003.json")  # disabled
path_8 = FilePath("C:\Users\panz\Documents\GitHub\2025-AEC-Hackathon\json\GenericDesign_21004\21004.json")  # disabled
list_item = ListItem(List=panel_36, Index=candidate_design, Wrap=True)  # disabled

# ----
# aGraphML detection and creation
# aGraphML analyses
path_9 = FilePath("C:\Users\panz\Documents\GitHub\IBC\05_Floorplan_processing\45613.json")  # disabled
path_10 = FilePath("C:\Users\panz\Documents\GitHub\IBC\05_Floorplan_processing\45774.json")  # disabled
panel_37 = Panel(agraphmlfilechecker.StateOfResult)  # disabled
panel_38 = Panel(agraphmlfilechecker_2.StateOfResult)  # disabled
panel_39 = Panel("2")  # disabled

filter = StreamFilter(
    Gate=candidate_design,
    Stream0=path,
    Stream1=path_3,
    Stream2=path_2,
    Stream3=path_5,
    Stream4=path_6,
    Stream5=path_4,
    Stream6=path_7,
    Stream7=path_8,
    Stream8=path_9,
    Stream9=path_10)  # disabled

panel_40 = Panel(filter)  # disabled

# ---- group: Statistics
# Decimals is optional input!
# Right Click on component name (e.g. RoomAreaShare) to reveal additional menu items like the sorting option.
# Area Shares sum up to 1 (or 100, depending on representation)
# Every component offers a short description by dragging the mouse over the component's name.
# The outputs are currently two lists: edgetype labels and the corresponding values. Every entry in the first list corresponds to an entry in the second list. (e.g. The LIVING item of the first list has an area share of 25.9 percent)
# Both Roomtypes can be the same. In this case, the component checks if two rooms of the same types are connected
# Use the right-click menu to output probabilistic values instead of average edge count values
data_3 = Data(agraphmlreader_2.AgraphMLs)  # disabled
data_4 = Data(agraphmlreader_2.AgraphMLs)  # disabled
panel_41 = Panel("CORRIDOR")  # disabled
panel_42 = Panel("KITCHEN")  # disabled
data_5 = Data(agraphmlreader_2.AgraphMLs)  # disabled
panel_43 = Panel("CORRIDOR")  # disabled
roomareashare = AgraphMLRoomAreaShareCalculator(AGraphMLList=data_3, Decimals=3)  # -> RoomTypes, AreaShares; disabled
room_2_room_edges = AGraphMLRoom2RoomEdgeOccurrences(AGraphMLList=data_4, Roomtype1=panel_41, Roomtype2=panel_42, DecimalsRounding=panel_39)  # -> Edgetypes, EdgeProbabilities; disabled
averageroomedges = AGraphMLAverageEdgeOccurrencesForOneRoomtype(AGraphMLList=data_5, Roomtype=panel_43, DecimalsRounding=panel_39)  # -> EdgetypeLabels, EdgetypeCount; disabled
panel_44 = Panel(room_2_room_edges.Edgetypes)  # disabled
panel_45 = Panel(room_2_room_edges.EdgeProbabilities)  # disabled
panel_46 = Panel(averageroomedges.EdgetypeLabels)  # disabled
panel_47 = Panel(averageroomedges.EdgetypeCount)  # disabled
panel_48 = Panel(roomareashare.RoomTypes)  # disabled
panel_49 = Panel(roomareashare.AreaShares)  # disabled
