# Grasshopper definition ReadJsonAndCreateGeometry_5python.gh (Grasshopper 1.0.8)
# plug-ins: RhinoCodePluginGH, Speckle 2, Pufferfish, Human

select_reference_design = ValueList({"reference design 01": 0, "reference design 02": 1, "reference design 03": 2}, selected="reference design 02")
select_reference_apt = ValueList({"Apartment 1", "Apartment 2", "Apartment 3", "Apartment 4"}, selected="Apartment 2")

candidate_design = ValueList({"candidate 11001": 0, "candidate 12001": 1, "candidate 12005": 2, "candidate 12009": 3, "candidate 14007": 4, "candidate 14012": 5, "candidate 18003": 6, "candidate 21004": 7}, selected="candidate 14012")
select_reference_apt_2 = ValueList({"Apartment 1", "Apartment 2", "Apartment 3", "Apartment 4"}, selected="Apartment 1")

# ----
# READ json
# with floorplan
path = FilePath("C:\Users\panz\Documents\GitHub\2025-AEC-Hackathon\json\GenericDesign_12001\12001.json")
path_2 = FilePath("C:\Users\panz\Documents\GitHub\2025-AEC-Hackathon\json\GenericDesign_11001\11001.json")
path_3 = FilePath("C:\Users\panz\Documents\GitHub\2025-AEC-Hackathon\json\GenericDesign_12005\12005.json")
path_4 = FilePath("C:\Users\panz\Documents\GitHub\2025-AEC-Hackathon\json\GenericDesign_14012\14012.json")
panel = Panel("""candidate design 11001
candidate design 12001
candidate design 12005
candidate design 12009
candidate design 14007
candidate design 14012
candidate design 18003
candidate design 21004""")
path_5 = FilePath("C:\Users\panz\Documents\GitHub\2025-AEC-Hackathon\json\GenericDesign_12009\12009.json")
path_6 = FilePath("C:\Users\panz\Documents\GitHub\2025-AEC-Hackathon\json\GenericDesign_14007\14007.json")
path_7 = FilePath("C:\Users\panz\Documents\GitHub\2025-AEC-Hackathon\json\GenericDesign_18003\18003.json")
path_8 = FilePath("C:\Users\panz\Documents\GitHub\2025-AEC-Hackathon\json\GenericDesign_21004\21004.json")
list_item = ListItem(List=panel, Index=candidate_design, Wrap=True)
filter = StreamFilter(
    Gate=candidate_design,
    Stream0=path_2,
    Stream1=path,
    Stream2=path_3,
    Stream3=path_5,
    Stream4=path_6,
    Stream5=path_4,
    Stream6=path_7,
    Stream7=path_8)

list_of_implenia_design = Panel("""reference design 01
reference design 02
reference design 03""")
path_9 = FilePath("C:\Users\panz\Documents\GitHub\2025-AEC-Hackathon\json\ReferenceDesign_01\Reference01.json")
path_10 = FilePath("C:\Users\panz\Documents\GitHub\IBC\05_Flooplan_processing\jsonExports\ReferenceDesign_02\ReferenceDesign_02_EP_bom.json")
list_item_2 = ListItem(List=list_of_implenia_design, Index=select_reference_design, Wrap=True)
filter_2 = StreamFilter(Gate=select_reference_design, Stream0=path_9, Stream1=path_10)

panel_2 = Panel("""153,137,255
151,255,255
153,137,255
153,137,255
151,255,255
153,137,255
150,150,150
0,150,200
255,100,0""")
panel_3 = Panel("""core
living_room
dining
bedroom
bathroom
kitchen
storeroom
stairs
corridor
balcony""")
balcony = ColourSwatch(SwatchColor=RGB(199, 201, 255))
bedroom = ColourSwatch(SwatchColor=RGB(214, 178, 192))
core = ColourSwatch(SwatchColor=RGB(156, 156, 156))
living_room = ColourSwatch(SwatchColor=RGB(217, 208, 147))
bathroom = ColourSwatch(SwatchColor=RGB(38, 84, 122))
dining = ColourSwatch(SwatchColor=RGB(82, 55, 55))
kitchen = ColourSwatch(SwatchColor=RGB(212, 162, 0))
storeroom = ColourSwatch(SwatchColor=RGB(120, 120, 120))
corridor = ColourSwatch(SwatchColor=RGB(0, 6, 194))
stairs = ColourSwatch(SwatchColor=RGB(55, 76, 82))
merge = Merge(
    Data1=core,
    Data2=living_room,
    Data3=dining,
    Data4=bedroom,
    Data5=bathroom,
    Data6=kitchen,
    Data7=storeroom,
    Data8=stairs,
    Data9=corridor,
    Data10=balcony)

# ----
# Save one image
view_to_capture = Panel("Parallel_01")
panel_4 = Panel("C:\Users\panz\Implenia AG\Innosuisse - Intelligent Configurator - Dokumente\04_images_screenshots\")
view_to_capture_2 = Panel("1080")
view_to_capture_3 = Panel("1920")
concat = Concatenate(FragmentA=list_item)
save_image = Button()
captureview = LBCaptureView(
    file_name=concat,
    folder=panel_4,
    viewport=view_to_capture,
    width=view_to_capture_3,
    height=view_to_capture_2,
    capture=save_image)  # -> Output; plug-in component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
panel_5 = Panel(captureview)

panel_6 = Panel(list_item_2)
path_11 = FilePath(filter_2)

# ---- group: sanity check
compare_reference_design_with = ValueList({"candidate designs": 0, "reference designs": 1}, selected="candidate designs")
filter_3 = StreamFilter(Gate=compare_reference_design_with, Stream0=filter, Stream1=path_11)
filter_4 = StreamFilter(Gate=compare_reference_design_with, Stream0=list_item, Stream1=list_item_2)

# ----
panel_7 = Panel(filter_4)
path_12 = FilePath(filter_3)

# ----
# TO DO fix the panel index
# GET WALL PROPERTIES
list = ValueList({"select single item (Wall panel)": 0, "select multiple items (Wall panel)": 1}, selected="select multiple items (Wall panel)")
select_item = Slider(35, range=0..76)
series = Series(Start=0, Step=1, Count=select_item)
filter_5 = StreamFilter(Gate=list, Stream0=select_item, Stream1=series)
python = GhPythonScript(file=path_12, panelIndex=filter_5)  # -> out, PanelType, StartPoint, EndPoint, Height, Thickness, RoomType, ApartmentName; inputs panelIndex: Int32
# ---------- python: Python ----------
__author__ = "panz"
__version__ = "2024.11.11"

import rhinoscriptsyntax as rs
import json
import json
import Rhino.Geometry as rg

# Read and parse JSON data from the file
with open(file, 'r') as inputfile:
    data = json.load(inputfile)

# Extract panel information
panels = data["panels"]["items"]
if not panels:
    print("Warning: 'panels.items' key is missing or empty in JSON.")
    
# Extract apartment outlines from 'spaces'
spaces_data = data.get("spaces", {})


# Initialize lists to store panel data
panel_types = []
start_points = []
end_points = []
heights = []
thicknesses = []
roomTypes = []
apartmentNames = []



# Loop through each panel and extract relevant information
for key, panel in panels.items():
    panel_types.append(panel.get("panel_type"))
    start_points.append(panel.get("start_point"))
    end_points.append(panel.get("end_point"))
    heights.append(panel.get("height"))
    thicknesses.append(panel.get("thickness"))
    roomTypes.append(panel.get("room"))
    apartmentNames.append(panel.get("apartment", "N/A"))          # Default: "N/A"


# Assume 'index' is passed as an argument (in a Grasshopper environment, for example)

PanelType = panel_types[panelIndex]
StartPoint = start_points[panelIndex]
EndPoint = end_points[panelIndex]
Height = heights[panelIndex]
Thickness = thicknesses[panelIndex]
RoomType = roomTypes[panelIndex]
ApartmentName = apartmentNames[panelIndex]



print("Panel Type:", PanelType)
print("Start Point:", StartPoint)
print("End Point:", EndPoint)
print("Height:", Height)
print("Thickness:", Thickness)
print("Room Type:", RoomType)
print("Apartment:", ApartmentName)
# ---------- end python ----------

# ---- group: older version ve0.1
python_2 = GhPythonScript(file=path_12)  # -> out, apartmentNames, roomTypes, roomPolylines, roomSurfaces, roomColors, roomCombos; disabled
# ---------- python_2: Python ----------
__author__ = "panz"
__version__ = "2024.11.11"

import rhinoscriptsyntax as rs
import json
import json
import Rhino.Geometry as rg

# Read and parse JSON data from the file
with open(file, 'r') as inputfile:
    data = json.load(inputfile)

# Extract panels (walls) data
panels_data = data.get("panels", {}).get("items", {})
if not panels_data:
    print("Warning: 'panels.items' key is missing or empty in JSON.")
    
# Extract apartment outlines from 'spaces'
spaces_data = data.get("spaces", {})
roomOutlines = []
roomPolylines =[]
apartmentNames = []
roomTypes = []
roomColors = []
roomSurfaces = []
roomCombos = []

for space_id, space in spaces_data.items():
    coordinates = space.get("coordinates")
    roomTypes.append(space.get("room_type"))
    apartmentNames.append(space.get("apartment"))
    outline_points = [[point["x"], point["y"], point["z"]] for point in coordinates]
    roomOutlines.append(outline_points)
print ("there are ", len(roomOutlines), "rooms in the json file")

roomCounter = 0 

for index in range (0, len(spaces_data)):
    roomOutline = roomOutlines[index] 
    # Convert the point lists into Rhino Point3d objects
    polyline_points = [rg.Point3d(point[0], point[1], point[2]) for point in roomOutline]
    
    # Create the polyline using the list of Point3d objects
    polyline = rg.Polyline(polyline_points)
    #assign colors based on room type
    print(roomTypes[index])
    if (roomTypes[index] == "living_room"):
        roomColors.append('255,100,0')
    elif (roomTypes[index] == "bedroom"):
        roomColors.append('153,137,255')
    elif (roomTypes[index] == "kitchen"):
        print ("got here")
        roomColors.append('0,0,220')
        roomCombos.append(polyline)
    elif (roomTypes[index] == "corridor"):
        print ("got here")
        roomColors.append('0,150,200')
        roomCombos.append(polyline)
    elif (roomTypes[index] == "bathroom"):
        print ("got here")
        roomColors.append('151,255,255')
        roomCombos.append(polyline)
    elif (roomTypes[index] == "core"):
        roomColors.append('150,150,150')

    # create a surface
    roomSrfs = rg.Brep.CreatePlanarBreps(polyline.ToNurbsCurve())
    roomSurfaces.append(roomSrfs[0])
    # Ensure the polyline is closed if necessary (optional)
    if not polyline.IsClosed:
        polyline.Add(polyline[0])  # Add the first point to close the polyline
        
    # Output the polyline (e.g., to Grasshopper)
    roomPolylines.append(polyline)
    roomCounter +=1 
    

    print ("created", roomCounter, "space polylines")
    print(roomSurfaces)
# ---------- end python_2 ----------

# ----
# GET  spaces, and Generate
# bounding rectangles for Reference
python_3_script = Python3Script(file=path_11, roomTypeKeys=panel_3, roomColorValues=merge)  # -> out, apartmentNames, roomTypes, roomPolylines, roomSurfaces, roomColors, possibleBoundingRect; inputs roomTypeKeys: list, roomColorValues: list
# ---------- python_3_script: Python ----------
"""Grasshopper Script"""
import System
__author__ = "panz"
__version__ = "2024.11.11"

import rhinoscriptsyntax as rs
import json
import Rhino.Geometry as rg

# Read and parse JSON data from the file
with open(file, 'r') as inputfile:
    data = json.load(inputfile)

# Extract panels (walls) data
panels_data = data.get("panels", {}).get("items", {})
if not panels_data:
    print("Warning: 'panels.items' key is missing or empty in JSON.")
    
# Extract apartment outlines from 'spaces'
spaces_data = data.get("spaces", {})
roomOutlines = []
roomPolylines = []
apartmentNames = []
roomTypes = []
roomColors = []
roomSurfaces = []
possibleBoundingRect = []

for space_id, space in spaces_data.items():
    coordinates = space.get("coordinates")
    roomTypes.append(space.get("room_type"))
    apartmentNames.append(space.get("apartment"))
    outline_points = [[point["x"], point["y"], point["z"]] for point in coordinates]
    roomOutlines.append(outline_points)

print("There are", len(roomOutlines), "rooms in the JSON file")

roomCounter = 0 
#TO DO CALCULATE AREA OF APARMENT AND EXCLUDE CRVS THAT ARE LARGER THAN THAT
#TO DO ADD a dictionary where you mape roomTypes to Specific Colors that you get as input

# Selected room types
selectedRoomTypes = ["kitchen", "corridor", "bathroom"]

#create a dictionary with room type keys nad color value
room_color_map = dict(zip(roomTypeKeys, roomColorValues))


print("looking to create bounding rect for", selectedRoomTypes)
for index in range(len(spaces_data)):
    roomOutline = roomOutlines[index] 
    polyline_points = [rg.Point3d(point[0], point[1], point[2]) for point in roomOutline]
    polyline = rg.Polyline(polyline_points)

    # Assign colors and store rooms for bounding box calculation
    
    # Assign color using the dictionary, default to gray if missing
    roomType = roomTypes[index]
    roomColor = room_color_map.get(roomType, System.Drawing.Color.Gray)
    roomColors.append(roomColor)
    
    if roomType in selectedRoomTypes:  # Selected room types
        possibleBoundingRect.append(polyline)

    # Create a surface from the polyline
    roomSrfs = rg.Brep.CreatePlanarBreps(polyline.ToNurbsCurve())
    roomSurfaces.append(roomSrfs[0])

    # Ensure the polyline is closed
    if not polyline.IsClosed:
        polyline.Add(polyline[0])
        
    roomPolylines.append(polyline)
    roomCounter += 1 

print("Created", roomCounter, "space outlines")

# ==========================
# BOUNDING RECTANGLE LOGIC
# ==========================

def get_bounding_rectangle(polylines):
    """Finds the bounding box for a list of polylines."""
    all_points = []
    
    for polyline in polylines:
        all_points.extend(list(polyline)) 

    if not all_points:
        return None  # Avoid errors if list is empty

    # Find min/max X and Y
    min_x, max_x = min(pt.X for pt in all_points), max(pt.X for pt in all_points)
    min_y, max_y = min(pt.Y for pt in all_points), max(pt.Y for pt in all_points)

    # Define the rectangle corners
    corners = [
        rg.Point3d(min_x, min_y, 0),
        rg.Point3d(max_x, min_y, 0),
        rg.Point3d(max_x, max_y, 0),
        rg.Point3d(min_x, max_y, 0),
        rg.Point3d(min_x, min_y, 0)  # Closing the rectangle
    ]

    return rg.Polyline(corners)

possible_bounding_rects = []

# Compute bounding box for all selected rooms
bounding_rect = get_bounding_rectangle(possibleBoundingRect)
possible_bounding_rects.append(bounding_rect)


# Compute bounding boxes for pairs of rooms
for i in range(len(possibleBoundingRect)):
    for j in range(i + 1, len(possibleBoundingRect)):
        pair_rect = get_bounding_rectangle([possibleBoundingRect[i], possibleBoundingRect[j]])
        if pair_rect:
            possible_bounding_rects.append(pair_rect)
possibleBoundingRect = possible_bounding_rects
print("Generated", len(possible_bounding_rects), "bounding rectangles for room pairs.")
# ---------- end python_3_script ----------
bounding_rectangle = BoundingRectangle(Geometry=python_3_script.roomPolylines, Plane=PlaneXY(0, 0, 0), Axis=0, Slide=0, Union=True)  # -> Bounding, DimensionX, DimensionY
replace_nulls = ReplaceNulls(Items=python_3_script.apartmentNames, Replacements="Core")  # -> Items, Count
area = Area(Geometry=bounding_rectangle.Bounding)  # -> Area, Centroid
panel_8 = Panel(replace_nulls.Items)

# ---- group: older version ve0.2
python_3_script_2 = Python3Script(file=path_12)  # -> out, apartmentNames, roomTypes, roomPolylines, roomSurfaces, roomColors, possibleBoundingRect; disabled
# ---------- python_3_script_2: Python ----------
"""Grasshopper Script"""
a = "Hello Python 3 in Grasshopper!"
print(a)
"""Grasshopper Script"""
a = "Hello Python 3 in Grasshopper!"
__author__ = "panz"
__version__ = "2024.11.11"

import rhinoscriptsyntax as rs
import json
import Rhino.Geometry as rg

# Read and parse JSON data from the file
with open(file, 'r') as inputfile:
    data = json.load(inputfile)

# Extract panels (walls) data
panels_data = data.get("panels", {}).get("items", {})
if not panels_data:
    print("Warning: 'panels.items' key is missing or empty in JSON.")
    
# Extract apartment outlines from 'spaces'
spaces_data = data.get("spaces", {})
roomOutlines = []
roomPolylines = []
apartmentNames = []
roomTypes = []
roomColors = []
roomSurfaces = []
possibleBoundingRect = []

for space_id, space in spaces_data.items():
    coordinates = space.get("coordinates")
    roomTypes.append(space.get("room_type"))
    apartmentNames.append(space.get("apartment"))
    outline_points = [[point["x"], point["y"], point["z"]] for point in coordinates]
    roomOutlines.append(outline_points)
print("There are", len(roomOutlines), "rooms in the JSON file")


roomCounter = 0 
#TO DO CALCULATE AREA OF APARMENT AND EXCLUDE CRVS THAT ARE LARGER THAN THAT
#TO DO ADD a dictionary where you mape roomTypes to Specific Colors that you get as input
#TO DO FIX COLORs to ve nicer 
for index in range(len(spaces_data)):
    roomOutline = roomOutlines[index] 
    polyline_points = [rg.Point3d(point[0], point[1], point[2]) for point in roomOutline]
    polyline = rg.Polyline(polyline_points)

    # Assign colors and store rooms for bounding box calculation
    
    roomType = roomTypes[index]
    if roomType == "living_room":
        roomColors.append('255,100,0')
    elif roomType == "bedroom":
        roomColors.append('153,137,255')
    elif roomType in ["kitchen", "corridor", "bathroom"]:  # Selected room types
        print("Processing", roomType)
        roomColors.append({'kitchen': '0,0,220', 'corridor': '0,150,200', 'bathroom': '151,255,255'}[roomType])
        possibleBoundingRect.append(polyline)
    elif roomType == "core":
        roomColors.append('150,150,150')

    # Create a surface from the polyline
    roomSrfs = rg.Brep.CreatePlanarBreps(polyline.ToNurbsCurve())
    roomSurfaces.append(roomSrfs[0])

    # Ensure the polyline is closed
    if not polyline.IsClosed:
        polyline.Add(polyline[0])
        
    roomPolylines.append(polyline)
    roomCounter += 1 

print("Created", roomCounter, "space polylines")

# ==========================
# BOUNDING RECTANGLE LOGIC
# ==========================

def get_bounding_rectangle(polylines):
    """Finds the bounding box for a list of polylines."""
    all_points = []
    
    for polyline in polylines:
        all_points.extend(list(polyline)) 

    if not all_points:
        return None  # Avoid errors if list is empty

    # Find min/max X and Y
    min_x, max_x = min(pt.X for pt in all_points), max(pt.X for pt in all_points)
    min_y, max_y = min(pt.Y for pt in all_points), max(pt.Y for pt in all_points)

    # Define the rectangle corners
    corners = [
        rg.Point3d(min_x, min_y, 0),
        rg.Point3d(max_x, min_y, 0),
        rg.Point3d(max_x, max_y, 0),
        rg.Point3d(min_x, max_y, 0),
        rg.Point3d(min_x, min_y, 0)  # Closing the rectangle
    ]

    return rg.Polyline(corners)

possible_bounding_rects = []

# Compute bounding box for all selected rooms
bounding_rect = get_bounding_rectangle(possibleBoundingRect)
print("Bounding rectangle for all rooms:", bounding_rect)
possible_bounding_rects.append(bounding_rect)


# Compute bounding boxes for pairs of rooms
for i in range(len(possibleBoundingRect)):
    for j in range(i + 1, len(possibleBoundingRect)):
        pair_rect = get_bounding_rectangle([possibleBoundingRect[i], possibleBoundingRect[j]])
        if pair_rect:
            possible_bounding_rects.append(pair_rect)
possibleBoundingRect = possible_bounding_rects
print("Generated", len(possible_bounding_rects), "bounding rectangles for room pairs.")
# ---------- end python_3_script_2 ----------

# ----
# TO DO add openings classification
# entrance door
# interior doors
# window
# passage-corridor
item = ListItem(List=python.StartPoint, Index=0, Wrap=True)  # -> Item, Item1, Item2
item_2 = ListItem(List=python.EndPoint, Index=0, Wrap=True)  # -> Item, Item1, Item2
Z = UnitZ(Factor=python.Height)
pt = ConstructPoint(XCoordinate=item_2.Item, YCoordinate=item_2.Item1, ZCoordinate=item_2.Item2)
pt_2 = ConstructPoint(XCoordinate=item.Item, YCoordinate=item.Item1, ZCoordinate=item.Item2)
division = Division(A=python.Thickness, B=2)
ln = Line(StartPoint=pt_2, EndPoint=pt)
offcrv = OffsetCurve(Curve=ln, Plane=PlaneXY(0, 0, 0), Distance=graft(division), BothSides=True, Kinks=0, CapType=1)

point = Point(Point(27478.25969, 13.60035537, 0))
# POINTS TO MOVE TO
point_2 = Point(Point(-12791.16896, 11.99833375, 0))

# ---- group: AREA
area_threshold_sqm = Slider(29, range=0..100)
max_length_threshold = Panel("14.00")
max_width_threshold = Panel("3.40")

# ----
show_room_labels = BooleanToggle(True)
room_label_size = Slider(191, range=0..250)
room_label_color = ColourSwatch(SwatchColor=RGB(87, 87, 87))
room_label_height = Slider(1530, range=0..1530)
show_whole_floor = BooleanToggle(True)
show_floorplan = BooleanToggle(True)

apt_label_color = ColourSwatch(SwatchColor=RGB(0, 0, 0))
apt_outline = ColourSwatch(SwatchColor=RGB(0, 0, 0))
apt_outline_thickness = Slider(7, range=0..10)

# ---- group: 3d module
# 3d_module json
path_13 = FilePath("C:\Users\panz\Documents\GitHub\IBC\05_Flooplan_processing\jsonExports\3dmodules_json\3d_module_BigAptA.json")

# ----
level_outline = ColourSwatch(SwatchColor=RGB(235, 0, 0))

python_3 = GhPythonScript(file=path_13)  # -> out, apartmentNames, roomTypes, roomPolylines, roomSurfaces, roomColors
# ---------- python_3: Python ----------
__author__ = "panz"
__version__ = "2024.11.11"

import rhinoscriptsyntax as rs
import json
import json
import Rhino.Geometry as rg

# Read and parse JSON data from the file
with open(file, 'r') as inputfile:
    data = json.load(inputfile)

# Extract panels (walls) data
panels_data = data.get("panels", {}).get("items", {})
if not panels_data:
    print("Warning: 'panels.items' key is missing or empty in JSON.")
    
# Extract apartment outlines from 'spaces'
spaces_data = data.get("rooms", {})
roomOutlines = []
roomPolylines =[]
apartmentNames = []
roomTypes = []
roomColors = []
roomSurfaces = []

for space_id, space in spaces_data.items():
    coordinates = space.get("coordinates")
    roomTypes.append(space.get("room_type"))
    apartmentNames.append(space.get("apartment"))
    outline_points = [[point["x"], point["y"], point["z"]] for point in coordinates]
    roomOutlines.append(outline_points)
print (len(roomOutlines))


roomCounter = 0 
for index in range (0, len(spaces_data)):
    roomOutline = roomOutlines[index] 
    
    # Convert the point lists into Rhino Point3d objects
    polyline_points = [rg.Point3d(point[0], point[1], point[2]) for point in roomOutline]
    # Create the polyline using the list of Point3d objects
    polyline = rg.Polyline(polyline_points)
    
    
    #assign colors based on roomput
    if (roomTypes[index] == "living_room"):
        roomColors.append('255,100,0')
    elif (roomTypes[index] == "bedroom"):
        roomColors.append('153,137,255')
    elif (roomTypes[index] == "kitchen"):
        roomColors.append('0,0,220')
    elif (roomTypes[index] == "bathroom"):
        roomColors.append('151,255,255')
    elif (roomTypes[index] == "core"):
        roomColors.append('150,150,150')
        
    # create a surface
    roomSrfs = rg.Brep.CreatePlanarBreps(polyline.ToNurbsCurve())
    roomSurfaces.append(roomSrfs[0])
    # Ensure the polyline is closed if necessary (optional)
    if not polyline.IsClosed:
        polyline.Add(polyline[0])  # Add the first point to close the polyline
    # Output the polyline (e.g., to Grasshopper)
    roomPolylines.append(polyline)
    roomCounter +=1 
    print ("created", roomCounter, "space polylines")
    print(roomSurfaces)
# ---------- end python_3 ----------
crv = Curve(python_3.roomPolylines)
brep = Brep(python_3.roomSurfaces)

panel_9 = Panel(path_13)
panel_10 = Panel(python_3.apartmentNames)
panel_11 = Panel(python_3.roomTypes)
bounding_rectangle_2 = BoundingRectangle(Geometry=crv, Plane=PlaneXY(0, 0, 0), Axis=0, Slide=0, Union=True)  # -> Bounding, DimensionX, DimensionY

i_want_to_convert_to = ValueList({"1 - Microns (1.0e-6 meters)": 1, "2 - Millimeters (1.0e-3 meters)": 2, "3 - Centimeters (1.0e-2 meters)": 3, "4 - Meters": 4, "5 - Kilometers (1.0e+3 meters)": 5, "6 - Microinches (2.54e-8 meters, 1.0e-6 inches)": 6, "7 - Mils (2.54e-5 meters, 0.001 inches)": 7, "8 - Inches (0.0254 meters)": 8, "9 - Feet (0.3408 meters, 12 inches)": 9, "10 - Miles (1609.344 meters, 5280 feet)": 10}, selected="4 - Meters")
my_model_is_in = ValueList({"1 - Microns (1.0e-6 meters)": 1, "2 - Millimeters (1.0e-3 meters)": 2, "3 - Centimeters (1.0e-2 meters)": 3, "4 - Meters": 4, "5 - Kilometers (1.0e+3 meters)": 5, "6 - Microinches (2.54e-8 meters, 1.0e-6 inches)": 6, "7 - Mils (2.54e-5 meters, 0.001 inches)": 7, "8 - Inches (0.0254 meters)": 8, "9 - Feet (0.3408 meters, 12 inches)": 9, "10 - Miles (1609.344 meters, 5280 feet)": 10}, selected="2 - Millimeters (1.0e-3 meters)")
what_are_the_untis = ValueList({"Distance": 1, "Area": 2, "Volume": 3}, selected="Area")

# ---- group: Remove bounding rectangles that completely not working
i_want_to_convert_to_2 = ValueList({"1 - Microns (1.0e-6 meters)": 1, "2 - Millimeters (1.0e-3 meters)": 2, "3 - Centimeters (1.0e-2 meters)": 3, "4 - Meters": 4, "5 - Kilometers (1.0e+3 meters)": 5, "6 - Microinches (2.54e-8 meters, 1.0e-6 inches)": 6, "7 - Mils (2.54e-5 meters, 0.001 inches)": 7, "8 - Inches (0.0254 meters)": 8, "9 - Feet (0.3408 meters, 12 inches)": 9, "10 - Miles (1609.344 meters, 5280 feet)": 10}, selected="2 - Millimeters (1.0e-3 meters)")
my_model_is_in_2 = ValueList({"1 - Microns (1.0e-6 meters)": 1, "2 - Millimeters (1.0e-3 meters)": 2, "3 - Centimeters (1.0e-2 meters)": 3, "4 - Meters": 4, "5 - Kilometers (1.0e+3 meters)": 5, "6 - Microinches (2.54e-8 meters, 1.0e-6 inches)": 6, "7 - Mils (2.54e-5 meters, 0.001 inches)": 7, "8 - Inches (0.0254 meters)": 8, "9 - Feet (0.3408 meters, 12 inches)": 9, "10 - Miles (1609.344 meters, 5280 feet)": 10}, selected="4 - Meters")
what_are_the_untis_2 = ValueList({"Distance": 1, "Area": 2, "Volume": 3}, selected="Area")

# ---- group: visualize
geometry = ValueList({"Show bounding box": 0, "show detailed geometry": 1}, selected="Show bounding box")
_3d_module_on_design = BooleanToggle(True)

# ----
# TO DO-LOAD GEOMETRIES FROM Speckle
# load all available objects in a list
# and select the one which matchen the Typename
panel_12 = Panel("https://speckle.xyz/projects/48b3051cfd/models/d8ac8f1b88")

_3d_module_on_design_2 = BooleanToggle(False)

panel_13 = Panel(filter_4)
panel_14 = Panel(list_item_2)
concatenate = Concatenate(Fragment_A="Comparing:", Fragment_B=panel_13, A=" with ", B=panel_14)

integer = Integer()

# ----
# GET  spaces, and Generate
# bounding rectangles for candidate
python_3_script_3 = Python3Script(file=path_12, roomTypeKeys=panel_3, roomColorValues=merge)  # -> out, apartmentNames, roomTypes, roomPolylines, roomSurfaces, roomColors, possibleBoundingRect; inputs roomTypeKeys: list, roomColorValues: list
# ---------- python_3_script_3: Python ----------
"""Grasshopper Script"""
import System
__author__ = "panz"
__version__ = "2024.11.11"

import rhinoscriptsyntax as rs
import json
import Rhino.Geometry as rg

# Read and parse JSON data from the file
with open(file, 'r') as inputfile:
    data = json.load(inputfile)

# Extract panels (walls) data
panels_data = data.get("panels", {}).get("items", {})
if not panels_data:
    print("Warning: 'panels.items' key is missing or empty in JSON.")
    
# Extract apartment outlines from 'spaces'
spaces_data = data.get("spaces", {})
roomOutlines = []
roomPolylines = []
apartmentNames = []
roomTypes = []
roomColors = []
roomSurfaces = []
possibleBoundingRect = []

for space_id, space in spaces_data.items():
    coordinates = space.get("coordinates")
    roomTypes.append(space.get("room_type"))
    apartmentNames.append(space.get("apartment"))
    outline_points = [[point["x"], point["y"], point["z"]] for point in coordinates]
    roomOutlines.append(outline_points)

print("There are", len(roomOutlines), "rooms in the JSON file")

roomCounter = 0 
#TO DO CALCULATE AREA OF APARMENT AND EXCLUDE CRVS THAT ARE LARGER THAN THAT
#TO DO ADD a dictionary where you mape roomTypes to Specific Colors that you get as input

# Selected room types
selectedRoomTypes = ["kitchen", "corridor", "bathroom"]

#create a dictionary with room type keys nad color value
room_color_map = dict(zip(roomTypeKeys, roomColorValues))


print("looking to create bounding rect for", selectedRoomTypes)
for index in range(len(spaces_data)):
    roomOutline = roomOutlines[index] 
    polyline_points = [rg.Point3d(point[0], point[1], point[2]) for point in roomOutline]
    polyline = rg.Polyline(polyline_points)

    # Assign colors and store rooms for bounding box calculation
    
    # Assign color using the dictionary, default to gray if missing
    roomType = roomTypes[index]
    roomColor = room_color_map.get(roomType, System.Drawing.Color.Gray)
    roomColors.append(roomColor)
    
    if roomType in selectedRoomTypes:  # Selected room types
        possibleBoundingRect.append(polyline)

    # Create a surface from the polyline
    roomSrfs = rg.Brep.CreatePlanarBreps(polyline.ToNurbsCurve())
    roomSurfaces.append(roomSrfs[0])

    # Ensure the polyline is closed
    if not polyline.IsClosed:
        polyline.Add(polyline[0])
        
    roomPolylines.append(polyline)
    roomCounter += 1 

print("Created", roomCounter, "space outlines")

# ==========================
# BOUNDING RECTANGLE LOGIC
# ==========================

def get_bounding_rectangle(polylines):
    """Finds the bounding box for a list of polylines."""
    all_points = []
    
    for polyline in polylines:
        all_points.extend(list(polyline)) 

    if not all_points:
        return None  # Avoid errors if list is empty

    # Find min/max X and Y
    min_x, max_x = min(pt.X for pt in all_points), max(pt.X for pt in all_points)
    min_y, max_y = min(pt.Y for pt in all_points), max(pt.Y for pt in all_points)

    # Define the rectangle corners
    corners = [
        rg.Point3d(min_x, min_y, 0),
        rg.Point3d(max_x, min_y, 0),
        rg.Point3d(max_x, max_y, 0),
        rg.Point3d(min_x, max_y, 0),
        rg.Point3d(min_x, min_y, 0)  # Closing the rectangle
    ]

    return rg.Polyline(corners)

possible_bounding_rects = []

# Compute bounding box for all selected rooms
bounding_rect = get_bounding_rectangle(possibleBoundingRect)
possible_bounding_rects.append(bounding_rect)


# Compute bounding boxes for pairs of rooms
for i in range(len(possibleBoundingRect)):
    for j in range(i + 1, len(possibleBoundingRect)):
        pair_rect = get_bounding_rectangle([possibleBoundingRect[i], possibleBoundingRect[j]])
        if pair_rect:
            possible_bounding_rects.append(pair_rect)
possibleBoundingRect = possible_bounding_rects
print("Generated", len(possible_bounding_rects), "bounding rectangles for room pairs:", selectedRoomTypes)
# ---------- end python_3_script_3 ----------
bounding_rectangle_3 = BoundingRectangle(Geometry=python_3_script_3.roomPolylines, Plane=PlaneXY(0, 0, 0), Axis=0, Slide=0, Union=True)  # -> Bounding, DimensionX, DimensionY
panel_15 = Panel(python_3_script_3.out)
area_2 = Area(Geometry=bounding_rectangle_3.Bounding)  # -> Area, Centroid

panel_16 = Panel(python_3_script_3.roomTypes)  # disabled
area_3 = Area(Geometry=python_3_script_3.roomPolylines)  # -> Area, Centroid; disabled
custom_preview = CustomPreview(Geometry=python_3_script_3.roomSurfaces, Material=python_3_script_3.roomColors)  # disabled
tag = TextTag(Location=area_3.Centroid, Text=panel_16)  # disabled

replace_nulls_2 = ReplaceNulls(Items=python_3_script_3.apartmentNames, Replacements="Core")  # -> Items, Count

panel_17 = Panel(replace_nulls_2.Items)

# ---- group: Move and scale Candi
scaling_factor = Panel("1000")
scale = Scale(Geometry=python_3_script_3.roomSurfaces, Center=area_2.Centroid, Factor=scaling_factor)  # -> Geometry, Transform
scale_2 = Scale(Geometry=python_3_script_3.roomPolylines, Center=area_2.Centroid, Factor=scaling_factor)  # -> Geometry, Transform
scale_3 = Scale(Geometry=python_3_script_3.possibleBoundingRect, Center=area_2.Centroid, Factor=scaling_factor)  # -> Geometry, Transform
move_to_point = MoveToPoint(Geometry=scale.Geometry, PointA=area_2.Centroid, PointB=point_2)  # -> Moved, Vector, Transform
move_to_point_2 = MoveToPoint(Geometry=scale_2.Geometry, PointA=area_2.Centroid, PointB=point_2)  # -> Moved, Vector, Transform
move_to_point_3 = MoveToPoint(Geometry=scale_3.Geometry, PointA=area_2.Centroid, PointB=point_2)  # -> Moved, Vector, Transform

# ----
scale_4 = Scale(Geometry=python_3_script.possibleBoundingRect, Center=area.Centroid, Factor=scaling_factor)  # -> Geometry, Transform
scale_5 = Scale(Geometry=python_3_script.roomPolylines, Center=area.Centroid, Factor=scaling_factor)  # -> Geometry, Transform
scale_6 = Scale(Geometry=python_3_script.roomSurfaces, Center=area.Centroid, Factor=scaling_factor)  # -> Geometry, Transform
move_to_point_4 = MoveToPoint(Geometry=scale_6.Geometry, PointA=area.Centroid, PointB=point)  # -> Moved, Vector, Transform
move_to_point_5 = MoveToPoint(Geometry=scale_5.Geometry, PointA=area.Centroid, PointB=point)  # -> Moved, Vector, Transform
move_to_point_6 = MoveToPoint(Geometry=scale_4.Geometry, PointA=area.Centroid, PointB=point)  # -> Moved, Vector, Transform

# ---- group: seleect curves for one apt
match_text = MatchText(Text=panel_8, Pattern=select_reference_apt, Case=True)
cull_pattern = CullPattern(List=move_to_point_4.Moved, CullPattern=match_text)
region_union = RegionUnion(Curves=cull_pattern)
boundary_surfaces = BoundarySurfaces(Edges=region_union)
curve = Curve(cull_pattern)
gate = StreamGate(Stream=region_union, Gate=show_floorplan)  # -> Target0, Target1
custom_preview_lineweights = CustomPreviewLineweights(Geometry=gate.Target1, Shader=apt_outline, Thickness=apt_outline_thickness, Absolute=False)

# ---- group: visualize whole floorplan
# SHOW floorplan
region_union_2 = RegionUnion(Curves=move_to_point_4.Moved)
bounding_rectangle_4 = BoundingRectangle(Geometry=region_union_2, Plane=PlaneXY(0, 0, 0), Axis=0, Slide=0, Union=True)  # -> Bounding, DimensionX, DimensionY
thickness = Slider(7, range=0..10)
offset_curve = OffsetCurve(Curve=bounding_rectangle_4.Bounding, Distance=1, Corners=1)
gate_2 = StreamGate(Stream=offset_curve, Gate=show_whole_floor)  # -> Target0, Target1
custom_preview_lineweights_2 = CustomPreviewLineweights(Geometry=gate_2.Target1, Shader=level_outline, Thickness=thickness, Absolute=False)

# ----
match_text_2 = MatchText(Text=panel_17, Pattern=select_reference_apt_2, Case=True)

# ----
# organize curves and surfaces  by apartment
crv_2 = Curve(move_to_point_2.Moved)
brep_2 = Brep(move_to_point.Moved)
cull_pattern_2 = CullPattern(List=crv_2, CullPattern=match_text_2)
cull_pattern_3 = CullPattern(List=brep_2, CullPattern=match_text_2)
cull_pattern_4 = CullPattern(List=python_3_script_3.roomTypes, CullPattern=match_text_2)
preview = CustomPreview(Geometry=cull_pattern_3, Material=python_3_script_3.roomColors)

# ---- group: seleect curves for one apt
region_union_3 = RegionUnion(Curves=cull_pattern_2)
boundary_surfaces_2 = BoundarySurfaces(Edges=region_union_3)
gate_3 = StreamGate(Stream=region_union_3, Gate=show_floorplan)  # -> Target0, Target1
custom_preview_lineweights_3 = CustomPreviewLineweights(Geometry=gate_3.Target1, Shader=apt_outline, Thickness=apt_outline_thickness, Absolute=False)

# ---- group: Remove bounding rectangles that completely not working
crv_3 = Curve(move_to_point_3.Moved)
i_want_to_convert_to_3 = ValueList({"1 - Microns (1.0e-6 meters)": 1, "2 - Millimeters (1.0e-3 meters)": 2, "3 - Centimeters (1.0e-2 meters)": 3, "4 - Meters": 4, "5 - Kilometers (1.0e+3 meters)": 5, "6 - Microinches (2.54e-8 meters, 1.0e-6 inches)": 6, "7 - Mils (2.54e-5 meters, 0.001 inches)": 7, "8 - Inches (0.0254 meters)": 8, "9 - Feet (0.3408 meters, 12 inches)": 9, "10 - Miles (1609.344 meters, 5280 feet)": 10}, selected="4 - Meters")
my_model_is_in_3 = ValueList({"1 - Microns (1.0e-6 meters)": 1, "2 - Millimeters (1.0e-3 meters)": 2, "3 - Centimeters (1.0e-2 meters)": 3, "4 - Meters": 4, "5 - Kilometers (1.0e+3 meters)": 5, "6 - Microinches (2.54e-8 meters, 1.0e-6 inches)": 6, "7 - Mils (2.54e-5 meters, 0.001 inches)": 7, "8 - Inches (0.0254 meters)": 8, "9 - Feet (0.3408 meters, 12 inches)": 9, "10 - Miles (1609.344 meters, 5280 feet)": 10}, selected="2 - Millimeters (1.0e-3 meters)")
explode = Explode(Curve=crv_3, Recursive=True)  # -> Segments, Vertices
bounds = Bounds(Numbers=explode.Segments)
what_are_the_untis_3 = ValueList({"Distance": 1, "Area": 2, "Volume": 3}, selected="Distance")
deconstruct_domain = DeconstructDomain(Domain=bounds)  # -> Start, End
integer_2 = Integer(area_threshold_sqm)
area_4 = Area(Geometry=crv_3)  # -> Area, Centroid
sysunits = GhPythonScript(N=deconstruct_domain.Start, unitsFrom=my_model_is_in_3, unitsTo=i_want_to_convert_to_3, mag=what_are_the_untis_3)  # -> message, R
# ---------- sysunits: Python ----------
__author__ = "michael.lee"
__version__ = "2019.05.29"

import rhinoscriptsyntax as rs
intModelUnits = rs.UnitSystem()

if (intModelUnits == 0):
    message = "No unit system is assigned"
elif (intModelUnits == 1 ):
    message = "Your model is in Microns (1.0e-6 meters)"
elif (intModelUnits == 2 ):
    message = "Your model is in Millimeters (1.0e-3 meters)"
elif (intModelUnits == 3 ):
    message ="Your model is in Centimeters (1.0e-2 meters)"
elif (intModelUnits == 4 ):
    message = "Your model is in Meters"
elif (intModelUnits == 5 ):
    message = "Your model is in Kilometers (1.0e+3 meters)"
elif (intModelUnits == 6 ):
    message = "Your model is in Microinches (2.54e-8 meters, 1.0e-6 inches)"
elif (intModelUnits == 7 ):
    message = "Yourmodel is in Mils (2.54e-5 meters, 0.001 inches)"
elif (intModelUnits == 8 ):
    message = "Your model is in Inches (0.0254 meters)"
elif (intModelUnits == 9 ):
    message = "Your model is in Feet (0.3408 meters, 12 inches)"
elif (intModelUnits == 10 ):
    message = "Your model is in Miles (1609.344 meters, 5280 feet)"
else:
    message = "please check your inputs"



if (intModelUnits != unitsFrom ):
    message = "Caution! your model units are different from what you indicate, if this is in purpose you are good"
else:
    message = message + ". Converting units!"
    print(message)
    
if (N):
    R = N*pow(rs.UnitScale(unitsTo,unitsFrom),mag)

else:
    R = None
# ---------- end sysunits ----------
sysunits_2 = GhPythonScript(N=integer_2, unitsFrom=my_model_is_in_2, unitsTo=i_want_to_convert_to_2, mag=what_are_the_untis_2)  # -> message, R; same code as sysunits
sysunits_3 = GhPythonScript(N=deconstruct_domain.End, unitsFrom=my_model_is_in_3, unitsTo=i_want_to_convert_to_3, mag=what_are_the_untis_3)  # -> message, R; same code as sysunits
smaller_than = SmallerThan(FirstNumber=sysunits.R, SecondNumber=max_width_threshold)  # -> SmallerThan, OrEqualTo
smaller_than_2 = SmallerThan(FirstNumber=sysunits_3.R, SecondNumber=max_length_threshold)  # -> SmallerThan, OrEqualTo
smaller_than_3 = SmallerThan(FirstNumber=area_4.Area, SecondNumber=sysunits_2.R)  # -> SmallerThan, OrEqualTo
gate_or = GateOr(A=smaller_than.SmallerThan, B=smaller_than_2.SmallerThan)  # -> flatten(Result)
gate_and = GateAnd(A=smaller_than_3.SmallerThan, B=gate_or)
cull_pattern_5 = CullPattern(List=crv_3, CullPattern=gate_and)

# ----
number_slider = Slider(4, range=0..5)  # disabled
series_2 = Series(Start=0, Step=1, Count=number_slider)  # disabled
item_3 = ListItem(List=cull_pattern_2, Index=series_2, Wrap=True)  # disabled
brec = BoundingRectangle(Geometry=item_3, Plane=PlaneXY(0, 0, 0), Axis=0, Slide=0, Union=True)  # -> Bounding, DimensionX, DimensionY; disabled
boundary = BoundarySurfaces(Edges=brec.Bounding)  # disabled
pull = PullCurve(Curve=item_3, Surface=boundary)  # disabled

area_5 = Area(Geometry=bounding_rectangle_2.Bounding)  # -> Area, Centroid
scale_7 = Scale(Geometry=bounding_rectangle_2.Bounding, Center=area_5.Centroid, Factor=scaling_factor)  # -> Geometry, Transform

# ---- group: viz_bounding_Rect_of_3d_module
panel_18 = Panel(python_3_script.roomTypes)
panel_19 = Panel("""bathroom
corridor
kitchen""")
cull_pattern_6 = CullPattern(List=panel_18, CullPattern=match_text)
curve_2 = Curve(curve)
match_text_3 = MatchText(Text=cull_pattern_6, Pattern=graft(panel_19), Case=True)
cull_pattern_7 = CullPattern(List=curve_2, CullPattern=match_text_3)
thickness_2 = Slider(10, range=0..10)
region_union_4 = RegionUnion(Curves=flatten(cull_pattern_7))
custom_preview_lineweights_4 = CustomPreviewLineweights(Geometry=region_union_4, Shader=ColourSwatch(SwatchColor=RGB(255, 0, 0)), Thickness=thickness_2, Absolute=False)

# ---- group: Viz_Tags-candidateDesign
area_6 = Area(Geometry=cull_pattern_2)  # -> Area, Centroid
sysunits_4 = GhPythonScript(N=area_6.Area, unitsFrom=my_model_is_in, unitsTo=i_want_to_convert_to, mag=what_are_the_untis)  # -> message, R; same code as sysunits
expression = Expression(x=sysunits_4.R, Expression="Format(\"{0:0.00}\",x)")
Z_2 = UnitZ(Factor=room_label_height)
move = Move(Geometry=area_6.Centroid, Motion=Z_2)  # -> Geometry, Transform
concat_2 = Concatenate(FragmentA=cull_pattern_4, FragmentC=":", FragmentB=expression, FragmentD=" m2")
ln_2 = Line(StartPoint=area_6.Centroid, EndPoint=move.Geometry)
gate_4 = StreamGate(Stream=ln_2, Gate=show_room_labels)  # -> Target0, Target1
gate_5 = StreamGate(Stream=move.Geometry, Gate=show_room_labels)  # -> Target0, Target1
tag_2 = TextTag3D(Location=gate_5.Target1, Text=flatten(concat_2), Size=room_label_size, Colour=room_label_color, Justification=5)
preview_2 = CustomPreview(Geometry=gate_4.Target1, Material=room_label_color)

# ---- group: viz_core_candidate
match_text_4 = MatchText(Text=panel_17, Pattern="Core", Case=True)
cull_pattern_8 = CullPattern(List=move_to_point.Moved, CullPattern=match_text_4)
cull_pattern_9 = CullPattern(List=panel_17, CullPattern=match_text_4)
curve_3 = Curve(cull_pattern_8)
polygon_center = PolygonCenter(Polyline=curve_3)  # -> CenterV, CenterE, CenterA
boundary_surfaces_3 = BoundarySurfaces(Edges=curve_3)
room_labler_color = ColourSwatch(SwatchColor=RGB(82, 82, 82))
move_2 = Move(Geometry=polygon_center.CenterV, Motion=Z_2)  # -> Geometry, Transform
ln_3 = Line(StartPoint=polygon_center.CenterV, EndPoint=move_2.Geometry)
tag_3 = TextTag3D(Location=move_2.Geometry, Text=flatten(cull_pattern_9), Size=room_label_size, Colour=room_label_color, Justification=5)
preview_3 = CustomPreview(Geometry=[boundary_surfaces_3, ln_3], Material=room_labler_color)

# ---- group: viz_core_reference
match_text_5 = MatchText(Text=panel_8, Pattern="Core", Case=True)
cull_pattern_10 = CullPattern(List=move_to_point_4.Moved, CullPattern=match_text_5)
cull_pattern_11 = CullPattern(List=panel_8, CullPattern=match_text_5)
curve_4 = Curve(cull_pattern_10)
panel_20 = Panel(cull_pattern_11)
polygon_center_2 = PolygonCenter(Polyline=curve_4)  # -> CenterV, CenterE, CenterA
boundary_surfaces_4 = BoundarySurfaces(Edges=curve_4)
room_labler_color_2 = ColourSwatch(SwatchColor=RGB(82, 82, 82))
move_3 = Move(Geometry=polygon_center_2.CenterV, Motion=Z_2)  # -> Geometry, Transform
ln_4 = Line(StartPoint=polygon_center_2.CenterV, EndPoint=move_3.Geometry)
tag_4 = TextTag3D(Location=move_3.Geometry, Text=flatten(panel_20), Size=room_label_size, Colour=room_label_color, Justification=5)
preview_4 = CustomPreview(Geometry=[boundary_surfaces_4, ln_4], Material=room_labler_color_2)

# ---- group: VIZ_spaces and tags_ReferenceDesign
panel_21 = Panel("2500")
addition = Addition(A=room_label_height, B=panel_21)
panel_22 = Panel(list_item_2)
panel_23 = Panel(select_reference_apt)
panel_24 = Panel(": ")
area_7 = Area(Geometry=boundary_surfaces)  # -> Area, Centroid
Z_3 = UnitZ(Factor=addition)
move_4 = Move(Geometry=area_7.Centroid, Motion=Z_3)  # -> Geometry, Transform
ln_5 = Line(StartPoint=area_7.Centroid, EndPoint=move_4.Geometry)
concat_3 = Concatenate(FragmentA=panel_22, FragmentD=panel_24, FragmentE=panel_23)
gate_6 = StreamGate(Stream=ln_5, Gate=show_room_labels)  # -> Target0, Target1
gate_7 = StreamGate(Stream=move_4.Geometry, Gate=show_room_labels)  # -> Target0, Target1
tag_5 = TextTag3D(Location=gate_7.Target1, Text=flatten(concat_3), Size=room_label_size, Colour=apt_label_color, Justification=5)
preview_5 = CustomPreview(Geometry=gate_6.Target1, Material=room_label_color)

area_8 = Area(Geometry=region_union_3)  # -> Area, Centroid
addition_2 = Addition(A=room_label_height, B=panel_21)
panel_25 = Panel(panel_7)
panel_26 = Panel(select_reference_apt_2)
Z_4 = UnitZ(Factor=addition_2)
move_5 = Move(Geometry=area_8.Centroid, Motion=Z_4)  # -> Geometry, Transform
ln_6 = Line(StartPoint=area_8.Centroid, EndPoint=move_5.Geometry)
concat_4 = Concatenate(FragmentA=panel_25, FragmentD=": ", FragmentE=panel_26)
gate_8 = StreamGate(Stream=ln_6, Gate=show_room_labels)  # -> Target0, Target1
gate_9 = StreamGate(Stream=move_5.Geometry, Gate=show_room_labels)  # -> Target0, Target1
tag_6 = TextTag3D(Location=gate_9.Target1, Text=flatten(concat_4), Size=room_label_size, Colour=apt_label_color, Justification=5)
preview_6 = CustomPreview(Geometry=gate_8.Target1, Material=room_label_color)

# ---- group: Viz_spaces&tags-ReferenceDesign
panel_27 = Panel(python_3_script.roomTypes)
cull_pattern_12 = CullPattern(List=python_3_script.roomColors, CullPattern=match_text)
cull_pattern_13 = CullPattern(List=panel_27, CullPattern=match_text)
cull_pattern_14 = CullPattern(List=move_to_point_4.Moved, CullPattern=match_text)
area_9 = Area(Geometry=cull_pattern_14)  # -> Area, Centroid
sysunits_5 = GhPythonScript(N=area_9.Area, unitsFrom=2, unitsTo=4, mag=2)  # -> message, R; same code as sysunits
brep_3 = Brep(cull_pattern_3)
Z_5 = UnitZ(Factor=room_label_height)
expression_2 = Expression(x=sysunits_5.R, Expression="Format(\"{0:0.00}\",x)")
move_6 = Move(Geometry=area_9.Centroid, Motion=Z_5)  # -> Geometry, Transform
ln_7 = Line(StartPoint=area_9.Centroid, EndPoint=move_6.Geometry)
gate_10 = StreamGate(Stream=ln_7, Gate=show_room_labels)  # -> Target0, Target1
custom_preview_2 = CustomPreview(Geometry=cull_pattern_14, Material=cull_pattern_12)
concat_5 = Concatenate(FragmentA=cull_pattern_6, FragmentC=panel_24, FragmentB=expression_2, FragmentD=" m2")
gate_11 = StreamGate(Stream=move_6.Geometry, Gate=show_room_labels)  # -> Target0, Target1
preview_7 = CustomPreview(Geometry=brep_3, Material=python_3_script_3.roomColors)
tag_7 = TextTag3D(Location=gate_11.Target1, Text=concat_5, Size=room_label_size, Colour=room_label_color, Justification=5)
preview_8 = CustomPreview(Geometry=gate_10.Target1, Material=room_label_color)

# ----
crv_4 = Curve(cull_pattern_5)
merge_2 = Merge(Data1=crv_4)  # -> flatten(Result)
curve_5 = Curve(scale_7.Geometry)

crv_5 = Curve(crv_3)
length = Length(Curve=crv_5)
bounds_2 = Bounds(Numbers=length)
deconstruct_domain_2 = DeconstructDomain(Domain=bounds_2)  # -> Start, End
gradient = Gradient(
    LowerLimit=deconstruct_domain_2.Start,
    UpperLimit=deconstruct_domain_2.End,
    Parameter=length,
    stops=[0: RGB(0, 255, 0), 1: RGB(220, 0, 40)])
previewlw = CustomPreviewLineweights(Geometry=crv_5, Shader=gradient, Thickness=Slider(2.387, range=0..8), Absolute=False)

# ---- group: compare different bounding boxes with the bounding rectangle
# compare and give a similarity score
python_3_script_4 = Python3Script(inputBounding=merge_2, refBounding=curve_5)  # -> out, output_rectangles, output_colors, output_scores; inputs inputBounding: list of Polyline, refBounding: Polyline
# ---------- python_3_script_4: Python ----------
import Rhino.Geometry as rg
import rhinoscriptsyntax as rs
import System.Drawing as sd

def get_dimensions(rect):
    """Extracts width, height, area, perimeter, and aspect ratio from a rectangle."""
    if not rect or len(rect) != 5:  # A valid closed rectangle has 5 points (4 for the rectangle + 1 for closure)
        print(f"Invalid rectangle: Rect has fewer or more than 5 points. Rect points: {rect}")  # Debugging message
        return None

    # Calculate the width and height from the polyline
    width = abs(rect[1].X - rect[0].X)
    height = abs(rect[2].Y - rect[1].Y)
    area = width * height
    perimeter = 2 * (width + height)
    aspect_ratio = width / height if height != 0 else 1  # Avoid division by zero
    
    # Debugging: Print the dimensions
    print(f"Rectangle dimensions - Width: {width}, Height: {height}, Area: {area}, Perimeter: {perimeter}, Aspect Ratio: {aspect_ratio}")
    
    return width, height, area, perimeter, aspect_ratio

def compare_rectangles(rect1, rect2, shape_weight=0.4, length_weight=0.3, area_weight=0.3):
    """
    Compares two rectangles based on shape (aspect ratio), perimeter, and area.
    Returns a similarity score between 0 and 1.
    """
    dims1 = get_dimensions(rect1)
    dims2 = get_dimensions(rect2)

    if not dims1 or not dims2:
        print("Invalid dimensions for comparison.")
        return 0  # Invalid rectangles, return lowest score

    width1, height1, area1, perimeter1, aspect_ratio1 = dims1
    width2, height2, area2, perimeter2, aspect_ratio2 = dims2

    # Shape Similarity (Aspect Ratio Comparison)
    shape_score = 1 - abs(aspect_ratio1 - aspect_ratio2) / max(aspect_ratio1, aspect_ratio2)
    print(f"Shape Score: {shape_score}")  # Debugging: Print shape score

    # Length Similarity (Perimeter Comparison)
    length_score = 1 - abs(perimeter1 - perimeter2) / max(perimeter1, perimeter2)
    print(f"Length Score: {length_score}")  # Debugging: Print length score

    # Area Similarity (Area Comparison)
    area_score = 1 - abs(area1 - area2) / max(area1, area2)
    print(f"Area Score: {area_score}")  # Debugging: Print area score

    # Weighted sum of scores
    final_score = (shape_score * shape_weight) + (length_score * length_weight) + (area_score * area_weight)

    # Debugging: Print final score
    print(f"Final Score: {final_score}")
    
    return round(final_score, 3)  # Round for better readability

def assign_color_based_on_score(score):
    """
    Assigns a color based on the similarity score.
    Returns a System.Drawing.Color object.
    """
    if score >= 0.9:
        return sd.Color.Green  # Very similar
    elif score >= 0.7:
        return sd.Color.Yellow  # Moderately similar
    else:
        return sd.Color.Red  # Not similar

def ensure_polyline_input(input_curve):
    """
    Ensures that the input is a valid Polyline object.
    If it's a Curve, it tries to coerce it into a Polyline object.
    """
    print(f"Ensuring input curve: {input_curve}")  # Debugging message
    # Check if it's already a Polyline
    if isinstance(input_curve, rg.Polyline):
        print(f"Input is already a valid Polyline: {input_curve}")  # Debugging message
        if input_curve.IsClosed:
            print("Polyline is closed.")  # Debugging message
        else:
            print("Polyline is not closed.")  # Debugging message
        return input_curve

    # Coerce the curve to a Polyline (if it's a valid curve)
    coerced_curve = rs.coercecurve(input_curve)
    if coerced_curve:
        if isinstance(coerced_curve, rg.Polyline):
            print(f"Coerced curve to Polyline: {coerced_curve}")  # Debugging message
            if coerced_curve.IsClosed:
                print("Coerced polyline is closed.")  # Debugging message
            else:
                print("Coerced polyline is not closed.")  # Debugging message
            return coerced_curve
        else:
            print("The coerced curve is not a Polyline.")  # Debugging message
    else:
        print("Curve coercion failed.")  # Debugging message
    return None

def main(possible_rects, ref_rect):
    # Ensure inputs are valid polylines by coercing curves
    valid_rects = []
    for rect in possible_rects:
        rect_polyline = ensure_polyline_input(rect)
        if rect_polyline:
            valid_rects.append(rect_polyline)
        else:
            print(f"Skipping invalid rectangle: {rect}")  # Debugging message

    # Ensure reference rectangle is a valid polyline
    ref_polyline = ensure_polyline_input(ref_rect)
    if not ref_polyline:
        print("Invalid reference rectangle.")
        return [], []  # Return empty lists if reference rectangle is invalid

    # Compare all valid rectangles with the reference rectangle
    scores = [compare_rectangles(rect, ref_polyline) for rect in valid_rects]

    # Output similarity scores and color code each rectangle based on its similarity score
    colored_rects = []
    for rect, score in zip(valid_rects, scores):
        # Assign color based on score
        color = assign_color_based_on_score(score)
        colored_rects.append((rect, color))  # Store the rectangle and its color

    # Output the rectangles and their corresponding colors

    output_rects = [rect for rect, color in colored_rects]
    output_colors = [color for rect, color in colored_rects]
    
    # Return both output_rects and output_colors for use in Grasshopper
    return scores, output_rects, output_colors

# The outputs in Grasshopper:
# Make sure you assign the outputs to variables like this:
output_scores, output_rectangles, output_colors = main(inputBounding, refBounding)


# Example call to the main function (replace with actual inputs in Grasshopper)
main(inputBounding, refBounding)
# ---------- end python_3_script_4 ----------
similarity_score = Panel(python_3_script_4.output_scores)
sort_list = SortList(
    Keys=python_3_script_4.output_scores,
    ValuesValuesA=python_3_script_4.output_rectangles,
    ValuesA=python_3_script_4.output_colors)  # -> reverse(Keys), reverse(ValuesValuesA), reverse(ValuesA)
previewlw_2 = CustomPreviewLineweights(
    Geometry=python_3_script_4.output_rectangles,
    Shader=python_3_script_4.output_colors,
    Thickness=Slider(8, range=0..8),
    Absolute=False)

# ---- group: change label color based on a threshold
list_item_3 = ListItem(List=python_3_script_4.output_scores, Index=0, Wrap=True)
similarity_score_2 = Panel(list_item_3)
score_threshold = Panel("0.8")
score_label_color = ColourSwatch(SwatchColor=RGB(46, 46, 46))
score_label_color_2 = ColourSwatch(SwatchColor=RGB(255, 0, 0))
smaller_than_4 = SmallerThan(FirstNumber=similarity_score_2, SecondNumber=score_threshold)  # -> SmallerThan, OrEqualTo
stream_filter = StreamFilter(Gate=smaller_than_4.OrEqualTo, Stream0=score_label_color, Stream1=score_label_color_2)

# ----
_3d_module_height = Panel("3000")
curve_6 = Curve(region_union_4)
unit_z = UnitZ(Factor=_3d_module_height)
extrude = Extrude(Base=curve_6, Direction=unit_z)
cap_holes = CapHoles(Brep=extrude)
preview_9 = CustomPreview(Geometry=cap_holes, Material=ColourSwatch(SwatchColor=RGBA(255, 77, 77, 180)))

number_slider_2 = Slider(1, range=0..10)  # disabled
series_3 = Series(Start=0, Step=1, Count=number_slider_2)  # disabled
item_4 = ListItem(List=cull_pattern_2, Index=series_3, Wrap=True)  # disabled
explode_2 = Explode(Curve=item_4, Recursive=True)  # -> Segments, Vertices; disabled
strainghten_poly_lin = StrainghtenPolyLin(vec=explode_2.Segments, pt=explode_2.Vertices)  # disabled

swatch = ColourSwatch(SwatchColor=RGB(0, 247, 41))  # disabled
number_slider_3 = Slider(8, range=0..8)  # disabled
previewlw_3 = CustomPreviewLineweights(Geometry=strainghten_poly_lin, Shader=swatch, Thickness=number_slider_3, Absolute=False)  # disabled

previewlw_4 = CustomPreviewLineweights(Geometry=item_4, Shader=ColourSwatch(SwatchColor=RGB(247, 0, 0)), Thickness=Slider(8, range=0..8), Absolute=False)

receive = Receive(
    Stream=panel_12,
    AutoReceive=False,
    CurrentComponentState="expired",
    ExpandOutput=True,
    LastInfoMessage="Evan Pantazis @ 11/19/2024 14:40:47: first assembly export (id:2d5ec2171e)",
    ReceiveOnOpen=False,
    ReceivedCommitId="2d5ec2171e",
    StreamWrapper="https://speckle.xyz/projects/48b3051cfd/models/3dmod_21_com",
    selectedKitName="Objects")  # -> Info, Data
list_item_4 = ListItem(List=receive.Data, Index=6, Wrap=True)
list_item_5 = ListItem(List=receive.Data, Index=0, Wrap=True)
deconstruct_speckle_object = DeconstructSpeckleObject(SpeckleObject=list_item_4, selectedKitName="Objects")
bounding_rectangle_5 = BoundingRectangle(Geometry=list_item_5, Plane=PlaneXY(0, 0, 0), Axis=0, Slide=0, Union=True)  # -> Bounding, DimensionX, DimensionY

stream_filter_2 = StreamFilter(Gate=geometry, Stream0=cap_holes, Stream1=receive.Data)
stream_filter_3 = StreamFilter(Gate=geometry, Stream0=curve_6, Stream1=bounding_rectangle_5.Bounding)
stream_gate = StreamGate(Stream=stream_filter_2, Gate=_3d_module_on_design)  # -> Target0, Target1
stream_gate_2 = StreamGate(Stream=stream_filter_3, Gate=_3d_module_on_design)  # -> Target0, Target1

# ---- group: rotate module
area_10 = Area(Geometry=scale_7.Geometry)  # -> Area, Centroid
division_2 = Division(A=bounding_rectangle_2.DimensionX, B=bounding_rectangle_2.DimensionY)
panel_28 = Panel(division_2)

# ---- group: tags
select_no_of_top = Slider(1, range=0..4)
show_score_labels = BooleanToggle(True)
score_label_height = Slider(12547, range=0..13020)
score_label_size = Slider(530, range=0..1300)
series_4 = Series(Start=0, Step=1, Count=select_no_of_top)
list_item_6 = ListItem(List=sort_list.Keys, Index=select_no_of_top, Wrap=True)
similarity_score_3 = Panel(list_item_6)
list_item_7 = ListItem(List=sort_list.ValuesValuesA, Index=series_4, Wrap=True)
concat_6 = Concatenate(FragmentE="3d module fitting score", FragmentC=":", FragmentB=list_item_6)
curve_7 = Curve(list_item_7)
area_11 = Area(Geometry=curve_7)  # -> Area, Centroid
Z_6 = UnitZ(Factor=1)
concat_7 = Concatenate(FragmentE=concatenate, FragmentC=concat_6)

# ----
list_item_8 = ListItem(List=sort_list.ValuesValuesA, Index=select_no_of_top, Wrap=True)
bounding_rectangle_6 = BoundingRectangle(Geometry=list_item_8, Plane=PlaneXY(0, 0, 0), Axis=0, Slide=0, Union=True)  # -> Bounding, DimensionX, DimensionY

# ---- group: rotate module (continued)
division_3 = Division(A=bounding_rectangle_6.DimensionX, B=bounding_rectangle_6.DimensionY)
panel_29 = Panel(division_3)
python_3_script_5 = Python3Script(ratio=division_3)  # -> out, rotationFlag
# ---------- python_3_script_5: Python ----------
"""Grasshopper Script"""
a = "Hello Python 3 in Grasshopper!"
print(a)
if (ratio < 1 and ratio >0.8):
    rotationFlag = 1
elif (ratio > 1 ):
    rotationFlag = 0
elif (ratio > 0.4 and ratio < 0.8 ):
    rotationFlag = 1
else:
    rotationFlag = 0
# ---------- end python_3_script_5 ----------
stream_filter_4 = StreamFilter(Gate=python_3_script_5.rotationFlag, Stream0="90", Stream1="0")
radians = Radians(Degrees=stream_filter_4)
rotate = Rotate(Geometry=scale_7.Geometry, Angle=radians, Plane=area_10.Centroid)  # -> Geometry, Transform

# ----
area_12 = Area(Geometry=stream_gate_2.Target1)  # -> Area, Centroid
rotate_2 = Rotate(Geometry=stream_gate.Target1, Angle=radians, Plane=area_12.Centroid)  # -> Geometry, Transform
move_to_point_7 = MoveToPoint(Geometry=rotate_2.Geometry, PointA=area_12.Centroid, PointB=area_11.Centroid)  # -> Moved, Vector, Transform

# ---- group: visualize bounding box of 3d module
move_to_point_8 = MoveToPoint(Geometry=rotate.Geometry, PointA=area_10.Centroid, PointB=area_11.Centroid)  # -> Moved, Vector, Transform
boundary_surfaces_5 = BoundarySurfaces(Edges=curve_7)
preview_10 = CustomPreview(Geometry=boundary_surfaces_5, Material=python_3_script_3.roomColors)
previewlw_5 = CustomPreviewLineweights(
    Geometry=move_to_point_8.Moved,
    Shader=ColourSwatch(SwatchColor=RGB(0, 247, 41)),
    Thickness=Slider(8, range=0..8),
    Absolute=False)

# ----
unit_y = UnitY(Factor=score_label_height)
reverse = Reverse(Vector=unit_y)

# ---- group: tags (continued)
move_7 = Move(Geometry=area_11.Centroid, Motion=reverse)  # -> Geometry, Transform
ln_8 = Line(StartPoint=area_11.Centroid, EndPoint=move_7.Geometry)
gate_12 = StreamGate(Stream=ln_8, Gate=show_score_labels)  # -> Target0, Target1
gate_13 = StreamGate(Stream=move_7.Geometry, Gate=show_score_labels)  # -> Target0, Target1
tag_8 = TextTag3D(Location=gate_13.Target1, Text=flatten(concat_7), Size=score_label_size, Colour=stream_filter, Justification=5)
preview_11 = CustomPreview(Geometry=gate_12.Target1, Material=stream_filter)

# ==== cluster StrainghtenPolyLin
vec = ClusterInput()
pt = ClusterInput()
vec_2 = Vector(vec)
pt_2 = Point(pt)
pt_3 = Point(pt)
devec = DeconstructVector(Vector=vec_2)  # -> XComponent, YComponent, ZComponent
lng = ListLength(List=pt_2)
round = Round(Number=devec.XComponent)  # -> Nearest, Floor, Ceiling
round_2 = Round(Number=devec.YComponent)  # -> Nearest, Floor, Ceiling
round_3 = Round(Number=devec.ZComponent)  # -> Nearest, Floor, Ceiling
culln = CullNth(List=pt_3, CullFrequency=lng)
vec_3 = VectorXYZ(XComponent=round.Nearest, YComponent=round_2.Nearest, ZComponent=round_3.Nearest)  # -> Vector, Length
number_slider = Slider(66, range=1..100)
line = LineSDL(Start=culln, Direction=vec_3.Vector, Length="1")
ext = ExtendCurve(Curve=line, Type=0, Start=number_slider, End=number_slider)
ccx = CurveCurve(CurveA=ext, CurveB=graft(ext))  # -> Points, ParamsA, ParamsB
cp = ClosestPoint(Point=pt_3, Cloud=flatten(ccx.Points))  # -> ClosestPoint, CPIndex, Distance
pline = PolyLine(Vertices=cp.ClosestPoint, Closed=False)
pl = ClusterOutput(pline)
